# Dynamo graph Area-天花板產生範圍線.dyn (Dynamo 3.6.2.11575)

views = Views("1FL天花板平面圖")  # graph input
python_script = Python(IN[0]=views)  # CPython3
# ---------- python_script.python (107 lines) ----------
import clr
import sys

# 載入 Revit API
clr.AddReference('RevitAPI')
from Autodesk.Revit.DB import *

# 載入 Revit 節點與事務處理
clr.AddReference('RevitServices')
import RevitServices
from RevitServices.Persistence import DocumentManager
from RevitServices.Transactions import TransactionManager

doc = DocumentManager.Instance.CurrentDBDocument

# 接收 Dynamo 輸入
source_view = UnwrapElement(IN[0]) # 天花板平面圖
target_view = doc.ActiveView       # 當前作用中的視圖

def flatten_curve(curve, z_val):
    """將曲線精準投影(壓平)到目標視圖的 Z 高度"""
    try:
        if isinstance(curve, Line):
            p1 = curve.GetEndPoint(0)
            p2 = curve.GetEndPoint(1)
            return Line.CreateBound(XYZ(p1.X, p1.Y, z_val), XYZ(p2.X, p2.Y, z_val))
        elif isinstance(curve, Arc):
            p1 = curve.GetEndPoint(0)
            p2 = curve.GetEndPoint(1)
            pm = curve.Evaluate(0.5, True)
            return Arc.Create(XYZ(p1.X, p1.Y, z_val), XYZ(p2.X, p2.Y, z_val), XYZ(pm.X, pm.Y, z_val))
        else:
            start_z = curve.GetEndPoint(0).Z
            translation = Transform.CreateTranslation(XYZ(0, 0, z_val - start_z))
            return curve.CreateTransformed(translation)
    except:
        return None

# 確保當前視圖是平面視圖 (包含一般平面圖與面積平面圖)
if not isinstance(source_view, View) or not isinstance(target_view, ViewPlan):
    OUT = "錯誤：IN[0] 必須是視圖，且您目前 Revit 的作用中視圖必須是平面圖或面積平面圖。"
else:
    # 取得目標視圖的基準高度
    if target_view.GenLevel:
        target_z = target_view.GenLevel.Elevation
    else:
        target_z = target_view.Origin.Z

    # 篩選天花板
    ceilings = FilteredElementCollector(doc, source_view.Id)\
                .OfCategory(BuiltInCategory.OST_Ceilings)\
                .WhereElementIsNotElementType()\
                .ToElements()

    opt = Options()
    opt.ComputeReferences = True
    opt.View = source_view

    created_lines = []

    TransactionManager.Instance.EnsureInTransaction(doc)

    # 處理 SketchPlane (面積邊界線必須要有草圖平面才能建立)
    sketch_plane = target_view.SketchPlane
    if not sketch_plane and target_view.GenLevel:
        try:
            sketch_plane = SketchPlane.Create(doc, target_view.GenLevel.Id)
            target_view.SketchPlane = sketch_plane
        except:
            pass

    # 判斷當下是否為「面積平面圖」
    is_area_plan = (target_view.ViewType == ViewType.AreaPlan)

    for ceiling in ceilings:
        geom_elem = ceiling.get_Geometry(opt)
        if not geom_elem: continue

        for geom_obj in geom_elem:
            if isinstance(geom_obj, Solid) and geom_obj.Volume > 0:
                for face in geom_obj.Faces:
                    # 尋找底面
                    if isinstance(face, PlanarFace) and face.FaceNormal.Z < -0.5:
                        curve_loops = face.GetEdgesAsCurveLoops()
                        
                        if curve_loops:
                            # 篩選最外圍邊界 (過濾掉內部開孔)
                            outer_loop = max(curve_loops, key=lambda loop: loop.GetExactLength())
                            
                            for curve in outer_loop:
                                flat_curve = flatten_curve(curve, target_z)
                                if flat_curve and sketch_plane:
                                    try:
                                        if is_area_plan:
                                            # 如果是面積視圖，直接建立「面積邊界線」
                                            line = doc.Create.NewAreaBoundaryLine(sketch_plane, flat_curve, target_view)
                                        else:
                                            # 如果是一般視圖，建立「一般詳圖線」
                                            line = doc.Create.NewDetailCurve(target_view, flat_curve)
                                        
                                        created_lines.append(line)
                                    except Exception as e:
                                        pass

    TransactionManager.Instance.TransactionTaskDone()
    
    OUT = created_lines
# ----------------------------------------
watch = Watch(python_script)  # graph output
string = StringInput("""Area-天花板產生範圍線--
選到你要計算面積的平面視圖(建地平面圖)，然後按下確定就會在各牆面中心線畫上面積的邊界線；注意陽臺是算在外皮所以你要移動一下面積邊界線的位置...""")  # graph input
