# Dynamo graph Area-替換文字.dyn (Dynamo 3.6.1.9895)

要修改的文字 = DSModelElementsSelection()  # 1 picked in the model; graph input
原來文字 = StringInput("W19")  # graph input
新的文字 = StringInput("W5")  # graph input
python_script = Python(IN[0]=要修改的文字, IN[1]=原來文字, IN[2]=新的文字)  # CPython3
# ---------- python_script.python (46 lines) ----------
import clr
clr.AddReference('RevitAPI')
from Autodesk.Revit.DB import *

clr.AddReference('RevitServices')
import RevitServices
from RevitServices.Persistence import DocumentManager
from RevitServices.Transactions import TransactionManager

doc = DocumentManager.Instance.CurrentDBDocument

# --- [修正區] 更暴力的清單防呆機制 ---
# 檢查輸入的是不是清單 (list)，如果不是，就硬把它包成清單 [ ]
raw_input = IN[0]
if isinstance(raw_input, list):
    elements = UnwrapElement(raw_input)
else:
    elements = [UnwrapElement(raw_input)]

# 強制把尋找與取代的內容轉成字串 (避免輸入數字時報錯)
find_str = str(IN[1])    
replace_str = str(IN[2]) 

modified_elements = []

# 開啟 Transaction 準備修改模型
TransactionManager.Instance.EnsureInTransaction(doc)

for elem in elements:
    try:
        # 確保有這個物件，而且它是文字註解 (TextNote)
        if elem and isinstance(elem, TextNote):
            current_text = elem.Text
            # 檢查要找的字串有沒有在裡面
            if find_str in current_text:
                # 執行置換
                elem.Text = current_text.replace(find_str, replace_str)
                modified_elements.append(elem)
    except Exception as e:
        # 發生其他例外就略過
        pass

# 結束 Transaction
TransactionManager.Instance.TransactionTaskDone()

OUT = modified_elements
# ----------------------------------------
watch = Watch(python_script)
