# Dynamo graph Area-牆心產生範圍線.dyn (Dynamo 3.6.1.9895)

python_script = Python()  # CPython3
# ---------- python_script.python (65 lines) ----------
import clr
import sys

# 載入 Revit API
clr.AddReference('RevitAPI')
from Autodesk.Revit.DB import *

# 載入 Document Manager 和 Transaction Manager
clr.AddReference('RevitServices')
import RevitServices
from RevitServices.Persistence import DocumentManager
from RevitServices.Transactions import TransactionManager

# 取得當前文件與作用中的視圖
doc = DocumentManager.Instance.CurrentDBDocument
active_view = doc.ActiveView

# --- 1. 直接從當前視圖抓取牆元素 ---
# 使用 FilteredElementCollector，限定只在 active_view 的範圍內搜尋
collector = FilteredElementCollector(doc, active_view.Id)

# 過濾出類別為「牆」(OST_Walls) 且為「實體元素」(非類型) 的物件
walls = collector.OfCategory(BuiltInCategory.OST_Walls).WhereElementIsNotElementType().ToElements()

curves = []

# --- 2. 收集所有牆心線 ---
for wall in walls:
    if hasattr(wall, "Location"):
        loc = wall.Location
        if isinstance(loc, LocationCurve):
            curves.append(loc.Curve)

created_lines = []

# --- 3. 開啟交易，生成區域邊界線 ---
# 再次確認是否在面積平面圖
if active_view.ViewType != ViewType.AreaPlan:
    OUT = ["錯誤：當前視圖不是「面積平面圖」。請切換視圖後再試。"]
else:
    if len(curves) > 0:
        TransactionManager.Instance.EnsureInTransaction(doc)
        
        try:
            # 取得或自動生成當前視圖的工作平面
            sketch_plane = active_view.SketchPlane
            if sketch_plane is None:
                level = active_view.GenLevel
                plane = Plane.CreateByNormalAndOrigin(XYZ.BasisZ, XYZ(0, 0, level.Elevation))
                sketch_plane = SketchPlane.Create(doc, plane)
            
            # 使用單數 NewAreaBoundaryLine，並用迴圈一條一條畫
            for curve in curves:
                # 語法：NewAreaBoundaryLine(工作平面, 單一線段, 面積平面圖)
                new_line = doc.Create.NewAreaBoundaryLine(sketch_plane, curve, active_view)
                created_lines.append(new_line)
                
            TransactionManager.Instance.TransactionTaskDone()
            OUT = created_lines # 成功輸出
            
        except Exception as e:
            TransactionManager.Instance.ForceCloseTransaction()
            OUT = ["發生錯誤: " + str(e)]
    else:
        OUT = ["在當前視圖沒有找到有效的牆心線"]
# ----------------------------------------
watch = Watch(python_script)  # graph output
string = StringInput("""Area-牆心產生範圍線--
選到你要計算面積的平面視圖(建地平面圖)，然後按下確定就會在各牆面中心線畫上面積的邊界線；注意陽臺是算在外皮所以你要移動一下面積邊界線的位置...""")  # graph input
