# Dynamo graph Area-範圍線標註長度周長與外殼面積-V1.5.3.dyn (Dynamo 3.6.1.9895)
# author: OpenAI Codex
# 範圍線改為黑色 RGB(0,0,0) 虛線，並保留舊版本線條清除相容性。

長度小數位數 = DoubleInput("2.0")  # "1.長度小數位數"; graph input
n2_邊長文字偏移_mm = DoubleInput("2.5")  # "2.邊長文字偏移(mm)"; graph input
繪製範圍線 = BoolSelector(true)  # "3.繪製範圍線"; graph input
周長包含內孔 = BoolSelector(false)  # "4.周長包含內孔"; graph input
n5_只清除結果_不重新產生 = BoolSelector(false)  # "5.只清除結果(不重新產生)"; graph input
n6_周長文字偏移_mm = DoubleInput(10)  # "6.周長文字偏移(mm)"; graph input
python_script = Python(IN[0]=長度小數位數, IN[1]=n2_邊長文字偏移_mm, IN[2]=繪製範圍線, IN[3]=周長包含內孔, IN[4]=n5_只清除結果_不重新產生, IN[5]=n6_周長文字偏移_mm)  # CPython3
# ---------- python_script.python (393 lines) ----------
# AREA PERIMETER Script Version: 2026.07.20-V1.5.3
import clr
import math
import traceback

clr.AddReference('System')
from System.Collections.Generic import List

clr.AddReference('RevitAPI')
from Autodesk.Revit.DB import *

clr.AddReference('RevitServices')
from RevitServices.Persistence import DocumentManager

doc = DocumentManager.Instance.CurrentDBDocument
view = doc.ActiveView

FT_TO_M = 0.3048
TAG = "CODEX_AREA_PERIMETER_V1"
LINE_STYLE_NAME = "AREA_周長範圍線_黑色虛線"
LEGACY_LINE_STYLE_NAMES = ("AREA_周長範圍線_紫", "AREA_周長範圍線_洋紅虛線", "AREA_周長範圍線_RGB000-166-000_虛線")
LINE_PATTERN_NAME = "AREA_周長_虛線3mm_間隔1.5mm"
SEG_TEXT_NAME = "AREA_邊長_2.5mm"
TOTAL_TEXT_NAME = "AREA_周長合計_3.5mm"

def get_num(idx, default):
    try:
        value = IN[idx]
        if isinstance(value, list):
            value = value[0] if value else default
        return float(value)
    except:
        return default

def get_bool(idx, default):
    try:
        value = IN[idx]
        if isinstance(value, list):
            value = value[0] if value else default
        if isinstance(value, str):
            return value.strip().lower() == "true"
        return bool(value)
    except:
        return default

decimals = max(0, min(6, int(get_num(0, 2))))
label_offset_mm = max(0.0, get_num(1, 2.5))
draw_boundary = get_bool(2, True)
include_inner = get_bool(3, False)
clear_only = get_bool(4, False)
total_offset_mm = max(0.0, get_num(5, 10.0))

def format_m(value):
    text = ("{0:." + str(decimals) + "f}").format(value)
    if "." in text:
        text = text.rstrip("0").rstrip(".")
    return text + " m"

def get_type_name(element_type):
    p = element_type.get_Parameter(BuiltInParameter.SYMBOL_NAME_PARAM)
    return p.AsString() if p else ""

def get_or_create_text_type(name, size_mm):
    types = list(FilteredElementCollector(doc).OfClass(TextNoteType).ToElements())
    for text_type in types:
        if get_type_name(text_type) == name:
            return text_type.Id
    if not types:
        raise Exception("文件中找不到可複製的文字註解型別。")
    new_type = types[0].Duplicate(name)
    size_param = new_type.get_Parameter(BuiltInParameter.TEXT_SIZE)
    if size_param and not size_param.IsReadOnly:
        size_param.Set(size_mm / 304.8)
    return new_type.Id

def get_or_create_dash_pattern():
    for pattern_element in FilteredElementCollector(doc).OfClass(LinePatternElement):
        if pattern_element.Name == LINE_PATTERN_NAME:
            return pattern_element

    pattern = LinePattern(LINE_PATTERN_NAME)
    segments = List[LinePatternSegment]()
    segments.Add(LinePatternSegment(LinePatternSegmentType.Dash, 3.0 / 304.8))
    segments.Add(LinePatternSegment(LinePatternSegmentType.Space, 1.5 / 304.8))
    pattern.SetSegments(segments)
    return LinePatternElement.Create(doc, pattern)

def get_or_create_line_style():
    lines = doc.Settings.Categories.get_Item(BuiltInCategory.OST_Lines)
    if lines.SubCategories.Contains(LINE_STYLE_NAME):
        subcat = lines.SubCategories.get_Item(LINE_STYLE_NAME)
    else:
        subcat = doc.Settings.Categories.NewSubcategory(lines, LINE_STYLE_NAME)

    dash_pattern = get_or_create_dash_pattern()
    subcat.LineColor = Color(0, 0, 0)
    subcat.SetLineWeight(3, GraphicsStyleType.Projection)
    subcat.SetLinePatternId(dash_pattern.Id, GraphicsStyleType.Projection)
    return subcat.GetGraphicsStyle(GraphicsStyleType.Projection)

def set_tag(element):
    p = element.get_Parameter(BuiltInParameter.ALL_MODEL_INSTANCE_COMMENTS)
    if p and not p.IsReadOnly:
        p.Set(TAG)

def has_tag(element):
    p = element.get_Parameter(BuiltInParameter.ALL_MODEL_INSTANCE_COMMENTS)
    return p is not None and p.AsString() == TAG

def readable_angle(curve):
    try:
        tangent = curve.ComputeDerivatives(0.5, True).BasisX
        angle = math.atan2(tangent.Y, tangent.X)
    except:
        p0 = curve.GetEndPoint(0)
        p1 = curve.GetEndPoint(1)
        angle = math.atan2(p1.Y - p0.Y, p1.X - p0.X)
    while angle > math.pi:
        angle -= 2.0 * math.pi
    while angle <= -math.pi:
        angle += 2.0 * math.pi
    if angle > math.pi / 2.0:
        angle -= math.pi
    elif angle < -math.pi / 2.0:
        angle += math.pi
    return angle

def loop_points(loop):
    points = []
    for segment in loop:
        curve = segment.GetCurve()
        try:
            tess = list(curve.Tessellate())
            if points and tess:
                tess = tess[1:]
            points.extend(tess)
        except:
            points.append(curve.GetEndPoint(0))
    return points

def signed_area_xy(points):
    if len(points) < 3:
        return 0.0
    total = 0.0
    for i in range(len(points)):
        a = points[i]
        b = points[(i + 1) % len(points)]
        total += a.X * b.Y - b.X * a.Y
    return total * 0.5

def loop_centroid(points):
    if not points:
        return XYZ(0, 0, 0)
    return XYZ(
        sum(p.X for p in points) / len(points),
        sum(p.Y for p in points) / len(points),
        sum(p.Z for p in points) / len(points)
    )

def element_id_number(element_id):
    # Revit 2024+ uses the 64-bit Value property; older releases use IntegerValue.
    if hasattr(element_id, "Value"):
        return int(element_id.Value)
    return int(element_id.IntegerValue)

def plain_number(value):
    text = ("{0:." + str(decimals) + "f}").format(value)
    if "." in text:
        text = text.rstrip("0").rstrip(".")
    return text

def sum_formula(values):
    parts = [plain_number(v) for v in values]
    if not parts:
        return "0"
    lines = []
    for i in range(0, len(parts), 8):
        lines.append(" + ".join(parts[i:i + 8]))
    return ("\n+ ").join(lines)

all_levels = sorted(
    list(FilteredElementCollector(doc).OfClass(Level).ToElements()),
    key=lambda level: level.Elevation
)

def get_floor_height(area):
    current_level = doc.GetElement(area.LevelId)
    if current_level is None and hasattr(view, "GenLevel"):
        current_level = view.GenLevel
    if current_level is None:
        return None, None, None
    next_level = next(
        (level for level in all_levels
         if level.Elevation > current_level.Elevation + 0.0001),
        None
    )
    if next_level is None:
        return current_level, None, None
    height_m = (next_level.Elevation - current_level.Elevation) * FT_TO_M
    return current_level, next_level, height_m

areas = list(
    FilteredElementCollector(doc, view.Id)
    .OfCategory(BuiltInCategory.OST_Areas)
    .WhereElementIsNotElementType()
    .ToElements()
)

if not areas and not clear_only:
    OUT = ["目前視圖中沒有 Area。"]
else:
    tx = Transaction(doc, "Area 範圍線、邊長與周長")
    tx.Start()
    try:
        segment_text_id = get_or_create_text_type(SEG_TEXT_NAME, 2.5)
        total_text_id = get_or_create_text_type(TOTAL_TEXT_NAME, 3.5)
        line_style = get_or_create_line_style()

        # Always remove results produced by older runs before generating.
        # Use three identifiers because some Revit element classes do not expose Comments.
        generated_ids = []
        for text_note in FilteredElementCollector(doc, view.Id).OfClass(TextNote).ToElements():
            text_type = doc.GetElement(text_note.GetTypeId())
            type_name = get_type_name(text_type) if text_type else ""
            if has_tag(text_note) or type_name in (SEG_TEXT_NAME, TOTAL_TEXT_NAME):
                generated_ids.append(text_note.Id)

        for curve_element in FilteredElementCollector(doc, view.Id).OfClass(CurveElement).ToElements():
            style_name = ""
            try:
                if curve_element.LineStyle is not None:
                    style_name = curve_element.LineStyle.Name
            except:
                pass
            if has_tag(curve_element) or style_name in ((LINE_STYLE_NAME,) + LEGACY_LINE_STYLE_NAMES):
                generated_ids.append(curve_element.Id)

        unique_ids = []
        seen_ids = set()
        for element_id in generated_ids:
            value = element_id_number(element_id)
            if value not in seen_ids:
                seen_ids.add(value)
                unique_ids.append(element_id)

        for element_id in unique_ids:
            doc.Delete(element_id)
        deleted_count = len(unique_ids)

        if clear_only:
            tx.Commit()
            OUT = ["清除完成", "已刪除 {0} 個上次產生的圖元。".format(deleted_count)]
        else:
            seg_options = TextNoteOptions(segment_text_id)
            seg_options.HorizontalAlignment = HorizontalTextAlignment.Center
            seg_options.VerticalAlignment = VerticalTextAlignment.Middle

            total_options = TextNoteOptions(total_text_id)
            total_options.HorizontalAlignment = HorizontalTextAlignment.Left
            total_options.VerticalAlignment = VerticalTextAlignment.Top

            boundary_options = SpatialElementBoundaryOptions()
            boundary_options.SpatialElementBoundaryLocation = SpatialElementBoundaryLocation.Finish

            segment_offset_ft = (label_offset_mm / 304.8) * view.Scale
            total_offset_ft = (total_offset_mm / 304.8) * view.Scale
            results = []

            for index, area in enumerate(areas, 1):
                loops = area.GetBoundarySegments(boundary_options)
                if not loops:
                    results.append("Area {0}: 無有效邊界".format(element_id_number(area.Id)))
                    continue

                loop_data = []
                for loop in loops:
                    points = loop_points(loop)
                    loop_data.append((loop, points, abs(signed_area_xy(points))))

                loop_data.sort(key=lambda item: item[2], reverse=True)
                selected = loop_data if include_inner else loop_data[:1]
                perimeter_ft = 0.0
                segment_lengths_m = []
                all_points = []

                for loop, points, _ in selected:
                    all_points.extend(points)
                    for segment in loop:
                        curve = segment.GetCurve()
                        length_ft = curve.Length
                        perimeter_ft += length_ft
                        segment_lengths_m.append(length_ft * FT_TO_M)

                        if draw_boundary:
                            detail = doc.Create.NewDetailCurve(view, curve)
                            if line_style:
                                detail.LineStyle = line_style
                            set_tag(detail)

                        mid = curve.Evaluate(0.5, True)
                        try:
                            tangent = curve.ComputeDerivatives(0.5, True).BasisX.Normalize()
                            normal = XYZ(-tangent.Y, tangent.X, 0)
                        except:
                            normal = XYZ(0, 1, 0)
                        text_point = mid.Add(normal.Multiply(segment_offset_ft))
                        text = format_m(length_ft * FT_TO_M)
                        note = TextNote.Create(doc, view.Id, text_point, text, seg_options)
                        set_tag(note)
                        angle = readable_angle(curve)
                        axis = Line.CreateBound(text_point, text_point.Add(XYZ.BasisZ))
                        ElementTransformUtils.RotateElement(doc, note.Id, axis, angle)

                perimeter_m = perimeter_ft * FT_TO_M
                area_name = ""
                try:
                    area_name = area.Name or ""
                except:
                    pass
                title = area_name if area_name else "Area {0}".format(element_id_number(area.Id))

                # Place the calculation block to the right of the boundary.
                max_x = max(p.X for p in all_points)
                max_y = max(p.Y for p in all_points)
                base_z = sum(p.Z for p in all_points) / len(all_points)
                total_point = XYZ(max_x + total_offset_ft, max_y, base_z)

                formula = sum_formula(segment_lengths_m)
                current_level, next_level, floor_height_m = get_floor_height(area)
                if current_level is not None and current_level.Name:
                    calculation_heading = "{0}外殼面積計算式".format(current_level.Name)
                else:
                    calculation_heading = "樓層外殼面積計算式"
                block_lines = [
                    calculation_heading,
                    "周長算式 = {0} = {1}".format(formula, format_m(perimeter_m))
                ]

                shell_area_m2 = None
                if floor_height_m is not None:
                    shell_area_m2 = perimeter_m * floor_height_m
                    block_lines.append(
                        "樓高 = {0} - {1} = {2}".format(
                            next_level.Name,
                            current_level.Name,
                            format_m(floor_height_m)
                        )
                    )
                    block_lines.append(
                        "外殼面積 = {0} × {1} = {2} m²".format(
                            plain_number(perimeter_m),
                            plain_number(floor_height_m),
                            plain_number(shell_area_m2)
                        )
                    )
                elif current_level is None:
                    block_lines.append("樓高 = 找不到 Area 所屬樓層")
                    block_lines.append("外殼面積 = 無法計算")
                else:
                    block_lines.append(
                        "樓高 = {0} 上方沒有更高樓層".format(current_level.Name)
                    )
                    block_lines.append("外殼面積 = 無法計算")

                total_note = TextNote.Create(
                    doc,
                    view.Id,
                    total_point,
                    "\n".join(block_lines),
                    total_options
                )
                set_tag(total_note)
                results.append({
                    "AreaId": element_id_number(area.Id),
                    "Name": title,
                    "Perimeter_m": round(perimeter_m, decimals),
                    "FloorHeight_m": (
                        round(floor_height_m, decimals)
                        if floor_height_m is not None else None
                    ),
                    "ShellArea_m2": (
                        round(shell_area_m2, decimals)
                        if shell_area_m2 is not None else None
                    ),
                    "LoopCount": len(selected)
                })

            tx.Commit()
            OUT = results
    except Exception as ex:
        if tx.HasStarted():
            tx.RollBack()
        OUT = ["執行失敗，已回復本次變更。", str(ex), traceback.format_exc()]
# ----------------------------------------
watch = Watch(python_script)  # graph output
