# Dynamo graph Area-範圍線輕量化.dyn (Dynamo 3.6.1.9895)

python_script = Python()  # CPython3
# ---------- python_script.python (161 lines) ----------
import clr
import math

# 加入 Revit API
clr.AddReference('RevitAPI')
from Autodesk.Revit.DB import *

# 加入 Revit 服務
clr.AddReference('RevitServices')
import RevitServices
from RevitServices.Persistence import DocumentManager
from RevitServices.Transactions import TransactionManager

doc = DocumentManager.Instance.CurrentDBDocument
view = doc.ActiveView

def get_2d_line_eq(p1, p2):
    """取得 2D 直線方程式 Ax + By + C = 0"""
    A = p2.Y - p1.Y
    B = p1.X - p2.X
    C = p2.X * p1.Y - p1.X * p2.Y
    norm = math.hypot(A, B)
    if norm < 1e-6: return None
    return A/norm, B/norm, C/norm

def dist_to_2d_line(eq, p):
    """計算點到 2D 直線的距離"""
    return abs(eq[0]*p.X + eq[1]*p.Y + eq[2])

# 1. 取得目前視圖中所有的區域邊界線
boundaries = FilteredElementCollector(doc, view.Id)\
    .OfCategory(BuiltInCategory.OST_AreaSchemeLines)\
    .WhereElementIsNotElementType().ToElements()

if not boundaries:
    OUT = "報告哥哥：目前視圖中沒有找到區域邊界線喔！"
else:
    groups = []
    
    # 2. 提高顯微鏡倍率！(調整 Tolerance)
    # 0.25cm 約等於 0.008 呎
    DIST_TOLERANCE = 0.008 
    
    for b in boundaries:
        curve = b.GeometryCurve
        if not isinstance(curve, Line): continue
        
        p1 = curve.GetEndPoint(0)
        p2 = curve.GetEndPoint(1)
        if p1.DistanceTo(p2) < 0.001: continue
        
        eq = get_2d_line_eq(p1, p2)
        if not eq: continue
        
        matched_group = None
        for grp in groups:
            # 檢查平行度 (角度誤差縮小到 0.001 弧度，約 0.05 度)
            # 並檢查兩端點到基準線的距離是否都在 0.25cm 以內
            if dist_to_2d_line(grp['eq'], p1) < DIST_TOLERANCE and \
               dist_to_2d_line(grp['eq'], p2) < DIST_TOLERANCE:
                matched_group = grp
                break
                
        if matched_group is not None:
            matched_group['elems'].append(b)
        else:
            groups.append({'eq': eq, 'elems': [b]})

    lines_to_create = []
    elements_to_delete = set()

    # 3. 處理每個群組
    for grp in groups:
        elems = grp['elems']
        if len(elems) == 1: continue 
        
        base_c = elems[0].GeometryCurve
        p_base = base_c.GetEndPoint(0)
        p_end = base_c.GetEndPoint(1)
        
        dir_x = p_end.X - p_base.X
        dir_y = p_end.Y - p_base.Y
        length = math.hypot(dir_x, dir_y)
        if length < 1e-6: continue
        dir_x /= length
        dir_y /= length
        
        intervals = []
        for e in elems:
            c = e.GeometryCurve
            ps = c.GetEndPoint(0)
            pe = c.GetEndPoint(1)
            t1 = (ps.X - p_base.X) * dir_x + (ps.Y - p_base.Y) * dir_y
            t2 = (pe.X - p_base.X) * dir_x + (pe.Y - p_base.Y) * dir_y
            intervals.append((min(t1, t2), max(t1, t2), e.Id))
            
        intervals.sort(key=lambda x: x[0])
        
        merged_intervals = []
        curr_start, curr_end, curr_ids = intervals[0][0], intervals[0][1], [intervals[0][2]]
        
        # 縫合間隙也縮小：只有間隙小於 0.5cm (0.016 呎) 才會自動縫合
        GAP_TOLERANCE = 0.016
        
        for i in range(1, len(intervals)):
            t_start, t_end, e_id = intervals[i]
            if t_start <= curr_end + GAP_TOLERANCE: 
                curr_end = max(curr_end, t_end)
                curr_ids.append(e_id)
            else:
                merged_intervals.append((curr_start, curr_end, curr_ids))
                curr_start, curr_end, curr_ids = t_start, t_end, [e_id]
        merged_intervals.append((curr_start, curr_end, curr_ids))
        
        for start_t, end_t, ids in merged_intervals:
            if len(ids) > 1: 
                for eid in ids:
                    elements_to_delete.add(eid)
                
                # 保持 Z 軸高度，避免產生斜線
                z_avg = sum([doc.GetElement(eid).GeometryCurve.GetEndPoint(0).Z for eid in ids]) / len(ids)
                
                new_start = XYZ(p_base.X + dir_x * start_t, p_base.Y + dir_y * start_t, z_avg)
                new_end = XYZ(p_base.X + dir_x * end_t, p_base.Y + dir_y * end_t, z_avg)
                
                if new_start.DistanceTo(new_end) > 0.001:
                    lines_to_create.append(Line.CreateBound(new_start, new_end))

    # 4. 更新 Revit
    if lines_to_create or elements_to_delete:
        TransactionManager.Instance.EnsureInTransaction(doc)
        
        deleted_count = 0
        for e_id in elements_to_delete:
            try:
                elem = doc.GetElement(e_id)
                if elem.Pinned: elem.Pinned = False
                doc.Delete(e_id)
                deleted_count += 1
            except: pass
                
        sketch_plane = view.SketchPlane
        if not sketch_plane:
            try:
                plane = Plane.CreateByNormalAndOrigin(view.ViewDirection, view.Origin)
                sketch_plane = SketchPlane.Create(doc, plane)
                view.SketchPlane = sketch_plane
            except: pass
            
        created_count = 0
        for geom in lines_to_create:
            try:
                doc.Create.NewAreaBoundaryLine(sketch_plane, geom, view)
                created_count += 1
            except: pass
                
        TransactionManager.Instance.TransactionTaskDone()
        msg = "優喝！精準度調校完成！畫了 " + str(created_count) + " 條細緻長線，清除了 " + str(deleted_count) + " 條碎線。1.5cm 的間距現在會被視為『兩條平行線』囉！😎"
        OUT = msg
    else:
        OUT = "檢查完畢！目前設定精度為 0.25cm，沒有發現需要合併的碎線。"
# ----------------------------------------
watch = Watch(python_script)
string = StringInput("""Area-範圍線輕量化
把斷續跟重疊的線整理清爽的邊界線""")  # graph input
