# Dynamo graph Area-範圍自動切面積.dyn (Dynamo 3.7.0.11777)

數字位數 = IntegerSlider(3, range=0..8 step 1)  # "5.數字位數"; graph input
角度位數 = IntegerSlider(3, range=0..8 step 1)  # "5.角度位數"; graph input
n2_旋轉切割90度嗎 = BoolSelector(false)  # "2.旋轉切割90度嗎?"; graph input
n3_是_編號列出算式_否_只更改_計算式_參數 = BoolSelector(false)  # "3.是:編號列出算式 /否:只更改"計算式"參數"; graph input
n1_自訂角度嗎 = BoolSelector(false)  # "1.自訂角度嗎?"; graph input
分割線角度 = DoubleInput(0)  # "4.分割線角度"; graph input
python_script = Python(IN[0]=數字位數, IN[1]=角度位數, IN[2]=n2_旋轉切割90度嗎, IN[3]=n3_是_編號列出算式_否_只更改_計算式_參數, IN[4]=n1_自訂角度嗎, IN[5]=分割線角度)  # CPython3
# ---------- python_script.python (424 lines) ----------
# CREATAREA Script Version: 2026.05.14-V3.8-SmartAuto-Bulletproof
import clr
import math

# 載入 Revit API
clr.AddReference('RevitAPI')
from Autodesk.Revit.DB import *

clr.AddReference('RevitNodes')
import Revit
clr.ImportExtensions(Revit.GeometryConversion)

clr.AddReference('RevitServices')
import RevitServices
from RevitServices.Persistence import DocumentManager
from RevitServices.Transactions import TransactionManager

doc = DocumentManager.Instance.CurrentDBDocument
view = doc.ActiveView

# --- 1. 工具函數 ---
def format_cm_label(val_m):
    val_cm = round(val_m * 100, 1)
    return str(int(val_cm)) if val_cm % 1 == 0 else str(val_cm)

def rotate_pt(pt, ang):
    return [pt[0]*math.cos(ang) - pt[1]*math.sin(ang), pt[0]*math.sin(ang) + pt[1]*math.cos(ang)]

def get_readable_angle(dx, dy):
    a = math.atan2(dy, dx) % (2*math.pi)
    if a > math.pi/2 + 0.01 and a <= 1.5*math.pi + 0.01:
        a -= math.pi
    return a

# --- 2. 取得控制參數 (加上超強防呆過濾器) ---
def get_num(idx, default):
    if len(IN) > idx and IN[idx] is not None:
        v = IN[idx]
        if isinstance(v, list): v = v[0] if v else default
        try: return float(v)
        except: return default
    return default

def get_bool(idx, default):
    if len(IN) > idx and IN[idx] is not None:
        v = IN[idx]
        if isinstance(v, list): v = v[0] if v else default
        if isinstance(v, str): return v.strip().lower() == 'true'
        return bool(v)
    return default

form_dec = int(get_num(0, 2))
ang_dec = int(get_num(1, 4))
rotate_90 = get_bool(2, False)
enable_list = get_bool(3, False)

# [防呆強化] 自訂角度開關與數值
use_custom_ang = get_bool(4, False)
custom_ang_deg = get_num(5, 0.0)

# 自動抓取目前視圖中的所有面積物件
all_areas = FilteredElementCollector(doc, view.Id).OfCategory(BuiltInCategory.OST_Areas).ToElements()

# 單位轉換
FT_TO_M = 0.3048 
M_TO_FT = 1.0 / 0.3048

# --- 3. 環境與樣式設定 ---
TransactionManager.Instance.EnsureInTransaction(doc)

all_txt_types = FilteredElementCollector(doc).OfClass(TextNoteType).ToElements()

def get_or_create_text_type(name, size_mm, box=0):
    tt_id = next((tt.Id for tt in all_txt_types if name in tt.get_Parameter(BuiltInParameter.SYMBOL_NAME_PARAM).AsString()), None)
    if not tt_id:
        new_type = all_txt_types[0].Duplicate(name)
        new_type.LookupParameter("文字大小").Set(size_mm / 304.8)
        if new_type.get_Parameter(BuiltInParameter.LINE_COLOR): new_type.get_Parameter(BuiltInParameter.LINE_COLOR).Set(255)
        if new_type.get_Parameter(BuiltInParameter.TEXT_BOX_VISIBILITY): new_type.get_Parameter(BuiltInParameter.TEXT_BOX_VISIBILITY).Set(box)
        return new_type.Id
    return tt_id

targetTextTypeId = get_or_create_text_type("CREATAREA_Red_2.5", 2.5)
numTextTypeId = get_or_create_text_type("CREATAREA_Num_4.0_Box", 4.0, 1)
calcTextTypeId = get_or_create_text_type("CREATAREA_Calc_4.0", 4.0, 0)

cat_lines = doc.Settings.Categories.get_Item(BuiltInCategory.OST_Lines)
subcat_name = "CREATAREA_分割線_綠0.25"
if cat_lines.SubCategories.Contains(subcat_name):
    split_style_elem = cat_lines.SubCategories.get_Item(subcat_name)
else:
    split_style_elem = doc.Settings.Categories.NewSubcategory(cat_lines, subcat_name)
    split_style_elem.LineColor = Color(0, 150, 0)
    split_style_elem.SetLineWeight(3, GraphicsStyleType.Projection)
split_gs = split_style_elem.GetGraphicsStyle(GraphicsStyleType.Projection)

# --- [自動淨化 Auto-Purge] ---
purge_names = ["CREATAREA_Red_2.5", "CREATAREA_Num_4.0_Box", "CREATAREA_Calc_4.0"]
existing_texts = FilteredElementCollector(doc, view.Id).OfClass(TextNote).ToElements()
for txt in existing_texts:
    if txt.TextNoteType.get_Parameter(BuiltInParameter.SYMBOL_NAME_PARAM).AsString() in purge_names:
        try: doc.Delete(txt.Id)
        except: pass

existing_curves = FilteredElementCollector(doc, view.Id).OfClass(CurveElement).ToElements()
for c in existing_curves:
    if hasattr(c, "LineStyle") and c.LineStyle is not None:
        if c.LineStyle.Name == "CREATAREA_分割線_綠0.25":
            try: doc.Delete(c.Id)
            except: pass

# --- 4. 執行主邏輯 ---
results = []
global_shape_id = 1 
global_max_x, global_max_y = -1e9, -1e9
dashboard_data = []

global_drawn_segments = [] 
def is_segment_labeled(seg_x_ft, seg_y_ft, txt, threshold_ft):
    for dx, dy, dtxt in global_drawn_segments:
        if dtxt == txt and math.hypot(seg_x_ft-dx, seg_y_ft-dy) < threshold_ft: return True
    return False

global_drawn_lines = []
def draw_unique_split_line(ptA_ft, ptB_ft, z_val):
    if math.hypot(ptA_ft[0]-ptB_ft[0], ptA_ft[1]-ptB_ft[1]) < 0.005: return
    tol = 0.01 
    for lA, lB in global_drawn_lines:
        match1 = math.hypot(ptA_ft[0]-lA[0], ptA_ft[1]-lA[1]) < tol and math.hypot(ptB_ft[0]-lB[0], ptB_ft[1]-lB[1]) < tol
        match2 = math.hypot(ptA_ft[0]-lB[0], ptA_ft[1]-lB[1]) < tol and math.hypot(ptB_ft[0]-lA[0], ptB_ft[1]-lA[1]) < tol
        if match1 or match2: return 
    try:
        dl = doc.Create.NewDetailCurve(view, Line.CreateBound(XYZ(ptA_ft[0], ptA_ft[1], z_val), XYZ(ptB_ft[0], ptB_ft[1], z_val)))
        if split_gs: dl.LineStyle = split_gs
        global_drawn_lines.append((ptA_ft, ptB_ft)) 
    except: pass

paper_offset_mm = 2.5 
offset_m = (paper_offset_mm / 1000.0) * view.Scale
global_threshold_ft = (5.0 / 1000.0) * view.Scale * M_TO_FT

txt_opts = TextNoteOptions(targetTextTypeId)
txt_opts.HorizontalAlignment = HorizontalTextAlignment.Center
txt_opts.VerticalAlignment = VerticalTextAlignment.Middle 

txt_opts_num = TextNoteOptions(numTextTypeId)
txt_opts_num.HorizontalAlignment = HorizontalTextAlignment.Center
txt_opts_num.VerticalAlignment = VerticalTextAlignment.Middle 

txt_opts_calc = TextNoteOptions(calcTextTypeId)
txt_opts_calc.HorizontalAlignment = HorizontalTextAlignment.Left
txt_opts_calc.VerticalAlignment = VerticalTextAlignment.Top 

bound_opt = SpatialElementBoundaryOptions()
bound_opt.SpatialElementBoundaryLocation = SpatialElementBoundaryLocation.Finish

for area_el in all_areas:
    boundary_segs = area_el.GetBoundarySegments(bound_opt)
    if not boundary_segs: continue
    
    pList_m, arcs_info = [], []
    sumX, sumY, sumZ, count = 0, 0, 0, 0
    
    for loop in boundary_segs:
        for seg in loop:
            crv = seg.GetCurve()
            pt1 = crv.GetEndPoint(0)
            pt2 = crv.GetEndPoint(1)
            
            mx, my, mz = pt1.X * FT_TO_M, pt1.Y * FT_TO_M, pt1.Z * FT_TO_M
            pList_m.append([mx, my]); sumX+=mx; sumY+=my; sumZ+=mz; count+=1
            
            if isinstance(crv, Arc) or "Arc" in crv.GetType().Name:
                rad = crv.Radius * FT_TO_M
                sweep = crv.Length / crv.Radius
                mid_pt = crv.Evaluate(0.5, True)
                arcs_info.append({
                    'p1': [pt1.X * FT_TO_M, pt1.Y * FT_TO_M], 
                    'p2': [pt2.X * FT_TO_M, pt2.Y * FT_TO_M], 
                    'mid': [mid_pt.X * FT_TO_M, mid_pt.Y * FT_TO_M], 
                    'R': rad, 
                    'rad': sweep, 
                    'deg': math.degrees(sweep)
                })
    
    if count == 0: continue
    baseZ_ft = (sumZ/count)*M_TO_FT
    if math.hypot(pList_m[0][0]-pList_m[-1][0], pList_m[0][1]-pList_m[-1][1]) > 1e-4: pList_m.append(pList_m[0])
    
    for p in pList_m:
        if p[0] > global_max_x: global_max_x = p[0]
        if p[1] > global_max_y: global_max_y = p[1]

    # --- [核心邏輯修復] 自訂角度 vs 自動長軸 ---
    if use_custom_ang:
        bestAng = math.radians(custom_ang_deg)
    else:
        # 當取消自訂時，完美回歸長軸計算，並加上精準度收斂防止同角度誤判
        angleDist = {}
        for i in range(len(pList_m)-1):
            p1, p2 = pList_m[i], pList_m[i+1]
            curAng = round(math.atan2(p2[1]-p1[1], p2[0]-p1[0]) % math.pi, 5) # 小數點後五位收斂
            angleDist[curAng] = angleDist.get(curAng, 0) + math.hypot(p2[0]-p1[0], p2[1]-p1[1])
        bestAng = max(angleDist, key=angleDist.get) if angleDist else 0.0
    
    if rotate_90: bestAng += math.pi / 2

    vList_rot = [rotate_pt(p, -bestAng) for p in pList_m]
    segs_rot_raw = [[vList_rot[i], vList_rot[i+1]] for i in range(len(vList_rot)-1)]

    sortedY = sorted(list(set([round(p[1], 4) for p in vList_rot])))
    rawSlices = []
    for i in range(len(sortedY)-1):
        y1, y2 = sortedY[i], sortedY[i+1]
        if (y2 - y1) > 0.005:
            yMid = (y1 + y2) / 2.0
            def get_x(s, y): return s[0][0] + (y-s[0][1])/(s[1][1]-s[0][1])*(s[1][0]-s[0][0]) if abs(s[0][1]-s[1][1]) > 1e-6 else s[0][0]
            xInfo = sorted([[get_x(s, yMid), s] for s in segs_rot_raw if (s[0][1] <= yMid < s[1][1]) or (s[1][1] <= yMid < s[0][1])], key=lambda x: x[0])
            for j in range(0, len(xInfo)-1, 2): rawSlices.append([get_x(xInfo[j][1], y1), get_x(xInfo[j+1][1], y1), get_x(xInfo[j][1], y2), get_x(xInfo[j+1][1], y2), y1, y2])

    def is_collinear(x1, y1, x2, y2, x3, y3):
        L = math.hypot(x3 - x1, y3 - y1)
        if L < 1e-4: return True
        d = abs((y3 - y1)*x2 - (x3 - x1)*y2 + x3*y1 - y3*x1) / L
        return d < 0.005 

    mergedSlices = []
    for slice_raw in rawSlices:
        merged = False
        for m in mergedSlices:
            if abs(m[5] - slice_raw[4]) < 0.005:
                if abs(m[2] - slice_raw[0]) < 0.005 and abs(m[3] - slice_raw[1]) < 0.005:
                    if is_collinear(m[0], m[4], m[2], m[5], slice_raw[2], slice_raw[5]) and \
                       is_collinear(m[1], m[4], m[3], m[5], slice_raw[3], slice_raw[5]):
                        m[2] = slice_raw[2]
                        m[3] = slice_raw[3]
                        m[5] = slice_raw[5]
                        merged = True
                        break
        if not merged:
            mergedSlices.append(list(slice_raw))

    formula_parts = []
    area_formulas = [] 

    for s in mergedSlices:
        xL_b, xR_b, xL_t, xR_t, y1, y2 = s
        h, w1, w2 = y2 - y1, xR_b - xL_b, xR_t - xL_t
        mid_y = (y1 + y2) / 2.0
        slice_drawn_w = set() 
        
        for y_val, w_val, xl, xr in [(y1, w1, xL_b, xR_b), (y2, w2, xL_t, xR_t)]:
            if w_val < 0.05: continue
            is_on_boundary = any(abs(b[0][1]-y_val)<1e-3 and abs(b[1][1]-y_val)<1e-3 and (min(xr, max(b[0][0], b[1][0])) - max(xl, min(b[0][0], b[1][0])) > 0.01) for b in segs_rot_raw)
            if not is_on_boundary:
                p1r, p2r = rotate_pt([xl, y_val], bestAng), rotate_pt([xr, y_val], bestAng)
                draw_unique_split_line([p1r[0]*M_TO_FT, p1r[1]*M_TO_FT], [p2r[0]*M_TO_FT, p2r[1]*M_TO_FT], baseZ_ft)
            
            label = format_cm_label(w_val)
            if label in slice_drawn_w: continue
            seg_mid_world = rotate_pt([(xl+xr)/2.0, y_val], bestAng)
            seg_x_ft, seg_y_ft = seg_mid_world[0]*M_TO_FT, seg_mid_world[1]*M_TO_FT
            
            if not is_segment_labeled(seg_x_ft, seg_y_ft, label, global_threshold_ft):
                off_y = offset_m if abs(y_val - y1) < 1e-4 else -offset_m
                tp_rot = [(xl+xr)/2.0, y_val + off_y]
                tp_world = rotate_pt(tp_rot, bestAng)
                note = TextNote.Create(doc, view.Id, XYZ(tp_world[0]*M_TO_FT, tp_world[1]*M_TO_FT, baseZ_ft), label, txt_opts)
                ElementTransformUtils.RotateElement(doc, note.Id, Line.CreateBound(XYZ(tp_world[0]*M_TO_FT, tp_world[1]*M_TO_FT, baseZ_ft), XYZ(tp_world[0]*M_TO_FT, tp_world[1]*M_TO_FT, baseZ_ft+1)), bestAng)
                global_drawn_segments.append((seg_x_ft, seg_y_ft, label))
                slice_drawn_w.add(label)

        is_left_v = abs(xL_b - xL_t) < 0.005
        is_right_v = abs(xR_b - xR_t) < 0.005
        candidates = []
        if is_left_v: candidates.append((xL_b, 1))   
        if is_right_v: candidates.append((xR_b, -1)) 
        h_label = format_cm_label(h)
        h_x, h_offset_dir = None, 1
        
        for cx, cdir in candidates:
            test_world = rotate_pt([cx, mid_y], bestAng)
            if not is_segment_labeled(test_world[0]*M_TO_FT, test_world[1]*M_TO_FT, h_label, global_threshold_ft):
                h_x, h_offset_dir = cx, cdir
                break
                
        if h_x is None:
            if candidates: h_x, h_offset_dir = candidates[0]
            else:
                h_x = (xL_b + xR_b + xL_t + xR_t) / 4.0 
                h_offset_dir = 1
                hp1r, hp2r = rotate_pt([h_x, y1], bestAng), rotate_pt([h_x, y2], bestAng)
                draw_unique_split_line([hp1r[0]*M_TO_FT, hp1r[1]*M_TO_FT], [hp2r[0]*M_TO_FT, hp2r[1]*M_TO_FT], baseZ_ft)
        else:
            is_h_on_b = any(abs(b[0][0]-h_x)<1e-3 and abs(b[1][0]-h_x)<1e-3 and (min(y2, max(b[0][1], b[1][1])) - max(y1, min(b[0][1], b[1][1])) > 0.01) for b in segs_rot_raw)
            if not is_h_on_b:
                hp1r, hp2r = rotate_pt([h_x, y1], bestAng), rotate_pt([h_x, y2], bestAng)
                draw_unique_split_line([hp1r[0]*M_TO_FT, hp1r[1]*M_TO_FT], [hp2r[0]*M_TO_FT, hp2r[1]*M_TO_FT], baseZ_ft)

        seg_mid_world_h = rotate_pt([h_x, mid_y], bestAng)
        seg_h_x_ft, seg_h_y_ft = seg_mid_world_h[0]*M_TO_FT, seg_mid_world_h[1]*M_TO_FT
        
        if not is_segment_labeled(seg_h_x_ft, seg_h_y_ft, h_label, global_threshold_ft):
            h_tp_rot = [h_x + (offset_m * h_offset_dir), mid_y]
            h_tp_world = rotate_pt(h_tp_rot, bestAng)
            h_note = TextNote.Create(doc, view.Id, XYZ(h_tp_world[0]*M_TO_FT, h_tp_world[1]*M_TO_FT, baseZ_ft), h_label, txt_opts)
            ElementTransformUtils.RotateElement(doc, h_note.Id, Line.CreateBound(XYZ(h_tp_world[0]*M_TO_FT, h_tp_world[1]*M_TO_FT, baseZ_ft), XYZ(h_tp_world[0]*M_TO_FT, h_tp_world[1]*M_TO_FT, baseZ_ft+1)), bestAng + math.pi/2)
            global_drawn_segments.append((seg_h_x_ft, seg_h_y_ft, h_label))

        sh, sw1, sw2 = round(h, form_dec), round(w1, form_dec), round(w2, form_dec)
        
        is_ghost = (sw1 <= 0 and sw2 <= 0)
        f_str = ""
        val = 0.0
        
        if is_ghost:
            pass 
        elif is_left_v and is_right_v and sw1 > 0 and abs(sw1 - sw2) <= 0.01: 
            f_str = "({}*{})".format(sw1, sh) 
            val = sw1 * sh
        elif sw1 <= 0 and sw2 > 0: 
            f_str = "({}*{}/2)".format(sw2, sh) 
            val = sw2 * sh / 2.0
        elif sw2 <= 0 and sw1 > 0: 
            f_str = "({}*{}/2)".format(sw1, sh) 
            val = sw1 * sh / 2.0
        else: 
            f_str = "(({}+{})*{}/2)".format(sw1 if sw1>0 else 0, sw2 if sw2>0 else 0, sh) 
            val = ((sw1 if sw1>0 else 0) + (sw2 if sw2>0 else 0)) * sh / 2.0

        if not is_ghost:
            formula_parts.append(f_str)
            if enable_list:
                sid = str(global_shape_id)
                global_shape_id += 1
                area_formulas.append((sid, f_str, val))
                
                cX = (xL_b + xR_b + xL_t + xR_t) / 4.0
                cY = mid_y
                c_world = rotate_pt([cX, cY], bestAng)
                TextNote.Create(doc, view.Id, XYZ(c_world[0]*M_TO_FT, c_world[1]*M_TO_FT, baseZ_ft), sid, txt_opts_num)

    # --- 3. 弧線與弓形 ---
    first_arc = True
    for arc in arcs_info:
        p1, p2, mid, R, rad, deg = arc['p1'], arc['p2'], arc['mid'], arc['R'], arc['rad'], arc['deg']
        mx, my = (p1[0]+p2[0])/2.0, (p1[1]+p2[1])/2.0
        C, H = math.hypot(p2[0]-p1[0], p2[1]-p1[1]), math.hypot(mid[0]-mx, mid[1]-my)
        if H > 0.005:
            draw_unique_split_line([p1[0]*M_TO_FT, p1[1]*M_TO_FT], [p2[0]*M_TO_FT, p2[1]*M_TO_FT], baseZ_ft)
            draw_unique_split_line([mx*M_TO_FT, my*M_TO_FT], [mid[0]*M_TO_FT, mid[1]*M_TO_FT], baseZ_ft)
            c_label = format_cm_label(C)
            c_pt_x_ft, c_pt_y_ft = mx*M_TO_FT, my*M_TO_FT
            if not is_segment_labeled(c_pt_x_ft, c_pt_y_ft, c_label, global_threshold_ft):
                out_v = [mid[0]-mx, mid[1]-my]; out_len = math.hypot(*out_v)
                c_txt_x = mx + (out_v[0]/out_len) * offset_m
                c_txt_y = my + (out_v[1]/out_len) * offset_m
                note_C = TextNote.Create(doc, view.Id, XYZ(c_txt_x*M_TO_FT, c_txt_y*M_TO_FT, baseZ_ft), c_label, txt_opts)
                ElementTransformUtils.RotateElement(doc, note_C.Id, Line.CreateBound(XYZ(c_txt_x*M_TO_FT, c_txt_y*M_TO_FT, baseZ_ft), XYZ(c_txt_x*M_TO_FT, c_txt_y*M_TO_FT, baseZ_ft+1)), get_readable_angle(p2[0]-p1[0], p2[1]-p1[1]))
                global_drawn_segments.append((c_pt_x_ft, c_pt_y_ft, c_label))
            
            out_v = [mid[0]-mx, mid[1]-my]; out_len = math.hypot(*out_v)
            txt_pt_arc = XYZ((mid[0]+out_v[0]/out_len*offset_m*2.5)*M_TO_FT, (mid[1]+out_v[1]/out_len*offset_m*2.5)*M_TO_FT, baseZ_ft)
            sRad, sDeg, sR = round(rad, ang_dec), round(deg, ang_dec), round(R, form_dec)
            label = "R={}\n∠{}°".format(format_cm_label(R), sDeg)
            if first_arc: label += "\n(R*R)*(rad-sin(ang))/2"; first_arc = False
            TextNote.Create(doc, view.Id, txt_pt_arc, label, txt_opts)
            
            f_str = "(({}*{})*({}-sin({}))/2)".format(sR, sR, sRad, sDeg)
            formula_parts.append(f_str)
            
            if enable_list:
                sid = str(global_shape_id)
                global_shape_id += 1
                val = (sR * sR) * (sRad - math.sin(math.radians(sDeg))) / 2.0
                area_formulas.append((sid, f_str, val))
                
                cX = (mx + mid[0]) / 2.0
                cY = (my + mid[1]) / 2.0
                TextNote.Create(doc, view.Id, XYZ(cX*M_TO_FT, cY*M_TO_FT, baseZ_ft), sid, txt_opts_num)

    pure_formula = "+".join(formula_parts).replace("+-", "-")
    if hasattr(area_el, "LookupParameter"):
        p = area_el.LookupParameter("計算式")
        if p and not p.IsReadOnly: p.Set(pure_formula)
    results.append(pure_formula)
    
    # 收集當前區域的明細表資料
    if enable_list and area_formulas:
        el_name = "區域"
        if hasattr(area_el, "get_Parameter") and area_el.get_Parameter(BuiltInParameter.ROOM_NAME):
            el_name = area_el.get_Parameter(BuiltInParameter.ROOM_NAME).AsString()
        elif hasattr(area_el, "Name") and area_el.Name:
            el_name = area_el.Name
            
        block_lines = ["【{}】".format(el_name)]
        total_val = 0.0
        val_strs = []
        
        for sid, f, v in area_formulas:
            v_str = str(round(v, 3))
            block_lines.append("({}) : {}={}".format(sid, f, v_str))
            val_strs.append(v_str)
            total_val += v
        
        sum_str = "總計 =" + "+".join(val_strs) + "=" + str(round(total_val, 3))
        block_lines.append(sum_str)
        
        block_text = "\n".join(block_lines)
        dashboard_data.append((block_text, len(block_lines)))

# --- 自動生成全域極簡版計算明細表 ---
if enable_list and dashboard_data:
    offset_x_m = (15.0 / 1000.0) * view.Scale # 離圖形最右側 15mm 開始排版
    current_y_m = global_max_y # 從所有圖形的最上方開始往下排
    
    line_height_m = (6.0 / 1000.0) * view.Scale 
    
    for text, line_count in dashboard_data:
        TextNote.Create(doc, view.Id, XYZ((global_max_x + offset_x_m)*M_TO_FT, current_y_m*M_TO_FT, baseZ_ft), text, txt_opts_calc)
        current_y_m -= (line_count + 1) * line_height_m

TransactionManager.Instance.TransactionTaskDone()
OUT = results
# ----------------------------------------
watch = Watch(python_script)  # graph output
