# Dynamo graph Area-計算式求值.dyn (Dynamo 3.6.2.11575)

要修改的計算式 = DSModelElementsSelection()  # 29 picked in the model; graph input
小數位數 = IntegerSlider(4, range=0..6 step 1)  # graph input
python_script = Python(IN[0]=要修改的計算式, IN[1]=小數位數)  # CPython3
# ---------- python_script.python (163 lines) ----------
import clr
import re
import math

# 載入 Revit API
clr.AddReference('RevitAPI')
from Autodesk.Revit.DB import *

clr.AddReference('RevitServices')
import RevitServices
from RevitServices.Persistence import DocumentManager
from RevitServices.Transactions import TransactionManager

doc = DocumentManager.Instance.CurrentDBDocument

# === 接收 Dynamo 輸入 ===
inputs = IN[0]
if not isinstance(inputs, list):
    inputs = [inputs]

# 處理 IN[1] 的小數位數變數 (防呆機制：預設 2 位)
try:
    if len(IN) > 1 and IN[1] is not None:
        dec_places = int(IN[1])
    else:
        dec_places = 2 
except:
    dec_places = 2 

# 安全的數學運算環境設定
safe_env = {
    'sin': lambda x: math.sin(math.radians(x)),
    'cos': lambda x: math.cos(math.radians(x)),
    'tan': lambda x: math.tan(math.radians(x)),
    'sqrt': math.sqrt
}

def evaluate_math(expr_str):
    try:
        # 替換 Revit 的平方符號
        safe_expr = expr_str.replace('^', '**')
        safe_expr = safe_expr.strip()
        ans = eval(safe_expr, {"__builtins__": None}, safe_env)
        
        if isinstance(ans, (int, float)):
            # 依照 IN[1] 指定的位數強制格式化
            format_str = f"{{:.{dec_places}f}}"
            ans_str = format_str.format(ans)
            
            # 處理極小負數變成 "-0.00" 的顯示問題，以及【智能抑制零】
            if float(ans_str) == 0.0:
                ans_str = "0"
            else:
                # 妹妹特調：抑制小數點後多餘的 0 (與 CAD 的 DIMZIN=8 同步)
                if '.' in ans_str:
                    ans_str = ans_str.rstrip('0').rstrip('.')
                    
            return ans_str
    except:
        return None
    return None

def process_line(line):
    if not line.strip(): return line
    
    # 尋找算式的正則表達式
    math_pattern = r'((?:[0-9\.\+\-\*\/\^\(\)\s]|sin|cos|tan|sqrt)+)'
    matches = list(re.finditer(math_pattern, line, re.IGNORECASE))
    new_line = line
    
    for m in reversed(matches):
        expr_str = m.group(1)
        
        nums = re.findall(r'\d+(?:\.\d+)?', expr_str)
        has_math_op = bool(re.search(r'[\+\-\*\/\^]', expr_str))
        has_parentheses = bool(re.search(r'[\(\)]', expr_str))
        has_trig = bool(re.search(r'sin|cos|tan|sqrt', expr_str, re.IGNORECASE))
        
        # 判斷是否為有效算式
        is_calc = (len(nums) >= 2 and (has_math_op or has_parentheses)) or has_trig
        if not is_calc: continue
            
        ans_str = evaluate_math(expr_str)
        if ans_str is None: continue
            
        expr_end_index = m.end()
        equal_pattern = r'^\s*=\s*'
        equal_match = re.match(equal_pattern, line[expr_end_index:])
        
        clean_expr = expr_str.rstrip()
        
        if equal_match:
            equal_end_index = expr_end_index + equal_match.end()
            old_ans_pattern = r'^([-+]?[0-9]+(\.[0-9]+)?)'
            old_ans_match = re.match(old_ans_pattern, line[equal_end_index:])
            
            if old_ans_match:
                # 替換舊答案
                old_ans_end_index = equal_end_index + old_ans_match.end()
                new_full_expression = f"{clean_expr}={ans_str}"
                new_line = new_line[:m.start()] + new_full_expression + new_line[old_ans_end_index:]
            else:
                # 只有等號沒答案，補上答案
                new_full_expression = f"{clean_expr}={ans_str}"
                new_line = new_line[:m.start()] + new_full_expression + new_line[equal_end_index:]
        else:
            # 沒有等號，補上等號與答案
            new_full_expression = f"{clean_expr}={ans_str}"
            new_line = new_line[:m.start()] + new_full_expression + new_line[m.end():]
            
    return new_line

def process_text(text):
    if not text: return text
    
    # 分割所有可能的分行與控制符號 (\n, \r, \v, \x0b)
    parts = re.split(r'(\r\n|\n|\r|\v|\x0b)', text)
    processed_parts = []
    
    for part in parts:
        if re.match(r'^(\r\n|\n|\r|\v|\x0b)$', part):
            processed_parts.append(part)
        else:
            processed_parts.append(process_line(part))
            
    return ''.join(processed_parts)

# === 執行更新邏輯 ===
output = []
elements_to_update = []

for item in inputs:
    try:
        unwrapped = UnwrapElement(item)
    except:
        unwrapped = item

    if isinstance(unwrapped, str):
        output.append(process_text(unwrapped))
    elif hasattr(unwrapped, "Text"):
        elements_to_update.append(unwrapped)
    else:
        output.append(str(item))

# 更新 Revit 物件並強制重生畫面
if elements_to_update:
    TransactionManager.Instance.EnsureInTransaction(doc)
    
    for elem in elements_to_update:
        try:
            old_text = elem.Text
            new_text = process_text(old_text)
            if old_text != new_text:
                elem.Text = new_text 
            output.append(new_text)
        except Exception as e:
            output.append(f"Error updating element {elem.Id}: {str(e)}")
            
    # 強制 Revit 進行全域資料刷新，解除文字鎖定狀態
    doc.Regenerate()
    TransactionManager.Instance.TransactionTaskDone()

OUT = output
# ----------------------------------------
watch = Watch(python_script)
string = StringInput("""要修改的計算式計算式後面最好帶"="
你的計算是跟一些描述文字在一起也沒關係
***假如程式執行完，無法改字或加字切換視圖回來就好***""")  # graph input
