# Dynamo graph Area-計算式求值並求和.dyn (Dynamo 3.6.1.9895)

要修改的計算式 = DSModelElementsSelection()  # 1 picked in the model; graph input
integer_slider = IntegerSlider(3, range=0..6 step 1)  # graph input
python_script = Python(IN[0]=要修改的計算式, IN[1]=integer_slider)  # CPython3
# ---------- python_script.python (201 lines) ----------
import clr
import re
import math

# 載入 Revit API
clr.AddReference('RevitAPI')
from Autodesk.Revit.DB import *

clr.AddReference('RevitServices')
import RevitServices
from RevitServices.Persistence import DocumentManager
from RevitServices.Transactions import TransactionManager

doc = DocumentManager.Instance.CurrentDBDocument

# === 接收 Dynamo 輸入 ===
inputs = IN[0]
if not isinstance(inputs, list):
    inputs = [inputs]

# 處理 IN[1] 的小數位數變數
try:
    if len(IN) > 1 and IN[1] is not None:
        dec_places = int(IN[1])
    else:
        dec_places = 2 
except:
    dec_places = 2 

safe_env = {
    'sin': lambda x: math.sin(math.radians(x)),
    'cos': lambda x: math.cos(math.radians(x)),
    'tan': lambda x: math.tan(math.radians(x)),
    'sqrt': math.sqrt
}

def evaluate_math(expr_str):
    try:
        safe_expr = expr_str.replace('^', '**')
        safe_expr = safe_expr.strip()
        ans = eval(safe_expr, {"__builtins__": None}, safe_env)
        
        if isinstance(ans, (int, float)):
            format_str = f"{{:.{dec_places}f}}"
            ans_str = format_str.format(ans)
            if float(ans_str) == 0.0:
                ans_str = format_str.format(0)
            return ans_str
    except:
        return None
    return None

def process_line(line):
    if not line.strip(): return line, []
    
    math_pattern = r'((?:[0-9\.\+\-\*\/\^\(\)\s]|sin|cos|tan|sqrt)+)'
    matches = list(re.finditer(math_pattern, line, re.IGNORECASE))
    new_line = line
    line_answers = [] 
    
    for m in reversed(matches):
        expr_str = m.group(1)
        
        nums = re.findall(r'\d+(?:\.\d+)?', expr_str)
        has_math_op = bool(re.search(r'[\+\-\*\/\^]', expr_str))
        has_parentheses = bool(re.search(r'[\(\)]', expr_str))
        has_trig = bool(re.search(r'sin|cos|tan|sqrt', expr_str, re.IGNORECASE))
        
        is_calc = (len(nums) >= 2 and (has_math_op or has_parentheses)) or has_trig
        if not is_calc: continue
            
        ans_str = evaluate_math(expr_str)
        if ans_str is None: continue
            
        line_answers.append(ans_str)
            
        expr_end_index = m.end()
        equal_pattern = r'^\s*=\s*'
        equal_match = re.match(equal_pattern, line[expr_end_index:])
        clean_expr = expr_str.rstrip()
        
        if equal_match:
            equal_end_index = expr_end_index + equal_match.end()
            old_ans_pattern = r'^([-+]?[0-9]+(\.[0-9]+)?)'
            old_ans_match = re.match(old_ans_pattern, line[equal_end_index:])
            
            if old_ans_match:
                old_ans_end_index = equal_end_index + old_ans_match.end()
                new_full_expression = f"{clean_expr}={ans_str}"
                new_line = new_line[:m.start()] + new_full_expression + new_line[old_ans_end_index:]
            else:
                new_full_expression = f"{clean_expr}={ans_str}"
                new_line = new_line[:m.start()] + new_full_expression + new_line[equal_end_index:]
        else:
            new_full_expression = f"{clean_expr}={ans_str}"
            new_line = new_line[:m.start()] + new_full_expression + new_line[m.end():]
            
    line_answers.reverse()
    return new_line, line_answers

def process_text(text):
    if not text: return text, []
    
    parts = re.split(r'(\r\n|\n|\r|\v|\x0b)', text)
    processed_parts = []
    all_answers = [] 
    
    for part in parts:
        if re.match(r'^(\r\n|\n|\r|\v|\x0b)$', part):
            processed_parts.append(part)
        else:
            new_part, answers = process_line(part)
            processed_parts.append(new_part)
            all_answers.extend(answers)
            
    return ''.join(processed_parts), all_answers

# === 執行更新邏輯 ===
output = []
text_notes = []

for item in inputs:
    try:
        unwrapped = UnwrapElement(item)
    except:
        unwrapped = item

    if hasattr(unwrapped, "TextNoteType"):
        text_notes.append(unwrapped)

if text_notes:
    TransactionManager.Instance.EnsureInTransaction(doc)
    
    all_global_answers = []
    
    lowest_y = float('inf')
    leftmost_x = float('inf')
    ref_z = 0
    
    text_type_id = text_notes[0].TextNoteType.Id
    view_id = text_notes[0].OwnerViewId
    view = doc.GetElement(view_id)
    
    for elem in text_notes:
        try:
            old_text = elem.Text
            new_text, text_answers = process_text(old_text)
            
            if old_text != new_text:
                elem.Text = new_text 
            
            all_global_answers.extend(text_answers)
            
            # 【關鍵修正】：改用 BoundingBox 抓取最外圍邊界，避免多行文字重疊
            bbox = elem.get_BoundingBox(view)
            if bbox:
                if bbox.Min.Y < lowest_y:
                    lowest_y = bbox.Min.Y
                    ref_z = bbox.Min.Z
                if bbox.Min.X < leftmost_x:
                    leftmost_x = bbox.Min.X
            else:
                # 防呆：如果萬一沒有邊界框，才退回用插入點
                coord = elem.Coord
                if coord.Y < lowest_y:
                    lowest_y = coord.Y
                    ref_z = coord.Z
                if coord.X < leftmost_x:
                    leftmost_x = coord.X
                
        except Exception as e:
            output.append(f"Error updating element {elem.Id}: {str(e)}")
            
    if len(all_global_answers) > 1:
        try:
            total_val = sum([float(a) for a in all_global_answers])
            format_str = f"{{:.{dec_places}f}}"
            total_str = format_str.format(total_val)
            if float(total_str) == 0.0: total_str = format_str.format(0)
            
            sum_formula = "+".join(all_global_answers) + f"={total_str}"
            
            view_scale = view.Scale
            text_size_param = text_notes[0].TextNoteType.get_Parameter(BuiltInParameter.TEXT_SIZE)
            text_size = text_size_param.AsDouble() if text_size_param else 0.01
            
            # 既然 lowest_y 已經是真正的最底部，只要往下推一點行距就好
            offset = text_size * view_scale * 1.5 
            insert_pt = XYZ(leftmost_x, lowest_y - offset, ref_z)
            
            opts = TextNoteOptions(text_type_id)
            new_text_note = TextNote.Create(doc, view_id, insert_pt, sum_formula, opts)
            output.append("已成功建立總計文字並完美排版")
            
        except Exception as e:
            output.append(f"Error creating total text: {str(e)}")
            
    doc.Regenerate()
    TransactionManager.Instance.TransactionTaskDone()

OUT = output
# ----------------------------------------
watch = Watch(python_script)
string = StringInput("""要修改的計算式計算式後面最好帶"="
你的計算是跟一些描述文字在一起也沒關係
***假如程式執行完，無法改字或加字切換視圖回來就好***""")  # graph input
