# Dynamo graph Area-開窗面積計算.dyn (Dynamo 3.6.2.11575)

python_script = Python()  # CPython3
# ---------- python_script.python (182 lines) ----------
import clr

# 載入 Revit API
clr.AddReference('RevitAPI')
from Autodesk.Revit.DB import *

# 載入 Dynamo 專用的 Revit 服務
clr.AddReference("RevitServices")
import RevitServices
from RevitServices.Persistence import DocumentManager
from RevitServices.Transactions import TransactionManager

# 取得目前文件與視圖
doc = DocumentManager.Instance.CurrentDBDocument
view = doc.ActiveView

# 💡 核心功能：取得目前視圖的階段 ID
view_phase_id = view.get_Parameter(BuiltInParameter.VIEW_PHASE).AsElementId()

room_collector = FilteredElementCollector(doc, view.Id).OfCategory(BuiltInCategory.OST_Rooms)
result_text_lines = ["【房間外牆開窗率檢討清單】\n"]
options = SpatialElementBoundaryOptions()

outdoor_keywords = ["陽台", "花台", "露台","陽臺", "花臺", "露臺"]

def get_dimension(element, type_element, built_in, string_names):
    p = element.get_Parameter(built_in)
    if p and p.HasValue: return p.AsDouble()
    if type_element:
        p = type_element.get_Parameter(built_in)
        if p and p.HasValue: return p.AsDouble()
    for name in string_names:
        p = element.LookupParameter(name)
        if p and p.HasValue: return p.AsDouble()
    if type_element:
        for name in string_names:
            p = type_element.LookupParameter(name)
            if p and p.HasValue: return p.AsDouble()
    return 0.0

for room in room_collector:
    if room.Area > 0:
        room_num = room.Number
        room_name = room.get_Parameter(BuiltInParameter.ROOM_NAME).AsString()
        
        # 陽台類不計開窗率
        if room_name and any(kw in room_name for kw in outdoor_keywords):
            continue
            
        room_area_sqm = room.Area * 0.092903 
        
        phase_id = room.get_Parameter(BuiltInParameter.ROOM_PHASE).AsElementId()
        phase = doc.GetElement(phase_id)
        room_level = doc.GetElement(room.LevelId)
        probe_z = room_level.Elevation + 3.28 
        
        total_window_area_sqm = 0.0
        calc_strings = [] 
        window_marks = [] 
        
        boundaries = room.GetBoundarySegments(options)
        if boundaries:
            for boundary_list in boundaries:
                for segment in boundary_list:
                    element_id = segment.ElementId
                    if element_id != ElementId.InvalidElementId:
                        element = doc.GetElement(element_id)
                        
                        if isinstance(element, Wall) and hasattr(element.Location, "Curve"):
                            wall_curve = element.Location.Curve
                            inserts = element.FindInserts(True, False, False, False)
                            
                            for insert_id in inserts:
                                insert_element = doc.GetElement(insert_id)
                                
                                # 💡 核心修復：階段過濾邏輯
                                win_created_phase = insert_element.CreatedPhaseId
                                win_demolished_phase = insert_element.DemolishedPhaseId
                                
                                # 如果窗戶的新建階段不等於目前視圖階段，且視圖階段 ID 是有效的
                                # (註：此處採用嚴格比對視圖當前階段，若需包含既有則改為檢查階段順序)
                                if win_created_phase != view_phase_id:
                                    continue
                                
                                # 如果窗戶在目前階段已被拆除
                                if win_demolished_phase != ElementId.InvalidElementId:
                                    if win_demolished_phase == view_phase_id:
                                        continue

                                try:
                                    cat_id = insert_element.Category.Id.Value
                                except AttributeError:
                                    cat_id = insert_element.Category.Id.IntegerValue
                                    
                                if cat_id == int(BuiltInCategory.OST_Windows):
                                    loc = insert_element.Location
                                    if loc and hasattr(loc, "Point"):
                                        win_pt = loc.Point
                                        win_proj = wall_curve.Project(win_pt)
                                        seg_curve = segment.GetCurve()
                                        p1_proj = wall_curve.Project(seg_curve.GetEndPoint(0))
                                        p2_proj = wall_curve.Project(seg_curve.GetEndPoint(1))
                                        
                                        if win_proj and p1_proj and p2_proj:
                                            win_param = win_proj.Parameter
                                            seg_p1 = p1_proj.Parameter
                                            seg_p2 = p2_proj.Parameter
                                            
                                            min_p = min(seg_p1, seg_p2)
                                            max_p = max(seg_p1, seg_p2)
                                            
                                            if min_p - 0.05 <= win_param <= max_p + 0.05:
                                                is_interior_window = False
                                                if phase:
                                                    transform = wall_curve.ComputeDerivatives(win_param, False)
                                                    tangent = transform.BasisX.Normalize()
                                                    z_axis = XYZ(0,0,1)
                                                    normal = tangent.CrossProduct(z_axis).Normalize()
                                                    offset = 1.64 
                                                    pt1 = XYZ(win_pt.X + normal.X * offset, win_pt.Y + normal.Y * offset, probe_z)
                                                    pt2 = XYZ(win_pt.X - normal.X * offset, win_pt.Y - normal.Y * offset, probe_z)
                                                    room1 = doc.GetRoomAtPoint(pt1, phase)
                                                    room2 = doc.GetRoomAtPoint(pt2, phase)
                                                    if room1 and room2:
                                                        r1_name = room1.get_Parameter(BuiltInParameter.ROOM_NAME).AsString() if room1 else ""
                                                        r2_name = room2.get_Parameter(BuiltInParameter.ROOM_NAME).AsString() if room2 else ""
                                                        is_r1_outdoor = any(kw in r1_name for kw in outdoor_keywords)
                                                        is_r2_outdoor = any(kw in r2_name for kw in outdoor_keywords)
                                                        if not (is_r1_outdoor or is_r2_outdoor):
                                                            is_interior_window = True
                                                
                                                if is_interior_window: continue
                                                
                                                window_type = doc.GetElement(insert_element.GetTypeId())
                                                t_mark = window_type.get_Parameter(BuiltInParameter.ALL_MODEL_TYPE_MARK)
                                                i_mark = insert_element.get_Parameter(BuiltInParameter.ALL_MODEL_MARK)
                                                mark_str = t_mark.AsString() if (t_mark and t_mark.AsString()) else (i_mark.AsString() if (i_mark and i_mark.AsString()) else "未命名")
                                                
                                                w_raw = get_dimension(insert_element, window_type, BuiltInParameter.WINDOW_WIDTH, ["寬度", "寬", "Width", "W"])
                                                h_raw = get_dimension(insert_element, window_type, BuiltInParameter.WINDOW_HEIGHT, ["高度", "高", "Height", "H"])
                                                
                                                if w_raw > 0 and h_raw > 0:
                                                    w_m, h_m = w_raw * 0.3048, h_raw * 0.3048
                                                    total_window_area_sqm += (w_m * h_m)
                                                    calc_strings.append("{:.2f}*{:.2f}".format(w_m, h_m))
                                                    window_marks.append(mark_str)

        wfr_ratio = (total_window_area_sqm / room_area_sqm) * 100 if room_area_sqm > 0 else 0
        calc_display = " + ".join(calc_strings) if calc_strings else "0.00"
        mark_display = ", ".join(window_marks) if window_marks else "無"
        
        if room_name and "廚房" in room_name:
            l_s = ">12.5%...OK" if wfr_ratio >= 12.5 else "<12.5%...**NG"
            v_s = ">10%...OK" if wfr_ratio >= 10.0 else "<10%...**NG"
            check_text = " ,居室採光{}, 廚房通風{}".format(l_s, v_s)
        elif room_name and ("廁所" in room_name or "浴廁" in room_name):
            v_s = ">5%...OK" if wfr_ratio >= 5.0 else "<5%...**NG"
            check_text = " ,廁所通風{}".format(v_s)
        else:
            l_s = ">12.5%...OK" if wfr_ratio >= 12.5 else "<12.5%...**NG"
            check_text = " ,居室採光{}".format(l_s)
        
        line1 = "編號: {} | 名稱: {} | 房間面積: {:.2f}".format(room_num, room_name, room_area_sqm)
        line2 = "窗戶編號: {}".format(mark_display)
        line3 = "窗戶計算: {} = {:.2f}".format(calc_display, total_window_area_sqm)
        line4 = "開窗率: {:.2f} / {:.2f} = {:.2f}%{}".format(total_window_area_sqm, room_area_sqm, wfr_ratio, check_text)
        result_text_lines.append("{}\n{}\n{}\n{}\n".format(line1, line2, line3, line4))

final_text = "\n".join(result_text_lines)

TransactionManager.Instance.EnsureInTransaction(doc)
try:
    view_bbox = view.CropBox
    text_location = XYZ(view_bbox.Max.X + 10, view_bbox.Max.Y, 0)
    text_type_id = doc.GetDefaultElementTypeId(ElementTypeGroup.TextNoteType)
    TextNote.Create(doc, view.Id, text_location, final_text, text_type_id)
    status_msg = "成功：已加入「" + doc.GetElement(view_phase_id).Name + "」階段過濾！"
except Exception as e:
    status_msg = "錯誤：" + str(e)
TransactionManager.Instance.TransactionTaskDone()

OUT = [status_msg, final_text]
# ----------------------------------------
watch = Watch(python_script)  # graph output
string = StringInput("""依照目前視圖的房間算出開窗的面積總和除以房間面積算出開窗率 
陽台, 花台, 露台,陽臺, 花臺, 露臺...算是室外 """)  # graph input
