# Dynamo graph B-門窗表-原點畫線.dyn (Dynamo 2.12.0.5650)
# packages: spring nodes 210.1.1

ꟿ_document_activeview = Custom[ꟿ Document.ActiveView]()  # package spring nodes; Selects the current document's active view. Supports more view types than the built-in option. Will be depreciated once the bult in node works with all plan types.
code_block = CodeBlock { 0; }
point_bycoordinates_1 = Point.ByCoordinates(x=code_block, y=code_block)
number = DoubleInput(-1000)  # graph input
point_bycoordinates_1_2 = Point.ByCoordinates(x=number, y=number)
byStartPointEndPoint = Line.ByStartPointEndPoint(startPoint=point_bycoordinates_1, endPoint=point_bycoordinates_1_2)
transpose = List.Transpose(lists=byStartPointEndPoint)
byCurve = DetailCurve.ByCurve(view=ꟿ_document_activeview, curve=transpose)
watch = Watch(ꟿ_document_activeview)
