# Dynamo graph F-圖紙張數總張編號.dyn (Dynamo 2.12.0.5650)
# packages: bimorphNodes 4.2.4, archi-lab.net 2023.213.1722, Clockwork for Dynamo 2.x 2.3.0

categories = Categories("OST_Sheets")
all_elements_of_category = ElementsOfCategory(Category=categories)
想要排序的品類_範圍 = Categories("OST_Sheets")  # graph input
activeViewFromCurrentDocument = Custom[Document.ActiveViewFromCurrentDocument]()  # package Clockwork for Dynamo 2.x; Gets the active view of the current document
byCategoryAndView = archilab.Revit.Selection.Select.ByCategoryAndView(category=想要排序的品類_範圍, view=activeViewFromCurrentDocument)
parameters = Element.Parameters(element=byCategoryAndView)
要編號的欄位 = StringInput("張號")  # graph input
getParameterValueByName = Revit.LinkElement.GetParameterValueByName(linkElement=byCategoryAndView, parameterName=要編號的欄位)
toNumber = String.ToNumber(string=getParameterValueByName)
list_create = List.Create(item0=byCategoryAndView, item1=toNumber)
transpose = List.Transpose(lists=list_create)
getData = Revit.Schedule.GetData(scheduleView=activeViewFromCurrentDocument)
code_block = CodeBlock { 1; }
takeItems = List.TakeItems(list=getData, amount=code_block)
flatten = List.Flatten(list=takeItems)
python_script = Python(IN[0]=flatten, IN[1]=要編號的欄位)  # IronPython2
# ---------- python_script.python (24 lines) ----------
# 載入 Python 標準資源庫和 DesignScript 資源庫
import sys
import clr
clr.AddReference('ProtoGeometry')
from Autodesk.DesignScript.Geometry import *

# 此節點的輸入將在 IN 變數中儲存為一個清單。
dataEnteringNode = IN

# 在此行下方放入您的程式碼
A=IN[0]
B=IN[1]
C=0
for i in A:
	if (i == B):
		K=C
	else:
		C+=1	
	 	



# 指定輸出至 OUT 變數。
OUT =  K
# ----------------------------------------
boolean = BoolSelector(true)
getDataColumns = Revit.Schedule.GetDataColumns(scheduleView=activeViewFromCurrentDocument, columnIndexes=python_script, removeHeading=boolean, refresh=boolean)
length = String.Length(string=getDataColumns)
code_block_2 = CodeBlock { 0; }
gt = length > code_block_2
filterByBoolMask = List.FilterByBoolMask(list=getDataColumns, mask=gt)
watch = Watch(filterByBoolMask.in)
flatten_2 = List.Flatten(list=watch)
toNumber_2 = String.ToNumber(string=flatten_2)
count = List.Count(list=flatten_2)
code_block_3 = CodeBlock(A=count) { 1..#A..1; }
list_create_2 = List.Create(item0=toNumber_2, item1=code_block_3)
transpose_2 = List.Transpose(lists=list_create_2)
code_block_4 = CodeBlock { 1; false; false; }
sortListOfLists = Custom[List.SortListOfLists](seq=list_create, sortIndex=code_block_4.out0, caseInsensitive=code_block_4.out1, orderDescending=code_block_4.out2)  # package Clockwork for Dynamo 2.x; Sorts a list of lists by one of its sublists
code_block_5 = CodeBlock { 1; }
takeItems_2 = List.TakeItems(list=sortListOfLists, amount=code_block_5)
flatten_3 = List.Flatten(list=takeItems_2)
code_block_6 = CodeBlock { ["張號","總張"]; }
watch_2 = Watch(code_block_6)
code_block_7 = CodeBlock { 0; false; false; }
sortListOfLists_2 = Custom[List.SortListOfLists](seq=list_create_2, sortIndex=code_block_7.out0, caseInsensitive=code_block_7.out1, orderDescending=code_block_7.out2)
code_block_8 = CodeBlock { 1; }
getItemAtIndex = List.GetItemAtIndex(list=sortListOfLists_2, index=code_block_8)
string_from_object = FromObject(object=getItemAtIndex)
count_2 = List.Count(list=string_from_object)
cycle = List.Cycle(list=watch_2@L1, amount=count_2)
transpose_3 = List.Transpose(lists=cycle)
string_from_object_2 = FromObject(object=count_2)
ofRepeatedItem = List.OfRepeatedItem(item=string_from_object_2, amount=count_2)
list_create_3 = List.Create(item0=string_from_object, item1=ofRepeatedItem)
transpose_4 = List.Transpose(lists=list_create_3)
setParameterByName = Element.SetParameterByName(element=flatten_3, parameterName=transpose_3, value=transpose_4)
明細表的名稱 = Views("A2-01-07各層面積計入檢討")
說明 = StringInput("""通常圖號排序，
然後在編號欄排序由1~N
**若沒產生多執行一次
張號後面緊接總張欄位""")  # graph input
要編號的欄位_2 = StringInput("[\"張號\",\"總張\"]")  # graph input
