# Dynamo graph F-更改圖紙編號.dyn (Dynamo 2.12.0.5650)
# packages: spring nodes 210.1.1, Clockwork for Dynamo 2.x 2.3.0

# group: 選視圖上的物件
ꟿ_collect_currentselection = Custom[ꟿ Collect.CurrentSelection]()  # package spring nodes; Gets the currently selected elements. Connect a boolean switch to refresh the selection.
name = Element.Name(element=ꟿ_collect_currentselection)

說明 = StringInput("""選取圖紙 更改號碼
記得圖紙要收闔""")  # graph input
parameters = Element.Parameters(element=ꟿ_collect_currentselection)
string = StringInput("圖紙號碼")
前置文字 = StringInput("")  # graph input
getParameterValueByName = Element.GetParameterValueByName(element=ꟿ_collect_currentselection, parameterName=string)
後置文字 = StringInput("")  # graph input
code_block = CodeBlock(pre=前置文字, origina=getParameterValueByName, suf=後置文字) { pre+origina+suf; }
尋找 = StringInput("-01-")  # graph input
替換 = StringInput("-00-")  # graph input
replaceMultiple = Custom[String.ReplaceMultiple](str=code_block, searchFor=尋找, replaceWith=替換)  # package Clockwork for Dynamo 2.x; Replaces multiple search terms in a given string with multiple replacements
setParameterByName = Element.SetParameterByName(element=ꟿ_collect_currentselection, parameterName=string, value=replaceMultiple)
