# Dynamo graph G-引線改箭頭.dyn (Dynamo 2.17.0.3472)

element_types = ElementTypes("ElementType")
all_elements_of_type = ElementsOfType(element_type=element_types)
parameters = Element.Parameters(element=all_elements_of_type)
name = Parameter.Name(parameter=parameters)
string = StringInput("引線箭頭")
eq = name == string
allFalse = List.AllFalse(list=eq, lacing=Shortest)
filterByBoolMask = List.FilterByBoolMask(list=all_elements_of_type, mask=allFalse)
watch = Watch(filterByBoolMask.out)
all_elements_of_type_2 = ElementsOfType(element_type=element_types)
name_2 = Element.Name(element=all_elements_of_type_2)
string_2 = StringInput("實心箭頭15°")  # graph input
indexOf = List.IndexOf(list=name_2, element=string_2)
getItemAtIndex = List.GetItemAtIndex(list=all_elements_of_type_2, index=indexOf)
setParameterByName = Element.SetParameterByName(element=watch, parameterName=string, value=getItemAtIndex)
code_block = CodeBlock { 1; }
takeItems = List.TakeItems(list=filterByBoolMask.in, amount=code_block)
parameters_2 = Element.Parameters(element=takeItems)
parameters_3 = Element.Parameters(element=watch)
element_types_2 = ElementTypes("ElementType")
string_3 = StringInput("實圓點 1.5mm")
