# Dynamo graph G-標座標並編號-測量點.dyn "G-標點座標並編號" (Dynamo 2.12.0.5650)
# packages: Genius Loci 2022.9.16, Synthesize toolkit 12.5.3

family_types = FamilyTypes("點座標高程:點座標高程")
family_types_2 = FamilyTypes("座標點:座標點")
all_elements_of_family = Custom[All Elements of Family](family=family_types_2)  # package Genius Loci; Get the family instances of the given loadable family.
all_elements_in_active_view = ElementsInView()
parameters = Element.Parameters(element=all_elements_in_active_view)
all_elements_of_family_type = ElementsOfFamilyType(Family_Type=family_types_2)
location = Custom[CW.Element.Location](VARelement=all_elements_of_family_type)  # package Synthesize toolkit; Returns the location of an element as an XYZ (or if it's line-based the start and end point of the line), along with some booleans to help filtering the results. Use this for some element types (e.g. walls or lines) that do not work with the built-in Get Family Instance Location node.
watch = Watch(location.VARpoints)
string = StringInput("類型")
parameterByName = Parameter.ParameterByName(element=all_elements_in_active_view, name=string)
string_from_object = FromObject(object=parameterByName)
string_2 = StringInput("座標點")
contains = String.Contains(string=string_from_object, searchFor=string_2)
filterByBoolMask = List.FilterByBoolMask(list=all_elements_in_active_view, mask=contains)
watch_2 = Watch(filterByBoolMask.in)
string_3 = StringInput("X")
location_2 = Custom[CW.Element.Location](VARelement=watch_2)
convert_from_internalorigin = Custom[Convert from InternalOrigin CoordinateSystem](point=location_2.VARpoints)  # package Genius Loci; Get the location point in the 3 coordinate systems : Shared Coordinates, Project Coordinates, Relative Origin Coordinates.
watch_3 = Watch(convert_from_internalorigin.Point_Survey_System)
watch_4 = Watch(watch_3)
X = Point.X(point=watch_4)
setParameterByName = Element.SetParameterByName(element=watch_2, parameterName=string_3, value=X)
string_4 = StringInput("Z")
Z = Point.Z(point=watch_4)
setParameterByName_2 = Element.SetParameterByName(element=watch_2, parameterName=string_4, value=Z)
string_5 = StringInput("Y")
Y = Point.Y(point=watch_4)
setParameterByName_3 = Element.SetParameterByName(element=watch_2, parameterName=string_5, value=Y)
string_6 = StringInput("Pt")
輸入前註碼 = StringInput("P")  # graph input
count = List.Count(list=watch_2)
code_block = CodeBlock(A=count) { 1..#A..1; }
add = 輸入前註碼 + code_block
setParameterByName_4 = Element.SetParameterByName(element=watch_2, parameterName=string_6, value=add)
categories = Categories("OST_ProjectBasePoint")
all_elements_of_category = ElementsOfCategory(Category=categories)
parameters_2 = Element.Parameters(element=all_elements_of_category)
categories_2 = Categories("OST_SharedBasePoint")
surveyPoint = Coordinates.SurveyPoint()
byOrigin = CoordinateSystem.ByOrigin(origin=surveyPoint)
basePoint = Coordinates.BasePoint()
byOrigin_2 = CoordinateSystem.ByOrigin(origin=basePoint)
transform = Geometry.Transform(fromCoordinateSystem=byOrigin, contextCoordinateSystem=byOrigin_2)  # unwired: geometry
transform_2 = Geometry.Transform(geometry=location_2.VARpoints, cs=byOrigin_2)
projectRotation = Coordinates.ProjectRotation()
