# Dynamo graph Green-外殼開窗數量計算.dyn (Dynamo 3.7.0.11777)

選擇階段 = RevitPhases()  # "1.選擇階段"; nothing selected; graph input
n2_產生明細表 = BoolSelector(true)  # "2.產生明細表?"; graph input
python_script = Python(IN[0]=選擇階段, IN[1]=n2_產生明細表)  # CPython3
# ---------- python_script.python (147 lines) ----------
import clr
import math

# 載入 Revit API
clr.AddReference('RevitAPI')
from Autodesk.Revit.DB import *

# 載入 Dynamo 服務
clr.AddReference("RevitServices")
from RevitServices.Persistence import DocumentManager
from RevitServices.Transactions import TransactionManager

doc = DocumentManager.Instance.CurrentDBDocument

# 脫外套 (Unwrap) 處理 IN[0]
phase = UnwrapElement(IN[0]) if isinstance(IN[0], list) else UnwrapElement(IN[0])

# 16 方位計算
def get_16_direction(vector_x, vector_y):
    angle_rad = math.atan2(vector_x, vector_y)
    angle_deg = math.degrees(angle_rad)
    if angle_deg < 0: angle_deg += 360
    idx = int((angle_deg + 11.25) / 22.5) % 16
    dirs = ["北 (N)", "北北東 (NNE)", "東北 (NE)", "東北東 (ENE)",
            "東 (E)", "東南東 (ESE)", "東南 (SE)", "南南東 (SSE)",
            "南 (S)", "南南西 (SSW)", "西南 (SW)", "西南西 (WSW)",
            "西 (W)", "西北西 (WNW)", "西北 (NW)", "北北西 (NNW)"]
    return dirs[idx]

# 取得階段 ID 的兼容寫法 (Revit 2024+)
def get_phase_id(ph):
    return ph.Id.Value if hasattr(ph.Id, "Value") else ph.Id.IntegerValue

# 取得樓層參數
def get_level_param_id(doc):
    params = [BuiltInParameter.SCHEDULE_LEVEL_PARAM, BuiltInParameter.FAMILY_LEVEL_PARAM, BuiltInParameter.INSTANCE_REFERENCE_LEVEL_PARAM]
    for p in params:
        param_id = ElementId(p)
        if doc.GetElement(param_id) or True: # 確保不報錯
            return param_id
    return ElementId(BuiltInParameter.SCHEDULE_LEVEL_PARAM)

# 執行運算
all_windows = FilteredElementCollector(doc).OfCategory(BuiltInCategory.OST_Windows).WhereElementIsNotElementType().ToElements()
project_pos = doc.ActiveProjectLocation.GetProjectPosition(XYZ.Zero)
true_north_rotation = Transform.CreateRotation(XYZ.BasisZ, project_pos.Angle)

# 小明哥專屬的戶外關鍵字 (含異體字)
outdoor_keywords = ["陽台", "花台", "露台", "雨遮", "戶外", "陽臺", "花臺", "露臺"]

TransactionManager.Instance.EnsureInTransaction(doc)

for win in all_windows:
    # 檢查階段
    if phase:
        p_id = get_phase_id(phase)
        c_id = win.CreatedPhaseId.Value if hasattr(win.CreatedPhaseId, "Value") else win.CreatedPhaseId.IntegerValue
        if c_id != p_id: continue

    # 改用 FacingOrientation (窗戶家族正面朝向) 解決牆角誤判問題
    if not hasattr(win, "FacingOrientation"): continue
    normal = win.FacingOrientation
    
    # 簡單室內外判斷
    win_pt = win.Location.Point
    win_level = doc.GetElement(win.LevelId)
    if not win_level: continue
    
    pt1 = XYZ(win_pt.X + normal.X*2, win_pt.Y + normal.Y*2, win_level.Elevation + 1)
    pt2 = XYZ(win_pt.X - normal.X*2, win_pt.Y - normal.Y*2, win_level.Elevation + 1)
    
    room1 = doc.GetRoomAtPoint(pt1, phase) if phase else None
    room2 = doc.GetRoomAtPoint(pt2, phase) if phase else None
    
    r1_name = room1.get_Parameter(BuiltInParameter.ROOM_NAME).AsString() if room1 else ""
    r2_name = room2.get_Parameter(BuiltInParameter.ROOM_NAME).AsString() if room2 else ""
    
    is_r1_out = (room1 is None) or any(kw in r1_name for kw in outdoor_keywords)
    is_r2_out = (room2 is None) or any(kw in r2_name for kw in outdoor_keywords)
    
    # 無視語言，直接用 Revit 底層 ID 抓取「備註 (Comments)」參數
    comments_param = win.get_Parameter(BuiltInParameter.ALL_MODEL_INSTANCE_COMMENTS)
    
    if comments_param:
        if not (is_r1_out or is_r2_out):
            comments_param.Set("室內不計")
        else:
            # 校正正北
            true_v = true_north_rotation.OfVector(normal if is_r1_out else normal.Negate())
            comments_param.Set(get_16_direction(true_v.X, true_v.Y))

# 處理明細表 (如果沒有才建立)
schedule_name = "EEWH 綠建築方位檢討表"
schedules = FilteredElementCollector(doc).OfClass(ViewSchedule).ToElements()
target_schedule = next((s for s in schedules if s.Name == schedule_name), None)

if not target_schedule:
    target_schedule = ViewSchedule.CreateSchedule(doc, ElementId(BuiltInCategory.OST_Windows))
    target_schedule.Name = schedule_name
    def_s = target_schedule.Definition
    
    # 取得明細表支援的所有可用欄位，確保絕對相容
    sf_list = def_s.GetSchedulableFields()
    def get_sf(param_id):
        for sf in sf_list:
            if sf.ParameterId == param_id:
                return sf
        return None
        
    sf_level = get_sf(get_level_param_id(doc))
    sf_mark = get_sf(ElementId(BuiltInParameter.ALL_MODEL_TYPE_MARK))
    sf_width = get_sf(ElementId(BuiltInParameter.WINDOW_WIDTH))
    sf_height = get_sf(ElementId(BuiltInParameter.WINDOW_HEIGHT))
    sf_comments = get_sf(ElementId(BuiltInParameter.ALL_MODEL_INSTANCE_COMMENTS)) or get_sf(ElementId(BuiltInParameter.ALL_MODEL_COMMENTS))
    
    # 依序加入欄位
    f_level = def_s.AddField(sf_level) if sf_level else None
    f_mark = def_s.AddField(sf_mark) if sf_mark else None
    f_width = def_s.AddField(sf_width) if sf_width else None
    f_height = def_s.AddField(sf_height) if sf_height else None
    f_comments = def_s.AddField(sf_comments) if sf_comments else None
    
    # 【無視語系】強制加入「數量(Count)」欄位
    f_count = def_s.AddField(ScheduleFieldType.Count)
    
    # 設定篩選、排序、群組與頁尾
    if f_comments:
        def_s.AddFilter(ScheduleFilter(f_comments.FieldId, ScheduleFilterType.NotEqual, "室內不計"))
        
    if f_level:
        sort_level = ScheduleSortGroupField(f_level.FieldId)
        sort_level.HasFooter = True
        sort_level.HasBlankLine = True
        def_s.AddSortGroupField(sort_level)
        
    if f_comments:
        def_s.AddSortGroupField(ScheduleSortGroupField(f_comments.FieldId))
        
    if f_mark:
        def_s.AddSortGroupField(ScheduleSortGroupField(f_mark.FieldId))
        
    # 取消逐項列舉，讓數量自動加總
    def_s.IsItemized = False

TransactionManager.Instance.TransactionTaskDone()

OUT = "運算完成！已自動寫入方位，並完美建立含數量、排序、過濾的明細表。"
# ----------------------------------------
watch = Watch(python_script)  # graph output
string = StringInput("""產出開窗方位跟數量公EEWH使用--明細表"EEWH 綠建築方位檢討表"窗戶有修改宅型
outdoor_keywords
陽台, 花台, 露台,陽臺, 花臺, 露臺...算是室外 """)  # graph input
