# Dynamo graph 圖例-牆圖例.dyn (Dynamo 3.6.1.9895)

圖示間距 = DoubleInput(35)  # graph input
python_script = Python(IN[0]=圖示間距)  # CPython3
# ---------- python_script.python (112 lines) ----------
import clr
import traceback
clr.AddReference('RevitAPI')
from Autodesk.Revit.DB import *

clr.AddReference('RevitServices')
import RevitServices
from RevitServices.Persistence import DocumentManager
from RevitServices.Transactions import TransactionManager

doc = DocumentManager.Instance.CurrentDBDocument

# 安全讀取 IN[0] (支援 Dynamo 的單一數值或清單格式)
try:
    if isinstance(IN[0], list):
        spacing_cm = float(IN[0][0])
    else:
        spacing_cm = float(IN[0])
except:
    spacing_cm = 50.0  # 預設 50 cm

def safe_get_name(elem):
    try:
        param = elem.get_Parameter(BuiltInParameter.SYMBOL_NAME_PARAM)
        if param and param.AsString(): return param.AsString()
    except: pass
    try: return elem.Name
    except: return "未知名稱"

def process_legend():
    views = FilteredElementCollector(doc).OfClass(View).ToElements()
    target_view = None
    for v in views:
        if v.ViewType == ViewType.Legend and v.Name == "牆圖示":
            target_view = v
            break
            
    if not target_view: return "❌ 找不到名稱為「牆圖示」的視圖！"

    walls = FilteredElementCollector(doc).OfClass(Wall).WhereElementIsNotElementType().ToElements()
    used_wall_type_ids = list(set([w.GetTypeId() for w in walls]))
    if not used_wall_type_ids: return "模型中沒有使用牆壁！"

    legend_comps = FilteredElementCollector(doc, target_view.Id).OfCategory(BuiltInCategory.OST_LegendComponents).WhereElementIsNotElementType().ToElements()
    if len(legend_comps) == 0: return "❌ 請放置一個圖例元件當種子！"
        
    seed_comp = legend_comps[0]
    
    text_types = FilteredElementCollector(doc).OfClass(TextNoteType).ToElements()
    target_text_type = None
    for tt in text_types:
        tt_name = safe_get_name(tt).lower()
        if "3mm" in tt_name or "3 mm" in tt_name:
            target_text_type = tt
            break
    if not target_text_type: target_text_type = text_types[0] # 找不到 3mm 就用預設第一個

    try:
        TransactionManager.Instance.EnsureInTransaction(doc)
        
        length_ft = 1100.0 / 304.8
        spacing_y_ft = (spacing_cm * 10.0) / 304.8
        text_gap_ft = 100.0 / 304.8 # 文字距離牆壁右邊緣 10cm 的完美空隙
        
        count = 0
        for i, w_type_id in enumerate(used_wall_type_ids):
            wall_type = doc.GetElement(w_type_id)
            if not wall_type: continue
            
            new_comp_ids = ElementTransformUtils.CopyElement(doc, seed_comp.Id, XYZ.Zero)
            new_comp = doc.GetElement(new_comp_ids[0])
            
            param_type = new_comp.get_Parameter(BuiltInParameter.LEGEND_COMPONENT)
            if param_type and not param_type.IsReadOnly: param_type.Set(w_type_id)
                
            param_length = new_comp.get_Parameter(BuiltInParameter.LEGEND_COMPONENT_LENGTH)
            if not param_length: param_length = new_comp.LookupParameter("Host Length")
            if not param_length: param_length = new_comp.LookupParameter("主體長度")
            if param_length and not param_length.IsReadOnly: param_length.Set(length_ft)
            
            move_vec = XYZ(0, - (i + 1) * spacing_y_ft, 0)
            ElementTransformUtils.MoveElement(doc, new_comp.Id, move_vec)
            
            # 【關鍵修復】：強制 Revit 更新畫面，取得這塊牆最新的長寬高！
            doc.Regenerate() 
            
            bbox = new_comp.get_BoundingBox(target_view)
            if bbox:
                # 絕對置中算法：(最高點 + 最低點) 除以 2
                center_y = (bbox.Max.Y + bbox.Min.Y) / 2.0
                # 絕對靠右算法：最右側邊緣 + 10cm 空隙
                text_x = bbox.Max.X + text_gap_ft
                text_loc = XYZ(text_x, center_y, 0)
            else:
                text_loc = XYZ(move_vec.X + (1200.0/304.8), move_vec.Y, 0)
            
            wall_name = safe_get_name(wall_type)
            options = TextNoteOptions(target_text_type.Id)
            options.HorizontalAlignment = HorizontalTextAlignment.Left
            options.VerticalAlignment = VerticalTextAlignment.Middle
            
            TextNote.Create(doc, target_view.Id, text_loc, wall_name, options)
            count += 1
            
        TransactionManager.Instance.TransactionTaskDone()
        return "🎉 成功產生 {} 個圖例，間距已經設定為 {} cm。".format(count, spacing_cm)
        
    except Exception as e:
        if TransactionManager.Instance.ForceCloseTransaction(): pass
        return "❌ 錯誤：\n" + traceback.format_exc()

OUT = process_legend()
# ----------------------------------------
watch = Watch(python_script)
說明 = StringInput("放牆圖示之前要先放一個牆平面圖示的種子不然不會產生")  # graph input
