# Dynamo graph 圖例-門窗表.dyn (Dynamo 3.6.1.9895)

表格基準偏移量_346_259 = DoubleInput(346.259)  # graph input
表格寬 = DoubleInput(550)  # graph input
表格高 = DoubleInput(880)  # graph input
水平格子數量 = DoubleInput(7)  # graph input
fl線高度_1737_45 = DoubleInput(1737.45)  # graph input
選取階段 = RevitPhases("新營造")  # "1.選取階段"; graph input
n2_顯示帷幕窗 = BoolSelector(false)  # "2.顯示帷幕窗?"; graph input
python_script = Python(IN[0]=表格基準偏移量_346_259, IN[1]=表格寬, IN[2]=表格高, IN[3]=水平格子數量, IN[4]=fl線高度_1737_45, IN[5]=選取階段, IN[6]=n2_顯示帷幕窗)  # CPython3
# ---------- python_script.python (252 lines) ----------
# ==========================================
# VER: v3.3.0 (完美降落・最終版)
# 修正：1. 新增「智能防飄浮機制」：偵測並解決 Revit 圖例自帶主體牆導致的 BoundingBox 虛胖問題。
#      2. 完美繼承 v3.2.0 的數學絕對定位、帷幕開關、自然排序與階段過濾。
# ==========================================
import clr
import math
import re

clr.AddReference('RevitAPI')
from Autodesk.Revit.DB import *
clr.AddReference("RevitServices")
import RevitServices
from RevitServices.Persistence import DocumentManager
from RevitServices.Transactions import TransactionManager

def get_input(i, default):
    try:
        if i < len(IN) and IN[i] is not None: return float(IN[i])
    except: pass
    return float(default)

def get_input_bool(i, default):
    try:
        if i < len(IN) and IN[i] is not None:
            val = IN[i]
            if isinstance(val, bool): return val
            if isinstance(val, str): return val.lower() in ['true', '1', 't', 'yes', '是']
            if isinstance(val, int): return val != 0
    except: pass
    return default

phase_input = IN[5] if len(IN) > 5 else None
PHASE_STR = ""
if phase_input:
    if hasattr(phase_input, "Name"): PHASE_STR = phase_input.Name
    elif isinstance(phase_input, str): PHASE_STR = phase_input

SHOW_CURTAIN = get_input_bool(6, True) 

BASE_X_CM = get_input(0, 346.259) + get_input(1, 550.0) 
OFF_X_CM  = get_input(1, 550.0)
OFF_Y_CM  = get_input(2, 880.0)
COLS      = int(get_input(3, 7))
FL_OFF_CM = get_input(4, 200.0) 
MIN_GRID  = 21 
SHIFT_DOWN_CM = 1342.2 

def run_script():
    doc = DocumentManager.Instance.CurrentDBDocument
    view = doc.ActiveView
    
    # --- 0. 階段時間軸解析 ---
    phase_dict = {p.Id.ToString(): idx for idx, p in enumerate(doc.Phases)}
    target_phase_idx = -1
    if PHASE_STR:
        for p in doc.Phases:
            if p.Name == PHASE_STR:
                target_phase_idx = phase_dict.get(p.Id.ToString(), -1); break
    if target_phase_idx == -1:
        view_phase_id = view.get_Parameter(BuiltInParameter.VIEW_PHASE).AsElementId()
        if view_phase_id: target_phase_idx = phase_dict.get(view_phase_id.ToString(), -1)
    if target_phase_idx == -1: return "❌ 找不到有效的階段，請確認專案設定！"

    # --- 1. 資料收集與帷幕判定 ---
    all_inst = list(FilteredElementCollector(doc).OfCategory(BuiltInCategory.OST_Doors).WhereElementIsNotElementType()) + \
               list(FilteredElementCollector(doc).OfCategory(BuiltInCategory.OST_Windows).WhereElementIsNotElementType())
    
    type_counts = {}
    first_inst_dict = {} 
    for inst in all_inst:
        c_id, d_id = inst.CreatedPhaseId, inst.DemolishedPhaseId
        c_val = c_id.ToString() if c_id else "-1"
        d_val = d_id.ToString() if d_id else "-1"
        c_idx = phase_dict.get(c_val, 999)
        d_idx = phase_dict.get(d_val, 999) 
        
        if c_idx <= target_phase_idx and target_phase_idx < d_idx:
            tid = inst.GetTypeId()
            if tid != ElementId.InvalidElementId:
                type_counts[tid] = type_counts.get(tid, 0) + 1
                if tid not in first_inst_dict: first_inst_dict[tid] = inst
            
    def get_dim_val(t, names):
        for n in names:
            p = t.LookupParameter(n)
            if p and p.StorageType == StorageType.Double:
                return str(int(round(p.AsDouble() * 30.48)))
        return "0"
    def get_str_val(t, names):
        for n in names:
            p = t.LookupParameter(n)
            if p:
                if p.StorageType == StorageType.String: return p.AsString() or ""
                return p.AsValueString() or str(p.AsInteger())
        return ""
    def natural_sort_key(s):
        return [int(text) if text.isdigit() else text.lower() for text in re.split('([0-9]+)', s)]

    data_list = []
    for tid, count in type_counts.items():
        t = doc.GetElement(tid)
        if not t or not getattr(t, "Category", None): continue
        is_d = "Door" in t.Category.Name or "門" in t.Category.Name
        inst = first_inst_dict[tid]
        sill_param = inst.get_Parameter(BuiltInParameter.INSTANCE_SILL_HEIGHT_PARAM)
        sill_ft = sill_param.AsDouble() if sill_param else 0.0
        
        w_str = get_dim_val(t, ["Width", "寬度", "寬"])
        h_str = get_dim_val(t, ["Height", "高度", "高"])
        fname = t.Family.Name if hasattr(t, "Family") else ""
        tname = get_str_val(t, ["Type Name", "類型名稱"])
        
        is_curtain = "帷幕" in fname or "帷幕" in tname or w_str == "0" or h_str == "0"
        if is_curtain and not SHOW_CURTAIN: continue

        remark = get_str_val(t, ["門窗備註", "備註", "Type Comments", "類型備註"])
        if not remark: remark = get_str_val(inst, ["門窗備註", "備註", "Comments"])
        
        data_list.append({
            "Type": t, "Mark": get_str_val(t, ["Type Mark", "類型標記"]),
            "Spec": get_str_val(t, ["門窗規格"]), "W_str": w_str, "H_str": h_str, 
            "Fire": get_str_val(t, ["防火等級", "防火時效"]), "Glass": get_str_val(t, ["玻璃厚度"]), 
            "Qty": str(count), "is_d": is_d, "Sill_ft": sill_ft, "Remark": remark, 
            "is_curtain": is_curtain 
        })
    data_list.sort(key=lambda d: (("1" if d["is_d"] else "2"), natural_sort_key(d["Mark"])))

    # --- 2. 視圖種子搜尋 ---
    leg_s, ann_s, blk_s = None, None, None
    view_collector = FilteredElementCollector(doc, view.Id)
    for el in view_collector.OfClass(FamilyInstance).OfCategory(BuiltInCategory.OST_GenericAnnotation):
        try:
            fn, tn = el.Symbol.Family.Name, el.Name
            if "門詳圖標註" in fn:
                if "空白" in tn: blk_s = el
                else: ann_s = el
        except: continue
    for el in FilteredElementCollector(doc, view.Id):
        if el.get_Parameter(BuiltInParameter.LEGEND_COMPONENT): leg_s = el; break
    if not leg_s or not ann_s: return "❌ 找不到種子！請確認目前視圖有圖例與標註。"

    # --- 3. 事務執行 ---
    TransactionManager.Instance.EnsureInTransaction(doc)
    try:
        total_slots = max(MIN_GRID, int(math.ceil(len(data_list)/float(COLS))*COLS))
        for i in range(total_slots):
            col, row = i % COLS, i // COLS
            vec_grid = XYZ((BASE_X_CM + col * OFF_X_CM) / 30.48, (row * OFF_Y_CM) / 30.48, 0)
            
            if i < len(data_list):
                d = data_list[i]
                na_ids = ElementTransformUtils.CopyElement(doc, ann_s.Id, vec_grid)
                nl_ids = ElementTransformUtils.CopyElement(doc, leg_s.Id, vec_grid)
                if not na_ids or not nl_ids: continue
                na, nl = doc.GetElement(na_ids[0]), doc.GetElement(nl_ids[0])
                
                nl.get_Parameter(BuiltInParameter.LEGEND_COMPONENT).Set(d["Type"].Id)
                
                display_w = "依現場尺寸" if d["is_curtain"] else d["W_str"]
                display_h = "依現場尺寸" if d["is_curtain"] else d["H_str"]

                def set_p(el, names, v):
                    for n in names:
                        p = el.LookupParameter(n)
                        if p and not p.IsReadOnly:
                            try:
                                if p.StorageType == StorageType.Integer: p.Set(int(float(v)))
                                elif p.StorageType == StorageType.Double: p.Set(float(v)/30.48)
                                else: p.Set(str(v))
                            except: pass
                            break
                set_p(na, ["類型標記", "編號"], d["Mark"]); set_p(na, ["寬度"], display_w)
                set_p(na, ["高度"], display_h); set_p(na, ["數量"], d["Qty"])
                set_p(na, ["門窗規格"], d["Spec"]); set_p(na, ["防火等級", "防火時效"], d["Fire"])
                set_p(na, ["玻璃厚度"], d["Glass"]); set_p(na, ["門窗備註", "備註", "門窗備註 "], d["Remark"])

                doc.Regenerate() 
                na_bb, nl_bb = na.get_BoundingBox(view), nl.get_BoundingBox(view)
                if na_bb and nl_bb:
                    na_center_x, na_bottom_y = (na_bb.Min.X + na_bb.Max.X)/2.0, na_bb.Min.Y
                    abs_fl_y = na_bottom_y + (FL_OFF_CM / 30.48) - (SHIFT_DOWN_CM / 30.48)
                    nl_center_x, nl_bottom_y = (nl_bb.Min.X + nl_bb.Max.X)/2.0, nl_bb.Min.Y
                    target_nl_y = abs_fl_y + d["Sill_ft"]
                    
                    # 🌟 v3.3.0 智能防飄浮機制 (Anti-Floating Logic) 🌟
                    bb_h = nl_bb.Max.Y - nl_bb.Min.Y
                    h_ft = float(d["H_str"]) / 30.48 if not d["is_curtain"] else 0
                    extra_h = bb_h - h_ft
                    
                    # 如果多出來的高度大於 30cm 或大於半個台度，認定它包含了「長到地板的主體牆」
                    if not d["is_curtain"] and not d["is_d"] and extra_h > max(1.0, d["Sill_ft"] * 0.5):
                        actual_move_y = abs_fl_y - nl_bottom_y # 對齊地板
                    else:
                        actual_move_y = target_nl_y - nl_bottom_y # 對齊窗台
                        
                    ElementTransformUtils.MoveElement(doc, nl.Id, XYZ(na_center_x - nl_center_x, actual_move_y, 0))
                    
                    doc.Regenerate() 
                    nl_bb_new = nl.get_BoundingBox(view)
                    if nl_bb_new:
                        fl_curve = doc.Create.NewDetailCurve(view, Line.CreateBound(XYZ(na_center_x - 2.0, abs_fl_y, 0), XYZ(na_center_x + 2.0, abs_fl_y, 0)))
                        dot_len = 0.02 
                        
                        if not d["is_curtain"]:
                            w_ft = (float(d["W_str"]) / 2.0) / 30.48
                            l, r = na_center_x - w_ft, na_center_x + w_ft
                            h_ft = float(d["H_str"]) / 30.48
                            b, t = target_nl_y, target_nl_y + h_ft
                            dim_w_txt, dim_h_txt = d["W_str"] + "\u200b", d["H_str"] + "\u200b"
                        else:
                            l, r = nl_bb_new.Min.X, nl_bb_new.Max.X
                            b, t = nl_bb_new.Min.Y, nl_bb_new.Max.Y
                            dim_w_txt = dim_h_txt = "依現場尺寸"
                        
                        # 1. 寬度標註
                        line_w = Line.CreateBound(XYZ(l, t + 0.8, 0), XYZ(r, t + 0.8, 0))
                        ref_l = doc.Create.NewDetailCurve(view, Line.CreateBound(XYZ(l, t + 0.8, 0), XYZ(l, t + 0.8 + dot_len, 0)))
                        ref_r = doc.Create.NewDetailCurve(view, Line.CreateBound(XYZ(r, t + 0.8, 0), XYZ(r, t + 0.8 + dot_len, 0)))
                        ref_arr_w = ReferenceArray()
                        ref_arr_w.Append(ref_l.GeometryCurve.Reference); ref_arr_w.Append(ref_r.GeometryCurve.Reference)
                        try: 
                            dim_w = doc.Create.NewDimension(view, line_w, ref_arr_w)
                            dim_w.ValueOverride = dim_w_txt 
                        except: pass
                        
                        # 2. 高度與台度標註
                        line_h = Line.CreateBound(XYZ(l - 0.8, abs_fl_y, 0), XYZ(l - 0.8, t + 0.5, 0))
                        ref_arr_h = ReferenceArray()
                        ref_arr_h.Append(fl_curve.GeometryCurve.Reference) 
                        if abs(b - abs_fl_y) > 0.03: 
                            ref_b = doc.Create.NewDetailCurve(view, Line.CreateBound(XYZ(l - 0.8, b, 0), XYZ(l - 0.8 - dot_len, b, 0)))
                            ref_arr_h.Append(ref_b.GeometryCurve.Reference)
                        ref_t = doc.Create.NewDetailCurve(view, Line.CreateBound(XYZ(l - 0.8, t, 0), XYZ(l - 0.8 - dot_len, t, 0)))
                        ref_arr_h.Append(ref_t.GeometryCurve.Reference)
                        try: 
                            dim_h = doc.Create.NewDimension(view, line_h, ref_arr_h)
                            dim_h.ValueOverride = dim_h_txt 
                        except: pass

            elif blk_s:
                vec_blank = XYZ((BASE_X_CM + col * OFF_X_CM) / 30.48, (row * OFF_Y_CM - OFF_Y_CM) / 30.48, 0)
                ElementTransformUtils.CopyElement(doc, blk_s.Id, vec_blank)
                
        TransactionManager.Instance.TransactionTaskDone()
        return "✅ v3.3.0 大功告成！防飄浮機制啟動，所有門窗已完美降落，尺寸精準無誤！"
        
    except Exception as e:
        TransactionManager.Instance.ForceCloseTransaction()
        return "❌ 錯誤: " + str(e)

OUT = run_script()
# ----------------------------------------
watch = Watch(python_script)
number = DoubleInput(0)
string = StringInput("""注意
備註是對應"門窗備註"
防火時效對應"防火等級"
若不是就要改SCRIPT裡的
get_str_val(t, ["防火等級"])""")  # graph input
