# Dynamo graph 圖紙-由EXCEL增加圖紙.dyn (Dynamo 3.6.1.9895)

選取群族名稱 = FamilyTypes("3LA1-2024:3LA1-2024")  # graph input
說明 = StringInput("""注意:
excel的頁面名稱為"參數表"
第一行為參數名稱""")  # graph input
輸入圖紙關鍵字 = StringInput("3LA1-2024")  # graph input
輸入關鍵字找出完整的family_type = Python(IN[0]=輸入圖紙關鍵字)  # CPython3
# ---------- 輸入關鍵字找出完整的family_type.python (57 lines) ----------
import clr
clr.AddReference('RevitAPI')
from Autodesk.Revit.DB import *

clr.AddReference('RevitNodes')
import Revit
clr.ImportExtensions(Revit.Elements)

clr.AddReference('RevitServices')
import RevitServices
from RevitServices.Persistence import DocumentManager

doc = DocumentManager.Instance.CurrentDBDocument

# 1. 取得關鍵字，轉小寫、去空白
raw_input = IN[0]
if isinstance(raw_input, list): 
    raw_input = raw_input[0]
keyword = str(raw_input).replace(" ", "").lower()

# 2. 萬用大客廳：搜集所有 ElementType (無差別全搜，真正橫著走！)
collector = FilteredElementCollector(doc).WhereElementIsElementType().ToElements()

target_elem = None
debug_msg = "報告哥哥：還是沒找到😭"

for elem in collector:
    f_name = ""
    t_name = ""
    
    # 🛡️ 獨立防護罩 A：只保護族群名稱
    try:
        f_name = str(elem.FamilyName)
    except:
        pass
        
    # 🛡️ 獨立防護罩 B：只保護類型名稱
    try:
        t_name = str(elem.Name)
    except:
        pass
        
    # 如果兩個都抓不到，才跳過這個隱形人
    if not f_name and not t_name:
        continue
        
    # 將名字組合、去空白、轉小寫，進行嚴酷比對
    full_string = (f_name + t_name).replace(" ", "").lower()
    
    if keyword in full_string:
        # 找到了！馬上包裝成 Dynamo 綠色元件
        target_elem = elem.ToDSType(True)
        debug_msg = "✅ 橫著走成功！抓到啦：{} : {} (ID: {})".format(f_name, t_name, elem.Id)
        break

# 輸出 [0]目標元件, [1]妹妹的回報
OUT = target_elem
# ----------------------------------------
選取excel資料_注意資料是文字還是數字 = Filename("C:\Users\Simon\Desktop\TODAY\圖紙編號.xlsx")  # graph input
file_from_path = FileObject(path=選取excel資料_注意資料是文字還是數字)
工作表明稱 = StringInput("參數表")  # graph input
importExcel = Data.ImportExcel(file=file_from_path, sheetName=工作表明稱)
python_script = Python(IN[0]=輸入關鍵字找出完整的family_type, IN[1]=importExcel)  # CPython3
# ---------- python_script.python (66 lines) ----------
import clr
clr.AddReference('RevitAPI')
from Autodesk.Revit.DB import *

clr.AddReference('RevitServices')
import RevitServices
from RevitServices.Persistence import DocumentManager
from RevitServices.Transactions import TransactionManager

doc = DocumentManager.Instance.CurrentDBDocument

# --- 接收輸入 ---
# IN[0]: 來自我們「橫著走萬用搜尋器」抓到的圖框 Element
input_element = UnwrapElement(IN[0]) if IN[0] else None
# IN[1]: 來自 Excel 的資料
excel_data = IN[1]

created_sheets = []
error_log = []

# 直接提取圖框的 ID (我們百分之百信任哥哥搜出來的東西！)
tb_id = ElementId.InvalidElementId
if input_element:
    try:
        tb_id = input_element.Id
    except:
        error_log.append("⚠️ 無法讀取圖框 ID，將建立空白圖紙。")
else:
    error_log.append("⚠️ 沒有收到圖框，將建立空白圖紙。")

# 取得目前專案中所有的圖紙編號，避免重複當機
existing_sheets = FilteredElementCollector(doc).OfClass(ViewSheet).ToElements()
existing_numbers = [s.SheetNumber for s in existing_sheets]

TransactionManager.Instance.EnsureInTransaction(doc)

# 從第 2 列開始跑 (跳過標題)
for i in range(1, len(excel_data)):
    row = excel_data[i]
    if not row or len(row) < 2: continue
        
    sheet_num = str(row[0]).strip()
    sheet_name = str(row[1]).strip()
    
    # 清理 Excel 可能帶來的 .0 尾巴
    if sheet_num.endswith('.0'):
        sheet_num = sheet_num[:-2]

    # 防呆：如果圖紙已經存在，安全跳過
    if sheet_num in existing_numbers:
        error_log.append("跳過：編號 {} 已存在".format(sheet_num))
        continue

    try:
        # 🌟 建立圖紙 (強制掛上我們指定的圖框 ID)
        new_sheet = ViewSheet.Create(doc, tb_id)
        new_sheet.SheetNumber = sheet_num
        new_sheet.Name = sheet_name
        created_sheets.append(new_sheet)
    except Exception as e:
        error_log.append("編號 {} 建立失敗: {}".format(sheet_num, str(e)))

TransactionManager.Instance.TransactionTaskDone()

# 輸出結果
OUT = created_sheets, "✅ 成功建立了 {} 張帶有圖框的圖紙！".format(len(created_sheets)), error_log
# ----------------------------------------
watch = Watch(python_script)
watch_2 = Watch(輸入關鍵字找出完整的family_type)  # graph output
