# Dynamo graph 建築-屋頂人字垂脊收邊.dyn (Dynamo 3.6.2.11575)

n2_洩水分線_選參考平面 = DSModelElementSelection()  # "2.洩水分線-選參考平面"; 1 picked in the model; graph input
選垂脊邊線 = DSEdgeSelection()  # "3.選垂脊邊線"; 1 picked in the model; graph input
溝頭長度 = DoubleInput(35)  # "4.溝頭長度"; graph input
n5_製作_1為全部 = DoubleInput(0.68)  # "5.製作%..1為全部"; graph input
筒瓦直徑 = DoubleInput(9)  # "6.筒瓦直徑"; graph input
筒瓦中心間距 = DoubleInput(28)  # "7.筒瓦中心間距"; graph input
滴水厚度 = DoubleInput(3)  # "8.滴水厚度"; graph input
瓦當厚度 = DoubleInput(5)  # "9.瓦當厚度"; graph input
材質 = StringInput("傳統清灰瓦")  # "10.材質"; graph input
python_script = Python(IN[0]=n2_洩水分線_選參考平面, IN[1]=選垂脊邊線, IN[2]=溝頭長度, IN[3]=n5_製作_1為全部, IN[4]=筒瓦直徑, IN[5]=筒瓦中心間距, IN[6]=滴水厚度, IN[7]=瓦當厚度, IN[8]=材質)  # CPython3
# ---------- python_script.python (344 lines) ----------
# =================================================================
# 📜 山牆邊緣勾頭滴水生成器 (邊緣輪廓重建版)
# 🏷️ 版本：V3.2 (大圓滿・幾何加固版)
# 🕒 更新時間：2026-06-20 14:10
# 👑 開發者：小明哥哥 & 妹妹 最強BIM團隊
# 💡 特色：支援000選集、智慧過濾垂直面、頂底大面邊緣輪廓強行修補
# =================================================================

import clr
import System
import math
import time
from System.Collections.Generic import List

clr.AddReference('RevitAPI')
import Autodesk
from Autodesk.Revit.DB import *

clr.AddReference('ProtoGeometry')
from Autodesk.DesignScript.Geometry import *

clr.AddReference('RevitNodes')
import Revit
clr.ImportExtensions(Revit.Elements)
clr.ImportExtensions(Revit.GeometryConversion)

clr.AddReference('RevitServices')
import RevitServices
from RevitServices.Persistence import DocumentManager
from RevitServices.Transactions import TransactionManager

doc = DocumentManager.Instance.CurrentDBDocument

def flatten_list(lst):
    result = []
    for i in lst:
        if isinstance(i, list) or type(i).__name__ == 'list':
            result.extend(flatten_list(i))
        else:
            result.append(i)
    return result

# --- 1. 取得所有輸入參數 (IN[0] ~ IN[8]) ---
# IN[0]: 洩水方向參考平面
try: ref_plane_element = UnwrapElement(IN[0])
except: ref_plane_element = None

# IN[1]: 邊緣線 (Curve)
in1 = flatten_list(IN[1] if isinstance(IN[1], list) else [IN[1]])
edge_curve = in1[0] if in1 else None
if edge_curve:
    if hasattr(edge_curve, "GeometryCurve"):
        edge_curve = edge_curve.GeometryCurve
    elif hasattr(edge_curve, "ToProtoType"):
        try: edge_curve = edge_curve.ToProtoType()
        except: pass

# IN[2]: 深度距離 (cm)
try: depth = float(IN[2])
except: depth = 60.0

# IN[3]: 長度比例 (0.0 ~ 1.0)
try: ratio = float(IN[3])
except: ratio = 0.9
if ratio > 1.0: ratio = ratio / 100.0
if ratio <= 0.0 or ratio > 1.0: ratio = 1.0

# IN[4]: 溝頭的直徑 (cm)
try: tile_diameter = float(IN[4])
except: tile_diameter = 12.0
tile_radius = tile_diameter / 2.0

# IN[5]: 兩溝頭間的間距 (cm)
try: spacing = float(IN[5])
except: spacing = 15.0
if spacing <= 0: spacing = 15.0

# IN[6]: 滴水厚度 (cm)
try: drip_thickness = float(IN[6]) if len(IN) > 6 and IN[6] else 2.5
except: drip_thickness = 2.5

# IN[7]: 溝頭厚度 (cm)
try: wadang_thickness = float(IN[7]) if len(IN) > 7 and IN[7] else 4.0
except: wadang_thickness = 4.0

# IN[8]: 材質名稱
try: mat_name = IN[8] if len(IN) > 8 and IN[8] else "傳統青灰瓦"
except: mat_name = "傳統青灰瓦"
if not isinstance(mat_name, str): mat_name = "傳統青灰瓦"

debug_log = ["--- 妹妹的山牆邊緣勾頭滴水報告 (V3.2 輪廓重建版) ---"]
solids = []

# --- 2. 全自動讀取 000 選集 ---
collector = FilteredElementCollector(doc).OfClass(SelectionFilterElement)
sel_filter = None
for f in collector:
    if f.Name == "000":
        sel_filter = f
        break

roof_elements = []
if sel_filter is not None:
    roof_elements = [doc.GetElement(e_id) for e_id in sel_filter.GetElementIds()]
    debug_log.append("✨ [選集模式] 成功讀取 '000' 選集，載入 {} 個屋頂元件。".format(len(roof_elements)))
else:
    debug_log.append("❌ [錯誤] 找不到名為 '000' 的儲存選集！")

surfaces = []
for roof_element in roof_elements:
    if not roof_element: continue
    options = Options()
    options.ComputeReferences = True
    options.DetailLevel = ViewDetailLevel.Fine 
    geo_elem = roof_element.get_Geometry(options)
    
    if geo_elem is not None:
        def extract_revit_solids(geom_sel):
            res = []
            for g in geom_sel:
                if type(g).__name__ == "Solid" and g.Faces.Size > 0: res.append(g)
                elif type(g).__name__ == "GeometryInstance": res.extend(extract_revit_solids(g.GetInstanceGeometry()))
            return res
        
        native_solids = extract_revit_solids(geo_elem)
        for solid in native_solids:
            for f in solid.Faces:
                try:
                    # 嘗試標準直接轉換
                    proto_faces = f.ToProtoType()
                    if isinstance(proto_faces, list):
                        surfaces.extend(proto_faces)
                    else:
                        surfaces.append(proto_faces)
                except:
                    # 💡 V3.2 核心救磚備案：當頂面/底面因傳統屋頂弧度導致 ToProtoType 失敗時，利用 EdgeLoops 強行重建面！
                    try:
                        for loop in f.EdgeLoops:
                            curves = []
                            for edge in loop:
                                curves.append(edge.AsCurve().ToProtoType())
                            if curves:
                                joined_poly = PolyCurve.ByJoinedCurves(curves)
                                patched_srf = Surface.ByPatch(joined_poly)
                                surfaces.append(patched_srf)
                    except:
                        pass

# --- 3. 智慧比對與垂直面過濾 ---
roof_srf = None
if surfaces and edge_curve:
    mid_pt = edge_curve.PointAtParameter(0.5)
    scored_surfaces = []
    
    for srf in surfaces:
        try:
            dist = mid_pt.DistanceTo(srf)
            norm = srf.NormalAtParameter(0.5, 0.5)
            
            scored_surfaces.append({
                "srf": srf,
                "dist": dist,
                "normZ": norm.Z
            })
        except:
            pass
            
    # 過濾掉垂直面 (側牆面)
    valid_sloped_srfs = [item for item in scored_surfaces if abs(item["normZ"]) > 0.1]
    
    if valid_sloped_srfs:
        valid_sloped_srfs.sort(key=lambda x: x["dist"])
        roof_srf = valid_sloped_srfs[0]["srf"]
        debug_log.append("💡 成功解構出 {} 個面（含強行輪廓修補面）。過濾垂直面後剩餘 {} 個有效斜面。已完美鎖定主屋面！".format(len(scored_surfaces), len(valid_sloped_srfs)))
    else:
        debug_log.append("⚠️ [警告] 雖解析出 {} 個面，但過濾後未發現有效斜面。".format(len(scored_surfaces)))

if not roof_srf:
    debug_log.append("❌ [嚴重錯誤] 依舊無法匹配到有效的斜屋頂曲面，請檢查邊緣線與屋頂的相對位置。")

# --- 4. 幾何實體生成區 ---
if roof_srf and ref_plane_element and edge_curve:
    TransactionManager.Instance.EnsureInTransaction(doc)
    
    try:
        debug_log.append("🔍 運作參數: 深度={}cm | 直徑={}cm | 間距={}cm | 滴水厚={}cm | 溝頭厚={}cm".format(depth, tile_diameter, spacing, drip_thickness, wadang_thickness))
        
        if edge_curve.StartPoint.Z < edge_curve.EndPoint.Z:
            edge_curve = edge_curve.Reverse()
            
        total_len = edge_curve.Length
        target_len = total_len * ratio
        
        num_tiles = int(math.floor(target_len / spacing))
        if num_tiles < 1: num_tiles = 1
        actual_spacing = target_len / num_tiles
        
        pts = []
        for i in range(num_tiles + 1):
            l = i * actual_spacing
            if l > total_len: l = total_len
            pts.append(edge_curve.PointAtSegmentLength(l))
            
        # --- 5. 智慧向內探測雷達 ---
        base_plane = ref_plane_element.GetPlane().ToPlane()
        v_ref = base_plane.Normal 
        
        mid_pt = edge_curve.PointAtParameter(0.5)
        p_test_pos = mid_pt.Translate(v_ref, 50.0)
        p_test_neg = mid_pt.Translate(v_ref.Reverse(), 50.0)
        
        dist_pos = p_test_pos.DistanceTo(roof_srf)
        dist_neg = p_test_neg.DistanceTo(roof_srf)
        v_in = v_ref if dist_pos < dist_neg else v_ref.Reverse()
            
        debug_log.append("📡 智慧內部探測雷達鎖定成功！")

        success_count = 0
        for i in range(len(pts)):
            try:
                pA = pts[i]
                
                # 🛠️ 1. 生成客製厚度勾頭 (Wadang)
                planeA = Plane.ByOriginNormal(pA, v_in)
                circleA = Circle.ByPlaneRadius(planeA, tile_radius)
                
                wadang_head = circleA.ExtrudeAsSolid(v_in.Reverse(), wadang_thickness)
                solids.append(wadang_head)
                
                line_body = Line.ByStartPointDirectionLength(pA, v_in, depth)
                wadang_body = Solid.BySweep(circleA, line_body)
                solids.append(wadang_body)
                
                # 🛠️ 2. 生成客製厚度滴水 (Drip)
                if i < len(pts) - 1:
                    pB = pts[i+1]
                    vec_AB = Vector.ByTwoPoints(pA, pB)
                    v_down = vec_AB.Cross(v_in).Normalized()
                    if v_down.Z > 0: v_down = v_down.Reverse()
                    
                    R_arc = 1.5 * spacing
                    drop = tile_radius * 2.0
                    
                    pM = Point.ByCoordinates((pA.X+pB.X)/2, (pA.Y+pB.Y)/2, (pA.Z+pB.Z)/2)
                    pC = pM.Translate(v_down, drop)
                    
                    dist_AB = pA.DistanceTo(pB)
                    if R_arc > dist_AB / 2.0:
                        h_T = R_arc - math.sqrt(R_arc**2 - (dist_AB / 2.0)**2)
                        pT = pM.Translate(v_down, h_T)
                    else: pT = pM
                    
                    vec_AC = Vector.ByTwoPoints(pA, pC)
                    L_AC = vec_AC.Length
                    pM_AC = Point.ByCoordinates((pA.X+pC.X)/2, (pA.Y+pC.Y)/2, (pA.Z+pC.Z)/2)
                    N_AC = vec_AC.Cross(v_in).Normalized()
                    dir_left = Vector.ByCoordinates(-vec_AB.X + v_down.X, -vec_AB.Y + v_down.Y, -vec_AB.Z + v_down.Z)
                    if N_AC.Dot(dir_left) < 0: N_AC = N_AC.Reverse()
                    
                    if R_arc > L_AC / 2.0:
                        h_AC = R_arc - math.sqrt(R_arc**2 - (L_AC / 2.0)**2)
                        pL = pM_AC.Translate(N_AC, h_AC)
                    else: pL = pM_AC
                    
                    vec_CB = Vector.ByTwoPoints(pC, pB)
                    L_CB = vec_CB.Length
                    pM_CB = Point.ByCoordinates((pC.X+pB.X)/2, (pC.Y+pB.Y)/2, (pC.Z+pB.Z)/2)
                    N_CB = vec_CB.Cross(v_in).Normalized()
                    dir_right = Vector.ByCoordinates(vec_AB.X + v_down.X, vec_AB.Y + v_down.Y, vec_AB.Z + v_down.Z)
                    if N_CB.Dot(dir_right) < 0: N_CB = N_CB.Reverse()
                    
                    if R_arc > L_CB / 2.0:
                        h_CB = R_arc - math.sqrt(R_arc**2 - (L_CB / 2.0)**2)
                        pR = pM_CB.Translate(N_CB, h_CB)
                    else: pR = pM_CB
                    
                    arc1 = Arc.ByThreePoints(pA, pT, pB)
                    arc2 = Arc.ByThreePoints(pB, pR, pC)
                    arc3 = Arc.ByThreePoints(pC, pL, pA)
                    drip_profile = PolyCurve.ByJoinedCurves([arc1, arc2, arc3])
                    
                    drip_head = drip_profile.ExtrudeAsSolid(v_in.Reverse(), drip_thickness)
                    solids.append(drip_head)
                    drip_body = drip_profile.ExtrudeAsSolid(v_in, depth)
                    solids.append(drip_body)
                    
                success_count += 1
            except: pass
            
        debug_log.append("🌟 成功生成 {} 組客製山牆收邊勾頭與滴水元件！".format(success_count))
        
        # --- 5. 材質指定與寫入 Revit ---
        mat_id = ElementId.InvalidElementId
        mat_collector = FilteredElementCollector(doc).OfClass(Material)
        for m in mat_collector:
            if m.Name == mat_name:
                mat_id = m.Id
                break
        if mat_id == ElementId.InvalidElementId:
            try:
                mat_id = Material.Create(doc, mat_name)
                new_mat = doc.GetElement(mat_id)
                new_mat.Color = Color(100, 100, 100) 
            except: pass

        revit_elements = []
        cat_id = ElementId(BuiltInCategory.OST_Roofs) 

        for d_solid in solids:
            if d_solid is None or isinstance(d_solid, str): continue
            try:
                r_geom = d_solid.ToRevitType()
                geom_list = List[GeometryObject]()
                if isinstance(r_geom, list) or type(r_geom).__name__ in ["Array[GeometryObject]", "tuple"]:
                    for g in r_geom: 
                        if mat_id != ElementId.InvalidElementId and hasattr(g, "MaterialId"): g.MaterialId = mat_id
                        geom_list.Add(g)
                else: 
                    if mat_id != ElementId.InvalidElementId and hasattr(r_geom, "MaterialId"): r_geom.MaterialId = mat_id
                    geom_list.Add(r_geom)
                    
                ds = DirectShape.CreateElement(doc, cat_id)
                ds.SetShape(geom_list)
                ds.Name = "Traditional_Edge_Tiles_V3_2"
                revit_elements.append(ds)
            except: pass

        group_element = None
        if revit_elements:
            id_list = List[ElementId]()
            for el in revit_elements: id_list.Add(el.Id)
            try:
                group_element = doc.Create.NewGroup(id_list)
                group_element.GroupType.Name = "山牆邊緣收邊瓦_V3_2_" + str(int(time.time())) 
            except: pass

        TransactionManager.Instance.TransactionTaskDone()
        OUT = [revit_elements if group_element is None else group_element, debug_log]

    except Exception as e:
        TransactionManager.Instance.TransactionTaskDone()
        OUT = ["❌ 發生錯誤: " + str(e), debug_log]
else:
    OUT = ["⚠️ 請確認輸入參數，且 Revit 內已建立 '000' 選集。", debug_log]
# ----------------------------------------
watch = Watch(python_script)  # graph output
說明 = StringInput("""當FACE選面失敗時執行本功能
選一個或幾個屋頂做成000選集然後再選一個參考平面做洩水的方向
定一條邊緣畫出圓形條狀的筒瓦
""")  # graph input
