# Dynamo graph 建築-屋頂人字溝頭滴水垂脊收邊-FACE.dyn "建築-屋頂人字垂脊收邊-FACE" (Dynamo 3.6.2.11575)

選你要放瓦的屋頂FACE = SelectFaces()  # "1.選你要放瓦的屋頂FACE"; 1 picked in the model; graph input
flatten = List.Flatten(list=選你要放瓦的屋頂FACE)
n2_洩水分線_選參考平面 = DSModelElementSelection()  # "2.洩水分線-選參考平面"; 1 picked in the model; graph input
選垂脊邊線 = DSEdgeSelection()  # "3.選垂脊邊線"; 1 picked in the model; graph input
溝頭長度 = DoubleInput(20)  # "4.溝頭長度"; graph input
n5_製作_1為全部 = DoubleInput(1)  # "5.製作%..1為全部"; graph input
筒瓦直徑 = DoubleInput(7)  # "6.筒瓦直徑"; graph input
筒瓦中心間距 = DoubleInput(20)  # "7.筒瓦中心間距"; graph input
滴水厚度 = DoubleInput(3)  # "8.滴水厚度"; graph input
瓦當厚度 = DoubleInput(2)  # "9.瓦當厚度"; graph input
材質 = StringInput("傳統清灰瓦")  # "10.材質"; graph input
python_script = Python(IN[0]=flatten, IN[1]=n2_洩水分線_選參考平面, IN[2]=選垂脊邊線, IN[3]=溝頭長度, IN[4]=n5_製作_1為全部, IN[5]=筒瓦直徑, IN[6]=筒瓦中心間距, IN[7]=滴水厚度, IN[8]=瓦當厚度, IN[9]=材質)  # CPython3
# ---------- python_script.python (268 lines) ----------
import clr
import System
import math
import time
from System.Collections.Generic import List

clr.AddReference('RevitAPI')
import Autodesk
from Autodesk.Revit.DB import *

clr.AddReference('ProtoGeometry')
from Autodesk.DesignScript.Geometry import *

clr.AddReference('RevitNodes')
import Revit
clr.ImportExtensions(Revit.Elements)
clr.ImportExtensions(Revit.GeometryConversion)

clr.AddReference('RevitServices')
import RevitServices
from RevitServices.Persistence import DocumentManager
from RevitServices.Transactions import TransactionManager

doc = DocumentManager.Instance.CurrentDBDocument

def flatten_list(lst):
    result = []
    for i in lst:
        if isinstance(i, list) or type(i).__name__ == 'list':
            result.extend(flatten_list(i))
        else:
            result.append(i)
    return result

# --- 1. 取得所有輸入參數 ---
# IN[0]: 屋頂曲面 (Surface)
in0 = flatten_list(IN[0] if isinstance(IN[0], list) else [IN[0]])
roof_srf = in0[0] if in0 else None

# IN[1]: 洩水方向參考平面
try: ref_plane_element = UnwrapElement(IN[1])
except: ref_plane_element = None

# IN[2]: 邊緣線 (Curve)
in2 = flatten_list(IN[2] if isinstance(IN[2], list) else [IN[2]])
edge_curve = in2[0] if in2 else None
if hasattr(edge_curve, "GeometryCurve"):
    edge_curve = edge_curve.GeometryCurve

# IN[3]: 深度距離 (cm)
try: depth = float(IN[3])
except: depth = 60.0

# IN[4]: 長度比例 (0.0 ~ 1.0)
try: ratio = float(IN[4])
except: ratio = 0.9
if ratio > 1.0: ratio = ratio / 100.0
if ratio <= 0.0 or ratio > 1.0: ratio = 1.0

# IN[5]: 溝頭的直徑 (cm)
try: tile_diameter = float(IN[5])
except: tile_diameter = 12.0
tile_radius = tile_diameter / 2.0

# IN[6]: 兩溝頭間的間距 (cm)
try: spacing = float(IN[6])
except: spacing = 15.0
if spacing <= 0: spacing = 15.0

# 💡 IN[7]: 滴水厚度 (cm)
try: drip_thickness = float(IN[7]) if len(IN) > 7 and IN[7] else 2.5
except: drip_thickness = 2.5

# 💡 IN[8]: 溝頭厚度 (cm)
try: wadang_thickness = float(IN[8]) if len(IN) > 8 and IN[8] else 4.0
except: wadang_thickness = 4.0

# 💡 IN[9]: 材質名稱
try: mat_name = IN[9] if len(IN) > 9 and IN[9] else "傳統青灰瓦"
except: mat_name = "傳統青灰瓦"
if not isinstance(mat_name, str): mat_name = "傳統青灰瓦"

debug_log = ["--- 妹妹的山牆邊緣勾頭滴水報告 ---"]
solids = []

if roof_srf and ref_plane_element and edge_curve:
    TransactionManager.Instance.EnsureInTransaction(doc)
    
    try:
        debug_log.append("🔍 參數: 深度={} | 直徑={} | 間距={} | 滴水厚={} | 溝頭厚={}".format(depth, tile_diameter, spacing, drip_thickness, wadang_thickness))
        
        # --- 2. 處理邊緣曲線與比例 ---
        # 確保曲線是從高處(屋脊)往低處(屋簷)走
        if edge_curve.StartPoint.Z < edge_curve.EndPoint.Z:
            edge_curve = edge_curve.Reverse()
            
        total_len = edge_curve.Length
        target_len = total_len * ratio
        
        # 使用 Fuzzy 絕對弧長均分法，算出每個瓦當的精準座標點
        num_tiles = int(math.floor(target_len / spacing))
        if num_tiles < 1: num_tiles = 1
        actual_spacing = target_len / num_tiles
        
        pts = []
        for i in range(num_tiles + 1):
            l = i * actual_spacing
            if l > total_len: l = total_len
            pts.append(edge_curve.PointAtSegmentLength(l))
            
        debug_log.append("📏 邊緣總長: {:.1f}cm, 目標比例: {}, 生成瓦當數量: {}".format(total_len, ratio, len(pts)))

        # --- 3. 智慧向內探測雷達 (判斷往左長還是往右長) ---
        base_plane = ref_plane_element.GetPlane().ToPlane()
        v_ref = base_plane.Normal 
        
        mid_pt = edge_curve.PointAtParameter(0.5)
        
        p_test_pos = mid_pt.Translate(v_ref, 50.0)
        p_test_neg = mid_pt.Translate(v_ref.Reverse(), 50.0)
        
        dist_pos = p_test_pos.DistanceTo(roof_srf.ClosestPointTo(p_test_pos))
        dist_neg = p_test_neg.DistanceTo(roof_srf.ClosestPointTo(p_test_neg))
        
        if dist_pos < dist_neg:
            v_in = v_ref
        else:
            v_in = v_ref.Reverse()
            
        debug_log.append("📡 智慧雷達已鎖定屋頂內部方向！")

        # --- 4. 生成勾頭與滴水幾何實體 ---
        success_count = 0
        for i in range(len(pts)):
            try:
                pA = pts[i]
                uvA = roof_srf.UVParameterAtPoint(pA)
                upA = roof_srf.NormalAtParameter(uvA.U, uvA.V) 
                
                # 🛠️ 生成勾頭 (Wadang)
                planeA = Plane.ByOriginNormal(pA, v_in)
                circleA = Circle.ByPlaneRadius(planeA, tile_radius)
                
                # 💡 勾頭蓋(瓦當)套用 IN[8] 厚度
                wadang_head = circleA.ExtrudeAsSolid(v_in.Reverse(), wadang_thickness)
                solids.append(wadang_head)
                
                line_body = Line.ByStartPointDirectionLength(pA, v_in, depth)
                wadang_body = Solid.BySweep(circleA, line_body)
                solids.append(wadang_body)
                
                # 🛠️ 生成滴水 (Drip)
                if i < len(pts) - 1:
                    pB = pts[i+1]
                    uvB = roof_srf.UVParameterAtPoint(pB)
                    upB = roof_srf.NormalAtParameter(uvB.U, uvB.V)
                    
                    vec_AB = Vector.ByTwoPoints(pA, pB)
                    
                    v_down = vec_AB.Cross(v_in).Normalized()
                    if v_down.Z > 0: v_down = v_down.Reverse()
                    
                    R_arc = 1.5 * spacing
                    drop = tile_radius * 2.0
                    
                    pM = Point.ByCoordinates((pA.X+pB.X)/2, (pA.Y+pB.Y)/2, (pA.Z+pB.Z)/2)
                    pC = pM.Translate(v_down, drop)
                    
                    dist_AB = pA.DistanceTo(pB)
                    if R_arc > dist_AB / 2.0:
                        h_T = R_arc - math.sqrt(R_arc**2 - (dist_AB / 2.0)**2)
                        pT = pM.Translate(v_down, h_T)
                    else: pT = pM
                    
                    vec_AC = Vector.ByTwoPoints(pA, pC)
                    L_AC = vec_AC.Length
                    pM_AC = Point.ByCoordinates((pA.X+pC.X)/2, (pA.Y+pC.Y)/2, (pA.Z+pC.Z)/2)
                    N_AC = vec_AC.Cross(v_in).Normalized()
                    dir_left = Vector.ByCoordinates(-vec_AB.X + v_down.X, -vec_AB.Y + v_down.Y, -vec_AB.Z + v_down.Z)
                    if N_AC.Dot(dir_left) < 0: N_AC = N_AC.Reverse()
                    
                    if R_arc > L_AC / 2.0:
                        h_AC = R_arc - math.sqrt(R_arc**2 - (L_AC / 2.0)**2)
                        pL = pM_AC.Translate(N_AC, h_AC)
                    else: pL = pM_AC
                    
                    vec_CB = Vector.ByTwoPoints(pC, pB)
                    L_CB = vec_CB.Length
                    pM_CB = Point.ByCoordinates((pC.X+pB.X)/2, (pC.Y+pB.Y)/2, (pC.Z+pB.Z)/2)
                    N_CB = vec_CB.Cross(v_in).Normalized()
                    dir_right = Vector.ByCoordinates(vec_AB.X + v_down.X, vec_AB.Y + v_down.Y, vec_AB.Z + v_down.Z)
                    if N_CB.Dot(dir_right) < 0: N_CB = N_CB.Reverse()
                    
                    if R_arc > L_CB / 2.0:
                        h_CB = R_arc - math.sqrt(R_arc**2 - (L_CB / 2.0)**2)
                        pR = pM_CB.Translate(N_CB, h_CB)
                    else: pR = pM_CB
                    
                    arc1 = Arc.ByThreePoints(pA, pT, pB)
                    arc2 = Arc.ByThreePoints(pB, pR, pC)
                    arc3 = Arc.ByThreePoints(pC, pL, pA)
                    drip_profile = PolyCurve.ByJoinedCurves([arc1, arc2, arc3])
                    
                    # 💡 滴水片(花邊)套用 IN[7] 厚度
                    drip_head = drip_profile.ExtrudeAsSolid(v_in.Reverse(), drip_thickness)
                    solids.append(drip_head)
                    
                    drip_body = drip_profile.ExtrudeAsSolid(v_in, depth)
                    solids.append(drip_body)
                    
                success_count += 1
            except Exception as e: pass
            
        debug_log.append("🌟 成功生成 {} 組客製厚度的邊緣勾頭與滴水！".format(success_count))
        
        # --- 5. 處理材質與寫入 Revit ---
        mat_id = ElementId.InvalidElementId
        mat_collector = FilteredElementCollector(doc).OfClass(Material)
        for m in mat_collector:
            if m.Name == mat_name:
                mat_id = m.Id
                break
        if mat_id == ElementId.InvalidElementId:
            try:
                mat_id = Material.Create(doc, mat_name)
                new_mat = doc.GetElement(mat_id)
                new_mat.Color = Color(100, 100, 100) 
            except: pass

        revit_elements = []
        cat_id = ElementId(BuiltInCategory.OST_Roofs) 

        for d_solid in solids:
            if d_solid is None or isinstance(d_solid, str): continue
            try:
                r_geom = d_solid.ToRevitType()
                geom_list = List[GeometryObject]()
                if isinstance(r_geom, list) or type(r_geom).__name__ in ["Array[GeometryObject]", "tuple"]:
                    for g in r_geom: 
                        if mat_id != ElementId.InvalidElementId and hasattr(g, "MaterialId"): g.MaterialId = mat_id
                        geom_list.Add(g)
                else: 
                    if mat_id != ElementId.InvalidElementId and hasattr(r_geom, "MaterialId"): r_geom.MaterialId = mat_id
                    geom_list.Add(r_geom)
                    
                ds = DirectShape.CreateElement(doc, cat_id)
                ds.SetShape(geom_list)
                ds.Name = "Traditional_Edge_Tiles"
                revit_elements.append(ds)
            except: pass

        group_element = None
        if revit_elements:
            id_list = List[ElementId]()
            for el in revit_elements: id_list.Add(el.Id)
            try:
                group_element = doc.Create.NewGroup(id_list)
                group_element.GroupType.Name = "山牆邊緣收邊瓦_" + str(int(time.time())) 
            except: pass

        TransactionManager.Instance.TransactionTaskDone()
        OUT = [revit_elements if group_element is None else group_element, debug_log]

    except Exception as e:
        TransactionManager.Instance.TransactionTaskDone()
        OUT = ["❌ 發生錯誤: " + str(e), debug_log]
else:
    OUT = ["⚠️ 請確認 IN[0]屋頂曲面、IN[1]參考平面、IN[2]邊緣線 皆已正確輸入。", debug_log]
# ----------------------------------------
watch = Watch(python_script)  # graph output
說明 = StringInput("選幾個屋頂的表面FACE然後再選一個參考平面做洩水的方向畫出圓形條狀的筒瓦\n")  # graph input
