# Dynamo graph 建築-屋頂加各形式屋脊.dyn "建築-屋頂加個形式屋脊" (Dynamo 3.6.2.11575)

選一條鞭界線 = DSEdgeSelection()  # "1.選一條鞭界線"; 1 picked in the model; graph input
boolean = BoolSelector(true)  # graph input
string = StringInput("\"正脊\",\"垂脊\",\"戧脊\",\"圍脊\",\"博脊\"")  # graph input
python_script = Python(IN[0]=boolean, IN[1]=string)  # CPython3
# ---------- python_script.python (85 lines) ----------
import clr
# 載入 Windows 原生的 Forms 與 Drawing 模組 (不需安裝任何套件)
clr.AddReference("System.Windows.Forms")
clr.AddReference("System.Drawing")

import System.Windows.Forms as WinForms
from System.Drawing import Point, Size

# 定義我們自己的彈出視窗類別
class DropdownForm(WinForms.Form):
    def __init__(self, options):
        # 視窗基本設定
        self.Text = "交通標線選擇器"
        self.Width = 320
        self.Height = 180
        self.StartPosition = WinForms.FormStartPosition.CenterScreen
        self.MaximizeBox = False
        self.MinimizeBox = False
        self.FormBorderStyle = WinForms.FormBorderStyle.FixedDialog
        self.TopMost = True # 確保視窗保持在最上層，不會被 Revit 擋住
        
        # 建立標籤 (Label)
        self.label = WinForms.Label()
        self.label.Text = "請選擇要繪製的標線類型："
        self.label.Location = Point(20, 20)
        self.label.AutoSize = True
        
        # 建立下拉選單 (ComboBox)
        self.combo = WinForms.ComboBox()
        self.combo.Location = Point(20, 50)
        self.combo.Width = 260
        self.combo.DropDownStyle = WinForms.ComboBoxStyle.DropDownList # 限制只能下拉，不能亂輸入
        
        # 將選項加入 ComboBox (使用迴圈確保相容於 IronPython 與 CPython3)
        for opt in options:
            self.combo.Items.Add(opt)
        
        # 預設選擇第一個項目
        if self.combo.Items.Count > 0:
            self.combo.SelectedIndex = 0
            
        # 建立確定按鈕 (Button)
        self.btn = WinForms.Button()
        self.btn.Text = "確認選取"
        self.btn.Location = Point(180, 95)
        self.btn.Width = 100
        self.btn.Click += self.button_clicked # 綁定點擊事件
        
        # 將控制項加入視窗
        self.Controls.Add(self.label)
        self.Controls.Add(self.combo)
        self.Controls.Add(self.btn)
        
        # 儲存結果的變數
        self.selected_value = None
        
    def button_clicked(self, sender, args):
        # 按下按鈕後，記錄選到的值並關閉視窗
        self.selected_value = self.combo.SelectedItem
        self.Close()

# --- 主程式執行區 ---

# IN[0] 作為觸發開關
run_it = IN[0] 

# IN[1] 接收外部清單，如果沒有接，就給預設值
if isinstance(IN[1], list) and len(IN[1]) > 0:
    line_options = IN[1]
else:
    line_options = [
        "正脊", "垂脊", "戧脊", "圍脊", "博脊"
    ]

# 判斷是否彈出視窗
if run_it:
    # 實體化視窗
    form = DropdownForm(line_options)
    # 使用 ShowDialog() 阻塞執行，直到使用者選完關閉視窗
    form.ShowDialog()
    
    # 輸出選取結果
    OUT = form.selected_value
else:
    OUT = "請將 IN[0] 切換為 True 以開啟選單"
# ----------------------------------------
比例 = DoubleInput(0.75)  # "3.比例"; graph input
n4_開始位置0為原起點0_1為縮短1_10_0 = DoubleInput(0)  # "4.開始位置0為原起點0.1為縮短1/10，-0.1唯一最後髮線延長1/10"; graph input
n5_結束位置1為結束點0_9為縮短1_10_1 = DoubleInput(1)  # "5.]結束位置1為結束點0.9為縮短1/10，1.1依最後方向線延長1/10"; graph input
材質名稱 = StringInput("屋頂")  # "6.材質名稱"; graph input
byName = Material.ByName(name=材質名稱)
python_script_2 = Python(IN[0]=選一條鞭界線, IN[1]=python_script, IN[2]=比例, IN[3]=n4_開始位置0為原起點0_1為縮短1_10_0, IN[4]=n5_結束位置1為結束點0_9為縮短1_10_1, IN[5]=byName)  # CPython3
# ---------- python_script_2.python (172 lines) ----------
# ==============================================================================
# 腳本名稱: 傳統建築中式屋脊 BIM 參數化生成器 (Dynamo to Revit API)
# 版本編號: VER: 2026.07-V11.0-FINAL (絕對零三角形·純 B-Rep 平滑實體終極版)
# 開發對象: 小明專屬 / 徹底拋棄 Dynamo 材質節點，保證 0% 三角碎線、線條完美流暢
# ==============================================================================

import clr
import sys

# 0. 引入 .NET 泛型列表
from System.Collections.Generic import List

# 1. 引入 Dynamo 幾何庫
clr.AddReference('ProtoGeometry')
from Autodesk.DesignScript.Geometry import *

# 2. 引入 Revit 節點與幾何擴充庫
clr.AddReference("RevitNodes")
import Revit
clr.ImportExtensions(Revit.GeometryConversion)
clr.ImportExtensions(Revit.Elements)

# 3. 引入 Revit API 核心庫 (絕對不碰任何會導致 Mesh 的材質封裝)
clr.AddReference("RevitAPI")
from Autodesk.Revit.DB import BuiltInCategory, ElementId, DirectShape, GeometryObject

# 4. 引入 Revit 交易與文件管理工具
clr.AddReference("RevitServices")
from RevitServices.Persistence import DocumentManager
from RevitServices.Transactions import TransactionManager

# ==============================================================================
# [輸入區] 讀取 Dynamo 前端參數
# ==============================================================================
if isinstance(IN[0], list):
    curves = IN[0]
elif IN[0] is not None:
    curves = [IN[0]]
else:
    curves = []

ridge_input = IN[1]
if isinstance(ridge_input, list):
    ridge_type = ridge_input[0] if (len(ridge_input) > 0 and isinstance(ridge_input[0], str)) else "垂脊"
elif isinstance(ridge_input, str):
    ridge_type = ridge_input
else:
    ridge_type = "垂脊"

scale = IN[2] if (IN[2] is not None and IN[2] > 0) else 1.0
t_start = IN[3] if (len(IN) > 3 and IN[3] is not None) else 0.0
t_end   = IN[4] if (len(IN) > 4 and IN[4] is not None) else 1.0

# ==============================================================================
# [資料庫] 傳統屋脊標準尺寸查表 (單位: cm)
# ==============================================================================
ridge_db = {
    "正脊": {"bw": 50, "mw": 40, "tw": 30, "h": 90},
    "垂脊": {"bw": 40, "mw": 30, "tw": 20, "h": 60},
    "戧脊": {"bw": 35, "mw": 26, "tw": 18, "h": 50},
    "圍脊": {"bw": 35, "mw": 26, "tw": 20, "h": 45},
    "博脊": {"bw": 30, "mw": 22, "tw": 16, "h": 40}
}

dim = ridge_db.get(ridge_type, ridge_db["垂脊"])
bw = dim["bw"] * scale
mw = dim["mw"] * scale
tw = dim["tw"] * scale
h  = dim["h"] * scale

generated_solids = []
world_z = Vector.ByCoordinates(0, 0, 1)

# ==============================================================================
# [運算區 1] 解析幾何一體純化 (維護絕對平滑軌跡)
# ==============================================================================
for crv in curves:
    if crv is None:
        continue
    
    crv_length = crv.Length
    if crv_length < 0.01:
        continue
    
    start_pt = crv.StartPoint
    end_pt   = crv.EndPoint
    chord_len = start_pt.DistanceTo(end_pt)
    
    if abs(crv_length - chord_len) < (crv_length * 0.001) or isinstance(crv, Line):
        tan_start = crv.TangentAtParameter(0.0).Normalized()
        tan_end   = crv.TangentAtParameter(1.0).Normalized()
        
        if t_start < 0.0:
            pure_start = start_pt.Subtract(tan_start.Scale(abs(t_start) * crv_length))
        else:
            pure_start = crv.PointAtParameter(min(t_start, 1.0))
            
        if t_end > 1.0:
            pure_end = end_pt.Add(tan_end.Scale((t_end - 1.0) * crv_length))
        else:
            pure_end = crv.PointAtParameter(max(t_end, 0.0))
            
        new_path = Line.ByStartPointEndPoint(pure_start, pure_end)
    else:
        sample_pts = [crv.PointAtParameter(i / 35.0) for i in range(36)]
        new_path = NurbsCurve.ByPoints(sample_pts, 3)
        
    pts = [
        Point.ByCoordinates(-bw/2, 0, 0),
        Point.ByCoordinates(-mw/2, h*0.3, 0),
        Point.ByCoordinates(-tw/2, h, 0),
        Point.ByCoordinates(tw/2, h, 0),
        Point.ByCoordinates(mw/2, h*0.3, 0),
        Point.ByCoordinates(bw/2, 0, 0)
    ]
    profile_poly = Polygon.ByPoints(pts)
    tangent = new_path.TangentAtParameter(0)
    
    if abs(tangent.Z) > 0.999:
        right_vec = tangent.Cross(Vector.ByCoordinates(1, 0, 0)).Normalized()
    else:
        right_vec = world_z.Cross(tangent).Normalized()
        
    up_vec = tangent.Cross(right_vec).Normalized()
    corrected_cs = CoordinateSystem.ByOriginVectors(new_path.StartPoint, right_vec, up_vec)
    oriented_profile = profile_poly.Transform(CoordinateSystem.Identity(), corrected_cs)
    
    ridge_solid = Solid.BySweep(oriented_profile, new_path)
    if ridge_solid is not None:
        generated_solids.append(ridge_solid)

# ==============================================================================
# [運算區 2] 純 Revit API 平滑烘焙 (100% 拒絕網格化，還原完美 B-Rep 外框)
# ==============================================================================
doc = DocumentManager.Instance.CurrentDBDocument
revit_baked_elements = []

TransactionManager.Instance.EnsureInTransaction(doc)
cat_id = ElementId(BuiltInCategory.OST_Roofs)

for sol in generated_solids:
    if sol is None:
        continue
    try:
        revit_geom = sol.ToRevitType()
        if revit_geom is None:
            continue
            
        geom_list = List[GeometryObject]()
        if hasattr(revit_geom, "__iter__"):
            for g in revit_geom:
                geom_list.Add(g)
        else:
            geom_list.Add(revit_geom)
        
        # 建立最純淨的 DirectShape B-Rep 實體，絕不觸發網格化
        ds = DirectShape.CreateElement(doc, cat_id)
        ds.ApplicationId = "Dynamo_Traditional_Ridge_V11.0"
        ds.ApplicationDataId = ridge_type
        ds.Name = f"傳統屋脊_{ridge_type}"
        ds.SetShape(geom_list)
        
        revit_baked_elements.append(ds)
    except Exception as e:
        revit_baked_elements.append(f"建立失敗: {str(e)}")

TransactionManager.Instance.TransactionTaskDone()

# ==============================================================================
# [輸出] 傳回 Revit 實體
# ==============================================================================
OUT = revit_baked_elements
# ----------------------------------------
watch = Watch(python_script_2)  # graph output
說明 = StringInput("")  # graph input
watch_2 = Watch(選一條鞭界線)
