# Dynamo graph 建築-屋頂加圓筒瓦溝頭滴水-FACE.dyn "建築-屋頂加圓筒瓦-FACE" (Dynamo 3.6.2.11575)

選你要放瓦的屋頂FACE = SelectFaces()  # "1.選你要放瓦的屋頂FACE"; 1 picked in the model; graph input
flatten = List.Flatten(list=選你要放瓦的屋頂FACE)
筒瓦半徑 = DoubleInput(5)  # "3.筒瓦半徑"; graph input
筒瓦中心間距 = DoubleInput(28)  # "4.筒瓦中心間距"; graph input
n2_洩水分線_選參考平面 = DSModelElementSelection()  # "2.洩水分線-選參考平面"; 1 picked in the model; graph input
滴水厚度 = DoubleInput(2)  # "5.滴水厚度"; graph input
瓦當厚度 = DoubleInput(2)  # "6.瓦當厚度"; graph input
材質 = StringInput("傳統清灰瓦")  # "7.材質"; graph input
python_script = Python(IN[0]=flatten, IN[1]=筒瓦半徑, IN[2]=筒瓦中心間距, IN[3]=n2_洩水分線_選參考平面, IN[4]=滴水厚度, IN[5]=瓦當厚度, IN[6]=材質)  # CPython3
# ---------- python_script.python (270 lines) ----------
import clr
import System
import math
import time
from System.Collections.Generic import List

clr.AddReference('RevitAPI')
from Autodesk.Revit.DB import *

clr.AddReference('ProtoGeometry')
from Autodesk.DesignScript.Geometry import *

clr.AddReference('RevitNodes')
import Revit
clr.ImportExtensions(Revit.Elements)
clr.ImportExtensions(Revit.GeometryConversion)

clr.AddReference('RevitServices')
import RevitServices
from RevitServices.Persistence import DocumentManager
from RevitServices.Transactions import TransactionManager

doc = DocumentManager.Instance.CurrentDBDocument

def flatten_list(lst):
    result = []
    for i in lst:
        if isinstance(i, list) or type(i).__name__ == 'list':
            result.extend(flatten_list(i))
        else:
            result.append(i)
    return result

def get_midpoint(p1, p2):
    return Point.ByCoordinates((p1.X+p2.X)/2.0, (p1.Y+p2.Y)/2.0, (p1.Z+p2.Z)/2.0)

def add_vec(v1, v2):
    return Vector.ByCoordinates(v1.X+v2.X, v1.Y+v2.Y, v1.Z+v2.Z)

# --- 1. 取得所有輸入參數 ---
surfaces = flatten_list(IN[0] if isinstance(IN[0], list) else [IN[0]])
radius = float(IN[1])
spacing = float(IN[2])
ref_plane_element = UnwrapElement(IN[3])
drip_thick = float(IN[4])
wadang_thick = float(IN[5])
extend_len = drip_thick + wadang_thick
mat_name = IN[6] if len(IN) > 6 and IN[6] else "傳統青灰瓦"

if spacing <= 0: spacing = 28.0

solids = []

TransactionManager.Instance.EnsureInTransaction(doc)

# --- 2. 處理材質 ---
mat_id = ElementId.InvalidElementId
collector = FilteredElementCollector(doc).OfClass(Material)
for m in collector:
    if m.Name == mat_name:
        mat_id = m.Id
        break
if mat_id == ElementId.InvalidElementId:
    try:
        mat_id = Material.Create(doc, mat_name)
        new_mat = doc.GetElement(mat_id)
        new_mat.Color = Color(100, 100, 100)
    except: pass

# --- 3. 計算參考平面與陣列 ---
try:
    revit_plane = ref_plane_element.GetPlane()
    base_plane = revit_plane.ToPlane()
    plane_normal = base_plane.Normal
    
    min_pts, max_pts = [], []
    for srf in surfaces:
        if srf is not None:
            bbox = srf.BoundingBox
            min_pts.append(bbox.MinPoint)
            max_pts.append(bbox.MaxPoint)
            
    if min_pts:
        min_x, min_y, min_z = min([p.X for p in min_pts]), min([p.Y for p in min_pts]), min([p.Z for p in min_pts])
        max_x, max_y, max_z = max([p.X for p in max_pts]), max([p.Y for p in max_pts]), max([p.Z for p in max_pts])
        corners = [
            Point.ByCoordinates(min_x, min_y, min_z), Point.ByCoordinates(max_x, min_y, min_z),
            Point.ByCoordinates(max_x, max_y, min_z), Point.ByCoordinates(min_x, max_y, min_z),
            Point.ByCoordinates(min_x, min_y, max_z), Point.ByCoordinates(max_x, min_y, max_z),
            Point.ByCoordinates(max_x, max_y, max_z), Point.ByCoordinates(min_x, max_y, max_z)
        ]
        
        max_dist, min_dist = 0.0, 0.0
        for pt in corners:
            vec = Vector.ByTwoPoints(base_plane.Origin, pt)
            dist = vec.Dot(plane_normal)
            if dist > max_dist: max_dist = dist
            if dist < min_dist: min_dist = dist
            
        # 💡 妹妹的檢核機制：將所有距離先收集起來，強制排序！
        d_values = []
        d = 0.0
        while d <= max_dist + spacing:
            d_values.append(d)
            d += spacing
        d = -spacing
        while d >= min_dist - spacing:
            d_values.append(d)
            d -= spacing
            
        d_values.sort() # <--- 這是保證不缺牙的關鍵！由小到大絕對排序
        
        cutting_planes = []
        for d in d_values:
            vec_offset = plane_normal.Scale(d)
            new_origin = base_plane.Origin.Translate(vec_offset)
            cutting_planes.append(Plane.ByOriginNormal(new_origin, plane_normal))
            
        # --- 4. 產生圓柱筒瓦與滴水 ---
        for srf in surfaces:
            if srf is None: continue
            
            srf_curves = [] 
            for cp in cutting_planes:
                intersections = srf.Intersect(cp)
                try: intersections = list(intersections) if not isinstance(intersections, list) else intersections
                except: intersections = [intersections]
                        
                for geom in intersections:
                    try:
                        if extend_len > 0:
                            test_ext_start = geom.ExtendStart(extend_len)
                            test_ext_end = geom.ExtendEnd(extend_len)
                            if test_ext_start.StartPoint.Z < test_ext_end.EndPoint.Z: ext_crv = test_ext_start
                            else: ext_crv = test_ext_end
                        else: ext_crv = geom
                            
                        crv_plane = ext_crv.PlaneAtParameter(0.0) if ext_crv.StartPoint.Z < ext_crv.EndPoint.Z else ext_crv.PlaneAtParameter(1.0)
                        circle = Circle.ByPlaneRadius(crv_plane, radius)
                        solids.append(Solid.BySweep(circle, ext_crv))
                        srf_curves.append(ext_crv) 
                    except: pass 
            
            # --- 滴水與瓦當生成區 ---
            for i in range(len(srf_curves) - 1):
                crvA = srf_curves[i]
                crvB = srf_curves[i+1]
                
                if crvA.StartPoint.Z < crvA.EndPoint.Z:
                    ptA, vec_upA = crvA.StartPoint, crvA.TangentAtParameter(0)
                else:
                    ptA, vec_upA = crvA.EndPoint, crvA.TangentAtParameter(1).Reverse()
                    
                if crvB.StartPoint.Z < crvB.EndPoint.Z:
                    ptB, vec_upB = crvB.StartPoint, crvB.TangentAtParameter(0)
                else:
                    ptB, vec_upB = crvB.EndPoint, crvB.TangentAtParameter(1).Reverse()
                
                dist_AB = ptA.DistanceTo(ptB)
                # 💡 放寬容許度到 2.5 倍，防止陡坡造成誤判跳過
                if dist_AB > spacing * 2.5 or dist_AB < 1.0: continue 
                
                try:
                    vec_up_sum = add_vec(vec_upA, vec_upB)
                    vec_up = vec_up_sum.Normalized()
                    
                    drip_ptA = ptA.Translate(vec_up, wadang_thick)
                    drip_ptB = ptB.Translate(vec_up, wadang_thick)
                    
                    vec_X = Vector.ByTwoPoints(drip_ptA, drip_ptB).Normalized()
                    vec_down = vec_up.Cross(vec_X).Normalized()
                    if vec_down.Z > 0: vec_down = vec_down.Reverse()
                    
                    R_arc = 1.5 * spacing
                    drop = radius * 2.0
                    
                    pM = get_midpoint(drip_ptA, drip_ptB)
                    pC = pM.Translate(vec_down, drop) 
                    
                    dist_dripAB = drip_ptA.DistanceTo(drip_ptB)
                    if R_arc > dist_dripAB / 2.0:
                        h_T = R_arc - math.sqrt(R_arc**2 - (dist_dripAB / 2.0)**2)
                        pT = pM.Translate(vec_down, h_T)
                    else: pT = pM
                    
                    vec_AC = Vector.ByTwoPoints(drip_ptA, pC)
                    L_AC = vec_AC.Length
                    pM_AC = get_midpoint(drip_ptA, pC) 
                    N_AC = vec_AC.Cross(vec_up).Normalized()
                    dir_left = add_vec(vec_X.Scale(-1), vec_down)
                    if N_AC.Dot(dir_left) < 0: N_AC = N_AC.Reverse()
                    
                    if R_arc > L_AC / 2.0:
                        h_AC = R_arc - math.sqrt(R_arc**2 - (L_AC / 2.0)**2) 
                        pL = pM_AC.Translate(N_AC, h_AC)
                    else: pL = pM_AC
                    
                    vec_CB = Vector.ByTwoPoints(pC, drip_ptB)
                    L_CB = vec_CB.Length
                    pM_CB = get_midpoint(pC, drip_ptB) 
                    N_CB = vec_CB.Cross(vec_up).Normalized()
                    dir_right = add_vec(vec_X, vec_down)
                    if N_CB.Dot(dir_right) < 0: N_CB = N_CB.Reverse()
                    
                    if R_arc > L_CB / 2.0:
                        h_CB = R_arc - math.sqrt(R_arc**2 - (L_CB / 2.0)**2) 
                        pR = pM_CB.Translate(N_CB, h_CB)
                    else: pR = pM_CB
                    
                    arc1 = Arc.ByThreePoints(drip_ptA, pT, drip_ptB)
                    arc2 = Arc.ByThreePoints(drip_ptB, pR, pC)
                    arc3 = Arc.ByThreePoints(pC, pL, drip_ptA)
                    drip_profile = PolyCurve.ByJoinedCurves([arc1, arc2, arc3])
                    drip_solid = drip_profile.ExtrudeAsSolid(vec_up, drip_thick)
                    
                    planeA = Plane.ByOriginNormal(ptA, vec_upA)
                    circleA = Circle.ByPlaneRadius(planeA, radius * 1.1)
                    wadangA = circleA.ExtrudeAsSolid(vec_upA, wadang_thick)
                    
                    planeB = Plane.ByOriginNormal(ptB, vec_upB)
                    circleB = Circle.ByPlaneRadius(planeB, radius * 1.1)
                    wadangB = circleB.ExtrudeAsSolid(vec_upB, wadang_thick)
                    
                    try:
                        union_solid = Solid.ByUnion([drip_solid, wadangA, wadangB])
                        solids.append(union_solid)
                    except:
                        solids.extend([drip_solid, wadangA, wadangB])
                    
                except:
                    pass 

except Exception as e:
    solids.append("Python Error: " + str(e))

# --- 5. 寫入 Revit 並自動群組 ---
revit_elements = []
cat_id = ElementId(BuiltInCategory.OST_Roofs) 

for d_solid in solids:
    if d_solid is None or isinstance(d_solid, str): continue
    try:
        r_geom = d_solid.ToRevitType()
        geom_list = List[GeometryObject]()
        if isinstance(r_geom, list) or type(r_geom).__name__ in ["Array[GeometryObject]", "tuple"]:
            for g in r_geom: 
                if mat_id != ElementId.InvalidElementId and hasattr(g, "MaterialId"): g.MaterialId = mat_id
                geom_list.Add(g)
        else: 
            if mat_id != ElementId.InvalidElementId and hasattr(r_geom, "MaterialId"): r_geom.MaterialId = mat_id
            geom_list.Add(r_geom)
            
        ds = DirectShape.CreateElement(doc, cat_id)
        ds.SetShape(geom_list)
        ds.Name = "Traditional_Roof_System"
        revit_elements.append(ds)
    except: pass

group_element = None
if revit_elements:
    id_list = List[ElementId]()
    for el in revit_elements: id_list.Add(el.Id)
    try:
        group_element = doc.Create.NewGroup(id_list)
        group_element.GroupType.Name = "瓦當與滴水系統_" + str(int(time.time())) 
    except: pass

TransactionManager.Instance.TransactionTaskDone()

OUT = revit_elements if group_element is None else group_element
# ----------------------------------------
watch = Watch(python_script)  # graph output
說明 = StringInput("選幾個屋頂的表面FACE然後再選一個參考平面做洩水的方向畫出圓形條狀的筒瓦\n")  # graph input
