# Dynamo graph 建築-屋頂加圓筒瓦溝頭滴水.dyn "建築-屋頂加圓筒瓦" (Dynamo 3.6.2.11575)

選你要放瓦的屋頂 = DSModelElementsSelection()  # "1.選你要放瓦的屋頂"; 3 picked in the model; graph input
flatten = List.Flatten(list=選你要放瓦的屋頂)
筒瓦半徑 = DoubleInput(5)  # "3.筒瓦半徑"; graph input
筒瓦中心間距 = DoubleInput(28)  # "4.筒瓦中心間距"; graph input
n2_洩水分線_選參考平面 = DSModelElementSelection()  # "2.洩水分線-選參考平面"; 1 picked in the model; graph input
滴水厚度 = DoubleInput(2)  # "5.滴水厚度"; graph input
瓦當厚度 = DoubleInput(2)  # "6.瓦當厚度"; graph input
材質 = StringInput("傳統清灰瓦")  # "7.材質"; graph input
n0_是否要用選集_000 = BoolSelector(false)  # "0.是否要用選集"000""; graph input
python_script = Python(IN[0]=flatten, IN[1]=筒瓦半徑, IN[2]=筒瓦中心間距, IN[3]=n2_洩水分線_選參考平面, IN[4]=滴水厚度, IN[5]=瓦當厚度, IN[6]=材質, IN[7]=n0_是否要用選集_000)  # CPython3
# ---------- python_script.python (386 lines) ----------
import clr
import System
import math
import time
from System.Collections.Generic import List

clr.AddReference('RevitAPI')
import Autodesk
from Autodesk.Revit.DB import *

clr.AddReference('ProtoGeometry')
from Autodesk.DesignScript.Geometry import *

clr.AddReference('RevitNodes')
import Revit
clr.ImportExtensions(Revit.Elements)
clr.ImportExtensions(Revit.GeometryConversion)

clr.AddReference('RevitServices')
import RevitServices
from RevitServices.Persistence import DocumentManager
from RevitServices.Transactions import TransactionManager

doc = DocumentManager.Instance.CurrentDBDocument

def flatten_list(lst):
    result = []
    for i in lst:
        if isinstance(i, list) or type(i).__name__ == 'list':
            result.extend(flatten_list(i))
        else:
            result.append(i)
    return result

def get_midpoint(p1, p2):
    return Point.ByCoordinates((p1.X+p2.X)/2.0, (p1.Y+p2.Y)/2.0, (p1.Z+p2.Z)/2.0)

def add_vec(v1, v2):
    return Vector.ByCoordinates(v1.X+v2.X, v1.Y+v2.Y, v1.Z+v2.Z)

# --- 1. 取得所有輸入參數 ---
input_objs = flatten_list(IN[0] if isinstance(IN[0], list) else [IN[0]])
radius = float(IN[1])
spacing = float(IN[2])
ref_plane_element = UnwrapElement(IN[3])
drip_thick = float(IN[4])
wadang_thick = float(IN[5])
extend_len = drip_thick + wadang_thick
mat_name = IN[6] if len(IN) > 6 and IN[6] else "傳統青灰瓦"

# 💡 新增：讀取 IN[7] 的布林值切換選集模式
use_selection_set = IN[7] if len(IN) > 7 else False
sel_set_name = "000"

if spacing <= 0: spacing = 28.0

solids = []
debug_log = ["--- 妹妹的選集升級版追蹤器報告 ---"] 

TransactionManager.Instance.EnsureInTransaction(doc)

# --- 💡 新增：選集攔截系統 ---
if use_selection_set:
    debug_log.append("🔍 [模式] 啟用「儲存選集」：正在尋找名為 '{}' 的選集...".format(sel_set_name))
    collector = FilteredElementCollector(doc).OfClass(SelectionFilterElement)
    sel_filter = None
    for f in collector:
        if f.Name == sel_set_name:
            sel_filter = f
            break
            
    if sel_filter is not None:
        sel_ids = sel_filter.GetElementIds()
        input_objs = [doc.GetElement(e_id) for e_id in sel_ids]
        debug_log.append("  ➔ 成功載入選集 '{}'，共提取出 {} 個物件！".format(sel_set_name, len(input_objs)))
    else:
        debug_log.append("  ⚠️ 找不到名為 '{}' 的選集！自動退回使用 IN[0] 的選取物件。".format(sel_set_name))
else:
    debug_log.append("🔍 [模式] 啟用「直接選取」：讀取 IN[0] 的物件...")

# --- 2. 雙軌修復過濾器 (實體過橋 + 邊緣織皮救磚術) ---
surfaces = []
for obj_idx, obj in enumerate(input_objs):
    if obj is None: continue
    
    revit_el = UnwrapElement(obj)
    if hasattr(revit_el, "get_Geometry"):
        opt = Options()
        opt.ComputeReferences = True
        opt.DetailLevel = ViewDetailLevel.Fine
        geom_element = revit_el.get_Geometry(opt)
        
        el_srf_count = 0
        if geom_element is not None:
            def extract_solids(geom_sel):
                res = []
                for g in geom_sel:
                    if type(g).__name__ == "Solid" and g.Faces.Size > 0:
                        res.append(g)
                    elif type(g).__name__ == "GeometryInstance":
                        res.extend(extract_solids(g.GetInstanceGeometry()))
                return res
                
            all_solids = extract_solids(geom_element)
            
            for solid in all_solids:
                is_closed = solid.Volume > 0
                solid_success = False
                try:
                    proto_solid = solid.ToProtoType()
                    if proto_solid is not None:
                        for pf in proto_solid.Faces:
                            norm = pf.NormalAtParameter(0.5, 0.5)
                            if (is_closed and norm.Z > 0.1) or (not is_closed and abs(norm.Z) > 0.1):
                                surfaces.append(pf)
                                el_srf_count += 1
                        solid_success = True
                except: pass
                    
                if solid_success: continue 
                
                for f in solid.Faces:
                    try:
                        uv_box = f.GetBoundingBox()
                        uv_center = Autodesk.Revit.DB.UV((uv_box.Min.U + uv_box.Max.U) / 2.0, (uv_box.Min.V + uv_box.Max.V) / 2.0)
                        native_norm = f.ComputeNormal(uv_center)
                        
                        is_candidate = (is_closed and native_norm.Z > 0.1) or (not is_closed and abs(native_norm.Z) > 0.1)
                        if not is_candidate: continue
                        
                        try:
                            proto_res = f.ToProtoType()
                            srfs_to_test = proto_res if isinstance(proto_res, list) else [proto_res]
                            for srf_geo in srfs_to_test:
                                surfaces.append(srf_geo)
                                el_srf_count += 1
                        except:
                            curves = []
                            for loop in f.EdgeLoops:
                                for edge in loop:
                                    curves.append(edge.AsCurve().ToProtoType())
                            if curves:
                                try:
                                    joined_poly = PolyCurve.ByJoinedCurves(curves)
                                    patched_srf = Surface.ByPatch(joined_poly) 
                                    surfaces.append(patched_srf)
                                    el_srf_count += 1
                                except: pass
                    except: pass
                    
        debug_log.append("🏠 解析第 {} 個屋頂元件：成功提取出 {} 個完美的排水面！".format(obj_idx + 1, el_srf_count))
    else:
        surfaces.append(obj)

valid_surfaces = [s for s in surfaces if s is not None]
debug_log.append("✅ 最終進入核心計算的有效表面總數: {} 個".format(len(valid_surfaces)))

if len(valid_surfaces) == 0:
    debug_log.append("⚠️ [警告] 找不到任何有效的排水面！請確認選取物件。")
else:
    # --- 3. 處理材質 ---
    mat_id = ElementId.InvalidElementId
    collector = FilteredElementCollector(doc).OfClass(Material)
    for m in collector:
        if m.Name == mat_name:
            mat_id = m.Id
            break
    if mat_id == ElementId.InvalidElementId:
        try:
            mat_id = Material.Create(doc, mat_name)
            new_mat = doc.GetElement(mat_id)
            new_mat.Color = Color(100, 100, 100)
        except: pass

    # --- 4. 計算參考平面與強制排序陣列 ---
    try:
        revit_plane = ref_plane_element.GetPlane()
        base_plane = revit_plane.ToPlane()
        plane_normal = base_plane.Normal
        
        min_pts, max_pts = [], []
        for srf in valid_surfaces:
            bbox = srf.BoundingBox
            min_pts.append(bbox.MinPoint)
            max_pts.append(bbox.MaxPoint)
                
        if min_pts:
            min_x, min_y, min_z = min([p.X for p in min_pts]), min([p.Y for p in min_pts]), min([p.Z for p in min_pts])
            max_x, max_y, max_z = max([p.X for p in max_pts]), max([p.Y for p in max_pts]), max([p.Z for p in max_pts])
            corners = [
                Point.ByCoordinates(min_x, min_y, min_z), Point.ByCoordinates(max_x, min_y, min_z),
                Point.ByCoordinates(max_x, max_y, min_z), Point.ByCoordinates(min_x, max_y, min_z),
                Point.ByCoordinates(min_x, min_y, max_z), Point.ByCoordinates(max_x, min_y, max_z),
                Point.ByCoordinates(max_x, max_y, max_z), Point.ByCoordinates(min_x, max_y, max_z)
            ]
            
            max_dist, min_dist = 0.0, 0.0
            for pt in corners:
                vec = Vector.ByTwoPoints(base_plane.Origin, pt)
                dist = vec.Dot(plane_normal)
                if dist > max_dist: max_dist = dist
                if dist < min_dist: min_dist = dist
                
            d_values = []
            d = 0.0
            while d <= max_dist + spacing:
                d_values.append(d)
                d += spacing
            d = -spacing
            while d >= min_dist - spacing:
                d_values.append(d)
                d -= spacing
                
            d_values.sort() 
            
            cutting_planes = []
            for d in d_values:
                vec_offset = plane_normal.Scale(d)
                new_origin = base_plane.Origin.Translate(vec_offset)
                cutting_planes.append(Plane.ByOriginNormal(new_origin, plane_normal))
                
            # --- 5. 產生圓柱筒瓦並將基準線投入「全域大熔爐」 ---
            global_curves = [] 
            
            for srf_idx, srf in enumerate(valid_surfaces):
                srf_crv_count = 0
                for cp in cutting_planes:
                    intersections = srf.Intersect(cp)
                    try: intersections = list(intersections) if not isinstance(intersections, list) else intersections
                    except: intersections = [intersections]
                            
                    for geom in intersections:
                        try:
                            if extend_len > 0:
                                test_ext_start = geom.ExtendStart(extend_len)
                                test_ext_end = geom.ExtendEnd(extend_len)
                                if test_ext_start.StartPoint.Z < test_ext_end.EndPoint.Z: ext_crv = test_ext_start
                                else: ext_crv = test_ext_end
                            else: ext_crv = geom
                            
                            z_diff = abs(ext_crv.StartPoint.Z - ext_crv.EndPoint.Z)
                            if z_diff < 0.1: continue 
                                
                            crv_plane = ext_crv.PlaneAtParameter(0.0) if ext_crv.StartPoint.Z < ext_crv.EndPoint.Z else ext_crv.PlaneAtParameter(1.0)
                            circle = Circle.ByPlaneRadius(crv_plane, radius)
                            solids.append(Solid.BySweep(circle, ext_crv))
                            
                            eval_pt = ext_crv.StartPoint
                            sort_val = Vector.ByTwoPoints(base_plane.Origin, eval_pt).Dot(plane_normal)
                            global_curves.append((sort_val, ext_crv))
                            srf_crv_count += 1
                        except Exception: pass 
                debug_log.append("  ➔ 面 {} 切割出 {} 條基準線".format(srf_idx + 1, srf_crv_count))
                
            # --- 6. 全域排序與跨面滴水無縫生成 ---
            global_curves.sort(key=lambda x: x[0])
            sorted_curves = [item[1] for item in global_curves]
            
            success_count = 0
            for i in range(len(sorted_curves) - 1):
                try:
                    crvA = sorted_curves[i]
                    crvB = sorted_curves[i+1]
                    
                    if crvA.StartPoint.Z < crvA.EndPoint.Z:
                        ptA, vec_upA = crvA.StartPoint, crvA.TangentAtParameter(0)
                    else:
                        ptA, vec_upA = crvA.EndPoint, crvA.TangentAtParameter(1).Reverse()
                        
                    if crvB.StartPoint.Z < crvB.EndPoint.Z:
                        ptB, vec_upB = crvB.StartPoint, crvB.TangentAtParameter(0)
                    else:
                        ptB, vec_upB = crvB.EndPoint, crvB.TangentAtParameter(1).Reverse()
                    
                    dist_AB = ptA.DistanceTo(ptB)
                    
                    if dist_AB > spacing * 2.5 or dist_AB < 1.0: continue 
                    
                    vec_up_sum = add_vec(vec_upA, vec_upB)
                    vec_up = vec_up_sum.Normalized()
                    
                    drip_ptA = ptA.Translate(vec_up, wadang_thick)
                    drip_ptB = ptB.Translate(vec_up, wadang_thick)
                    
                    vec_X = Vector.ByTwoPoints(drip_ptA, drip_ptB).Normalized()
                    vec_down = vec_up.Cross(vec_X).Normalized()
                    if vec_down.Z > 0: vec_down = vec_down.Reverse() 
                    
                    R_arc = 1.5 * spacing
                    drop = radius * 2.0
                    
                    pM = get_midpoint(drip_ptA, drip_ptB)
                    pC = pM.Translate(vec_down, drop) 
                    
                    dist_dripAB = drip_ptA.DistanceTo(drip_ptB)
                    if R_arc > dist_dripAB / 2.0:
                        h_T = R_arc - math.sqrt(R_arc**2 - (dist_dripAB / 2.0)**2)
                        pT = pM.Translate(vec_down, h_T)
                    else: pT = pM
                    
                    vec_AC = Vector.ByTwoPoints(drip_ptA, pC)
                    L_AC = vec_AC.Length
                    pM_AC = get_midpoint(drip_ptA, pC) 
                    N_AC = vec_AC.Cross(vec_up).Normalized()
                    dir_left = add_vec(vec_X.Scale(-1), vec_down)
                    if N_AC.Dot(dir_left) < 0: N_AC = N_AC.Reverse()
                    
                    if R_arc > L_AC / 2.0:
                        h_AC = R_arc - math.sqrt(R_arc**2 - (L_AC / 2.0)**2) 
                        pL = pM_AC.Translate(N_AC, h_AC)
                    else: pL = pM_AC
                    
                    vec_CB = Vector.ByTwoPoints(pC, drip_ptB)
                    L_CB = vec_CB.Length
                    pM_CB = get_midpoint(pC, drip_ptB) 
                    N_CB = vec_CB.Cross(vec_up).Normalized()
                    dir_right = add_vec(vec_X, vec_down)
                    if N_CB.Dot(dir_right) < 0: N_CB = N_CB.Reverse()
                    
                    if R_arc > L_CB / 2.0:
                        h_CB = R_arc - math.sqrt(R_arc**2 - (L_CB / 2.0)**2) 
                        pR = pM_CB.Translate(N_CB, h_CB)
                    else: pR = pM_CB
                    
                    arc1 = Arc.ByThreePoints(drip_ptA, pT, drip_ptB)
                    arc2 = Arc.ByThreePoints(drip_ptB, pR, pC)
                    arc3 = Arc.ByThreePoints(pC, pL, drip_ptA)
                    drip_profile = PolyCurve.ByJoinedCurves([arc1, arc2, arc3])
                    drip_solid = drip_profile.ExtrudeAsSolid(vec_up, drip_thick)
                    
                    planeA = Plane.ByOriginNormal(ptA, vec_upA)
                    circleA = Circle.ByPlaneRadius(planeA, radius * 1.1)
                    wadangA = circleA.ExtrudeAsSolid(vec_upA, wadang_thick)
                    
                    planeB = Plane.ByOriginNormal(ptB, vec_upB)
                    circleB = Circle.ByPlaneRadius(planeB, radius * 1.1)
                    wadangB = circleB.ExtrudeAsSolid(vec_upB, wadang_thick)
                    
                    try:
                        union_solid = Solid.ByUnion([drip_solid, wadangA, wadangB])
                        solids.append(union_solid)
                        success_count += 1
                    except:
                        solids.extend([drip_solid, wadangA, wadangB])
                        success_count += 1
                except Exception: pass
            debug_log.append("\n🌟 全域跨面融合：成功生成 {} 組滴水與瓦當！".format(success_count))
            
    except Exception as e:
        debug_log.append("❌ 重大錯誤: " + str(e))

# --- 7. 寫入 Revit 並自動群組 ---
revit_elements = []
cat_id = ElementId(BuiltInCategory.OST_Roofs) 

for d_solid in solids:
    if d_solid is None or isinstance(d_solid, str): continue
    try:
        r_geom = d_solid.ToRevitType()
        geom_list = List[GeometryObject]()
        if isinstance(r_geom, list) or type(r_geom).__name__ in ["Array[GeometryObject]", "tuple"]:
            for g in r_geom: 
                if mat_id != ElementId.InvalidElementId and hasattr(g, "MaterialId"): g.MaterialId = mat_id
                geom_list.Add(g)
        else: 
            if mat_id != ElementId.InvalidElementId and hasattr(r_geom, "MaterialId"): r_geom.MaterialId = mat_id
            geom_list.Add(r_geom)
            
        ds = DirectShape.CreateElement(doc, cat_id)
        ds.SetShape(geom_list)
        ds.Name = "Traditional_Roof_System"
        revit_elements.append(ds)
    except: pass

group_element = None
if revit_elements:
    id_list = List[ElementId]()
    for el in revit_elements: id_list.Add(el.Id)
    try:
        group_element = doc.Create.NewGroup(id_list)
        group_element.GroupType.Name = "瓦當與滴水系統_" + str(int(time.time())) 
    except: pass

TransactionManager.Instance.TransactionTaskDone()

OUT = [revit_elements if group_element is None else group_element, debug_log]
# ----------------------------------------
watch = Watch(python_script)  # graph output
說明 = StringInput("""選幾個屋頂的表面然後再選一個參考平面做洩水的方向畫出圓形條狀的筒瓦
如果屋頂為多片組合可以存成"000"選集作處理比較方便""")  # graph input
