# Dynamo graph 建築-屋頂加椽木.dyn (Dynamo 3.6.2.11575)

n1_洩水分線_選參考平面 = DSModelElementSelection()  # "1.洩水分線-選參考平面"; 1 picked in the model; graph input
定義上段界線 = BoolSelector(true)  # "3.定義上段界線"; graph input
n2_上段界線_選參考平面 = DSModelElementSelection()  # "2.上段界線-選參考平面"; 1 picked in the model; graph input
n4_做2層椽木 = BoolSelector(true)  # "4.做2層椽木?"; graph input
第2層椽木長度比 = DoubleInput(0.9)  # "5.第2層椽木長度比"; graph input
椽木邊長度 = DoubleInput(7.5)  # "6.椽木邊長度"; graph input
椽木間距 = DoubleInput(15)  # "7.椽木間距"; graph input
材質 = StringInput("椽木")  # "8.材質"; graph input
python_script = Python(IN[0]=n1_洩水分線_選參考平面, IN[1]=定義上段界線, IN[2]=n2_上段界線_選參考平面, IN[3]=n4_做2層椽木, IN[4]=第2層椽木長度比, IN[5]=椽木邊長度, IN[6]=椽木間距, IN[7]=材質)  # CPython3
# ---------- python_script.python (369 lines) ----------
import clr
import System
import math
import time
from System.Collections.Generic import List

clr.AddReference('RevitAPI')
import Autodesk
from Autodesk.Revit.DB import *

clr.AddReference('ProtoGeometry')
from Autodesk.DesignScript.Geometry import *

clr.AddReference('RevitNodes')
import Revit
clr.ImportExtensions(Revit.Elements)
clr.ImportExtensions(Revit.GeometryConversion)

clr.AddReference('RevitServices')
import RevitServices
from RevitServices.Persistence import DocumentManager
from RevitServices.Transactions import TransactionManager

doc = DocumentManager.Instance.CurrentDBDocument

def flatten_list(lst):
    result = []
    for i in lst:
        if isinstance(i, list) or type(i).__name__ == 'list':
            result.extend(flatten_list(i))
        else:
            result.append(i)
    return result

# 💡 絕對弧長均分重建器：徹底解決參差不齊的 Fuzzy 終極手段
def get_safe_subcurve(crv, is_start_high, ratio):
    try:
        total_len = crv.Length
        if total_len < 1.0: return None # 太短忽略
        
        target_len = total_len * ratio
        pts = []
        steps = 15 # 取15個控制點確保弧度平滑
        for i in range(steps + 1):
            # 關鍵 Fuzzy 手段：使用「真實長度(SegmentLength)」來取點，無視曲線接縫造成的參數扭曲！
            current_step_len = (target_len * float(i)) / float(steps)
            
            if is_start_high:
                eval_len = current_step_len
            else:
                eval_len = total_len - current_step_len
                
            # 防呆，避免浮點數誤差超過總長
            if eval_len < 0: eval_len = 0.0
            if eval_len > total_len: eval_len = total_len
            
            pts.append(crv.PointAtSegmentLength(eval_len))
            
        return NurbsCurve.ByPoints(pts)
    except:
        try:
            # 重建失敗的直線備案
            if is_start_high:
                pA = crv.PointAtSegmentLength(0)
                pB = crv.PointAtSegmentLength(target_len)
            else:
                pA = crv.PointAtSegmentLength(total_len)
                pB = crv.PointAtSegmentLength(total_len - target_len)
            return Line.ByStartPointEndPoint(pA, pB)
        except:
            return None

# --- 1. 取得所有輸入參數 (IN[0] ~ IN[7] 全面順推) ---
try: ref_plane_element = UnwrapElement(IN[0])
except: ref_plane_element = None

raw_bnd = IN[1] if len(IN) > 1 else False
has_upper_boundary = str(raw_bnd).lower() in ['true', '1', 't', 'yes']

upper_boundary_el = UnwrapElement(IN[2]) if len(IN) > 2 and IN[2] else None

raw_double = IN[3] if len(IN) > 3 else True
is_double_layer = str(raw_double).lower() not in ['false', '0', 'f', 'no']

try: layer2_ratio = float(IN[4]) if len(IN) > 4 and IN[4] else 0.7
except: layer2_ratio = 0.7
if layer2_ratio > 1.0: layer2_ratio = layer2_ratio / 100.0
if layer2_ratio <= 0.0 or layer2_ratio >= 1.0: layer2_ratio = 0.7

try: timber_size = float(IN[5]) if len(IN) > 5 and IN[5] else 7.5
except: timber_size = 7.5

try: spacing = float(IN[6]) if len(IN) > 6 and IN[6] else 15.0
except: spacing = 15.0

mat_name = IN[7] if len(IN) > 7 and IN[7] else "椽木"
if not isinstance(mat_name, str): mat_name = "椽木"

if spacing <= 0: spacing = 15.0
if timber_size <= 0: timber_size = 7.5

solids = []
debug_log = ["--- 妹妹的木構椽條「Fuzzy 齊平版」報告 ---"] 

TransactionManager.Instance.EnsureInTransaction(doc)

# 💡 全自動強制抓取 Revit 儲存選集 "000"
collector = FilteredElementCollector(doc).OfClass(SelectionFilterElement)
sel_filter = None
for f in collector:
    if f.Name == "000":
        sel_filter = f
        break

input_objs = []
if sel_filter is not None:
    input_objs = [doc.GetElement(e_id) for e_id in sel_filter.GetElementIds()]
else:
    debug_log.append("❌ [錯誤] 找不到名為 '000' 的儲存選集！")

# --- 2. 底層表面過濾器 ---
surfaces = []
if len(input_objs) > 0:
    for obj_idx, obj in enumerate(input_objs):
        if obj is None: continue
        revit_el = UnwrapElement(obj)
        if hasattr(revit_el, "get_Geometry"):
            opt = Options()
            opt.ComputeReferences = True
            opt.DetailLevel = ViewDetailLevel.Fine
            geom_element = revit_el.get_Geometry(opt)
            
            el_srf_count = 0
            if geom_element is not None:
                def extract_solids(geom_sel):
                    res = []
                    for g in geom_sel:
                        if type(g).__name__ == "Solid" and g.Faces.Size > 0: res.append(g)
                        elif type(g).__name__ == "GeometryInstance": res.extend(extract_solids(g.GetInstanceGeometry()))
                    return res
                
                all_solids = extract_solids(geom_element)
                for solid in all_solids:
                    is_closed = solid.Volume > 0
                    solid_success = False
                    try:
                        proto_solid = solid.ToProtoType()
                        if proto_solid is not None:
                            for pf in proto_solid.Faces:
                                norm = pf.NormalAtParameter(0.5, 0.5)
                                if (is_closed and norm.Z < -0.1) or (not is_closed and norm.Z < -0.1):
                                    surfaces.append((pf, norm))
                                    el_srf_count += 1
                            solid_success = True
                    except: pass
                    
                    if solid_success: continue
                    
                    for f in solid.Faces:
                        try:
                            uv_box = f.GetBoundingBox()
                            uv_center = Autodesk.Revit.DB.UV((uv_box.Min.U + uv_box.Max.U) / 2.0, (uv_box.Min.V + uv_box.Max.V) / 2.0)
                            native_norm = f.ComputeNormal(uv_center)
                            if native_norm.Z >= -0.1: continue
                            
                            try:
                                proto_res = f.ToProtoType()
                                srfs_to_test = proto_res if isinstance(proto_res, list) else [proto_res]
                                for srf_geo in srfs_to_test:
                                    surfaces.append((srf_geo, srf_geo.NormalAtParameter(0.5, 0.5)))
                                    el_srf_count += 1
                            except:
                                curves = []
                                for loop in f.EdgeLoops:
                                    for edge in loop: curves.append(edge.AsCurve().ToProtoType())
                                if curves:
                                    joined_poly = PolyCurve.ByJoinedCurves(curves)
                                    patched_srf = Surface.ByPatch(joined_poly)
                                    surfaces.append((patched_srf, patched_srf.NormalAtParameter(0.5, 0.5)))
                                    el_srf_count += 1
                        except: pass

if len(surfaces) > 0:
    # --- 3. 處理材質 ---
    mat_id = ElementId.InvalidElementId
    mat_collector = FilteredElementCollector(doc).OfClass(Material)
    for m in mat_collector:
        if m.Name == mat_name:
            mat_id = m.Id
            break
    if mat_id == ElementId.InvalidElementId:
        try:
            mat_id = Material.Create(doc, mat_name)
            new_mat = doc.GetElement(mat_id)
            new_mat.Color = Color(205, 170, 125) 
        except: pass

    # --- 4. 建立全域切刀陣列 ---
    try:
        if ref_plane_element:
            base_plane = ref_plane_element.GetPlane().ToPlane()
            plane_normal = base_plane.Normal
            
            min_pts, max_pts = [], []
            for srf, _ in surfaces:
                bbox = srf.BoundingBox
                min_pts.append(bbox.MinPoint)
                max_pts.append(bbox.MaxPoint)
                
            min_x, min_y, min_z = min([p.X for p in min_pts]), min([p.Y for p in min_pts]), min([p.Z for p in min_pts])
            max_x, max_y, max_z = max([p.X for p in max_pts]), max([p.Y for p in max_pts]), max([p.Z for p in max_pts])
            corners = [
                Point.ByCoordinates(min_x, min_y, min_z), Point.ByCoordinates(max_x, min_y, min_z),
                Point.ByCoordinates(max_x, max_y, min_z), Point.ByCoordinates(min_x, max_y, min_z),
                Point.ByCoordinates(min_x, min_y, max_z), Point.ByCoordinates(max_x, min_y, max_z),
                Point.ByCoordinates(max_x, max_y, max_z), Point.ByCoordinates(min_x, max_y, max_z)
            ]
            
            max_dist, min_dist = 0.0, 0.0
            for pt in corners:
                vec = Vector.ByTwoPoints(base_plane.Origin, pt)
                dist = vec.Dot(plane_normal)
                if dist > max_dist: max_dist = dist
                if dist < min_dist: min_dist = dist
            
            d_values = []
            d = 0.0
            while d <= max_dist + spacing:
                d_values.append(d)
                d += spacing
            d = -spacing
            while d >= min_dist - spacing:
                d_values.append(d)
                d -= spacing
            d_values.sort()
            
            cutting_planes = []
            for d in d_values:
                cutting_planes.append(Plane.ByOriginNormal(base_plane.Origin.Translate(plane_normal, d), plane_normal))
                
            bnd_geom = None
            if has_upper_boundary and upper_boundary_el:
                try:
                    if hasattr(upper_boundary_el, "Intersect"): bnd_geom = upper_boundary_el
                    elif hasattr(upper_boundary_el, "GetPlane"): bnd_geom = upper_boundary_el.GetPlane().ToPlane()
                    elif hasattr(upper_boundary_el, "ToPlane"): bnd_geom = upper_boundary_el.ToPlane()
                    elif hasattr(upper_boundary_el, "get_Geometry"):
                        opt = Options()
                        opt.ComputeReferences = True
                        for g in upper_boundary_el.get_Geometry(opt):
                            if type(g).__name__ == "Solid":
                                proto_solids = g.ToProtoType()
                                bnd_geom = proto_solids[0] if isinstance(proto_solids, list) else proto_solids
                                break
                except: pass

            # --- 5. 全域基準線切割與邊界裁剪 ---
            global_rafter_curves = []
            for srf_idx, (srf, srf_norm) in enumerate(surfaces):
                for cp in cutting_planes:
                    intersections = srf.Intersect(cp)
                    try: intersections = list(intersections) if not isinstance(intersections, list) else intersections
                    except: intersections = [intersections]
                    
                    for geom in intersections:
                        try:
                            z_diff = abs(geom.StartPoint.Z - geom.EndPoint.Z)
                            if z_diff < 0.1: continue
                            
                            trimmed_curve = geom
                            
                            if bnd_geom:
                                inter_res = geom.Intersect(bnd_geom)
                                if inter_res and len(inter_res) > 0:
                                    split_curves = geom.Split(inter_res[0])
                                    bottom_pt = geom.StartPoint if geom.StartPoint.Z < geom.EndPoint.Z else geom.EndPoint
                                    best_segment = None
                                    min_d = 999999.0
                                    for seg in split_curves:
                                        seg_end = seg.StartPoint if seg.StartPoint.Z < seg.EndPoint.Z else seg.EndPoint
                                        d_to_bottom = seg_end.DistanceTo(bottom_pt)
                                        if d_to_bottom < min_d:
                                            min_d = d_to_bottom
                                            best_segment = seg
                                    if best_segment: trimmed_curve = best_segment
                            
                            sort_val = Vector.ByTwoPoints(base_plane.Origin, trimmed_curve.StartPoint).Dot(plane_normal)
                            global_rafter_curves.append((sort_val, trimmed_curve, srf_norm))
                        except: pass

            # --- 6. 雙層角木生成區 (依附弧度版) ---
            global_rafter_curves.sort(key=lambda x: x[0])
            layer1_count = 0
            layer2_count = 0
            
            for _, curve, srf_norm in global_rafter_curves:
                downward_vec = srf_norm.Normalized()
                if downward_vec.Z > 0:
                    downward_vec = downward_vec.Reverse()
                
                # 🛠️ 第一層：檐椽
                try:
                    offset_vec_layer1 = downward_vec.Scale(timber_size / 2.0)
                    crv_layer1 = curve.Translate(offset_vec_layer1)
                    
                    p_start1 = crv_layer1.PlaneAtParameter(0.0)
                    profile1 = Rectangle.ByWidthLength(p_start1, timber_size, timber_size)
                    solids.append(Solid.BySweep(profile1, crv_layer1))
                    layer1_count += 1
                except: pass
                
                # 🛠️ 第二層：飛椽 (修正：精準從上段界線起算往下長，Fuzzy 均分齊平)
                if is_double_layer:
                    try:
                        # 判定哪一端是高處 (起點)
                        is_start_high = (curve.StartPoint.Z > curve.EndPoint.Z)
                        
                        # 呼叫無敵重建器，用絕對長度算出齊平的弧線
                        sub_curve = get_safe_subcurve(curve, is_start_high, layer2_ratio)
                        
                        if sub_curve:
                            offset_vec_layer2 = downward_vec.Scale(timber_size * 1.5)
                            crv_layer2 = sub_curve.Translate(offset_vec_layer2)
                            
                            p_start2 = crv_layer2.PlaneAtParameter(0.0)
                            profile2 = Rectangle.ByWidthLength(p_start2, timber_size, timber_size)
                            solids.append(Solid.BySweep(profile2, crv_layer2))
                            layer2_count += 1
                    except: pass
                        
            debug_log.append("🌟 椽條大功告成：成功生成 第一層 {} 根 / 第二層 {} 根 完美的木構架！".format(layer1_count, layer2_count))

    except Exception as e:
        debug_log.append("❌ 木構計算發生重大錯誤: " + str(e))

# --- 7. 寫入 Revit 並自動群組 ---
revit_elements = []
cat_id = ElementId(BuiltInCategory.OST_Roofs) 

for d_solid in solids:
    if d_solid is None or isinstance(d_solid, str): continue
    try:
        r_geom = d_solid.ToRevitType()
        geom_list = List[GeometryObject]()
        if isinstance(r_geom, list) or type(r_geom).__name__ in ["Array[GeometryObject]", "tuple"]:
            for g in r_geom: 
                if mat_id != ElementId.InvalidElementId and hasattr(g, "MaterialId"): g.MaterialId = mat_id
                geom_list.Add(g)
        else: 
            if mat_id != ElementId.InvalidElementId and hasattr(r_geom, "MaterialId"): r_geom.MaterialId = mat_id
            geom_list.Add(r_geom)
            
        ds = DirectShape.CreateElement(doc, cat_id)
        ds.SetShape(geom_list)
        ds.Name = "Traditional_Timber_Rafter"
        revit_elements.append(ds)
    except: pass

group_element = None
if revit_elements:
    id_list = List[ElementId]()
    for el in revit_elements: id_list.Add(el.Id)
    try:
        group_element = doc.Create.NewGroup(id_list)
        group_element.GroupType.Name = "傳統木構椽條系統_" + str(int(time.time())) 
    except: pass

TransactionManager.Instance.TransactionTaskDone()
OUT = [revit_elements if group_element is None else group_element, debug_log]
# ----------------------------------------
watch = Watch(python_script)  # graph output
說明 = StringInput("""選幾個屋頂的表面然後再選一個參考平面做洩水的方向畫出圓形條狀的筒瓦
屋頂為單片或多片用選集組合存成"000"選集作處理""")  # graph input
選你要放椽木的屋頂 = DSModelElementsSelection()  # "1.選你要放椽木的屋頂"; 3 picked in the model; frozen
flatten = List.Flatten(list=選你要放椽木的屋頂)
n0_是否要用選集_000 = BoolSelector(false)  # "0.是否要用選集"000""
