# Dynamo graph 建築-房間刪除現有房間粉刷.dyn (Dynamo 3.6.2.11575)

python_script = Python()  # CPython3
# ---------- python_script.python (82 lines) ----------
import clr
import sys
clr.AddReference('RevitAPI')
from Autodesk.Revit.DB import *

clr.AddReference('RevitServices')
from RevitServices.Persistence import DocumentManager
from RevitServices.Transactions import TransactionManager
from System.Collections.Generic import List 

# ==========================================
# Ver 12.1 - 終極大掃除・安全微距版
# 1. 小明哥微距雷達：XY 僅外擴 10cm，精準涵蓋樑側塗層，絕不越界。
# 2. 妹妹樓層鎖定：強制核對 elem.LevelId == room.LevelId，絕對不刪到樓上樓下！
# 3. 塗層辨識：只刪除 TypeName 包含「塗層」的牆與樓板。
# ==========================================
__version__ = "12.1.SafeCleaner"

doc = DocumentManager.Instance.CurrentDBDocument
active_view = doc.ActiveView

TransactionManager.Instance.EnsureInTransaction(doc)

# 1. 取得目前視圖的所有房間
rooms = FilteredElementCollector(doc, active_view.Id).OfCategory(BuiltInCategory.OST_Rooms).ToElements()

ids_to_delete = List[ElementId]()
del_count = 0

# 2. 準備收集所有的牆與樓板
cats = List[BuiltInCategory]([BuiltInCategory.OST_Walls, BuiltInCategory.OST_Floors])
filter_cats = ElementMulticategoryFilter(cats)

for room in rooms:
    if room.Area <= 0: continue
    
    bbox = room.get_BoundingBox(None)
    if not bbox: continue
    
    room_level_id = room.LevelId
    
    # ✨ 小明哥的微距雷達：外擴 10cm (0.1m)
    # Z 軸稍微抓 50cm (0.5m) 上下涵蓋天花板，但靠 LevelId 確保不會殺到樓上
    offset_xy = 0.1 / 0.3048   
    offset_z = 0.5 / 0.3048    
    
    outline = Outline(XYZ(bbox.Min.X - offset_xy, bbox.Min.Y - offset_xy, bbox.Min.Z - offset_z), 
                      XYZ(bbox.Max.X + offset_xy, bbox.Max.Y + offset_xy, bbox.Max.Z + offset_z))
                      
    bbox_filter = BoundingBoxIntersectsFilter(outline)
    
    local_elements = FilteredElementCollector(doc).WherePasses(bbox_filter).WherePasses(filter_cats).ToElements()
    
    for elem in local_elements:
        # ✨ 妹妹的絕對防護罩：不同樓層的絕對不碰！(保證樓上安全)
        if elem.LevelId != room_level_id:
            continue
            
        elem_type_id = elem.GetTypeId()
        if elem_type_id != ElementId.InvalidElementId:
            elem_type = doc.GetElement(elem_type_id)
            type_name = elem_type.get_Parameter(BuiltInParameter.SYMBOL_NAME_PARAM).AsString()
            
            # 只要名字裡有「塗層」兩個字，通通抓起來
            if type_name and "塗層" in type_name:
                if not ids_to_delete.Contains(elem.Id):
                    ids_to_delete.Add(elem.Id)

# 3. 執行安全大掃除！
if ids_to_delete.Count > 0:
    try:
        doc.Delete(ids_to_delete)
        del_count = ids_to_delete.Count
    except Exception as e:
        pass

TransactionManager.Instance.TransactionTaskDone()

OUT = {
    "🏆 狀態": "Ver 12.1 安全大掃除！樓上的鄰居安全了！",
    "🗑️ 總共刪除的塗層數量": del_count
}
# ----------------------------------------
watch = Watch(python_script)  # graph output
說明 = StringInput("把目前視圖所有房間的塗層粉刷全部刪除")  # graph input
是否刪除原有塗層 = BoolSelector(true)  # graph input
