# Dynamo graph 建築-房間加天地牆材料.dyn (Dynamo 3.6.2.11575)

python_script = Python()  # CPython3
# ---------- python_script.python (267 lines) ----------
import clr
import sys
import math
clr.AddReference('RevitAPI')
from Autodesk.Revit.DB import *

clr.AddReference('RevitServices')
from RevitServices.Persistence import DocumentManager
from RevitServices.Transactions import TransactionManager
from System.Collections.Generic import List 

# ==========================================
# Ver 12.2 - 無縫頂天・終極完美版
# 1. 牆高修正：無樑處牆壁恢復 rel_ceil_h (不扣2cm)，有樑處維持 rel_beam_h。
# 2. 智慧過濾：當塗層為「無」、「未設定」或空白時略過。
# 3. 樑側外移：精準往「房間空間」外推 1cm 並下緣包底。
# 4. 門窗接合：JoinGeometry 完美運作，洞口自動生成。
# ==========================================
__version__ = "12.2.FlawlessVictory"

doc = DocumentManager.Instance.CurrentDBDocument
active_view = doc.ActiveView

def get_fixed_thickness():
    return 0.02 / 0.3048 # 統一厚度 2cm

def get_material_id(mat_name):
    if not mat_name or mat_name == "未設定": return ElementId.InvalidElementId
    for m in FilteredElementCollector(doc).OfClass(Material).ToElements():
        if m.Name == mat_name: return m.Id
    return ElementId.InvalidElementId 

def get_or_create_type(base_type, mat_name, mat_id, thickness, is_wall=True, is_beamside=False):
    safe_mat_name = mat_name.replace(":", "-").replace("/", "-").replace("\\", "-")
    prefix = "牆面塗層_" if is_wall else "樓板塗層_"
    if is_beamside: prefix = "樑側塗層_"
    type_name = prefix + safe_mat_name + "_2cm"
    
    collector = FilteredElementCollector(doc).OfClass(WallType if is_wall else FloorType).ToElements()
    for t in collector:
        if is_wall and t.Kind != WallKind.Basic: continue
        try:
            if t.get_Parameter(BuiltInParameter.SYMBOL_NAME_PARAM).AsString() == type_name: return t
        except: pass
            
    new_type = base_type.Duplicate(type_name)
    cs = new_type.GetCompoundStructure()
    if cs:
        layer = CompoundStructureLayer(thickness, MaterialFunctionAssignment.Structure, mat_id)
        new_layers = List[CompoundStructureLayer](); new_layers.Add(layer)
        try: cs.SetLayers(new_layers); new_type.SetCompoundStructure(cs)
        except: pass 
    return new_type

def flatten_to_z0(curve):
    p0, p1 = curve.GetEndPoint(0), curve.GetEndPoint(1)
    if isinstance(curve, Line): return Line.CreateBound(XYZ(p0.X, p0.Y, 0), XYZ(p1.X, p1.Y, 0))
    elif isinstance(curve, Arc):
        try: mid = curve.Evaluate(0.5, True); return Arc.Create(XYZ(p0.X, p0.Y, 0), XYZ(p1.X, p1.Y, 0), XYZ(mid.X, mid.Y, 0))
        except: return Line.CreateBound(XYZ(p0.X, p0.Y, 0), XYZ(p1.X, p1.Y, 0))
    return Line.CreateBound(XYZ(p0.X, p0.Y, 0), XYZ(p1.X, p1.Y, 0))

def to_z0(loop):
    new_loop = CurveLoop()
    for c in loop: new_loop.Append(flatten_to_z0(c))
    if not new_loop.IsCounterclockwise(XYZ.BasisZ): 
        try: new_loop.Flip()
        except: pass
    return new_loop

def is_pt_in_polygon(pt, loops):
    crossings = 0
    for loop in loops:
        for curve in loop:
            pts = curve.Tessellate()
            for i in range(len(pts)-1):
                p0, p1 = pts[i], pts[i+1]
                if p0.Y > p1.Y: p0, p1 = p1, p0
                if pt.Y > p0.Y and pt.Y <= p1.Y:
                    if p1.Y != p0.Y:
                        x_int = p0.X + (pt.Y - p0.Y) * (p1.X - p0.X) / (p1.Y - p0.Y)
                        if pt.X < x_int: crossings += 1
    return (crossings % 2) != 0

def is_beam_side(curve, room_mold_loops):
    mid_pt = curve.Evaluate(0.5, True)
    min_dist = 9999
    for loop in room_mold_loops:
        for c in loop:
            dist = c.Distance(mid_pt)
            if dist < min_dist: min_dist = dist
    return min_dist > 0.01 / 0.3048

def should_create_coating(mat_name):
    if not mat_name: return False
    val = mat_name.strip()
    if val == "" or val == "未設定" or val == "無": return False
    return True

TransactionManager.Instance.EnsureInTransaction(doc)

fixed_thk = get_fixed_thickness() # 2cm
half_thk = fixed_thk / 2 # 1cm
base_wall_type = next((wt for wt in FilteredElementCollector(doc).OfClass(WallType).ToElements() if wt.Kind == WallKind.Basic), None)
base_floor_type = FilteredElementCollector(doc).OfClass(FloorType).FirstElement()
rooms = FilteredElementCollector(doc, active_view.Id).OfCategory(BuiltInCategory.OST_Rooms).ToElements()
all_levels = sorted(FilteredElementCollector(doc).OfClass(Level).ToElements(), key=lambda l: l.Elevation)

opt = Options(); opt.DetailLevel = ViewDetailLevel.Fine
w_cnt, f_cnt, c_cnt, b_cnt, bs_cnt = 0, 0, 0, 0, 0

if base_wall_type and base_floor_type:
    for room in rooms:
        if room.Area <= 0: continue
        
        mat_wall_str = room.LookupParameter("牆面塗層").AsString()
        mat_floor_str = room.LookupParameter("樓板塗層").AsString()
        mat_ceil_str = room.LookupParameter("天花板塗層").AsString()
        
        do_wall = should_create_coating(mat_wall_str)
        do_floor = should_create_coating(mat_floor_str)
        do_ceil = should_create_coating(mat_ceil_str)
        
        if do_wall:
            t_wall = get_or_create_type(base_wall_type, mat_wall_str, get_material_id(mat_wall_str), fixed_thk, True, False)
        if do_ceil:
            t_beamside = get_or_create_type(base_wall_type, mat_ceil_str, get_material_id(mat_ceil_str), fixed_thk, True, True)
            t_ceiling = get_or_create_type(base_floor_type, mat_ceil_str, get_material_id(mat_ceil_str), fixed_thk, False)
        if do_floor:
            t_floor = get_or_create_type(base_floor_type, mat_floor_str, get_material_id(mat_floor_str), fixed_thk, False)
        
        level_id = room.LevelId
        abs_level_z = doc.GetElement(level_id).Elevation
        next_level = next((lvl for lvl in all_levels if lvl.Elevation > abs_level_z + 0.1), None)
        rel_ceil_h = (next_level.Elevation - abs_level_z - 0.15/0.3048) if next_level else 3.0/0.3048
        
        # 1. 建立房間母體 
        room_mold = List[CurveLoop]()
        room_raw_loops = List[CurveLoop]()
        boundaries = room.GetBoundarySegments(SpatialElementBoundaryOptions())
        if not boundaries: continue
        for seg_list in boundaries:
            curves = List[Curve]()
            for seg in seg_list: curves.Add(seg.GetCurve())
            raw_l = to_z0(CurveLoop.Create(curves))
            room_raw_loops.Add(raw_l)
            try: room_mold.Add(CurveLoop.CreateViaOffset(raw_l, -fixed_thk, XYZ.BasisZ))
            except: pass
            
        if room_mold.Count == 0: continue

        if do_floor:
            Floor.Create(doc, room_mold, t_floor.Id, level_id).get_Parameter(BuiltInParameter.FLOOR_HEIGHTABOVELEVEL_PARAM).Set(fixed_thk)
            f_cnt += 1

        # 2. 抓原始混凝土樑投影 
        room_bbox = room.get_BoundingBox(None)
        outline = Outline(XYZ(room_bbox.Min.X - 0.5/0.3048, room_bbox.Min.Y - 0.5/0.3048, room_bbox.Min.Z + 1.0/0.3048), 
                          XYZ(room_bbox.Max.X + 0.5/0.3048, room_bbox.Max.Y + 0.5/0.3048, room_bbox.Min.Z + 5.0/0.3048))
        local_beams = FilteredElementCollector(doc).WherePasses(BoundingBoxIntersectsFilter(outline)).WherePasses(ElementMulticategoryFilter(List[BuiltInCategory]([BuiltInCategory.OST_StructuralFraming, BuiltInCategory.OST_GenericModel]))).ToElements()
        
        beam_footprints = []
        room_beams_info = []
        for beam in local_beams:
            geom = beam.get_Geometry(opt)
            solids = [obj for obj in geom if isinstance(obj, Solid) and obj.Volume > 0]
            if geom:
                for obj in geom:
                    if isinstance(obj, GeometryInstance): solids.extend([s for s in obj.GetInstanceGeometry() if isinstance(s, Solid) and s.Volume > 0])
            for solid in solids:
                for face in solid.Faces:
                    if isinstance(face, PlanarFace) and face.FaceNormal.Z < -0.9:
                        beam_footprints.append(to_z0(face.GetEdgesAsCurveLoops()[0]))
                        room_beams_info.append(face.Origin.Z)

        rel_beam_h = (min(room_beams_info) - abs_level_z) if room_beams_info else rel_ceil_h

        # 3. 3D 碰撞生成紫黃塗層
        room_solid = None
        for loop in room_mold:
            s = GeometryCreationUtilities.CreateExtrusionGeometry(List[CurveLoop]([loop]), XYZ.BasisZ, 1.0)
            if room_solid is None: room_solid = s
            else: room_solid = BooleanOperationsUtils.ExecuteBooleanOperation(room_solid, s, BooleanOperationsType.Union)

        if do_ceil and room_solid:
            merged_beam_solid = None
            for b_loop in beam_footprints:
                b_s = GeometryCreationUtilities.CreateExtrusionGeometry(List[CurveLoop]([b_loop]), XYZ.BasisZ, 1.0)
                if merged_beam_solid is None: merged_beam_solid = b_s
                else: merged_beam_solid = BooleanOperationsUtils.ExecuteBooleanOperation(merged_beam_solid, b_s, BooleanOperationsType.Union)
            
            if merged_beam_solid:
                p_solid = BooleanOperationsUtils.ExecuteBooleanOperation(room_solid, merged_beam_solid, BooleanOperationsType.Intersect)
                if p_solid and p_solid.Volume > 0:
                    for face in p_solid.Faces:
                        if isinstance(face, PlanarFace) and face.FaceNormal.Z < -0.9:
                            loops = face.GetEdgesAsCurveLoops()
                            Floor.Create(doc, loops, t_ceiling.Id, level_id).get_Parameter(BuiltInParameter.FLOOR_HEIGHTABOVELEVEL_PARAM).Set(rel_beam_h)
                            b_cnt += 1
                            
                            bs_bottom_z = rel_beam_h - fixed_thk
                            bs_h = rel_ceil_h - bs_bottom_z
                            for p_loop in loops:
                                for c in p_loop:
                                    if is_beam_side(c, room_mold):
                                        p0, p1 = c.GetEndPoint(0), c.GetEndPoint(1)
                                        v = XYZ(p1.X-p0.X, p1.Y-p0.Y, 0).Normalize()
                                        n = XYZ(-v.Y, v.X, 0)
                                        mid_pt = XYZ((p0.X+p1.X)/2, (p0.Y+p1.Y)/2, 0)
                                        test_p = XYZ(mid_pt.X + n.X*0.05, mid_pt.Y + n.Y*0.05, 0)
                                        if is_pt_in_polygon(test_p, List[CurveLoop]([p_loop])): 
                                            n = XYZ(-n.X, -n.Y, 0) 
                                            
                                        final_c = Line.CreateBound(XYZ(p0.X+n.X*half_thk, p0.Y+n.Y*half_thk, 0), XYZ(p1.X+n.X*half_thk, p1.Y+n.Y*half_thk, 0))
                                        Wall.Create(doc, final_c, t_beamside.Id, level_id, bs_h, bs_bottom_z, False, False)
                                        bs_cnt += 1

                y_solid = BooleanOperationsUtils.ExecuteBooleanOperation(room_solid, merged_beam_solid, BooleanOperationsType.Difference)
                if y_solid and y_solid.Volume > 0:
                    for face in y_solid.Faces:
                        if isinstance(face, PlanarFace) and face.FaceNormal.Z < -0.9:
                            Floor.Create(doc, face.GetEdgesAsCurveLoops(), t_ceiling.Id, level_id).get_Parameter(BuiltInParameter.FLOOR_HEIGHTABOVELEVEL_PARAM).Set(rel_ceil_h)
                            c_cnt += 1
            else:
                Floor.Create(doc, room_mold, t_ceiling.Id, level_id).get_Parameter(BuiltInParameter.FLOOR_HEIGHTABOVELEVEL_PARAM).Set(rel_ceil_h)
                c_cnt += 1

        # 🚀 5. 牆面生成 
        if do_wall:
            for seg_list in boundaries:
                for seg in seg_list:
                    c = seg.GetCurve()
                    host_id = seg.ElementId
                    
                    p0, p1 = c.GetEndPoint(0), c.GetEndPoint(1)
                    v = XYZ(p1.X-p0.X, p1.Y-p0.Y, 0).Normalize()
                    n = XYZ(-v.Y, v.X, 0) # 指向房間內
                    
                    w_curve = Line.CreateBound(XYZ(p0.X+n.X*half_thk, p0.Y+n.Y*half_thk, 0), XYZ(p1.X+n.X*half_thk, p1.Y+n.Y*half_thk, 0))
                    
                    mid_pt = w_curve.Evaluate(0.5, True)
                    
                    # ✨ 修正：一般牆壁直接頂天到 rel_ceil_h (不扣 2cm了！)
                    wall_h = rel_ceil_h 
                    
                    # ✨ 只有在「頭上有樑」的時候，才降高到 rel_beam_h
                    if is_pt_in_polygon(mid_pt, beam_footprints):
                        wall_h = rel_beam_h 
                    
                    try:
                        w1 = Wall.Create(doc, w_curve, t_wall.Id, level_id, wall_h, 0.0, False, False)
                        w_cnt += 1
                        
                        if host_id != ElementId.InvalidElementId:
                            host_wall = doc.GetElement(host_id)
                            if isinstance(host_wall, Wall):
                                JoinGeometryUtils.JoinGeometry(doc, w1, host_wall)
                    except: pass

TransactionManager.Instance.TransactionTaskDone()

OUT = {
    "🏆 狀態": "Ver 12.2 無縫頂天版！牆高缺口已完美修復！",
    "牆面 (無縫接頂)": w_cnt,
    "天花與樑塗層": b_cnt + bs_cnt + c_cnt,
    "地板": f_cnt
}
# ----------------------------------------
watch = Watch(python_script)  # graph output
說明 = StringInput("把目前視圖所有房間依照房間的塗層畫上粉刷")  # graph input
是否刪除原有塗層 = BoolSelector(true)  # graph input
