# Dynamo graph 建築-房間高度標準化.dyn (Dynamo 3.6.1.9895)

未放置房間是否刪除 = BoolSelector(true)  # graph input
python_script = Python(IN[0]=未放置房間是否刪除)  # CPython3
# ---------- python_script.python (82 lines) ----------
import clr

# 引用 Revit API
clr.AddReference('RevitAPI')
from Autodesk.Revit.DB import *

# 引用 Revit 服務
clr.AddReference('RevitServices')
import RevitServices
from RevitServices.Persistence import DocumentManager
from RevitServices.Transactions import TransactionManager

# 取得目前的檔案與文件
doc = DocumentManager.Instance.CurrentDBDocument

# --- 接收輸入參數 ---
# IN[0] 接 Boolean (True = 刪除未放置房間 / False = 不刪除)
should_delete_unplaced = IN[0]

# 1. 抓取專案中所有「房間」
room_collector = FilteredElementCollector(doc).OfCategory(BuiltInCategory.OST_Rooms).WhereElementIsNotElementType()
rooms = room_collector.ToElements()

# 2. 抓取所有「樓層」並依高程排序
level_collector = FilteredElementCollector(doc).OfClass(Level).WhereElementIsNotElementType()
sorted_levels = sorted(level_collector.ToElements(), key=lambda lvl: lvl.Elevation)

# 開始執行交易
TransactionManager.Instance.EnsureInTransaction(doc)

deleted_count = 0
processed_count = 0

for room in rooms:
    # --- 邏輯 A：處理未放置或無面積的房間 ---
    if room.Location is None or room.Area <= 0:
        if should_delete_unplaced:
            doc.Delete(room.Id)
            deleted_count += 1
        continue
    
    # --- 邏輯 B：處理正常房間的高程約束 ---
    base_level = room.Level
    if not base_level:
        continue
    
    current_idx = -1
    for i, lvl in enumerate(sorted_levels):
        if lvl.Id == base_level.Id:
            current_idx = i
            break
    
    # 尋找直上層
    if current_idx != -1 and current_idx < len(sorted_levels) - 1:
        next_level = sorted_levels[current_idx + 1]
        
        # 取得參數並執行修改
        upper_limit_param = room.get_Parameter(BuiltInParameter.ROOM_UPPER_LEVEL)
        limit_offset_param = room.get_Parameter(BuiltInParameter.ROOM_UPPER_OFFSET)
        base_offset_param = room.get_Parameter(BuiltInParameter.ROOM_LOWER_OFFSET)
        
        if upper_limit_param and not upper_limit_param.IsReadOnly:
            upper_limit_param.Set(next_level.Id)
        if limit_offset_param and not limit_offset_param.IsReadOnly:
            limit_offset_param.Set(0.0)
        if base_offset_param and not base_offset_param.IsReadOnly:
            base_offset_param.Set(0.0)
            
        processed_count += 1

# 結束交易
TransactionManager.Instance.TransactionTaskDone()

# 輸出結果回報
status = "【小明哥專業版腳本】\n"
status += f"● 已更新高程約束：{processed_count} 個房間\n"
if should_delete_unplaced:
    status += f"● 已清理未放置房間：{deleted_count} 個"
else:
    status += "● 本次執行未開啟清理功能"

OUT = status
# ----------------------------------------
watch = Watch(python_script)
說明 = StringInput("把所有房間高度調到直上樓層其限制偏移，基準偏移都為0")  # graph input
