# Dynamo graph 建築-接合全部取消.dyn "建築-全部取消接合" (Dynamo 3.6.1.9895)

python_script = Python()  # CPython3
# ---------- python_script.python (44 lines) ----------
import clr
clr.AddReference('RevitAPI')
from Autodesk.Revit.DB import *

clr.AddReference('RevitServices')
import RevitServices
from RevitServices.Persistence import DocumentManager
from RevitServices.Transactions import TransactionManager

doc = DocumentManager.Instance.CurrentDBDocument

unjoined_count = 0

# 🌟 開門密語
TransactionManager.Instance.EnsureInTransaction(doc)

# 妹妹的防呆過濾網：直接在內部撈出「所有不是類型(Type)」的實體物件
all_elements = FilteredElementCollector(doc).WhereElementIsNotElementType().ToElements()

for el in all_elements:
    # 效能優化：如果這個物件連 Category (類別) 都沒有，通常是系統隱藏物件，直接跳過不處理
    if el.Category is None: continue 
    
    try:
        # 直接問 Revit：這個物件現在跟誰接合在一起？
        joined_ids = JoinGeometryUtils.GetJoinedElements(doc, el)
        
        # 如果沒有跟別人接合，就換下一個
        if not joined_ids: continue
        
        for j_id in joined_ids:
            joined_el = doc.GetElement(j_id)
            if joined_el is not None:
                # 無情地把它們切開！
                JoinGeometryUtils.UnjoinGeometry(doc, el, joined_el)
                unjoined_count += 1
    except:
        # 遇到天生不支援接合的物件（例如文字、線條），直接忽略，保護腳本不崩潰
        continue

# 🌟 關門密語
TransactionManager.Instance.TransactionTaskDone()

OUT = "報告哥哥！全域無差別大掃除完成！共無情拆散了 {} 組接合關係。".format(unjoined_count)
# ----------------------------------------
說明 = StringInput("取消所有物件的接合")  # graph input
