# Dynamo graph 建築-接合批次.dyn "建築-批次接合" (Dynamo 3.6.1.9895)

順序1 = StringInput("結構柱")  # graph input
順序2 = StringInput("結構構架")  # graph input
順序3 = StringInput("牆")  # graph input
順序4 = StringInput("樓板")  # graph input
list_create = List.Create(item0=順序1, item1=順序2, item2=順序3, item3=順序4)
python_script = Python(IN[0]=list_create)  # CPython3
# ---------- python_script.python (81 lines) ----------
import clr
import System
# 引入 C# 的 List 資料結構
from System.Collections.Generic import List

clr.AddReference('RevitAPI')
from Autodesk.Revit.DB import *

clr.AddReference('RevitServices')
import RevitServices
from RevitServices.Persistence import DocumentManager
from RevitServices.Transactions import TransactionManager

doc = DocumentManager.Instance.CurrentDBDocument

# 接收字串清單
category_names = IN[0]

# 建立 Revit 類別字典
category_dict = {}
for c in doc.Settings.Categories:
    category_dict[c.Name] = c.Id

list_of_groups = []

# 把字串轉成實體物件
for name in category_names:
    if name in category_dict:
        cat_id = category_dict[name]
        elements = FilteredElementCollector(doc).OfCategoryId(cat_id).WhereElementIsNotElementType().ToElements()
        list_of_groups.append(elements)
    else:
        list_of_groups.append([])

joined_count = 0
switched_count = 0

# 🌟 開門密語：跟 Dynamo 說我們要開始改模型囉
TransactionManager.Instance.EnsureInTransaction(doc)

for i in range(len(list_of_groups)):
    high_priority_elements = list_of_groups[i]
    
    for j in range(i + 1, len(list_of_groups)):
        low_priority_elements = list_of_groups[j]
        
        for high_el in high_priority_elements:
            if high_el is None: continue
            
            bbox = high_el.get_BoundingBox(None)
            if bbox is None: continue
            
            outline = Outline(bbox.Min, bbox.Max)
            filter = BoundingBoxIntersectsFilter(outline)
            
            low_el_ids = List[ElementId]()
            for el in low_priority_elements:
                if el is not None:
                    low_el_ids.Add(el.Id)
            
            if low_el_ids.Count == 0: continue
            
            collector = FilteredElementCollector(doc, low_el_ids)
            intersecting_els = collector.WherePasses(filter).ToElements()
            
            for low_el in intersecting_els:
                try:
                    if not JoinGeometryUtils.AreElementsJoined(doc, high_el, low_el):
                        JoinGeometryUtils.JoinGeometry(doc, high_el, low_el)
                        joined_count += 1
                    
                    if not JoinGeometryUtils.IsFirstElementCutting(doc, high_el, low_el):
                        JoinGeometryUtils.SwitchJoinOrder(doc, high_el, low_el)
                        switched_count += 1
                except:
                    continue

# 🌟 關門密語修正：Dynamo 專屬的完成交易指令
TransactionManager.Instance.TransactionTaskDone()

OUT = "報告小明哥哥！處理完成！新建接合數：{}，切換順序數：{}".format(joined_count, switched_count)
# ----------------------------------------
