# Dynamo graph 建築-接合版樑柱切換.dyn "建築-版樑切換接合" (Dynamo 3.6.1.9895)

說明 = StringInput("""因為rvit的樓版非常有強勢會剪掉所有的物件我們就做切換接合模式把柱樑的主權抓回
結構柱
結構構架
牆
樓板""")  # graph input
python_script = Python()  # CPython3
# ---------- python_script.python (100 lines) ----------
import clr
import System
from System.Collections.Generic import List

clr.AddReference('RevitAPI')
from Autodesk.Revit.DB import *

clr.AddReference('RevitServices')
import RevitServices
from RevitServices.Persistence import DocumentManager
from RevitServices.Transactions import TransactionManager

doc = DocumentManager.Instance.CurrentDBDocument

# 1. 鎖定目標大掃描
columns = FilteredElementCollector(doc).OfCategory(BuiltInCategory.OST_StructuralColumns).WhereElementIsNotElementType().ToElements()
beams = FilteredElementCollector(doc).OfCategory(BuiltInCategory.OST_StructuralFraming).WhereElementIsNotElementType().ToElements()
floors = FilteredElementCollector(doc).OfCategory(BuiltInCategory.OST_Floors).WhereElementIsNotElementType().ToElements()

floor_ids = List[ElementId]([f.Id for f in floors])

clean_cut_count = 0
joined_count = 0
switch_count = 0
fail_count = 0
error_log = []

TransactionManager.Instance.EnsureInTransaction(doc)

# 🛠️ 定義核心作戰流程
def process_pair(boss, sub):
    global clean_cut_count, joined_count, switch_count, fail_count, error_log
    
    # 🔪 步驟 A：盲目解除實體剪切詛咒
    try:
        SolidSolidCutUtils.RemoveCutBetweenSolids(doc, boss, sub)
        clean_cut_count += 1
    except: pass
        
    try:
        SolidSolidCutUtils.RemoveCutBetweenSolids(doc, sub, boss)
        clean_cut_count += 1
    except: pass

    # 🤝 步驟 B：重新建立接合，並強制切換
    try:
        if not JoinGeometryUtils.AreElementsJoined(doc, boss, sub):
            JoinGeometryUtils.JoinGeometry(doc, boss, sub)
            joined_count += 1
            
        doc.Regenerate() # 強制刷新大腦
        
        # 👑 步驟 C：強制切換順序 (妹妹修正過 API 的版本！)
        if JoinGeometryUtils.AreElementsJoined(doc, boss, sub):
            if not JoinGeometryUtils.IsCuttingElementInJoin(doc, boss, sub):
                JoinGeometryUtils.SwitchJoinOrder(doc, boss, sub)
                switch_count += 1
                
    except Exception as e:
        fail_count += 1
        error_msg = str(e)
        if error_msg not in error_log:
            error_log.append(error_msg)

# ==========================================
# 🌟 全軍出擊
# ==========================================
if floor_ids.Count > 0:
    for col in columns:
        bbox = col.get_BoundingBox(None)
        if not bbox: continue
        outline = Outline(bbox.Min, bbox.Max)
        filter = BoundingBoxIntersectsFilter(outline)
        for f in FilteredElementCollector(doc, floor_ids).WherePasses(filter).ToElements():
            process_pair(col, f)
            
    for beam in beams:
        bbox = beam.get_BoundingBox(None)
        if not bbox: continue
        outline = Outline(bbox.Min, bbox.Max)
        filter = BoundingBoxIntersectsFilter(outline)
        for f in FilteredElementCollector(doc, floor_ids).WherePasses(filter).ToElements():
            process_pair(beam, f)

TransactionManager.Instance.TransactionTaskDone()

# 整理錯誤訊息
error_summary = "無"
if error_log:
    error_summary = "\n   👉 ".join(error_log[:3])

# 🌟 妹妹的防崩潰設計：改用逐行拼接，絕對不會再噴 EOL 錯誤！
out_str = "【終極解咒與篡位報告】\n"
out_str += "🧹 清除舊有詛咒：{}\n".format(clean_cut_count)
out_str += "🤝 成功重新牽手：{}\n".format(joined_count)
out_str += "👑 成功篡位奪權：{}\n".format(switch_count)
out_str += "💀 失敗次數：{}\n".format(fail_count)
out_str += "⚠️ Revit 殘留報錯：\n   👉 {}".format(error_summary)

OUT = out_str
# ----------------------------------------
watch = Watch(python_script)
