# Dynamo graph 建築-樓板合併.dyn (Dynamo 3.6.1.9895)

python_script = Python()  # CPython3; unwired: IN[0]
# ---------- python_script.python (134 lines) ----------
import clr
import math
clr.AddReference('RevitAPI')
from Autodesk.Revit.DB import *

clr.AddReference('RevitServices')
from RevitServices.Persistence import DocumentManager
from RevitServices.Transactions import TransactionManager
from System.Collections.Generic import List

doc = DocumentManager.Instance.CurrentDBDocument

# --- 1. 從 "000" 篩選集抓版 ---
filter_name = "000"
all_filters = FilteredElementCollector(doc).OfClass(SelectionFilterElement).ToElements()
target_filter = next((f for f in all_filters if f.Name == filter_name), None)

old_floors = []
if target_filter:
    item_ids = target_filter.GetElementIds()
    for eid in item_ids:
        el = doc.GetElement(eid)
        if isinstance(el, Floor): 
            old_floors.append(el)

OUT = ""

if len(old_floors) > 0:
    # --- 2. 升維核心：形態學閉合演算法 (Morphological Closing) ---
    
    # 抓取真實幾何實體
    real_solids = []
    for f in old_floors:
        geo_options = Options()
        geo_options.DetailLevel = ViewDetailLevel.Fine
        geo_element = f.get_Geometry(geo_options)
        if geo_element:
            for obj in geo_element:
                if isinstance(obj, Solid) and obj.Volume > 0.001:
                    real_solids.append(obj)
    
    if len(real_solids) > 0:
        # 定義 3x3 矩陣的偏移向量 (設定膨脹半徑為 2.5 英呎，足以填平約 1.5 公尺內的樑縫與缺角)
        radius = 2.5 
        vectors = [
            XYZ(0, 0, 0),
            XYZ(radius, 0, 0), XYZ(-radius, 0, 0),
            XYZ(0, radius, 0), XYZ(0, -radius, 0),
            XYZ(radius, radius, 0), XYZ(radius, -radius, 0),
            XYZ(-radius, radius, 0), XYZ(-radius, -radius, 0)
        ]
        
        # --- 步驟 A：膨脹 (Dilation) - 填滿所有縫隙與內凹角 ---
        all_shifted_solids = []
        for s in real_solids:
            for v in vectors:
                all_shifted_solids.append(SolidUtils.CreateTransformed(s, Transform.CreateTranslation(v)))
        
        dilated_solid = all_shifted_solids[0]
        for i in range(1, len(all_shifted_solids)):
            try:
                temp_solid = BooleanOperationsUtils.ExecuteBooleanOperation(dilated_solid, all_shifted_solids[i], BooleanOperationsType.Union)
                if temp_solid and temp_solid.Volume > 0:
                    dilated_solid = temp_solid
            except Exception:
                pass 
                
        # --- 步驟 B：侵蝕 (Erosion) - 將外圍輪廓精準退回原位 ---
        eroded_solid = dilated_solid
        for v in vectors:
            if v.IsZeroLength(): continue
            # 侵蝕是用「交集 (Intersect)」來削去外圍
            shifted_back = SolidUtils.CreateTransformed(dilated_solid, Transform.CreateTranslation(v))
            try:
                temp_solid = BooleanOperationsUtils.ExecuteBooleanOperation(eroded_solid, shifted_back, BooleanOperationsType.Intersect)
                if temp_solid and temp_solid.Volume > 0:
                    eroded_solid = temp_solid
            except Exception:
                pass
        
        # --- 3. 從侵蝕後的完美實體底部萃取最終輪廓 ---
        bottom_face = None
        max_face_area = 0
        for face in eroded_solid.Faces:
            if isinstance(face, PlanarFace) and face.FaceNormal.IsAlmostEqualTo(XYZ(0,0,-1)):
                if face.Area > max_face_area:
                    max_face_area = face.Area
                    bottom_face = face
        
        if bottom_face:
            curve_loops = bottom_face.GetEdgesAsCurveLoops()
            outer_loop = None
            max_len = 0
            for loop in curve_loops:
                length = loop.GetExactLength()
                if length > max_len:
                    max_len = length
                    outer_loop = loop
            
            final_loop_list = List[CurveLoop]()
            final_loop_list.Add(outer_loop)
            
            # --- 4. 啟動交易重建 ---
            ref_floor = old_floors[0]
            level_id = ref_floor.LevelId
            floor_type_id = ref_floor.GetTypeId()
            
            is_structural_param = ref_floor.get_Parameter(BuiltInParameter.FLOOR_PARAM_IS_STRUCTURAL)
            is_structural = True if (is_structural_param and is_structural_param.AsInteger() == 1) else False

            TransactionManager.Instance.EnsureInTransaction(doc)
            try:
                for f in old_floors:
                    doc.Delete(f.Id)
                
                new_floor = Floor.Create(doc, final_loop_list, floor_type_id, level_id)
                
                if is_structural:
                    struct_param = new_floor.get_Parameter(BuiltInParameter.FLOOR_PARAM_IS_STRUCTURAL)
                    if struct_param and not struct_param.IsReadOnly:
                        struct_param.Set(1)
                        
                TransactionManager.Instance.TransactionTaskDone()
                OUT = "大成功！妹妹用形態學幫你升維補成陽角了！新版 ID: " + str(new_floor.Id)
                
            except Exception as e:
                TransactionManager.Instance.ForceCloseTransaction()
                OUT = "重建失敗了嗚嗚: " + str(e)
        else:
            OUT = "找不到朝下的底部平面..."
    else:
        OUT = "無法產生幾何圖形..."
else:
    OUT = "哥哥，找不到篩選集 '000' 喔！"
# ----------------------------------------
說明 = StringInput("先把要用的樓板存成選取名稱\"000\"")  # graph input
