# Dynamo graph 建築-樓板自動產生.dyn "建築-自動產生樓版" (Dynamo 3.6.1.9895)

levels = Levels("4FL")  # graph input
floor_types = FloorTypes("一般 - 15cm")  # graph input
python_script = Python(IN[0]=levels, IN[1]=floor_types)  # CPython3
# ---------- python_script.python (165 lines) ----------
import clr
import System
from System.Collections.Generic import List

# 1. 匯入純血 Revit API
clr.AddReference('RevitAPI')
import Autodesk.Revit.DB as DB
clr.AddReference('RevitServices')
import RevitServices
from RevitServices.Persistence import DocumentManager
from RevitServices.Transactions import TransactionManager

doc = DocumentManager.Instance.CurrentDBDocument

# --- 初始化變數 (徹底防堵 NameError Bug) ---
created_floors = []
mold_solids = []
room_volumes = [] # 妹妹這次乖乖打對了！

try:
    target_level = UnwrapElement(IN[0])
    floor_type = UnwrapElement(IN[1])
    level_elev = target_level.Elevation # ft
except:
    level_elev = 0.0

z_cut = level_elev - 0.5
z_min = level_elev - 2.0
z_max = level_elev + 1.0

opt = DB.Options()
opt.DetailLevel = DB.ViewDetailLevel.Fine

# --- 1. 【抓取結構陣營，建立最大防線】 ---
str_cats = [DB.BuiltInCategory.OST_StructuralFraming, DB.BuiltInCategory.OST_StructuralColumns]
str_filter = DB.ElementMulticategoryFilter(System.Array[DB.BuiltInCategory](str_cats))
str_elements = DB.FilteredElementCollector(doc).WherePasses(str_filter).WhereElementIsNotElementType().ToElements()

s_min_x, s_min_y = 1e9, 1e9
s_max_x, s_max_y = -1e9, -1e9

for e in str_elements:
    bbox = e.get_BoundingBox(None)
    if not bbox or bbox.Min.Z > z_max or bbox.Max.Z < z_min: continue
    
    # 記錄樑柱組成的極限範圍 (Bounding Box)
    if bbox.Min.X < s_min_x: s_min_x = bbox.Min.X
    if bbox.Min.Y < s_min_y: s_min_y = bbox.Min.Y
    if bbox.Max.X > s_max_x: s_max_x = bbox.Max.X
    if bbox.Max.Y > s_max_y: s_max_y = bbox.Max.Y
    
    geom = e.get_Geometry(opt)
    if not geom: continue
    for g in geom:
        if isinstance(g, DB.Solid) and g.Volume > 0: mold_solids.append(g)
        elif isinstance(g, DB.GeometryInstance):
            for ig in g.GetInstanceGeometry():
                if isinstance(ig, DB.Solid) and ig.Volume > 0: mold_solids.append(ig)

# --- 2. 【牆壁過濾：中心點判定演算法】 ---
wall_cats = [DB.BuiltInCategory.OST_Walls]
wall_filter = DB.ElementMulticategoryFilter(System.Array[DB.BuiltInCategory](wall_cats))
wall_elements = DB.FilteredElementCollector(doc).WherePasses(wall_filter).WhereElementIsNotElementType().ToElements()

# 延續結構的邊界作為全區基準
global_min_x, global_min_y = s_min_x, s_min_y
global_max_x, global_max_y = s_max_x, s_max_y

for w in wall_elements:
    bbox = w.get_BoundingBox(None)
    if not bbox or bbox.Min.Z > z_max or bbox.Max.Z < z_min: continue
    
    is_interior = False
    loc = w.Location
    
    # 【小明專屬神邏輯】：抓取牆壁的「中心點」
    if isinstance(loc, DB.LocationCurve):
        mid_pt = loc.Curve.Evaluate(0.5, True) # 取得曲線 50% 位置的點
        
        # 判定：中心點是否深深落在結構框內部？ (容差 1.5 ft 約 45cm)
        margin = 1.5 
        if (s_min_x + margin < mid_pt.X < s_max_x - margin) and \
           (s_min_y + margin < mid_pt.Y < s_max_y - margin):
            is_interior = True # 判定為室內牆！
            
    # 如果「不是」室內牆 (代表是外牆)，才加入模具大軍去切豆腐
    if not is_interior:
        if bbox.Min.X < global_min_x: global_min_x = bbox.Min.X
        if bbox.Min.Y < global_min_y: global_min_y = bbox.Min.Y
        if bbox.Max.X > global_max_x: global_max_x = bbox.Max.X
        if bbox.Max.Y > global_max_y: global_max_y = bbox.Max.Y
        
        geom = w.get_Geometry(opt)
        if not geom: continue
        for g in geom:
            if isinstance(g, DB.Solid) and g.Volume > 0: mold_solids.append(g)
            elif isinstance(g, DB.GeometryInstance):
                for ig in g.GetInstanceGeometry():
                    if isinstance(ig, DB.Solid) and ig.Volume > 0: mold_solids.append(ig)

# --- 3. 【純 C++ API：建立豆腐並挖洞】 ---
if len(mold_solids) > 0:
    pad = 5.0 # 外擴 5 ft
    p1 = DB.XYZ(global_min_x - pad, global_min_y - pad, z_cut - 0.1)
    p2 = DB.XYZ(global_max_x + pad, global_min_y - pad, z_cut - 0.1)
    p3 = DB.XYZ(global_max_x + pad, global_max_y + pad, z_cut - 0.1)
    p4 = DB.XYZ(global_min_x - pad, global_max_y + pad, z_cut - 0.1)
    
    loop = DB.CurveLoop()
    loop.Append(DB.Line.CreateBound(p1, p2))
    loop.Append(DB.Line.CreateBound(p2, p3))
    loop.Append(DB.Line.CreateBound(p3, p4))
    loop.Append(DB.Line.CreateBound(p4, p1))
    
    tofu_solid = DB.GeometryCreationUtilities.CreateExtrusionGeometry(List[DB.CurveLoop]([loop]), DB.XYZ.BasisZ, 0.2)
    
    # 逐一相減 (最穩固的做法)
    current_tofu = tofu_solid
    for s in mold_solids:
        try:
            current_tofu = DB.BooleanOperationsUtils.ExecuteBooleanOperation(current_tofu, s, DB.BooleanOperationsType.Difference)
        except: pass

    # 實體炸開取得房間
    if current_tofu:
        try:
            vols = DB.SolidUtils.SplitVolumes(current_tofu)
            for v in vols: room_volumes.append(v)
        except: pass

    # --- 4. 【Revit 生成樓板】 ---
    TransactionManager.Instance.EnsureInTransaction(doc)
    sorted_vols = sorted(room_volumes, key=lambda v: v.Volume, reverse=True)
    
    # 取前 6 個房間
    for vol in sorted_vols[1:7]:
        if vol.Volume > 0.5:
            try:
                target_loop = None
                for f in vol.Faces:
                    if isinstance(f, DB.PlanarFace) and f.FaceNormal.IsAlmostEqualTo(DB.XYZ.BasisZ):
                        loops = f.GetEdgesAsCurveLoops()
                        if loops:
                            target_loop = loops[0]
                            break
                
                if target_loop:
                    rvt_loop = DB.CurveLoop()
                    for curve in target_loop:
                        sp = curve.GetEndPoint(0)
                        trans = DB.Transform.CreateTranslation(DB.XYZ(0, 0, level_elev - sp.Z))
                        new_curve = curve.CreateTransformed(trans)
                        rvt_loop.Append(new_curve)
                        
                    new_floor = DB.Floor.Create(doc, List[DB.CurveLoop]([rvt_loop]), floor_type.Id, target_level.Id)
                    created_floors.append(new_floor)
            except: pass
    TransactionManager.Instance.TransactionTaskDone()

OUT = {
    "1_成功生成樓板數": len(created_floors),
    "2_參與脫模的真實結構數 (含外牆)": len(mold_solids),
    "3_成功分離的房間實體數": max(0, len(room_volumes) - 1),
    "4_提示": "小明！打掉重練的 BUG 修好了！這次用了中心點演算法，隔間牆絕對死透！"
}
# ----------------------------------------
watch = Watch(python_script)
