# Dynamo graph 建築-樓板變車道版.dyn "建築-車道版" (Dynamo 3.6.1.9895)

選一塊樓板 = DSModelElementSelection()  # 1 picked in the model; graph input
選道路中心線 = DSModelElementsSelection()  # 3 picked in the model; graph input
前後高程差 = DoubleInput(-400)  # graph input
中心線分割距離 = DoubleInput(50)  # graph input
python_script = Python(IN[0]=選一塊樓板, IN[1]=選道路中心線, IN[2]=前後高程差, IN[3]=中心線分割距離)  # CPython3
# ---------- python_script.python (156 lines) ----------
import clr
import sys
import traceback

clr.AddReference('ProtoGeometry')
import Autodesk.DesignScript.Geometry as DS

clr.AddReference('RevitAPI')
from Autodesk.Revit.DB import *

clr.AddReference('RevitNodes')
import Revit
clr.ImportExtensions(Revit.Elements)
clr.ImportExtensions(Revit.GeometryConversion)
from Revit.GeometryConversion import *

clr.AddReference('RevitServices')
import RevitServices
from RevitServices.Persistence import DocumentManager
from RevitServices.Transactions import TransactionManager

doc = DocumentManager.Instance.CurrentDBDocument

# 將整個程式包裝在 try-except 中
try:
    # ================= 1. 輸入與資料整理 =================
    dyn_floor = IN[0]
    floor = UnwrapElement(dyn_floor)

    raw_lines = IN[1]
    if not hasattr(raw_lines, '__iter__'):
        raw_lines = [raw_lines]

    dyn_curves = []
    for item in raw_lines:
        if hasattr(item, "PointAtParameter"):
            dyn_curves.append(item)
        else:
            unwrapped = UnwrapElement(item)
            if hasattr(unwrapped, "GeometryCurve"):
                dyn_curves.append(unwrapped.GeometryCurve.ToProtoType())
            elif hasattr(unwrapped, "ToProtoType"):
                dyn_curves.append(unwrapped.ToProtoType())

    try: delta_z_cm = float(IN[2]) if IN[2] is not None else 0.0
    except: delta_z_cm = 0.0
    
    try: dist_cm = float(IN[3]) if IN[3] is not None else 50.0
    except: dist_cm = 50.0

    if not dyn_curves: raise ValueError("找不到線條！")

    polycurve = dyn_curves[0] if len(dyn_curves) == 1 else DS.PolyCurve.ByJoinedCurves(dyn_curves)
    
    # 將中心線投影到 Z=0 的 2D 平面上
    xy_plane = DS.Plane.ByOriginNormal(DS.Point.Origin(), DS.Vector.ZAxis())
    polycurve_2d = polycurve.PullOntoPlane(xy_plane)
    total_length_2d = polycurve_2d.Length

    # ================= 2. 幾何運算：計算放射交點 =================
    floor_solids = dyn_floor.Geometry()
    floor_solid = next((geo for geo in floor_solids if isinstance(geo, DS.Solid)), None)

    if not floor_solid:
        raise ValueError("無法取得樓板實體幾何")

    bbox = floor_solid.BoundingBox
    mid_z = (bbox.MinPoint.Z + bbox.MaxPoint.Z) / 2.0

    def get_furthest_pt(center_pt, intersect_results):
        max_dist = -1
        furthest_pt = None
        for item in intersect_results:
            if hasattr(item, "StartPoint") and hasattr(item, "EndPoint"):
                for p in [item.StartPoint, item.EndPoint]:
                    d = ((center_pt.X - p.X)**2 + (center_pt.Y - p.Y)**2)**0.5
                    if d > max_dist:
                        max_dist = d; furthest_pt = p
            elif hasattr(item, "X"):
                d = ((center_pt.X - item.X)**2 + (center_pt.Y - item.Y)**2)**0.5
                if d > max_dist:
                    max_dist = d; furthest_pt = item
        return furthest_pt

    num_segments = int(total_length_2d / dist_cm)
    if num_segments < 1: num_segments = 1

    split_lines_2d = []

    for i in range(1, num_segments):
        t = (i * dist_cm) / total_length_2d
        if t >= 1.0: continue

        pt_2d = polycurve_2d.PointAtParameter(t)
        tangent = polycurve_2d.TangentAtParameter(t)
        perp_vec = tangent.Cross(DS.Vector.ZAxis()).Normalized()

        ray_start_pt = DS.Point.ByCoordinates(pt_2d.X, pt_2d.Y, mid_z)
        line1 = DS.Line.ByStartPointDirectionLength(ray_start_pt, perp_vec, 100000)
        line2 = DS.Line.ByStartPointDirectionLength(ray_start_pt, perp_vec.Reverse(), 100000)

        int1 = line1.Intersect(floor_solid)
        int2 = line2.Intersect(floor_solid)

        p1 = get_furthest_pt(ray_start_pt, int1)
        p2 = get_furthest_pt(ray_start_pt, int2)

        if p1 and p2:
            dyn_p1 = DS.Point.ByCoordinates(p1.X, p1.Y, 0)
            dyn_p2 = DS.Point.ByCoordinates(p2.X, p2.Y, 0)
            split_lines_2d.append((dyn_p1.ToXyz(), dyn_p2.ToXyz()))

    # ================= 3. Revit API 修改：切割與變高 =================
    TransactionManager.Instance.EnsureInTransaction(doc)

    editor = floor.GetSlabShapeEditor() if hasattr(floor, "GetSlabShapeEditor") else floor.SlabShapeEditor
    
    # 【關鍵修正】：順序對調！先重置樓板，再啟用編輯器！
    editor.ResetSlabShape()
    editor.Enable()
    doc.Regenerate()

    for rp1, rp2 in split_lines_2d:
        try:
            if hasattr(editor, "AddPoint"):
                v1 = editor.AddPoint(rp1)
                v2 = editor.AddPoint(rp2)
                editor.AddSplitLine(v1, v2)
            else:
                v1 = editor.DrawPoint(rp1)
                v2 = editor.DrawPoint(rp2)
                editor.DrawSplitLine(v1, v2)
        except Exception as e:
            pass # 忽略極少數太靠近邊界無法畫線的情況

    doc.Regenerate()

    # 抓取「所有」頂點
    vertices = list(editor.SlabShapeVertices)
    
    for v in vertices:
        pt_dyn = v.Position.ToPoint()
        pt_2d = DS.Point.ByCoordinates(pt_dyn.X, pt_dyn.Y, 0)
        
        closest_pt = polycurve_2d.ClosestPointTo(pt_2d)
        t = polycurve_2d.ParameterAtPoint(closest_pt)
        
        offset_feet = (delta_z_cm * t) / 30.48
        
        editor.ModifySubElement(v, offset_feet)

    TransactionManager.Instance.TransactionTaskDone()
    OUT = f"Success: 完美切割並調整高程！共處理了 {len(vertices)} 個節點。"

except Exception as e:
    OUT = traceback.format_exc()
# ----------------------------------------
watch = Watch(python_script)
