# Dynamo graph 建築-車位安排-還沒好.dyn "建築-車位安排" (Dynamo 3.6.2.11575)

選一個廁所房間的物件 = DSModelElementSelection()  # 1 picked in the model; graph input
watch = Watch(選一個廁所房間的物件)
無障礙車位數量 = DoubleInput(1)
移動柱子 = BoolSelector(false)
family_types = FamilyTypes("法規停車位_V4:2.5m x 5.5m 法定停車位(標準汽車)")
n0_貼齊邊緣_1_中心輻射 = BoolSelector(false)  # "0: 貼齊邊緣 / 1: 中心輻射"
配置角度轉90 = BoolSelector(true)
python_script = Python(IN[0]=選一個廁所房間的物件, IN[1]=無障礙車位數量, IN[2]=移動柱子, IN[3]=family_types, IN[4]=n0_貼齊邊緣_1_中心輻射, IN[5]=配置角度轉90)  # CPython3
# ---------- python_script.python (173 lines) ----------
import clr
import math
clr.AddReference('RevitAPI')
from Autodesk.Revit.DB import *
from Autodesk.Revit.DB.Structure import StructuralType

clr.AddReference('RevitNodes')
import Revit
clr.ImportExtensions(Revit.GeometryConversion)
clr.ImportExtensions(Revit.Elements)

clr.AddReference("RevitServices")
import RevitServices
from RevitServices.Persistence import DocumentManager
from RevitServices.Transactions import TransactionManager

# --- 1. 讀取與解包 IN 節點 ---
room = UnwrapElement(IN[0])
acc_count = IN[1]
move_cols = IN[2]
car_symbol = UnwrapElement(IN[3]) 
is_center_mode = IN[4] 
is_rotated = IN[5]     

doc = DocumentManager.Instance.CurrentDBDocument
TransactionManager.Instance.EnsureInTransaction(doc)

# --- 2. 自動提取參數 ---
car_w_ft = 250.0 / 30.48
car_l_ft = 550.0 / 30.48

if car_symbol:
    param_w = car_symbol.LookupParameter("停車位寬")
    param_l = car_symbol.LookupParameter("停車位長")
    if param_w: car_w_ft = param_w.AsDouble()
    if param_l: car_l_ft = param_l.AsDouble()

# --- 3. 虛擬測量：探針偵測族群偏差 ---
if car_symbol and not car_symbol.IsActive:
    car_symbol.Activate()

room_level = doc.GetElement(room.LevelId)
bbox_room = room.get_BoundingBox(None)
room_z = bbox_room.Min.Z if bbox_room else 0.0

probe_origin = XYZ.Zero
probe_inst = doc.Create.NewFamilyInstance(probe_origin, car_symbol, room_level, StructuralType.NonStructural)
doc.Regenerate()

probe_bbox = probe_inst.get_BoundingBox(None)
offset_vec = XYZ.Zero

if probe_bbox:
    geom_center = XYZ((probe_bbox.Min.X + probe_bbox.Max.X)/2, (probe_bbox.Min.Y + probe_bbox.Max.Y)/2, 0)
    offset_vec = probe_origin.Subtract(geom_center)

doc.Delete(probe_inst.Id)

# --- 4. 自動清場 (舊車位回收) ---
existing_cars = FilteredElementCollector(doc).OfClass(FamilyInstance).WhereElementIsNotElementType().ToElements()
for old_car in existing_cars:
    if old_car.Symbol.Id == car_symbol.Id:
        loc = old_car.Location
        if isinstance(loc, LocationPoint):
            test_pt = XYZ(loc.Point.X, loc.Point.Y, room_z + 1.0)
            if room.IsPointInRoom(test_pt):
                doc.Delete(old_car.Id)

# --- 5. 尋找出入口與計算向量 ---
def is_safe(pt):
    return room.IsPointInRoom(XYZ(pt.X, pt.Y, room_z + 1.0))

room_center = XYZ((bbox_room.Min.X + bbox_room.Max.X)/2, (bbox_room.Min.Y + bbox_room.Max.Y)/2, room_z) if bbox_room else XYZ.Zero
entrance_pt = None

collector = FilteredElementCollector(doc).OfClass(FamilyInstance)
for inst in collector:
    if inst.Symbol.Family.Name == "停車場性質標記":
        loc = inst.Location
        if isinstance(loc, LocationPoint) and room.IsPointInRoom(loc.Point):
            type_elem = doc.GetElement(inst.GetTypeId())
            p = type_elem.LookupParameter("出入性質")
            if p and p.AsString() == "出入口":
                entrance_pt = XYZ(loc.Point.X, loc.Point.Y, room_z)
                break

opt = SpatialElementBoundaryOptions()
opt.SpatialElementBoundaryLocation = SpatialElementBoundaryLocation.Finish
boundaries = room.GetBoundarySegments(opt)
outer_lines = [seg.GetCurve() for seg in boundaries[0]] if boundaries else []

cut_vector = XYZ.BasisX
cut_origin = room_center

if entrance_pt and outer_lines:
    closest_curve = min(outer_lines, key=lambda c: c.Project(entrance_pt).Distance)
    line_dir = closest_curve.Direction
    normal_vec = XYZ(-line_dir.Y, line_dir.X, 0).Normalize()
    cut_vector = line_dir.Normalize() if is_rotated else normal_vec
    cut_origin = room_center if is_center_mode else entrance_pt

# --- 6. 智慧生成、校正與【動線開挖】 ---
placed_count = 0
band_width_ft = 1700.0 / 30.48
aisle_half_ft = 300.0 / 30.48
shift_dist = aisle_half_ft + (car_l_ft / 2.0)

spine_dir = cut_vector.CrossProduct(XYZ.BasisZ).Normalize()
angle_rad_A = math.atan2(cut_vector.Y, cut_vector.X) + (math.pi / 2.0)
angle_rad_B = angle_rad_A + math.pi

# 🚗 【動線開挖魔法】：主動線保留區半徑 (3公尺 = 6公尺寬的車道)
main_aisle_radius_ft = 300.0 / 30.48

def is_in_main_driveway(pt):
    if not entrance_pt: return False # 如果沒放標記就不開挖
    vec = pt.Subtract(entrance_pt)
    
    # 計算車位中心到「十字主車道」的垂直距離
    dist_to_spine_axis = abs(vec.DotProduct(cut_vector)) 
    dist_to_cut_axis = abs(vec.DotProduct(spine_dir))
    
    # 如果車位落入 6m 十字車道範圍內，就判定為擋道！
    if dist_to_spine_axis < main_aisle_radius_ft or dist_to_cut_axis < main_aisle_radius_ft:
        return True
    return False

def place_calibrated(target_center, rot_angle):
    # 1. 🛡️ 動線開挖檢查：擋到主車道就不放車！
    if is_in_main_driveway(target_center):
        return False
        
    # 2. 校正插入點
    transform = Transform.CreateRotation(XYZ.BasisZ, rot_angle)
    corrected_insertion_pt = target_center.Add(transform.OfVector(offset_vec))
    
    # 3. 邊界碰撞偵測
    w_vec = spine_dir.Multiply(car_w_ft / 2.0)
    l_vec = cut_vector.Multiply(car_l_ft / 2.0)
    corners = [
        target_center.Add(w_vec).Add(l_vec),
        target_center.Subtract(w_vec).Add(l_vec),
        target_center.Subtract(w_vec).Subtract(l_vec),
        target_center.Add(w_vec).Subtract(l_vec),
        target_center
    ]
    
    if all(is_safe(c) for c in corners):
        inst = doc.Create.NewFamilyInstance(corrected_insertion_pt, car_symbol, room_level, StructuralType.NonStructural)
        axis = Line.CreateBound(corrected_insertion_pt, corrected_insertion_pt.Add(XYZ.BasisZ))
        ElementTransformUtils.RotateElement(doc, inst.Id, axis, rot_angle)
        return True
    return False

# 佈置無限網格
for j in range(-15, 16):
    band_base = cut_origin.Add(cut_vector.Multiply(j * band_width_ft))
    for i in range(-50, 51):
        spot_line = band_base.Add(spine_dir.Multiply(i * car_w_ft))
        
        if place_calibrated(spot_line.Add(cut_vector.Multiply(shift_dist)), angle_rad_A): 
            placed_count += 1
        if place_calibrated(spot_line.Subtract(cut_vector.Multiply(shift_dist)), angle_rad_B): 
            placed_count += 1

TransactionManager.Instance.TransactionTaskDone()

# --- 7. 最終報告 ---
OUT = {
    "狀態": "🛣️ 摩西分海！主動線開挖完成！",
    "目前起點模式": "1: 中心輻射" if is_center_mode else "0: 貼齊邊緣 (出入口)",
    "成功生成數量": placed_count
}
# ----------------------------------------
watch_2 = Watch(python_script)
string = StringInput("")  # graph input
車位寬 = DoubleInput(250)
車位長 = DoubleInput(550)
