# Dynamo graph 敷地-地形-坵塊圖.dyn (Dynamo 3.6.1.9895)

string = StringInput("25x25坵塊圖A")  # graph input
select_model_element = DSModelElementSelection()  # 1 picked in the model; graph input
坵塊圖邊長 = DoubleInput(25)  # graph input
python_script = Python(IN[0]=string, IN[1]=select_model_element, IN[2]=坵塊圖邊長)  # CPython3
# ---------- python_script.python (122 lines) ----------
import clr
import math

# 載入 Revit API
clr.AddReference('RevitAPI')
from Autodesk.Revit.DB import *

clr.AddReference('RevitServices')
from RevitServices.Persistence import DocumentManager
from RevitServices.Transactions import TransactionManager

doc = DocumentManager.Instance.CurrentDBDocument

# 容差與輸入
MIN_TOLERANCE = 0.0053 
fam_name = IN[0]  # "25x25坵塊圖A"
terrain = UnwrapElement(IN[1])
# 【PRO 升級】：讀取 IN[2] 作為邊長，若無輸入則預設為 25
L_meters = float(IN[2]) if IN[2] is not None else 25.0

# --- 純數學 2D 交點判定 ---
def ccw(A, B, C):
    return (C.Y - A.Y) * (B.X - A.X) > (B.Y - A.Y) * (C.X - A.X)

def intersect_2d(A, B, C, D):
    return ccw(A, C, D) != ccw(B, C, D) and ccw(A, B, C) != ccw(A, B, D)

def get_inter_count(boundary_pts, contours_pts):
    if not boundary_pts: return 0
    pA, pB = boundary_pts
    count = 0
    for pC, pD in contours_pts:
        if intersect_2d(pA, pB, pC, pD):
            count += 1
    return count

# --- 1. 取得視圖專屬等高線 ---
opt = Options()
opt.View = doc.ActiveView
geo = terrain.get_Geometry(opt)

def extract_flat_contours(geom_elem):
    result = []
    if geom_elem is None: return result
    for g in geom_elem:
        if isinstance(g, Solid): continue
        elif isinstance(g, GeometryInstance):
            result.extend(extract_flat_contours(g.GetInstanceGeometry()))
        elif isinstance(g, Curve):
            p1, p2 = g.GetEndPoint(0), g.GetEndPoint(1)
            p1_f, p2_f = XYZ(p1.X, p1.Y, 0), XYZ(p2.X, p2.Y, 0)
            if p1_f.DistanceTo(p2_f) > MIN_TOLERANCE: result.append((p1_f, p2_f))
        elif isinstance(g, PolyLine):
            pts = g.GetCoordinates()
            for i in range(pts.Count - 1):
                p1_f, p2_f = XYZ(pts[i].X, pts[i].Y, 0), XYZ(pts[i+1].X, pts[i+1].Y, 0)
                if p1_f.DistanceTo(p2_f) > MIN_TOLERANCE: result.append((p1_f, p2_f))
    return result

flat_contours = extract_flat_contours(geo)

# --- 2. 處理族群 ---
collector = FilteredElementCollector(doc).OfClass(FamilyInstance)
instances = [i for i in collector if i.Symbol.Family.Name == fam_name]

TransactionManager.Instance.EnsureInTransaction(doc)
processed_count = 0
g_opt = Options()
g_opt.DetailLevel = ViewDetailLevel.Fine

for inst in instances:
    rot = inst.Location.Rotation
    inst_geo = inst.get_Geometry(g_opt)
    edge_lines = []
    
    for g_obj in inst_geo:
        if isinstance(g_obj, GeometryInstance):
            for e in g_obj.GetInstanceGeometry():
                if isinstance(e, Curve):
                    p1, p2 = e.GetEndPoint(0), e.GetEndPoint(1)
                    p1_f, p2_f = XYZ(p1.X, p1.Y, 0), XYZ(p2.X, p2.Y, 0)
                    if p1_f.DistanceTo(p2_f) > MIN_TOLERANCE:
                        edge_lines.append((p1_f, p2_f, p1_f.DistanceTo(p2_f)))

    if len(edge_lines) >= 4:
        edge_lines.sort(key=lambda x: x[2], reverse=True)
        top_4 = edge_lines[:4]
        cx = sum((l[0].X + l[1].X)/2.0 for l in top_4)/4.0
        cy = sum((l[0].Y + l[1].Y)/2.0 for l in top_4)/4.0
        
        line_A, line_B, line_C, line_D = None, None, None, None
        for l in top_4:
            mx, my = (l[0].X + l[1].X)/2.0, (l[0].Y + l[1].Y)/2.0
            lx = (mx-cx)*math.cos(-rot)-(my-cy)*math.sin(-rot)
            ly = (mx-cx)*math.sin(-rot)+(my-cy)*math.cos(-rot)
            ang = math.degrees(math.atan2(ly, lx)) % 360
            if 45 <= ang < 135: line_A = (l[0], l[1])     # 上
            elif 135 <= ang < 225: line_D = (l[0], l[1])   # 左
            elif 225 <= ang < 315: line_C = (l[0], l[1])   # 下
            else: line_B = (l[0], l[1])                  # 右

        # --- 3. 計算與寫入 ---
        vA, vB, vC, vD = [get_inter_count(line, flat_contours) for line in [line_A, line_B, line_C, line_D]]
        vN = vA + vB + vC + vD
        slope = (vN * math.pi) / (8.0 * L_meters) * 100.0 if L_meters > 0 else 0
        
        if slope < 5: lvl = "1"
        elif slope < 15: lvl = "2"
        elif slope < 30: lvl = "3"
        elif slope < 40: lvl = "4"
        elif slope < 55: lvl = "5"
        else: lvl = "6"
        
        # 寫入文字參數
        data = {"A":vA, "B":vB, "C":vC, "D":vD, "N":vN, "S":"{:.2f}%".format(slope), "級坡":lvl}
        for k, v in data.items():
            p = inst.LookupParameter(k)
            if p: p.Set(str(v))
        processed_count += 1

TransactionManager.Instance.TransactionTaskDone()
OUT = "哥哥，邊長設定為 " + str(L_meters) + "m，已處理 " + str(processed_count) + " 個坵塊！"
# ----------------------------------------
watch = Watch(python_script)
