# Dynamo graph 敷地-地形樓板整地.dyn (Dynamo 3.6.1.9895)

選一個地形 = DSModelElementSelection()  # 1 picked in the model; graph input
選一個樓板 = DSModelElementSelection()  # 1 picked in the model; graph input
填土坡度 = DoubleInput(45)  # graph input
開挖坡度 = DoubleInput(45)  # graph input
細分間距 = DoubleInput(100)  # graph input
python_script = Python(IN[0]=選一個地形, IN[1]=選一個樓板, IN[2]=填土坡度, IN[3]=開挖坡度, IN[4]=細分間距)  # CPython3
# ---------- python_script.python (218 lines) ----------
import clr
import math
import traceback

clr.AddReference('RevitAPI')
from Autodesk.Revit.DB import *

clr.AddReference('RevitNodes')
import Revit
clr.ImportExtensions(Revit.GeometryConversion)
clr.ImportExtensions(Revit.Elements)

clr.AddReference('RevitServices')
import RevitServices
from RevitServices.Persistence import DocumentManager
from RevitServices.Transactions import TransactionManager

doc = DocumentManager.Instance.CurrentDBDocument

# --- 輸入參數 ---
topo_solid = UnwrapElement(IN[0])
floor = UnwrapElement(IN[1])
fill_angle_deg = IN[2]
cut_angle_deg = IN[3]
spacing_cm = IN[4]

spacing_ft = spacing_cm * 0.0328084
fill_angle_rad = math.radians(fill_angle_deg)
cut_angle_rad = math.radians(cut_angle_deg)

debug_log = ["=== 宇宙無敵放坡腳本 V20.PRO (盛裝打扮・完美無瑕版) ==="]

try:
    view3D = None
    for v in FilteredElementCollector(doc).OfClass(View3D).WhereElementIsNotElementType():
        if not v.IsTemplate and not v.IsAssemblyView:
            view3D = v
            break
            
    topo_intersector = ReferenceIntersector(topo_solid.Id, FindReferenceTarget.Face, view3D)
    top_faces = [floor.GetGeometryObjectFromReference(ref) for ref in HostObjectUtils.GetTopFaces(floor)]
    
    bbox = topo_solid.get_BoundingBox(None)
    topo_min_z = bbox.Min.Z
    topo_max_z = bbox.Max.Z

    # --------------------------------------------------------
    # [Phase 1] 抓出樓板真正外輪廓
    # --------------------------------------------------------
    boundary_curves = []
    edge_tracker = {}
    for face in top_faces:
        for loop in face.GetEdgesAsCurveLoops():
            for curve in loop:
                p0, p1 = curve.Evaluate(0, True), curve.Evaluate(1, True)
                if p0.X < p1.X or (abs(p0.X - p1.X) < 0.001 and p0.Y < p1.Y) or (abs(p0.X - p1.X) < 0.001 and abs(p0.Y - p1.Y) < 0.001 and p0.Z < p1.Z):
                    k_start, k_end = p0, p1
                else: k_start, k_end = p1, p0
                key = "{:.3f}_{:.3f}_{:.3f}_to_{:.3f}_{:.3f}_{:.3f}".format(k_start.X, k_start.Y, k_start.Z, k_end.X, k_end.Y, k_end.Z)
                if key not in edge_tracker: edge_tracker[key] = [curve]
                else: edge_tracker[key].append(curve)

    for key, curves in edge_tracker.items():
        if len(curves) == 1: boundary_curves.append(curves[0])

    edge_points_xyz = []
    daylight_points_xyz = []

    # --------------------------------------------------------
    # [👗 Phase 1.5] 穿上衣服！完美的陽角分角線 (確保轉角鑽石級平滑)
    # --------------------------------------------------------
    try:
        all_loops = []
        for face in top_faces:
            for loop in face.GetEdgesAsCurveLoops():
                all_loops.append(loop)
        if all_loops:
            outer_loop = max(all_loops, key=lambda l: sum(c.Length for c in l))
            c_curves = [c for c in outer_loop]
            
            pts_area = [c.GetEndPoint(0) for c in c_curves]
            area = sum(pts_area[k].X * pts_area[(k+1)%len(pts_area)].Y - pts_area[(k+1)%len(pts_area)].X * pts_area[k].Y for k in range(len(pts_area)))
            if area < 0:
                c_curves.reverse()
                c_curves = [c.CreateReversed() for c in c_curves]
                
            for k in range(len(c_curves)):
                prev_c = c_curves[(k-1)%len(c_curves)]
                curr_c = c_curves[k]
                
                p_corner = curr_c.GetEndPoint(0)
                p_prev = prev_c.GetEndPoint(0)
                p_next = curr_c.GetEndPoint(1)
                
                e_in = XYZ(p_corner.X - p_prev.X, p_corner.Y - p_prev.Y, 0).Normalize()
                e_out = XYZ(p_next.X - p_corner.X, p_next.Y - p_corner.Y, 0).Normalize()
                n_in = XYZ(e_in.Y, -e_in.X, 0)
                n_out = XYZ(e_out.Y, -e_out.X, 0)
                
                n_bis = XYZ(n_in.X + n_out.X, n_in.Y + n_out.Y, 0)
                n_bis = n_bis.Normalize() if n_bis.GetLength() > 0.001 else n_in
                cos_beta = max(0.01, n_in.DotProduct(n_bis))
                
                ray_fill = XYZ(n_bis.X, n_bis.Y, -cos_beta * math.tan(fill_angle_rad)).Normalize()
                ray_cut = XYZ(n_bis.X, n_bis.Y, cos_beta * math.tan(cut_angle_rad)).Normalize()
                
                res_fill = topo_intersector.FindNearest(p_corner, ray_fill)
                res_cut = topo_intersector.FindNearest(p_corner, ray_cut)
                
                valid_res = None
                if res_fill and not res_cut: valid_res = res_fill
                elif res_cut and not res_fill: valid_res = res_cut
                elif res_fill and res_cut: valid_res = res_fill if res_fill.Proximity < res_cut.Proximity else res_cut
                
                if valid_res:
                    D = valid_res.GetReference().GlobalPoint
                    sky_D = XYZ(D.X, D.Y, D.Z + 10000)
                    res_sky = topo_intersector.FindNearest(sky_D, XYZ.BasisZ.Negate())
                    if res_sky and abs(D.Z - res_sky.GetReference().GlobalPoint.Z) < 0.2:
                        edge_points_xyz.append(p_corner)
                        daylight_points_xyz.append(D)
    except Exception as ex: pass
    
    # --------------------------------------------------------
    # [Phase 2] 精準雷射定位 C點與D點 (沿著邊緣放點)
    # --------------------------------------------------------
    def check_C_in(pt):
        return topo_intersector.FindNearest(XYZ(pt.X, pt.Y, pt.Z + 10000), XYZ.BasisZ.Negate()) is not None

    def get_D_status(param, curve):
        pt = curve.Evaluate(param, True)
        transform = curve.ComputeDerivatives(param, True)
        outward_vec = XYZ(transform.BasisX.Y, -transform.BasisX.X, 0).Normalize()
        ray_fill = XYZ(outward_vec.X, outward_vec.Y, -math.tan(fill_angle_rad)).Normalize()
        ray_cut = XYZ(outward_vec.X, outward_vec.Y, math.tan(cut_angle_rad)).Normalize()
        res_fill = topo_intersector.FindNearest(pt, ray_fill)
        res_cut = topo_intersector.FindNearest(pt, ray_cut)
        valid_res = res_fill if res_fill and not res_cut else res_cut if res_cut and not res_fill else res_fill if res_fill and res_cut and res_fill.Proximity < res_cut.Proximity else res_cut if res_fill and res_cut else None
        if not valid_res: return False, None 
        D = valid_res.GetReference().GlobalPoint
        res_sky = topo_intersector.FindNearest(XYZ(D.X, D.Y, D.Z + 10000), XYZ.BasisZ.Negate())
        if res_sky and abs(D.Z - res_sky.GetReference().GlobalPoint.Z) < 0.2: return True, D
        return False, D

    for curve in boundary_curves:
        num_points = max(2, int(curve.Length / spacing_ft) + 1)
        prev_C_in, prev_D_on_top, prev_param = None, None, None
        for i in range(num_points):
            param = i / float(num_points - 1)
            pt = curve.Evaluate(param, True)
            curr_C_in = check_C_in(pt)
            curr_D_on_top, curr_D_pt = get_D_status(param, curve)

            if i > 0:
                if curr_C_in != prev_C_in:
                    low, high = (prev_param, param) if prev_C_in else (param, prev_param)
                    for _ in range(12):
                        mid = (low + high) / 2.0
                        if check_C_in(curve.Evaluate(mid, True)): low = mid
                        else: high = mid
                    edge_points_xyz.append(curve.Evaluate(low, True))
                if curr_D_on_top != prev_D_on_top:
                    low, high = (prev_param, param) if prev_D_on_top else (param, prev_param)
                    for _ in range(12):
                        mid = (low + high) / 2.0
                        on_top, _ = get_D_status(mid, curve)
                        if on_top: low = mid
                        else: high = mid
                    _, D_cross = get_D_status(low, curve)
                    if D_cross: daylight_points_xyz.append(D_cross)

            if curr_C_in: edge_points_xyz.append(pt)
            if curr_D_on_top: daylight_points_xyz.append(curr_D_pt)
            prev_C_in, prev_D_on_top, prev_param = curr_C_in, curr_D_on_top, param

    # --------------------------------------------------------
    # [Phase 3] 執行基礎熨平 (只壓平樓板底下，外圍自然放坡！)
    # --------------------------------------------------------
    shape_editor = topo_solid.GetSlabShapeEditor()
    TransactionManager.Instance.EnsureInTransaction(doc)
    ironed_points = 0

    for vertex in shape_editor.SlabShapeVertices:
        V_3d = vertex.Position
        if abs(V_3d.Z - topo_min_z) < 0.5: continue
        
        # 僅壓平樓板正下方，外圍天然點交給 Revit 自動連接 C 與 D！
        for face in top_faces:
            res = face.Project(V_3d)
            if res: 
                safe_floor_z = max(topo_min_z + 0.5, res.XYZPoint.Z)
                if abs(V_3d.Z - safe_floor_z) > 0.01:
                    shape_editor.ModifySubElement(vertex, safe_floor_z)
                    ironed_points += 1
                break

    # --------------------------------------------------------
    # [Phase 4] 打下乾淨的放坡邊界鋼釘
    # --------------------------------------------------------
    final_pts = edge_points_xyz + daylight_points_xyz
    for pt in final_pts:
        try:
            if hasattr(shape_editor, 'DrawPoint'): shape_editor.DrawPoint(pt)
            else: shape_editor.AddPoint(pt)
        except: pass

    TransactionManager.Instance.TransactionTaskDone()
    debug_log.append("=== V20.PRO 破關！完美盛裝版執行完畢！ ===")
    debug_log.append("成功定位 {} 顆邊界點與放坡點！".format(len(final_pts)))
    debug_log.append("壓平樓板下方天然點: {} 顆 (無多餘雜訊生成)".format(ironed_points))

except Exception as e:
    try: TransactionManager.Instance.ForceCloseTransaction()
    except: pass
    debug_log.append("!!! 發生錯誤 !!!")
    debug_log.append(traceback.format_exc())

OUT = debug_log
# ----------------------------------------
watch = Watch(python_script)
