# Dynamo graph 敷地-專案北角度.dyn (Dynamo 3.6.2.11575)

python_script = Python()  # CPython3
# ---------- python_script.python (67 lines) ----------
import clr
import math

# 載入 Revit API
clr.AddReference('RevitAPI')
from Autodesk.Revit.DB import *

# 載入 Dynamo 的 Revit 節點與交易管理員
clr.AddReference('RevitServices')
import RevitServices
from RevitServices.Persistence import DocumentManager
from RevitServices.Transactions import TransactionManager

# 取得當前文件
doc = DocumentManager.Instance.CurrentDBDocument

# 你的整體參數名稱
param_name = "專案與正北角度"

# 1. 取得專案北與正北的夾角
project_location = doc.ActiveProjectLocation
project_position = project_location.GetProjectPosition(XYZ.Zero)
angle_rad = project_position.Angle
angle_deg = math.degrees(angle_rad)

result_msg = ""

# 2. 透過 GlobalParametersManager 處理整體參數
if GlobalParametersManager.AreGlobalParametersAllowed(doc):
    # 開啟交易以修改/建立文件元素
    TransactionManager.Instance.EnsureInTransaction(doc)
    try:
        # 尋找參數是否存在
        gp_id = GlobalParametersManager.FindByName(doc, param_name)
        
        if gp_id != ElementId.InvalidElementId:
            # 【狀況 A：參數已存在】取得該元件
            gp = doc.GetElement(gp_id)
            action_msg = "已更新現有參數"
        else:
            # 【狀況 B：參數不存在】讓程式自動建立
            try:
                # 嘗試 Revit 2022 (含) 以後版本的 API 寫法 (SpecTypeId)
                gp = GlobalParameter.Create(doc, param_name, SpecTypeId.Angle)
            except:
                # 若報錯，則退回 Revit 2021 (含) 以前版本的 API 寫法 (ParameterType)
                gp = GlobalParameter.Create(doc, param_name, ParameterType.Angle)
            
            action_msg = "已自動建立新參數並寫入"
            
        # 將數值寫入整體參數 (必須包裝為 DoubleParameterValue，且為弧度)
        new_value = DoubleParameterValue(angle_rad)
        gp.SetValue(new_value)
        
        # 提交交易
        TransactionManager.Instance.TransactionTaskDone()
        result_msg = "成功：{} (角度: {:.4f}°)。".format(action_msg, angle_deg)
        
    except Exception as e:
        # 若發生意外錯誤，退回交易
        TransactionManager.Instance.ForceCloseTransaction()
        result_msg = "執行失敗發生錯誤：" + str(e)
else:
    result_msg = "錯誤：當前的 Revit 專案檔案不支援整體參數功能。"

# 將度數與執行狀態輸出
OUT = [angle_deg, result_msg]
# ----------------------------------------
watch = Watch(python_script)  # graph output
說明 = StringInput("將專案北與正北角度寫到整體參數\"專案與正北角度\"中以利旋轉指北針")  # graph input
