# Dynamo graph 敷地-座標畫點.dyn (Dynamo 3.6.1.9895)

file_path = Filename("..\..\simon\2026年度\A10匹克球場\案件資料\座標點.xlsx")  # graph input
file_from_path = FileObject(path=file_path)
string = StringInput("座標點")
importExcel = Data.ImportExcel(file=file_from_path, sheetName=string)
python_script = Python(IN[0]=importExcel)  # CPython3
# ---------- python_script.python (120 lines) ----------
import clr
import time
from System.Collections.Generic import List

clr.AddReference('RevitAPI')
from Autodesk.Revit.DB import *

clr.AddReference('RevitServices')
from RevitServices.Persistence import DocumentManager
from RevitServices.Transactions import TransactionManager

doc = DocumentManager.Instance.CurrentDBDocument

# --- [參數解析] ---
raw_data = IN[0]  
active_view = doc.ActiveView

# 處理字體
text_types = FilteredElementCollector(doc).OfClass(TextNoteType)
my_text_type = next((t for t in text_types if "3mm_Red" in t.get_Parameter(BuiltInParameter.SYMBOL_NAME_PARAM).AsString()), None)

TransactionManager.Instance.EnsureInTransaction(doc)
if not my_text_type:
    base_type = text_types.FirstElement()
    my_text_type = base_type.Duplicate("3mm_Red")
    my_text_type.get_Parameter(BuiltInParameter.LINE_COLOR).Set(255) 
    my_text_type.get_Parameter(BuiltInParameter.TEXT_SIZE).Set(3.0 / 304.8) 

# --- [暴力破解資料結構] ---
clean_data = []

def extract_rows(data):
    try:
        for row in data:
            try:
                r = list(row)
                if len(r) >= 3:
                    pt_id = str(r[0]).strip()
                    x_val = str(r[1]).strip()
                    y_val = str(r[2]).strip()
                    
                    if "點" in pt_id or "X" in x_val or not pt_id or pt_id.lower() == "null":
                        continue
                        
                    x = float(x_val) * 100
                    y = float(y_val) * 100
                    clean_data.append([pt_id, x, y])
            except:
                if hasattr(row, '__iter__') and not isinstance(row, str):
                    extract_rows(row)
    except:
        pass

extract_rows(raw_data)

# --- [生成圖元與群組] ---
if clean_data:
    min_x = min(r[1] for r in clean_data)
    min_y = min(r[2] for r in clean_data)
    
    base_x, base_y = min_x - 100.0, min_y - 100.0
    
    xyz_pts = [] 
    cross_size = 20.0 / 30.48 
    
    # 建立一個專門裝 ElementId 的籃子
    element_ids = List[ElementId]()
    
    for pt_name, x, y in clean_data:
        rev_x = (x - base_x) / 30.48
        rev_y = (y - base_y) / 30.48
        pos = XYZ(rev_x, rev_y, 0)
        xyz_pts.append(pos)
        
        # 1. 建立文字標註並把 ID 丟進籃子
        t_note = TextNote.Create(doc, active_view.Id, pos, pt_name, my_text_type.Id)
        element_ids.Add(t_note.Id)
        
        # 2. 畫十字標記並把 ID 丟進籃子
        p1 = XYZ(rev_x - cross_size/2, rev_y, 0)
        p2 = XYZ(rev_x + cross_size/2, rev_y, 0)
        p3 = XYZ(rev_x, rev_y - cross_size/2, 0)
        p4 = XYZ(rev_x, rev_y + cross_size/2, 0)
        
        try:
            line1 = doc.Create.NewDetailCurve(active_view, Line.CreateBound(p1, p2))
            line2 = doc.Create.NewDetailCurve(active_view, Line.CreateBound(p3, p4))
            element_ids.Add(line1.Id)
            element_ids.Add(line2.Id)
        except:
            pass

    # 3. 將點位依序連線並把 ID 丟進籃子
    if len(xyz_pts) > 1:
        for i in range(len(xyz_pts)):
            ptA = xyz_pts[i]
            ptB = xyz_pts[(i + 1) % len(xyz_pts)] 
            
            try:
                bound_line = doc.Create.NewDetailCurve(active_view, Line.CreateBound(ptA, ptB))
                element_ids.Add(bound_line.Id)
            except:
                pass

    # 4. 將籃子裡的所有東西打包成一個 2D 詳圖群組
    if element_ids.Count > 0:
        new_group = doc.Create.NewGroup(element_ids)
        
        # 給群組一個好辨識的名字 (加上 timestamp 防止重複報錯)
        try:
            group_name = "地籍圖匯入_" + str(int(time.time()))
            new_group.GroupType.Name = group_name
        except:
            pass

    TransactionManager.Instance.TransactionTaskDone()
    OUT = "完美殺青！畫了 {} 個點位，並已全部打包成群組！\n原點偏移至(CM): X={}, Y={}".format(len(clean_data), base_x, base_y)
else:
    TransactionManager.Instance.TransactionTaskDone()
    OUT = "抓不到資料喔！"
# ----------------------------------------
watch = Watch(python_script)  # graph output
說明 = StringInput("""將地籍圖做成EXCEL座標點匯入畫呈現跟十字點做成族群
工作業要改"座標點"喔""")  # graph input
openXMLImportExcel = Data.OpenXMLImportExcel(filePath=file_from_path, sheetName=string)  # frozen
