# Dynamo graph 敷地-白色標線.dyn (Dynamo 3.6.1.9895)

標線厚度 = DoubleInput(2)  # "1.標線厚度"; graph input
選一或多條基準線 = SelectEdges()  # "2.選一或多條基準線"; 24 picked in the model; graph input
標線寬度 = DoubleInput(5)  # "1.標線寬度"; graph input
選取放置平面 = DSFaceSelection()  # "3.選取放置平面"; 1 picked in the model; graph input
python_script = Python(IN[0]=標線厚度, IN[1]=選一或多條基準線, IN[2]=標線寬度, IN[3]=選取放置平面)  # CPython3
# ---------- python_script.python (238 lines) ----------
import clr
import traceback 
import math

clr.AddReference('ProtoGeometry')
from Autodesk.DesignScript.Geometry import *

# === 加入 Revit API 相關模組 ===
clr.AddReference('RevitNodes')
import Revit
clr.ImportExtensions(Revit.GeometryConversion)
clr.ImportExtensions(Revit.Elements)

clr.AddReference('RevitServices')
import RevitServices
from RevitServices.Persistence import DocumentManager
from RevitServices.Transactions import TransactionManager

clr.AddReference('RevitAPI')
from Autodesk.Revit.DB import ElementId, BuiltInCategory, DirectShape, FilteredElementCollector
from Autodesk.Revit.DB import FillPatternElement, OverrideGraphicSettings, Color as RvtColor
from Autodesk.Revit.DB import Material as RvtMaterial
from System.Collections.Generic import List

# ==========================================
# VER: 跑道球場_自訂寬度白線_v2.0_PRO (抗 Toposolid 地形版)
# ==========================================

try:
    doc = DocumentManager.Instance.CurrentDBDocument

    if len(IN) < 4:
        raise Exception("節點輸入端不足！請確保依序輸入：IN[0]厚度, IN[1]線段, IN[2]自訂線寬, IN[3]表面")

    thk_in = IN[0]
    if isinstance(thk_in, list) and len(thk_in) > 0: thk_in = thk_in[0]
    thickness = float(thk_in) if thk_in is not None else 0.2
    
    raw_curves = IN[1] if isinstance(IN[1], list) else [IN[1]]
    
    width_in = IN[2]
    if isinstance(width_in, list) and len(width_in) > 0: width_in = width_in[0]
    line_width = float(width_in) if width_in is not None else 10.0
    
    raw_face = IN[3] 

    ref_surface = None
    
    # 支援 Toposolid 的強效解析 (支援 Surface 與 PolySurface)
    def extract_surface(obj):
        if isinstance(obj, list):
            if len(obj) > 0: return extract_surface(obj[0])
            return None
        try:
            geom = obj.Geometry()
            for g in geom:
                return g # 回傳找到的第一個幾何體 (Surface/PolySurface)
        except: 
            if hasattr(obj, "SurfaceGeometry"): return obj.SurfaceGeometry()
        return obj

    if raw_face is not None:
        ref_surface = extract_surface(raw_face)
        if not ref_surface: raise Exception("IN[3] 無法解析成有效平面！")

    parsed_curves = []
    for rc in raw_curves:
        if rc is None: continue
        if hasattr(rc, "StartPoint") and hasattr(rc, "PointAtParameter"):
            parsed_curves.append(rc)
            continue
        if hasattr(rc, "CurveGeometry"):
            try: parsed_curves.append(rc.CurveGeometry); continue
            except: pass
        if hasattr(rc, "GeometryCurve"):
            try: parsed_curves.append(rc.GeometryCurve.ToProtoType()); continue
            except: pass
        try:
            for g in rc.Geometry():
                if hasattr(g, "PointAtParameter"): parsed_curves.append(g)
        except: pass

    if not parsed_curves: raise Exception("IN[1] 找不到有效線段！")

    def chain_and_join_curves(curves, tol=0.01):
        if not curves: return []
        if len(curves) == 1: return curves
        unprocessed = list(curves)
        chains = []
        while unprocessed:
            current_chain = [unprocessed.pop(0)]
            added = True
            while added:
                added = False
                chain_start = current_chain[0].StartPoint
                chain_end = current_chain[-1].EndPoint
                for i in range(len(unprocessed)-1, -1, -1):
                    c = unprocessed[i]
                    c_start = c.StartPoint
                    c_end = c.EndPoint
                    if chain_end.DistanceTo(c_start) <= tol:
                        current_chain.append(c); unprocessed.pop(i); added = True; break
                    elif chain_end.DistanceTo(c_end) <= tol:
                        current_chain.append(c.Reverse()); unprocessed.pop(i); added = True; break
                    elif chain_start.DistanceTo(c_end) <= tol:
                        current_chain.insert(0, c); unprocessed.pop(i); added = True; break
                    elif chain_start.DistanceTo(c_start) <= tol:
                        current_chain.insert(0, c.Reverse()); unprocessed.pop(i); added = True; break
            chains.append(current_chain)
        joined_curves = []
        for chain in chains:
            if len(chain) == 1: joined_curves.append(chain[0])
            else:
                try: joined_curves.append(PolyCurve.ByJoinedCurves(chain))
                except: joined_curves.extend(chain)
        return joined_curves

    input_curves = chain_and_join_curves(parsed_curves)

    # 🌟 妹妹的抗地形迴圈補面法 (Perimeter Patch) 🌟
    def create_ribbon_solid(curve, width, thk, ref_surf):
        try:
            length = curve.Length
            if length < 0.1: return None 
            
            # 球場線通常較直，但我們還是保留足夠解析度貼合地形
            num_points = max(int(length / 20.0), 2)
            left_pts = []
            right_pts = []
            
            for i in range(num_points + 1):
                param = i / float(num_points)
                pt = curve.PointAtParameter(param)
                tangent = curve.TangentAtParameter(param)
                
                # 直接投影到 Toposolid 表面
                if ref_surf:
                    try:
                        proj_geom = ref_surf.ClosestPointTo(pt)
                        if proj_geom: pt = proj_geom
                    except: pass
                
                # 捨棄容易報錯的表面法線，統一使用 Z 軸計算偏移方向 (適用於球場與道路)
                offset_dir = Vector.ZAxis().Cross(tangent).Normalized()
                
                left_pts.append(pt.Translate(offset_dir, width / 2.0))
                right_pts.append(pt.Translate(offset_dir, -width / 2.0))
                
            # 將點陣列接合成封閉迴圈 (左側順向 + 右側反向)
            loop_pts = left_pts + list(reversed(right_pts))
            
            # 清理過於接近的點以防 PolyCurve 報錯
            clean_pts = []
            for p in loop_pts:
                if not clean_pts or clean_pts[-1].DistanceTo(p) > 0.1:
                    clean_pts.append(p)
            if clean_pts and clean_pts[0].DistanceTo(clean_pts[-1]) < 0.1:
                clean_pts.pop()
            clean_pts.append(clean_pts[0])
            
            # 建立封閉外框
            lines = []
            for i in range(len(clean_pts) - 1):
                lines.append(Line.ByStartPointEndPoint(clean_pts[i], clean_pts[i+1]))
                
            poly = PolyCurve.ByJoinedCurves(lines)
            surf = Surface.ByPatch(poly)
            if not surf: return None
            
            # 嘗試加厚，若地形太極端導致加厚失敗，則回傳無厚度貼面保底
            if thk > 0:
                try: 
                    solid = surf.Thicken(thk)
                    if solid: return solid
                except: pass
            
            return surf
        except Exception as e:
            return None

    output_solids = []

    for curve in input_curves:
        solid = create_ribbon_solid(curve, line_width, thickness, ref_surface)
        if solid: output_solids.append(solid)

    if not output_solids: raise Exception("實體清單為空！地形過度複雜導致貼面失敗。")

    # === Bake 轉換為 Revit 元件 ===
    TransactionManager.Instance.EnsureInTransaction(doc)
    
    mat_name = "球場跑道標線_白色"
    cr, cg, cb = 255, 255, 255
    elem_name = f"自訂白線_寬{line_width}"

    fill_pattern_id = None
    collector = FilteredElementCollector(doc).OfClass(FillPatternElement)
    for fp in collector:
        if fp.GetFillPattern().IsSolidFill:
            fill_pattern_id = fp.Id
            break
            
    rvt_cat = doc.Settings.Categories.get_Item(BuiltInCategory.OST_GenericModel)
    
    # 處理 2024 版本 API
    cat_id_int = getattr(rvt_cat.Id, "Value", getattr(rvt_cat.Id, "IntegerValue", None))
    
    created_ids = List[ElementId]()
    
    for dyn_solid in output_solids:
        try:
            rvt_solids = dyn_solid.ToRevitType() 
            ds = DirectShape.CreateElement(doc, rvt_cat.Id)
            ds.SetShape(rvt_solids)
            ds.Name = elem_name
            
            if fill_pattern_id:
                ogs = OverrideGraphicSettings()
                ogs.SetSurfaceForegroundPatternId(fill_pattern_id)
                ogs.SetSurfaceForegroundPatternColor(RvtColor(cr, cg, cb))
                doc.ActiveView.SetElementOverrides(ds.Id, ogs)
                
            created_ids.Add(ds.Id)
        except: pass
            
    final_output = None
    if created_ids.Count > 1:
        group = doc.Create.NewGroup(created_ids)
        group.GroupType.Name = f"標線群組_自訂白線_W{line_width}"
        final_output = group
    elif created_ids.Count == 1:
        final_output = doc.GetElement(created_ids[0])
        
    TransactionManager.Instance.TransactionTaskDone()
    OUT = final_output

except Exception as e:
    OUT = traceback.format_exc()
# ----------------------------------------
watch = Watch(python_script)  # graph output
說明 = StringInput("""先用標註畫參考線長
再選你放在哪個平面投影畫出白線""")  # graph input
