# Dynamo graph 敷地-道路標線.dyn (Dynamo 3.6.1.9895)

標線厚度 = DoubleInput(2)  # "1.標線厚度"; graph input
選一或多條基準線 = SelectEdges()  # "2.選一或多條基準線"; 1 picked in the model; graph input
選取標線清單 = BoolSelector(true)  # "5.選取標線清單"; graph input
標線清單 = StringInput("\"單白實線\",\"單黃實線\",\"雙白線\",\"雙黃線\",\"單白虛線\",\"單黃虛線\",\"行人穿越道(斑馬線)\",\"停止線\",\"機車停等區\", \"直行箭頭\", \"左轉箭頭\", \"右轉箭頭\", \"直左箭頭\", \"直右箭頭\"")  # "6.標線清單"; graph input
清單選單 = Python(IN[0]=選取標線清單, IN[1]=標線清單)  # CPython3
# ---------- 清單選單.python (98 lines) ----------
import clr
# 載入 Windows 原生的 Forms 與 Drawing 模組 (不需安裝任何套件)
clr.AddReference("System.Windows.Forms")
clr.AddReference("System.Drawing")

import System.Windows.Forms as WinForms
from System.Drawing import Point, Size

# 定義我們自己的彈出視窗類別
class DropdownForm(WinForms.Form):
    def __init__(self, options):
        # 視窗基本設定
        self.Text = "交通標線選擇器"
        self.Width = 320
        self.Height = 180
        self.StartPosition = WinForms.FormStartPosition.CenterScreen
        self.MaximizeBox = False
        self.MinimizeBox = False
        self.FormBorderStyle = WinForms.FormBorderStyle.FixedDialog
        self.TopMost = True # 確保視窗保持在最上層，不會被 Revit 擋住
        
        # 建立標籤 (Label)
        self.label = WinForms.Label()
        self.label.Text = "請選擇要繪製的標線類型："
        self.label.Location = Point(20, 20)
        self.label.AutoSize = True
        
        # 建立下拉選單 (ComboBox)
        self.combo = WinForms.ComboBox()
        self.combo.Location = Point(20, 50)
        self.combo.Width = 260
        self.combo.DropDownStyle = WinForms.ComboBoxStyle.DropDownList # 限制只能下拉，不能亂輸入
        
        # 將選項加入 ComboBox (使用迴圈確保相容於 IronPython 與 CPython3)
        for opt in options:
            self.combo.Items.Add(opt)
        
        # 預設選擇第一個項目
        if self.combo.Items.Count > 0:
            self.combo.SelectedIndex = 0
            
        # 建立確定按鈕 (Button)
        self.btn = WinForms.Button()
        self.btn.Text = "確認選取"
        self.btn.Location = Point(180, 95)
        self.btn.Width = 100
        self.btn.Click += self.button_clicked # 綁定點擊事件
        
        # 將控制項加入視窗
        self.Controls.Add(self.label)
        self.Controls.Add(self.combo)
        self.Controls.Add(self.btn)
        
        # 儲存結果的變數
        self.selected_value = None
        
    def button_clicked(self, sender, args):
        # 按下按鈕後，記錄選到的值並關閉視窗
        self.selected_value = self.combo.SelectedItem
        self.Close()

# --- 主程式執行區 ---

# IN[0] 作為觸發開關
run_it = IN[0] 

# IN[1] 接收外部清單，如果沒有接，就給預設值
if isinstance(IN[1], list) and len(IN[1]) > 0:
    line_options = IN[1]
else:
    line_options = [
        "單白實線", 
        "單黃實線", 
        "雙白線", 
        "雙黃線", 
        "單白虛線", 
        "單黃虛線", 
        "行人穿越道 (斑馬線)", 
        "停止線",
        "機車停等區",
        "直行箭頭",
        "左轉箭頭",
        "右轉箭頭",
        "直左箭頭",
        "直右箭頭"
    ]

# 判斷是否彈出視窗
if run_it:
    # 實體化視窗
    form = DropdownForm(line_options)
    # 使用 ShowDialog() 阻塞執行，直到使用者選完關閉視窗
    form.ShowDialog()
    
    # 輸出選取結果
    OUT = form.selected_value
else:
    OUT = "請將 IN[0] 切換為 True 以開啟選單"
# ----------------------------------------
選取道路平面 = DSFaceSelection()  # "3.選取道路平面"; 1 picked in the model; graph input
機車待轉區寬或是人行道寬 = DoubleInput(200)  # "4.機車待轉區寬或是人行道寬"; graph input
python_script = Python(IN[0]=標線厚度, IN[1]=選一或多條基準線, IN[2]=清單選單, IN[3]=選取道路平面, IN[4]=機車待轉區寬或是人行道寬)  # CPython3
# ---------- python_script.python (433 lines) ----------
import clr
import traceback 
import math

clr.AddReference('ProtoGeometry')
from Autodesk.DesignScript.Geometry import *

# === 加入 Revit API 相關模組 ===
clr.AddReference('RevitNodes')
import Revit
clr.ImportExtensions(Revit.GeometryConversion)
clr.ImportExtensions(Revit.Elements)

clr.AddReference('RevitServices')
import RevitServices
from RevitServices.Persistence import DocumentManager
from RevitServices.Transactions import TransactionManager

clr.AddReference('RevitAPI')
from Autodesk.Revit.DB import ElementId, BuiltInCategory, DirectShape, FilteredElementCollector
from Autodesk.Revit.DB import FillPatternElement, OverrideGraphicSettings, Color as RvtColor
from System.Collections.Generic import List

# ==========================================
# VER: 絕對無敵CAD原點直出_全線型版_v8.0_PRO
# ==========================================

try:
    doc = DocumentManager.Instance.CurrentDBDocument

    if len(IN) < 5:
        raise Exception("節點輸入端不足！請確保有 IN[0]到IN[4]")

    thk_in = IN[0]
    if isinstance(thk_in, list) and len(thk_in) > 0: thk_in = thk_in[0]
    thickness = float(thk_in) if thk_in is not None else 0.2
    
    raw_curves = IN[1] if isinstance(IN[1], list) else [IN[1]]
    line_type = IN[2]
    raw_face = IN[3] 
    
    width_in = IN[4]
    if isinstance(width_in, list) and len(width_in) > 0: width_in = width_in[0]
    custom_width = float(width_in) if width_in is not None else 300.0

    ref_surface = None
    
    def extract_surface(obj):
        if isinstance(obj, list):
            if len(obj) > 0: return extract_surface(obj[0])
            return None
        if isinstance(obj, Surface): return obj
        if hasattr(obj, "SurfaceGeometry"): return obj.SurfaceGeometry()
        try:
            for g in obj.Geometry():
                if isinstance(g, Surface): return g
        except: pass
        return None

    if raw_face is not None:
        ref_surface = extract_surface(raw_face)
        if not ref_surface: raise Exception("IN[3] 無法解析成有效平面！")
    else:
        raise Exception("請務必在 IN[3] 輸入道路平面！")

    parsed_curves = []
    for rc in raw_curves:
        if rc is None: continue
        if hasattr(rc, "StartPoint") and hasattr(rc, "PointAtParameter"):
            parsed_curves.append(rc)
            continue
        if hasattr(rc, "CurveGeometry"):
            try: parsed_curves.append(rc.CurveGeometry); continue
            except: pass
        if hasattr(rc, "GeometryCurve"):
            try: parsed_curves.append(rc.GeometryCurve.ToProtoType()); continue
            except: pass
        try:
            for g in rc.Geometry():
                if hasattr(g, "PointAtParameter"): parsed_curves.append(g)
        except: pass

    if not parsed_curves: raise Exception("IN[1] 找不到有效線段！")
    if not line_type: raise Exception("IN[2] 找不到標線類型！")

    def chain_and_join_curves(curves, tol=0.01):
        if not curves: return []
        if len(curves) == 1: return curves
        unprocessed = list(curves)
        chains = []
        while unprocessed:
            current_chain = [unprocessed.pop(0)]
            added = True
            while added:
                added = False
                chain_start = current_chain[0].StartPoint
                chain_end = current_chain[-1].EndPoint
                for i in range(len(unprocessed)-1, -1, -1):
                    c = unprocessed[i]
                    c_start = c.StartPoint
                    c_end = c.EndPoint
                    if chain_end.DistanceTo(c_start) <= tol:
                        current_chain.append(c); unprocessed.pop(i); added = True; break
                    elif chain_end.DistanceTo(c_end) <= tol:
                        current_chain.append(c.Reverse()); unprocessed.pop(i); added = True; break
                    elif chain_start.DistanceTo(c_end) <= tol:
                        current_chain.insert(0, c); unprocessed.pop(i); added = True; break
                    elif chain_start.DistanceTo(c_start) <= tol:
                        current_chain.insert(0, c.Reverse()); unprocessed.pop(i); added = True; break
            chains.append(current_chain)
        joined_curves = []
        for chain in chains:
            if len(chain) == 1: joined_curves.append(chain[0])
            else:
                try: joined_curves.append(PolyCurve.ByJoinedCurves(chain))
                except: joined_curves.extend(chain)
        return joined_curves

    is_arrow = "箭頭" in line_type
    input_curves = parsed_curves if is_arrow else chain_and_join_curves(parsed_curves)

    line_width = 10.0           
    dash_length = 400.0         
    dash_gap = 600.0            
    double_line_offset = 10.0   
    stop_line_width = 40.0      
    zebra_width = 40.0          
    zebra_gap = 40.0            
    zebra_length = custom_width        
    moto_depth = custom_width          
    segment_resolution = 20.0 

    def get_arc_pts(p1, p2, r, sweep_left=True, steps=12):
        x1, y1 = p1
        x2, y2 = p2
        d = math.sqrt((x2-x1)**2 + (y2-y1)**2)
        if d == 0: return [p1]
        if d > 2*r: r = (d / 2.0) + 0.1 
        
        mx, my = (x1+x2)/2.0, (y1+y2)/2.0
        h = math.sqrt(max(0, r**2 - (d/2.0)**2))
        vx, vy = (x2-x1)/d, (y2-y1)/d
        
        if sweep_left: nx, ny = -vy, vx
        else: nx, ny = vy, -vx
            
        cx, cy = mx + h * nx, my + h * ny
        a1, a2 = math.atan2(y1 - cy, x1 - cx), math.atan2(y2 - cy, x2 - cx)
        
        while a1 < 0: a1 += 2*math.pi
        while a2 < 0: a2 += 2*math.pi
        
        diff = a2 - a1
        if sweep_left:
            if diff < 0: diff += 2*math.pi
        else:
            if diff > 0: diff -= 2*math.pi
            
        pts = []
        for i in range(steps + 1):
            a = a1 + diff * (i / float(steps))
            pts.append((cx + r * math.cos(a), cy + r * math.sin(a)))
        return pts

    def get_arrow_pts(atype):
        pts = []
        if "直行" in atype:
            pts = [(10,0), (10,250), (45,240), (0,500), (-45,240), (-10,250), (-10,0)]
            
        elif "左轉" in atype:
            p1, p9 = (10, 0), (10, 270)
            p8, p7, p6 = (-65, 425), (-45, 500), (-110, 425)
            p5, p4 = (-65, 280), (-65, 364.387)
            p3, p2 = (-10, 270), (-10, 0)
            
            pts = [p1, p9]
            pts.extend(get_arc_pts(p9, p8, 200, sweep_left=True)[1:])
            pts.extend([p7, p6, p5, p4])
            pts.extend(get_arc_pts(p4, p3, 120, sweep_left=False)[1:])
            pts.append(p2)
            
        elif "直左" in atype:
            p1, p14, p13 = (15, 0), (15, 277.778), (50, 270)
            p12, p11, p10 = (5, 500), (-40, 270), (-5, 277.778)
            p9, p8, p7 = (-5, 95.719), (-70, 195), (-50, 270)
            p6, p5, p4 = (-115, 195), (-70, 50), (-70, 134.387)
            p3, p2 = (-15, 26.798), (-15, 0)
            
            pts = [p1, p14, p13, p12, p11, p10, p9]
            pts.extend(get_arc_pts(p9, p8, 200, sweep_left=True)[1:])
            pts.extend([p7, p6, p5, p4])
            pts.extend(get_arc_pts(p4, p3, 120, sweep_left=False)[1:])
            pts.append(p2)
            
        elif "右轉" in atype:
            pts = [(-x, y) for x, y in reversed(get_arrow_pts("左轉"))]
            
        elif "直右" in atype:
            pts = [(-x, y) for x, y in reversed(get_arrow_pts("直左"))]
            
        return pts

    def safe_curve_from_pts(pts):
        if len(pts) == 2: return Line.ByStartPointEndPoint(pts[0], pts[1])
        lines = []
        for i in range(len(pts) - 1):
            if pts[i].DistanceTo(pts[i+1]) > 0.01:
                lines.append(Line.ByStartPointEndPoint(pts[i], pts[i+1]))
        if not lines: return None
        if len(lines) == 1: return lines[0]
        return PolyCurve.ByJoinedCurves(lines)

    def get_offset_curve(curve, offset_dist, ref_surf):
        length = curve.Length
        if length < 0.1: return None 
        num_points = max(int(length / segment_resolution), 1)
        pts = []
        for i in range(num_points + 1):
            param = i / float(num_points)
            pt = curve.PointAtParameter(param)
            tangent = curve.TangentAtParameter(param)
            try:
                proj_pt = ref_surf.ClosestPointTo(pt)
                uv = ref_surf.UVParameterAtPoint(proj_pt)
                normal = ref_surf.NormalAtParameter(uv.U, uv.V)
                pt = proj_pt 
            except: normal = Vector.ZAxis()
            offset_dir = normal.Cross(tangent).Normalized()
            pts.append(pt.Translate(offset_dir, offset_dist))
        return safe_curve_from_pts(pts)

    def create_ribbon_solid(curve, width, thk, ref_surf):
        try:
            left_curve = get_offset_curve(curve, width / 2.0, ref_surf)
            right_curve = get_offset_curve(curve, -width / 2.0, ref_surf)
            if not left_curve or not right_curve: return None
            ribbon_surf = Surface.ByLoft([left_curve, right_curve])
            return ribbon_surf.Thicken(thk) if thk > 0 else ribbon_surf
        except: return None

    def create_arrow_solid(curve, atype, thk, ref_surf):
        try:
            start_pt = curve.StartPoint
            forward_vec = curve.TangentAtParameter(0).Normalized()
            
            if ref_surf:
                try:
                    start_pt = ref_surf.ClosestPointTo(start_pt)
                    uv = ref_surf.UVParameterAtPoint(start_pt)
                    normal = ref_surf.NormalAtParameter(uv.U, uv.V)
                except: normal = Vector.ZAxis()
            else: normal = Vector.ZAxis()
                
            right_vec = forward_vec.Cross(normal).Normalized()
            true_forward = normal.Cross(right_vec).Normalized()
            
            points_3d = []
            pts = get_arrow_pts(atype)
            
            for x, y in pts:
                pt_proj = start_pt.Translate(right_vec, x).Translate(true_forward, y)
                if ref_surf:
                    try: pt_proj = ref_surf.ClosestPointTo(pt_proj)
                    except: pass
                points_3d.append(pt_proj)
                
            clean_pts = []
            for p in points_3d:
                if not clean_pts or clean_pts[-1].DistanceTo(p) > 0.05:
                    clean_pts.append(p)
            if clean_pts and clean_pts[0].DistanceTo(clean_pts[-1]) < 0.05:
                clean_pts.pop()
                
            clean_pts.append(clean_pts[0]) 
            
            poly = safe_curve_from_pts(clean_pts)
            if not poly: return []
            
            surf = Surface.ByPatch(poly)
            if not surf: return []
                
            solid = surf.Thicken(thk) if thk > 0 else surf
            return [solid] if solid else []
        except Exception as e:
            return []

    output_solids = []

    for curve in input_curves:
        if is_arrow:
            solids = create_arrow_solid(curve, line_type, thickness, ref_surface)
            output_solids.extend(solids)
            
        elif line_type in ["單黃實線", "單白實線", "單黃線", "單白線"]:
            solid = create_ribbon_solid(curve, line_width, thickness, ref_surface)
            if solid: output_solids.append(solid)
            
        # 👉 在這裡加入了「雙白線」的判斷 👈
        elif "雙黃線" in line_type or "雙白線" in line_type:
            curve_left = get_offset_curve(curve, double_line_offset, ref_surface)
            curve_right = get_offset_curve(curve, -double_line_offset, ref_surface)
            if curve_left and curve_right:
                solid_L = create_ribbon_solid(curve_left, line_width, thickness, ref_surface)
                solid_R = create_ribbon_solid(curve_right, line_width, thickness, ref_surface)
                if solid_L: output_solids.append(solid_L); output_solids.append(solid_R)
            
        elif "虛線" in line_type:
            rem_curve = curve 
            while rem_curve.Length > 0.1: 
                if rem_curve.Length <= dash_length + 0.1:
                    solid = create_ribbon_solid(rem_curve, line_width, thickness, ref_surface)
                    if solid: output_solids.append(solid)
                    break
                t_dash = rem_curve.ParameterAtSegmentLength(dash_length)
                parts = rem_curve.SplitByParameter(t_dash)
                solid = create_ribbon_solid(parts[0], line_width, thickness, ref_surface)
                if solid: output_solids.append(solid)
                rem_curve = parts[1]
                if rem_curve.Length <= dash_gap + 0.1: break
                t_gap = rem_curve.ParameterAtSegmentLength(dash_gap)
                rem_curve = rem_curve.SplitByParameter(t_gap)[1]

        elif "停止線" in line_type:
            solid = create_ribbon_solid(curve, stop_line_width, thickness, ref_surface)
            if solid: output_solids.append(solid)

        elif "行人穿越道" in line_type or "斑馬線" in line_type:
            rem_curve = curve 
            while rem_curve.Length > 0.1: 
                if rem_curve.Length <= zebra_width + 0.1:
                    solid = create_ribbon_solid(rem_curve, zebra_length, thickness, ref_surface)
                    if solid: output_solids.append(solid)
                    break
                t_dash = rem_curve.ParameterAtSegmentLength(zebra_width)
                parts = rem_curve.SplitByParameter(t_dash)
                solid = create_ribbon_solid(parts[0], zebra_length, thickness, ref_surface)
                if solid: output_solids.append(solid)
                rem_curve = parts[1]
                if rem_curve.Length <= zebra_gap + 0.1: break
                t_gap = rem_curve.ParameterAtSegmentLength(zebra_gap)
                rem_curve = rem_curve.SplitByParameter(t_gap)[1]

        elif "機車停等區" in line_type:
            half_w = line_width / 2.0
            def extend_curve_on_surface(c, e_start, e_end, rs):
                try:
                    sp, ep = c.StartPoint, c.EndPoint
                    ts, te = c.TangentAtParameter(0.01).Normalized(), c.TangentAtParameter(0.99).Normalized()
                    ns, ne = sp.Translate(ts, -e_start), ep.Translate(te, e_end)
                    if rs:
                        try: ns = rs.ClosestPointTo(ns)
                        except: pass
                        try: ne = rs.ClosestPointTo(ne)
                        except: pass
                    return safe_curve_from_pts([ns, ne])
                except: return c

            back_curve = get_offset_curve(curve, moto_depth, ref_surface)
            if back_curve:
                front_ext = extend_curve_on_surface(curve, half_w, half_w, ref_surface)
                back_ext = extend_curve_on_surface(back_curve, half_w, half_w, ref_surface)
                solid_front = create_ribbon_solid(front_ext, line_width, thickness, ref_surface)
                solid_back = create_ribbon_solid(back_ext, line_width, thickness, ref_surface)
                if solid_front: output_solids.append(solid_front); output_solids.append(solid_back)
                
                left_line = safe_curve_from_pts([curve.StartPoint, back_curve.StartPoint])
                right_line = safe_curve_from_pts([curve.EndPoint, back_curve.EndPoint])
                if left_line:
                    left_shrink = extend_curve_on_surface(left_line, -half_w, -half_w, ref_surface)
                    solid_L = create_ribbon_solid(left_shrink, line_width, thickness, ref_surface)
                    if solid_L: output_solids.append(solid_L)
                if right_line:
                    right_shrink = extend_curve_on_surface(right_line, -half_w, -half_w, ref_surface)
                    solid_R = create_ribbon_solid(right_shrink, line_width, thickness, ref_surface)
                    if solid_R: output_solids.append(solid_R)

    if not output_solids: raise Exception("實體清單為空！")

    # === 5. Bake 轉換為 Revit 元件 (無痕 BIM 塗裝引擎) ===
    TransactionManager.Instance.EnsureInTransaction(doc)
    
    # 決定顏色代碼與植入的名稱
    if "黃" in line_type:
        mat_name = "標線_黃色"
        cr, cg, cb = 255, 204, 0
    else:
        mat_name = "標線_白色"
        cr, cg, cb = 255, 255, 255

    # 尋找 Revit 專案內的「實體填滿 (Solid Fill)」樣式 ID
    fill_pattern_id = None
    collector = FilteredElementCollector(doc).OfClass(FillPatternElement)
    for fp in collector:
        if fp.GetFillPattern().IsSolidFill:
            fill_pattern_id = fp.Id
            break
            
    rvt_cat = doc.Settings.Categories.get_Item(BuiltInCategory.OST_GenericModel)
    created_ids = List[ElementId]()
    
    for dyn_solid in output_solids:
        try:
            # 1. 回歸純淨：使用純 Revit API 生成 B-Rep 平滑實體 (無網格分割線)
            rvt_solids = dyn_solid.ToRevitType() 
            ds = DirectShape.CreateElement(doc, rvt_cat.Id)
            ds.SetShape(rvt_solids)
            
            # 2. 植入 BIM 資訊：將材質屬性寫入元件名稱，方便未來使用視圖篩選器管理
            ds.Name = mat_name + "_" + line_type
            
            # 3. 視覺覆寫：自動將當前畫面中的標線塗上完美無瑕的黃色/白色
            if fill_pattern_id:
                ogs = OverrideGraphicSettings()
                ogs.SetSurfaceForegroundPatternId(fill_pattern_id)
                ogs.SetSurfaceForegroundPatternColor(RvtColor(cr, cg, cb))
                doc.ActiveView.SetElementOverrides(ds.Id, ogs)
                
            created_ids.Add(ds.Id)
        except: pass
            
    final_output = None
    if created_ids.Count > 1:
        group = doc.Create.NewGroup(created_ids)
        group.GroupType.Name = "標線群組_" + line_type 
        final_output = group
    elif created_ids.Count == 1:
        final_output = doc.GetElement(created_ids[0])
        
    TransactionManager.Instance.TransactionTaskDone()
    OUT = final_output

except Exception as e:
    OUT = traceback.format_exc()
# ----------------------------------------
watch = Watch(python_script)  # graph output
說明 = StringInput("""先用標註畫參考線長
再選你標線的性質
人行道跟待轉區要輸入寬度其長度是參考線長
黃線材質名稱：標線_黃色
白線材質名稱：標線_白色""")  # graph input
選一條基準線 = DSEdgeSelection()  # "2.選一條基準線"; 1 picked in the model; frozen
