# Dynamo graph 明細-刪除幽靈房間跟範圍.dyn (Dynamo 3.7.0.11777)

python_script = Python()  # CPython3
# ---------- python_script.python (39 lines) ----------
import clr
clr.AddReference('RevitAPI')
from Autodesk.Revit.DB import FilteredElementCollector, BuiltInCategory, SpatialElement

clr.AddReference('RevitServices')
import RevitServices
from RevitServices.Persistence import DocumentManager
from RevitServices.Transactions import TransactionManager

# 取得目前的 Revit 檔案
doc = DocumentManager.Instance.CurrentDBDocument

# 直接使用 Revit API 抓取專案中所有的房間 (Rooms) 與面積 (Areas)
rooms = FilteredElementCollector(doc).OfCategory(BuiltInCategory.OST_Rooms).WhereElementIsNotElementType().ToElements()
areas = FilteredElementCollector(doc).OfCategory(BuiltInCategory.OST_Areas).WhereElementIsNotElementType().ToElements()

# 將房間與面積的清單合併
all_spatial_elements = list(rooms) + list(areas)

deleted_count = 0

# 開啟 Transaction 進行修改
TransactionManager.Instance.EnsureInTransaction(doc)

for item in all_spatial_elements:
    try:
        # 確保是 SpatialElement
        if isinstance(item, SpatialElement):
            # 判斷是否為未放置 (Location 為 None) 或是未正確圍合 (Area 為 0)
            if item.Area == 0 or item.Location is None:
                doc.Delete(item.Id)
                deleted_count += 1
    except Exception as e:
        pass

TransactionManager.Instance.TransactionTaskDone()

# 輸出結果，不需要再設定任何 IN 輸入
OUT = f"清理完成！自動抓取並刪除了 {deleted_count} 個未放置的房間與面積。"
# ----------------------------------------
watch = Watch(python_script)
string = StringInput("刪除幽靈的房間及範圍")  # graph input
