# Dynamo graph 明細-房間編號.dyn (Dynamo 3.6.1.9895)

樓層流水號 = StringInput("1")  # graph input
房間流水號 = StringInput("01")  # graph input
python_script = Python(IN[0]=樓層流水號, IN[1]=房間流水號)  # CPython3
# ---------- python_script.python (96 lines) ----------
import clr
# 引入 Revit API
clr.AddReference('RevitServices')
import RevitServices
from RevitServices.Persistence import DocumentManager
from RevitServices.Transactions import TransactionManager

clr.AddReference('RevitAPI')
from Autodesk.Revit.DB import *

import re

# 取得目前的 Revit 文件與視圖
doc = DocumentManager.Instance.CurrentDBDocument
active_view = doc.ActiveView

# 取得輸入格式
level_format = str(IN[0])
seq_format = str(IN[1])
lvl_pad = len(level_format)
seq_pad = len(seq_format)

# --- 核心邏輯：自動從目前的明細表視圖抓取房間 ---
rooms = []
if isinstance(active_view, ViewSchedule):
    collector = FilteredElementCollector(doc, active_view.Id)
    rooms = collector.OfCategory(BuiltInCategory.OST_Rooms).ToElements()
else:
    OUT = "請先切換到『房間明細表』視圖再執行喔！"
    rooms = []

if rooms:
    data_list = []
    for rm in rooms:
        # 1. 取得樓層參數
        lvl_param = rm.get_Parameter(BuiltInParameter.ROOM_LEVEL_ID)
        
        # ⚠️ 防呆機制 1：檢查是否真的有抓到樓層元件
        level_elem = doc.GetElement(lvl_param.AsElementId()) if lvl_param else None
        if not level_elem:
            continue # 如果是幽靈房間 (沒有樓層)，就直接跳過不處理！
            
        lvl_name = level_elem.Name.upper()
        
        # 2. 取得面積參數
        area_param = rm.get_Parameter(BuiltInParameter.ROOM_AREA)
        area_val = area_param.AsDouble() if area_param else 0.0
        
        # ⚠️ 防呆機制 2：面積小於等於 0 的通常也是未放置房間，一併跳過
        if area_val <= 0:
            continue
            
        data_list.append({
            'element': rm,
            'lvl_name': lvl_name,
            'area': area_val
        })

    # 依照「樓層名稱」分組
    rooms_by_level = {}
    for item in data_list:
        lvl = item['lvl_name']
        if lvl not in rooms_by_level:
            rooms_by_level[lvl] = []
        rooms_by_level[lvl].append(item)

    # 開啟交易修改 Revit 資料
    TransactionManager.Instance.EnsureInTransaction(doc)
    
    count = 0
    for lvl_name, group in rooms_by_level.items():
        # 面積大的排前面
        sorted_group = sorted(group, key=lambda x: x['area'], reverse=True)
        
        # 判斷前綴
        if "B" in lvl_name: prefix = "B"
        elif "R" in lvl_name: prefix = "R"
        else: prefix = "F"
        
        # 提取樓層數字
        match = re.search(r'\d+', lvl_name)
        lvl_num_str = match.group().zfill(lvl_pad) if match else "0".zfill(lvl_pad)
        
        for i, item in enumerate(sorted_group):
            seq_num_str = str(i + 1).zfill(seq_pad)
            new_number = prefix + lvl_num_str + seq_num_str
            
            # 寫入房間的「編號」參數
            item['element'].get_Parameter(BuiltInParameter.ROOM_NUMBER).Set(new_number)
            count += 1
            
    TransactionManager.Instance.TransactionTaskDone()
    OUT = "成功！已閃避幽靈房間，並為 {} 個實體房間重新編號！".format(count)
else:
    if not isinstance(active_view, ViewSchedule):
        OUT = "錯誤：請開啟房間明細表視圖"
# ----------------------------------------
watch = Watch(python_script)
string = StringInput("""執行時開啟明細表然後會依照樓層編號每個房間面積大的他會排在前面 
B:地下室
F:地面層
R:屋突層""")  # graph input
