# Dynamo graph 明細-欄位填滿或替換文字.dyn (Dynamo 3.6.1.9895)

要處理的欄位 = StringInput("門窗備註")  # graph input
原來字串 = StringInput("六金")  # graph input
替換字串 = StringInput("五金")  # graph input
填滿的文字 = StringInput("")  # graph input
python_script = Python(IN[0]=要處理的欄位, IN[1]=原來字串, IN[2]=替換字串, IN[3]=填滿的文字)  # CPython3
# ---------- python_script.python (101 lines) ----------
import clr

clr.AddReference('RevitAPI')
from Autodesk.Revit.DB import *

clr.AddReference('RevitServices')
from RevitServices.Persistence import DocumentManager
from RevitServices.Transactions import TransactionManager

doc = DocumentManager.Instance.CurrentDBDocument
active_view = doc.ActiveView

# IN[0]: 目標欄位名稱
# IN[1]: 要尋找的字串 (A)
# IN[2]: 要替換的字串 (B)
# IN[3]: 欲填充的統一字串 (填滿)

if len(IN) < 4:
    OUT = "⚠️ 錯誤：需要 4 個輸入端喔！請確認接線 (欄位, 找A, 換B, 填滿)"
else:
    param_name = IN[0]
    find_str = str(IN[1]) if IN[1] else ""
    replace_str = str(IN[2]) if IN[2] else ""
    fill_value = IN[3]

    is_fill_mode = False
    if fill_value and str(fill_value).strip() != "":
        is_fill_mode = True
        fill_value = str(fill_value)

    # 【進化 1】超強大參數尋找器：無視唯讀分身，直搗黃龍！
    def get_writable_param(element, p_name):
        params = element.GetParameters(p_name)
        for p in params:
            if not p.IsReadOnly:
                return p
        return None

    if isinstance(active_view, ViewSchedule):
        elements = list(FilteredElementCollector(doc, active_view.Id).WhereElementIsNotElementType().ToElements())
        TransactionManager.Instance.EnsureInTransaction(doc)
        
        success_count = 0
        processed_types = []
        log = [] # 錯誤紀錄本
        
        for el in elements:
            target_param = None
            is_type_param = False
            
            # 先找實體，找不到就去挖類型
            p_inst = get_writable_param(el, param_name)
            if p_inst:
                target_param = p_inst
            else:
                tid = el.GetTypeId()
                if tid != ElementId.InvalidElementId:
                    etype = doc.GetElement(tid)
                    if etype:
                        p_type = get_writable_param(etype, param_name)
                        if p_type:
                            target_param = p_type
                            is_type_param = True
                            
            if not target_param:
                continue
                
            if is_type_param:
                if tid in processed_types:
                    continue
                processed_types.append(tid)

            # 執行寫入，這次如果有錯絕不吞掉！
            try:
                if is_fill_mode:
                    target_param.Set(fill_value)
                    success_count += 1
                else:
                    current_val = target_param.AsValueString() or target_param.AsString() or ""
                    
                    # 【進化 2】神級判斷：如果 Revit 裡是空的，但你要找 "無"，直接算你中！
                    if find_str == "無" and current_val.strip() == "":
                        target_param.Set(replace_str)
                        success_count += 1
                    elif find_str and find_str in current_val:
                        new_val = current_val.replace(find_str, replace_str)
                        target_param.Set(new_val)
                        success_count += 1
            except Exception as e:
                if str(e) not in log:
                    log.append(str(e))
                    
        TransactionManager.Instance.TransactionTaskDone()
        
        mode_str = "「霸道填滿」" if is_fill_mode else "「尋找取代」"
        if len(log) > 0:
            OUT = "⚠️ 發現 Revit 底層阻擋！成功 {} 個，但遇到錯誤：{}".format(success_count, log[0])
        else:
            OUT = "【優呵！破案成功】使用{}模式，成功更新了 {} 個「類型」項目！啾咪！".format(mode_str, success_count)
    else:
        OUT = "錯誤：小明哥哥，請記得切換到明細表視窗喔！"
# ----------------------------------------
watch = Watch(python_script)
stringinput = StringInput("""門:類型標記
窗:類型標記
範圍:編號
""")  # "說明.."; graph input
