# Dynamo graph 明細-欄位排序.dyn (Dynamo 3.6.2.11575)

要排序的欄位 = StringInput("編號")  # graph input
python_script = Python(IN[0]=要排序的欄位)  # CPython3
# ---------- python_script.python (105 lines) ----------
import clr
import System
from System import StringComparer
import functools

clr.AddReference('RevitAPI')
from Autodesk.Revit.DB import *

clr.AddReference('RevitServices')
from RevitServices.Persistence import DocumentManager
from RevitServices.Transactions import TransactionManager

doc = DocumentManager.Instance.CurrentDBDocument

# 取得 Dynamo 傳入的欄位名稱
param_to_set = IN[0] 

active_view = doc.ActiveView

def get_param_by_id(element, param_id):
    for p in element.Parameters:
        if p.Id == param_id:
            return p
    return None

def get_sort_value(element, param_id):
    param = get_param_by_id(element, param_id)
    if param and param.HasValue:
        if param.StorageType == StorageType.String:
            return param.AsString() or ""
        elif param.StorageType == StorageType.Double:
            return param.AsDouble()
        elif param.StorageType == StorageType.Integer:
            return param.AsInteger()
        elif param.StorageType == StorageType.ElementId:
            elem = doc.GetElement(param.AsElementId())
            return elem.Name if elem else ""
    return ""

if isinstance(active_view, ViewSchedule):
    definition = active_view.Definition
    sort_group_fields = definition.GetSortGroupFields()
    
    # 收集排序規則：包含 ParameterId 和 是否為「遞增 (Ascending)」
    sort_rules = []
    for sgf in sort_group_fields:
        field = definition.GetField(sgf.FieldId)
        is_ascending = (sgf.SortOrder == ScheduleSortOrder.Ascending)
        sort_rules.append((field.ParameterId, is_ascending))
        
    collector = FilteredElementCollector(doc, active_view.Id).ToElements()
    elements = list(collector)
    
    # 妹妹特製：支援多條件、混合遞增/遞減，外加中文語系防護的終極比較器
    def compare_elements(e1, e2):
        for param_id, is_asc in sort_rules:
            v1 = get_sort_value(e1, param_id)
            v2 = get_sort_value(e2, param_id)
            
            if v1 == v2:
                continue
                
            # 【防護 1】如果遇到一個是字串(空值)，一個是數值，強制轉字串比較避免崩潰
            if type(v1) != type(v2):
                v1, v2 = str(v1), str(v2)
                
            # 字串交給系統文化特性去比對
            if isinstance(v1, str) and isinstance(v2, str):
                cmp_res = StringComparer.CurrentCulture.Compare(v1, v2)
                if cmp_res != 0:
                    return cmp_res if is_asc else -cmp_res
            else:
                # 數值比對 (例如面積的浮點數)
                if v1 > v2:
                    return 1 if is_asc else -1
                else:
                    return -1 if is_asc else 1
                    
        # 【防護 2】相容 Revit 2024+ (Value) 與舊版 (IntegerValue) 的 ID 取值法
        id1 = e1.Id.Value if hasattr(e1.Id, "Value") else e1.Id.IntegerValue
        id2 = e2.Id.Value if hasattr(e2.Id, "Value") else e2.Id.IntegerValue
        
        if id1 > id2: return 1
        if id1 < id2: return -1
        return 0

    # 套用自訂排序邏輯
    if sort_rules:
        elements.sort(key=functools.cmp_to_key(compare_elements))
    
    TransactionManager.Instance.EnsureInTransaction(doc)
    
    count = 1
    for el in elements:
        param = el.LookupParameter(param_to_set)
        # 確保參數存在且不是唯讀狀態
        if param and not param.IsReadOnly:
            param.Set(str(count)) 
            count += 1
            
    TransactionManager.Instance.TransactionTaskDone()
    
    OUT = "大成功！成功讀取明細表的「遞增/遞減」規則，完美複製視覺順序，重新編號了 {} 個元件！".format(count - 1)
else:
    OUT = "錯誤：請先將視窗切換到明細表喔！"
# ----------------------------------------
watch = Watch(python_script)  # graph output
