# Dynamo graph 明細-欄位排序加字母.dyn (Dynamo 3.6.1.9895)

要排序的欄位 = StringInput("編號")  # graph input
排序前文字 = StringInput("")  # graph input
python_script = Python(IN[0]=要排序的欄位, IN[1]=排序前文字)  # CPython3
# ---------- python_script.python (118 lines) ----------
import clr

clr.AddReference('RevitAPI')
from Autodesk.Revit.DB import *

clr.AddReference('RevitServices')
from RevitServices.Persistence import DocumentManager
from RevitServices.Transactions import TransactionManager

doc = DocumentManager.Instance.CurrentDBDocument
active_view = doc.ActiveView

# 只需要 2 個輸入端 (IN[0]目標欄位, IN[1]前綴字)
if len(IN) < 2:
    OUT = "⚠️ 錯誤：只需要 2 個輸入端 (IN[0]目標欄位, IN[1]前綴字) 喔！"
else:
    param_name = IN[0] 
    prefix = str(IN[1]) if IN[1] else ""

    def get_parameter_value(el, p_name):
        p = el.LookupParameter(p_name)
        if p and p.HasValue:
            return p.AsValueString() or p.AsString() or str(p.AsDouble())
        
        tid = el.GetTypeId()
        if tid != ElementId.InvalidElementId:
            etype = doc.GetElement(tid)
            if etype:
                p_type = etype.LookupParameter(p_name)
                if p_type and p_type.HasValue:
                    return p_type.AsValueString() or p_type.AsString() or str(p_type.AsDouble())
        return ""

    if isinstance(active_view, ViewSchedule):
        elements = list(FilteredElementCollector(doc, active_view.Id).WhereElementIsNotElementType().ToElements())
        
        # 【小明核心智慧】：自動偵測是「實體參數」還是「類型參數」
        is_type_param = False
        is_instance_param = False
        
        if elements:
            test_el = elements[0]
            p_inst = test_el.LookupParameter(param_name)
            if p_inst and not p_inst.IsReadOnly:
                is_instance_param = True
            else:
                tid = test_el.GetTypeId()
                if tid != ElementId.InvalidElementId:
                    etype = doc.GetElement(tid)
                    if etype:
                        p_type = etype.LookupParameter(param_name)
                        if p_type and not p_type.IsReadOnly:
                            is_type_param = True

        existing_values = []
        for el in elements:
            val = get_parameter_value(el, param_name)
            if val and val not in existing_values:
                existing_values.append(val)

        table_data = active_view.GetTableData()
        body_data = table_data.GetSectionData(SectionType.Body)
        num_rows = body_data.NumberOfRows
        num_cols = body_data.NumberOfColumns
        
        visual_order_list = []
        for r in range(num_rows):
            for c in range(num_cols):
                cell_text = active_view.GetCellText(SectionType.Body, r, c)
                if cell_text in existing_values and cell_text not in visual_order_list:
                    visual_order_list.append(cell_text)

        TransactionManager.Instance.EnsureInTransaction(doc)
        
        count = 1
        processed_types = [] 
        
        for target_old_val in visual_order_list:
            updated_type_this_turn = False
            
            for el in elements:
                old_val = get_parameter_value(el, param_name)
                
                if old_val == target_old_val:
                    if is_type_param:
                        # 【類型參數】：改完族群類型後做記號
                        tid = el.GetTypeId()
                        if tid != ElementId.InvalidElementId and tid not in processed_types:
                            etype = doc.GetElement(tid)
                            p_type = etype.LookupParameter(param_name)
                            if p_type and not p_type.IsReadOnly:
                                try:
                                    p_type.Set(prefix + str(count))
                                    updated_type_this_turn = True
                                    processed_types.append(tid) 
                                except:
                                    pass
                    
                    elif is_instance_param:
                        # 【實體參數】：每發出一個號碼，號碼機立刻 +1！絕對不重複！
                        p_inst = el.LookupParameter(param_name)
                        if p_inst and not p_inst.IsReadOnly:
                            try:
                                p_inst.Set(prefix + str(count))
                                count += 1 
                            except:
                                pass
                                
            # 如果是類型參數，同一款全部處理完，號碼機才 +1
            if is_type_param and updated_type_this_turn:
                count += 1
                
        TransactionManager.Instance.TransactionTaskDone()
        
        param_type_str = "類型參數" if is_type_param else ("實體參數" if is_instance_param else "唯讀參數")
        OUT = "【突破盲點大成功】！目標為「{}」！成功發放了 {} 個不重複的獨立號碼！優呵！".format(param_type_str, count - 1)
    else:
        OUT = "錯誤：請確認你在明細表視窗喔！"
# ----------------------------------------
watch = Watch(python_script)
stringinput = StringInput("""門:類型標記
窗:類型標記
範圍:編號
注意:不行多執行一次就好囉!!""")  # "說明.."; graph input
