# Dynamo graph 明細-欄位暫時獨立編號.dyn (Dynamo 3.6.1.9895)

要排序的欄位 = StringInput("類型標記")  # graph input
python_script = Python(IN[0]=要排序的欄位)  # CPython3
# ---------- python_script.python (74 lines) ----------
import clr

clr.AddReference('RevitAPI')
from Autodesk.Revit.DB import *

clr.AddReference('RevitServices')
from RevitServices.Persistence import DocumentManager
from RevitServices.Transactions import TransactionManager

doc = DocumentManager.Instance.CurrentDBDocument
active_view = doc.ActiveView

# IN[0]: 要重新編號的目標欄位 (例如 "類型標記")
if len(IN) < 1 or not IN[0]:
    OUT = "⚠️ 錯誤：小明哥哥，請給妹妹 IN[0] (要處理的欄位名稱) 喔！"
else:
    param_name = IN[0]
    prefix = "T" # 小明指定的臨時前置字母

    # 超強大參數尋找器：無視唯讀分身
    def get_writable_param(element, p_name):
        params = element.GetParameters(p_name)
        for p in params:
            if not p.IsReadOnly:
                return p
        return None

    if isinstance(active_view, ViewSchedule):
        elements = list(FilteredElementCollector(doc, active_view.Id).WhereElementIsNotElementType().ToElements())
        TransactionManager.Instance.EnsureInTransaction(doc)
        
        count = 1
        processed_types = []
        
        for el in elements:
            target_param = None
            is_type_param = False
            
            # 先找實體，找不到就去挖類型
            p_inst = get_writable_param(el, param_name)
            if p_inst:
                target_param = p_inst
            else:
                tid = el.GetTypeId()
                if tid != ElementId.InvalidElementId:
                    etype = doc.GetElement(tid)
                    if etype:
                        p_type = get_writable_param(etype, param_name)
                        if p_type:
                            target_param = p_type
                            is_type_param = True
                            
            if not target_param:
                continue
                
            # 如果是類型參數，確保每個「類型」只發一次臨時編號
            if is_type_param:
                tid = el.GetTypeId()
                if tid in processed_types:
                    continue
                processed_types.append(tid)

            # 執行寫入：賦予絕對獨立的 T 編號
            try:
                target_param.Set(prefix + str(count))
                count += 1
            except:
                pass
                    
        TransactionManager.Instance.TransactionTaskDone()
        
        OUT = "【臨時獨立編號大成功】！成功為「{}」欄位產生了 {} 個不重複的 T 編號！現在可以安心去排序囉！優呵！啾咪！".format(param_name, count - 1)
    else:
        OUT = "錯誤：小明哥哥，請記得切換到明細表視窗喔！"
# ----------------------------------------
watch = Watch(python_script)
說明 = StringInput("""門:類型標記
窗:類型標記
範圍:編號""")
