# Dynamo graph 明細-牆面積列式.dyn (Dynamo 3.6.2.11575)

python_script = Python()  # CPython3
# ---------- python_script.python (224 lines) ----------
import clr
import math
clr.AddReference('RevitAPI')
from Autodesk.Revit.DB import *
from System.Collections.Generic import List

clr.AddReference('RevitServices')
import RevitServices
from RevitServices.Persistence import DocumentManager
from RevitServices.Transactions import TransactionManager

doc = DocumentManager.Instance.CurrentDBDocument
active_view = doc.ActiveView

if not isinstance(active_view, ViewSchedule):
    OUT = "【妹妹提示】哥哥，請確認目前 Revit 的作用中畫面是你的「牆明細表」喔！"
else:
    collector = FilteredElementCollector(doc, active_view.Id).OfCategory(BuiltInCategory.OST_Walls).WhereElementIsNotElementType()
    walls = [w for w in collector]

    if not walls:
        OUT = "明細表中沒有找到任何牆體資料。"
    else:
        TransactionManager.Instance.EnsureInTransaction(doc)

        ft_to_m = 0.3048
        sqft_to_sqm = 0.09290304

        # ------------------------------------------------
        # 建立全域門窗快取 (把專案所有門窗的 2D 座標先記下來)
        # ------------------------------------------------
        cats = List[BuiltInCategory]()
        cats.Add(BuiltInCategory.OST_Doors)
        cats.Add(BuiltInCategory.OST_Windows)
        multi_cat_filter = ElementMulticategoryFilter(cats)
        all_dws = FilteredElementCollector(doc).WherePasses(multi_cat_filter).WhereElementIsNotElementType().ToElements()

        dw_data_list = []
        for dw in all_dws:
            bb = dw.get_BoundingBox(None)
            if not bb: continue
            
            # 取得中心點並壓平到 2D 座標 (Z=0)
            loc = dw.Location
            if loc and isinstance(loc, LocationPoint):
                pt2d = XYZ(loc.Point.X, loc.Point.Y, 0)
            else:
                # 【抓蟲蟲修正】：避免 XYZ 直接相加除以 2 報錯，改用拆解寫法
                cx = (bb.Min.X + bb.Max.X) / 2.0
                cy = (bb.Min.Y + bb.Max.Y) / 2.0
                pt2d = XYZ(cx, cy, 0)
                
            # 取得門窗的開口朝向
            facing_2d = None
            if hasattr(dw, "FacingOrientation") and dw.FacingOrientation:
                try:
                    facing_2d = XYZ(dw.FacingOrientation.X, dw.FacingOrientation.Y, 0).Normalize()
                except:
                    pass
                    
            host_id = None
            try:
                if dw.Host: host_id = dw.Host.Id
            except:
                pass
                
            dw_data_list.append({
                "elem": dw,
                "pt2d": pt2d,
                "min_z": bb.Min.Z,
                "max_z": bb.Max.Z,
                "facing_2d": facing_2d,
                "host_id": host_id
            })

        # ------------------------------------------------
        # 將牆體依照樓層分組並排序
        # ------------------------------------------------
        walls_by_level = {}
        for w in walls:
            level_param = w.get_Parameter(BuiltInParameter.WALL_BASE_CONSTRAINT)
            level_name = "未命名樓層"
            if level_param:
                level = doc.GetElement(level_param.AsElementId())
                if level: level_name = level.Name

            length_param = w.get_Parameter(BuiltInParameter.CURVE_ELEM_LENGTH)
            length_m = length_param.AsDouble() * ft_to_m if length_param else 0.0

            if level_name not in walls_by_level:
                walls_by_level[level_name] = []
            
            walls_by_level[level_name].append({"wall": w, "length_m": length_m})

        def set_custom_parameter(elem, param_name, val_num, val_str):
            p = elem.LookupParameter(param_name)
            if p and not p.IsReadOnly:
                if p.StorageType == StorageType.Double:
                    p.Set(val_num)
                elif p.StorageType == StorageType.String:
                    p.Set(val_str)

        def get_dimension(inst, typ, built_in_param, search_names):
            p = inst.get_Parameter(built_in_param)
            if p and p.HasValue: return p.AsDouble()
            p = typ.get_Parameter(built_in_param)
            if p and p.HasValue: return p.AsDouble()
            for name in search_names:
                p = inst.LookupParameter(name)
                if p and p.HasValue: return p.AsDouble()
            for name in search_names:
                p = typ.LookupParameter(name)
                if p and p.HasValue: return p.AsDouble()
            return 0.0

        width_keywords = ["寬度", "Width", "粗略寬度", "Rough Width", "W"]
        height_keywords = ["高度", "Height", "粗略高度", "Rough Height", "H"]

        # ------------------------------------------------
        # 處理每一道牆 (核心辨識邏輯)
        # ------------------------------------------------
        for level_name, wall_list in walls_by_level.items():
            wall_list.sort(key=lambda x: x["length_m"], reverse=True)

            for idx, item in enumerate(wall_list):
                w = item["wall"]
                length_m = item["length_m"]

                mark_str = "{}-{:02d}".format(level_name, idx + 1)
                mark_param = w.get_Parameter(BuiltInParameter.ALL_MODEL_MARK)
                if mark_param and not mark_param.IsReadOnly:
                    mark_param.Set(mark_str)

                openings_dict = {}
                total_opening_area_sqm = 0.0
                
                w_bb = w.get_BoundingBox(None)
                w_loc = w.Location
                
                if w_bb and isinstance(w_loc, LocationCurve):
                    w_curve = w_loc.Curve
                    # 把牆體兩端點壓平到 2D
                    pt1 = XYZ(w_curve.GetEndPoint(0).X, w_curve.GetEndPoint(0).Y, 0)
                    pt2 = XYZ(w_curve.GetEndPoint(1).X, w_curve.GetEndPoint(1).Y, 0)
                    
                    if pt1.DistanceTo(pt2) > 0.01:
                        w_line_2d = Line.CreateBound(pt1, pt2)
                        
                        # 【抓蟲蟲修正】：用拆解座標相減的方式取得向量，取代 pt2 - pt1
                        w_dir_2d = XYZ(pt2.X - pt1.X, pt2.Y - pt1.Y, 0).Normalize()
                        
                        # 把所有門窗拿來跟這道牆配對
                        for dw_data in dw_data_list:
                            dw = dw_data["elem"]
                            is_match = False
                            
                            # 條件一：如果是直接掛在這道牆上，無條件收入
                            if dw_data["host_id"] == w.Id:
                                is_match = True
                            else:
                                # 條件二：Z 高度必須有交集 (防呆，避免抓到樓上樓下)
                                if dw_data["min_z"] <= w_bb.Max.Z + 0.1 and dw_data["max_z"] >= w_bb.Min.Z - 0.1:
                                    
                                    # 條件三：2D 投影距離小於 1.5 呎 (約 45 公分，足以涵蓋主牆加粉刷牆)
                                    res = w_line_2d.Project(dw_data["pt2d"])
                                    if res and res.Distance < 1.5:
                                        
                                        # 條件四：門窗開口方向必須跟牆體垂直 (避免抓到垂直轉角的另一道牆)
                                        if dw_data["facing_2d"]:
                                            dot = abs(w_dir_2d.DotProduct(dw_data["facing_2d"]))
                                            # dot=0表示完美垂直，1表示平行。小於0.5代表偏向垂直
                                            if dot <= 0.5: 
                                                is_match = True
                                        else:
                                            is_match = True

                            # 配對成功，抓取尺寸算面積！
                            if is_match:
                                type_elem = doc.GetElement(dw.GetTypeId())
                                type_mark_param = type_elem.get_Parameter(BuiltInParameter.ALL_MODEL_TYPE_MARK)
                                type_mark = type_mark_param.AsString() if type_mark_param and type_mark_param.AsString() else "未命名標記"

                                width = get_dimension(dw, type_elem, BuiltInParameter.FAMILY_WIDTH_PARAM, width_keywords)
                                height = get_dimension(dw, type_elem, BuiltInParameter.FAMILY_HEIGHT_PARAM, height_keywords)

                                area_sqm = width * height * sqft_to_sqm
                                total_opening_area_sqm += area_sqm

                                if type_mark not in openings_dict:
                                    openings_dict[type_mark] = {"count": 0, "single_area_sqm": area_sqm}
                                openings_dict[type_mark]["count"] += 1

                opening_names = []
                opening_calc_parts = []
                for tm, data in openings_dict.items():
                    count = data["count"]
                    single_area = data["single_area_sqm"]
                    
                    if count > 1:
                        opening_names.append("{}*{}".format(tm, count))
                        opening_calc_parts.append("{:.2f}*{}".format(single_area, count))
                    else:
                        opening_names.append(tm)
                        opening_calc_parts.append("{:.2f}".format(single_area))

                opening_str = ",".join(opening_names)

                net_area_param = w.get_Parameter(BuiltInParameter.HOST_AREA_COMPUTED)
                net_area_sqm = net_area_param.AsDouble() * sqft_to_sqm if net_area_param else 0.0
                gross_area_sqm = net_area_sqm + total_opening_area_sqm
                avg_height_m = (gross_area_sqm / length_m) if length_m > 0 else 0.0

                if opening_calc_parts:
                    calc_str = "{:.2f}*{:.2f}-({})".format(length_m, avg_height_m, "+".join(opening_calc_parts))
                else:
                    calc_str = "{:.2f}*{:.2f}".format(length_m, avg_height_m)

                set_custom_parameter(w, "長度(M)", length_m, "{:.2f}".format(length_m))
                set_custom_parameter(w, "平均高度(M)", avg_height_m, "{:.2f}".format(avg_height_m))
                set_custom_parameter(w, "開孔門窗", 0.0, opening_str)
                set_custom_parameter(w, "計算式", 0.0, calc_str)

        TransactionManager.Instance.TransactionTaskDone()
        OUT = "【執行成功】優喝！討厭的蟲蟲抓完啦！雷達已經重新啟動，準備迎接滿滿的數據吧！啾咪"
# ----------------------------------------
watch = Watch(python_script)
string = StringInput("""必須有下列欄位:
1.標記:牆的編碼
2.長度(M)
2.平均高度(M)
3.開孔門窗:如W1*2,W2,D1
4.計算式(平方公尺)=牆體長度*平均高度-(W1面積*2+W2面積+D1面積)
""")  # graph input
