# Dynamo graph 標註-停車位編號-雲行線.dyn (Dynamo 3.6.1.9895)

停車位群族名稱 = StringInput("法規停車位_V4")  # graph input
開始編號 = DoubleInput(1)  # graph input
選一個雲行線 = DSModelElementSelection()  # 1 picked in the model; graph input
編號的參數 = StringInput("備註")  # graph input
python_script = Python(IN[0]=開始編號, IN[1]=選一個雲行線, IN[2]=編號的參數)  # CPython3
# ---------- python_script.python (112 lines) ----------
import clr
import sys

# 載入 Revit API
clr.AddReference('RevitAPI')
from Autodesk.Revit.DB import *

# 載入 Revit 節點與幾何轉換
clr.AddReference('RevitNodes')
import Revit
clr.ImportExtensions(Revit.Elements)
clr.ImportExtensions(Revit.GeometryConversion)

# 載入事務管理
clr.AddReference('RevitServices')
from RevitServices.Persistence import DocumentManager
from RevitServices.Transactions import TransactionManager

doc = DocumentManager.Instance.CurrentDBDocument

# --- 讀取 Dynamo 輸入 ---
# 族群名稱的 IN 已經移除了，輸入端順序往前遞補！
start_num = int(IN[0])     # 起始編號 (原 IN[1])
curve_input = UnwrapElement(IN[1]) # 雲形線 (原 IN[2])
param_name = IN[2]         # 參數名稱 (原 IN[3])

# --- 1. 取得 Revit 曲線幾何 ---
revit_curve = None
if hasattr(curve_input, "GeometryCurve"):
    revit_curve = curve_input.GeometryCurve
elif hasattr(curve_input, "Location"):
    revit_curve = curve_input.Location.Curve

if not revit_curve:
    OUT = "錯誤：請確認 IN[1] 輸入的是 Revit 中的模型線或細部線。"
    sys.exit()

# --- 2. 收集所有的停車位 (不限族群名稱) ---
# 妹妹改用 Revit 內建的「停車 (OST_Parking)」品類來抓取
# 這樣不管你有幾種大車、小車、機車的族群，只要品類是停車位就會被抓進來！
collector = FilteredElementCollector(doc).OfCategory(BuiltInCategory.OST_Parking).WhereElementIsNotElementType()
parking_spaces = [e for e in collector if isinstance(e, FamilyInstance)]

# --- 取得 Z 軸加厚範圍 ---
z_values = []
for space in parking_spaces:
    loc = space.Location
    if isinstance(loc, LocationPoint):
        z_values.append(loc.Point.Z)

z_buffer = 0.5
if not z_values:
    OUT = "模型中找不到任何『停車』品類的物件"
    sys.exit()

min_z = min(z_values) - z_buffer
max_z = max(z_values) + z_buffer

intersecting_spaces = []

# 🔴 關鍵修改：將 XY 平面的感應距離大幅增加到 30 英呎 (約 9 公尺)
# 這樣即使線畫得比較偏或有大弧度，也能順利掃描到車位
xy_tolerance = 30.0 

# --- 3. 找出符合範圍的車位 ---
for space in parking_spaces:
    loc = space.Location
    if isinstance(loc, LocationPoint):
        pt = loc.Point
        
        # Z 軸過濾
        if pt.Z < min_z or pt.Z > max_z:
            continue 
            
        result = revit_curve.Project(pt)
        
        if result:
            # 🔴 使用加大的容許距離
            if result.Distance < xy_tolerance: 
                intersecting_spaces.append({
                    "param": result.Parameter,
                    "space": space
                })

intersecting_spaces.sort(key=lambda x: x["param"])

# --- 4. 寫入參數 ---
TransactionManager.Instance.EnsureInTransaction(doc)

current_num = start_num
success_elements = []

for item in intersecting_spaces:
    space = item["space"]
    p = space.LookupParameter(param_name)
    
    if p and not p.IsReadOnly:
        if p.StorageType == StorageType.String:
            p.Set(str(current_num))
        elif p.StorageType == StorageType.Integer:
            p.Set(current_num)
        
        success_elements.append(space)
        current_num += 1

TransactionManager.Instance.TransactionTaskDone()

# --- 輸出結果：加入總編號數量統計 ---
OUT = {
    "1_總共編了多少車位": str(len(success_elements)) + " 個",
    "2_成功處理的車位清單": success_elements
}
# ----------------------------------------
