# Dynamo graph 標註-停車位自動編號.dyn (Dynamo 3.6.1.9895)

current = Document.Current()
activeView = Document.ActiveView(document=current)
汽車開始編號 = DoubleInput(1)  # graph input
機車開始編號 = DoubleInput(1)  # graph input
編號的參數 = StringInput("備註")  # graph input
python_script = Python(IN[0]=汽車開始編號, IN[1]=機車開始編號, IN[2]=編號的參數)  # CPython3
# ---------- python_script.python (150 lines) ----------
import clr
import sys

# 載入 Revit API
clr.AddReference('RevitAPI')
from Autodesk.Revit.DB import *

# 載入事務管理
clr.AddReference('RevitServices')
from RevitServices.Persistence import DocumentManager
from RevitServices.Transactions import TransactionManager

doc = DocumentManager.Instance.CurrentDBDocument

# --- 1. 讀取 Dynamo 輸入 ---
start_num_cars = int(IN[0])     # 汽車起始編號 
start_num_motors = int(IN[1])   # 機車起始編號 
param_name = IN[2]              # 參數名稱 

# --- 2. 核心功能：座標分群排序函數 ---
def get_sorted_elements(elements):
    if not elements:
        return []
    
    data_list = []
    for e in elements:
        loc = e.Location
        if isinstance(loc, LocationPoint):
            pt = loc.Point
            data_list.append({"elem": e, "pt": pt, "x": pt.X, "y": pt.Y})
    
    cluster_tolerance = 12.0 
    clusters = []
    visited = set()
    
    for i, d1 in enumerate(data_list):
        if i in visited: continue
        current_cluster = []
        queue = [i]
        visited.add(i)
        while queue:
            curr_idx = queue.pop(0)
            current_cluster.append(data_list[curr_idx])
            for j, d2 in enumerate(data_list):
                if j not in visited:
                    dist = ((data_list[curr_idx]["pt"].X - d2["pt"].X)**2 + (data_list[curr_idx]["pt"].Y - d2["pt"].Y)**2)**0.5
                    if dist < cluster_tolerance:
                        visited.add(j)
                        queue.append(j)
        clusters.append(current_cluster)
    
    cluster_info = []
    for c in clusters:
        cy = sum([item["y"] for item in c]) / float(len(c))
        cx = sum([item["x"] for item in c]) / float(len(c))
        cluster_info.append({"cluster": c, "cy": cy, "cx": cx})
    
    cluster_info.sort(key=lambda c: c["cy"], reverse=True) 
    
    block_rows = []
    curr_b_row = []
    if cluster_info:
        curr_b_row.append(cluster_info[0])
        for c in cluster_info[1:]:
            if abs(c["cy"] - curr_b_row[0]["cy"]) < 15.0:
                curr_b_row.append(c)
            else:
                block_rows.append(curr_b_row)
                curr_b_row = [c]
        block_rows.append(curr_b_row)
    
    sorted_clusters = []
    for b_row in block_rows:
        b_row.sort(key=lambda c: c["cx"]) 
        for c in b_row: sorted_clusters.append(c["cluster"])
    
    final_ordered = []
    for c in sorted_clusters:
        c.sort(key=lambda item: item["y"], reverse=True)
        rows = []
        curr_row = []
        if c:
            curr_row.append(c[0])
            for item in c[1:]:
                if abs(item["y"] - curr_row[0]["y"]) < 5.0:
                    curr_row.append(item)
                else:
                    rows.append(curr_row)
                    curr_row = [item]
            rows.append(curr_row)
        for row in rows:
            row.sort(key=lambda item: item["x"])
            for r in row: final_ordered.append(r["elem"])
            
    return final_ordered

# --- 3. 收集目前視圖中的所有停車位並分類 ---
active_view_id = doc.ActiveView.Id 
collector = FilteredElementCollector(doc, active_view_id).OfCategory(BuiltInCategory.OST_Parking).WhereElementIsNotElementType()

cars_to_process = []
motors_to_process = []

for e in collector:
    if not isinstance(e, FamilyInstance): continue
    
    # 🔴 核心修正：同時抓取「類型名稱」與「族群名稱」
    type_name = e.Name               # 取得類型名稱 (例如: 1m x 2m 法定停車位(機車))
    fam_name = e.Symbol.Family.Name  # 取得族群名稱 (例如: 法規停車位_V4)
    
    # 只要類型或族群名稱其中一個包含「機車」，就判定為機車位
    if "機車" in type_name or "機車" in fam_name:
        motors_to_process.append(e)
    else:
        cars_to_process.append(e)

# --- 4. 分別執行排序 ---
sorted_cars = get_sorted_elements(cars_to_process)
sorted_motors = get_sorted_elements(motors_to_process)

# --- 5. 寫入參數 ---
TransactionManager.Instance.EnsureInTransaction(doc)

# 處理汽車編號
current_car = start_num_cars
for car in sorted_cars:
    p = car.LookupParameter(param_name)
    if p and not p.IsReadOnly:
        val = str(current_car) if p.StorageType == StorageType.String else current_car
        p.Set(val)
        current_car += 1

# 處理機車編號
current_motor = start_num_motors
for motor in sorted_motors:
    p = motor.LookupParameter(param_name)
    if p and not p.IsReadOnly:
        val = str(current_motor) if p.StorageType == StorageType.String else current_motor
        p.Set(val)
        current_motor += 1

TransactionManager.Instance.TransactionTaskDone()

# --- 6. 輸出結果 ---
OUT = {
    "1_鎖定視圖": doc.ActiveView.Name,
    "2_汽車編號數量": len(sorted_cars),
    "3_機車編號數量": len(sorted_motors),
    "4_總計編號數量": len(sorted_cars) + len(sorted_motors)
}
# ----------------------------------------
編號統計 = Watch(python_script)  # graph output
