# Dynamo graph 標註-加標籤-梁柱.dyn (Dynamo 3.6.1.9895)

同類型視窗一起加標籤 = BoolSelector(false)  # "1.同類型視窗一起加標籤"; graph input
n2_樑標籤距樑的距離_2 = DoubleInput(2)  # "2.樑標籤距樑的距離(2)"; graph input
python_script = Python(IN[0]=同類型視窗一起加標籤, IN[1]=n2_樑標籤距樑的距離_2)  # CPython3
# ---------- python_script.python (186 lines) ----------
import clr

# 載入 Revit API
clr.AddReference('RevitAPI')
import Autodesk
from Autodesk.Revit.DB import *

# 載入 Revit 服務
clr.AddReference('RevitServices')
import RevitServices
from RevitServices.Persistence import DocumentManager
from RevitServices.Transactions import TransactionManager

# ========================================================
# 🎛️ 讀取 IN[0] & IN[1] 開關設定
# ========================================================
if IN[0] is None:
    apply_to_all_views = False
elif isinstance(IN[0], list):
    apply_to_all_views = IN[0][0]
else:
    apply_to_all_views = IN[0]

if IN[1] is None:
    paper_offset_mm = 5.0  
elif isinstance(IN[1], list):
    paper_offset_mm = IN[1][0]
else:
    paper_offset_mm = IN[1]

doc = DocumentManager.Instance.CurrentDBDocument
active_view = doc.ActiveView

# ========================================================
# 🗺️ 決定要處理的視圖清單 (字串化 ID 絕對比對法！)
# ========================================================
views_to_process = []
target_type_name = "專屬結構平面" # 預設名稱

if apply_to_all_views:
    # 💡 核心防護 1：把目標類型 ID 強制轉成「字串 (String)」
    # 這樣既能避開新版 Revit 沒有 IntegerValue 的問題，又能保證比對 100% 精準不漏抓！
    target_type_id_str = str(active_view.GetTypeId())
    
    try:
        # 💡 核心防護 2：繞過 .Name 報錯 Bug，改從底層參數抓取類型名稱
        target_type_elem = doc.GetElement(active_view.GetTypeId())
        if target_type_elem:
            param = target_type_elem.get_Parameter(BuiltInParameter.SYMBOL_NAME_PARAM)
            if param:
                target_type_name = param.AsString()
    except:
        pass
    
    all_views = FilteredElementCollector(doc).OfClass(View).ToElements()
    
    for v in all_views:
        if v.IsTemplate: 
            continue
            
        v_type_id_str = str(v.GetTypeId())
        
        # 💡 只要字串化後的 ID 一模一樣，才放行處理！差一個字都不行！
        if v_type_id_str == target_type_id_str:
            views_to_process.append(v)
else:
    views_to_process.append(active_view)

# 開始交易
TransactionManager.Instance.EnsureInTransaction(doc)

total_deleted = 0
total_created = 0
error_messages = []

# 設定區
column_filter = ElementCategoryFilter(BuiltInCategory.OST_StructuralColumns)
beam_filter = ElementCategoryFilter(BuiltInCategory.OST_StructuralFraming)
or_filter = LogicalOrFilter(column_filter, beam_filter)

# 🔄 步驟：迴圈處理每一張視圖
for v in views_to_process:
    
    try:
        v_scale = v.Scale if hasattr(v, 'Scale') and v.Scale else 100
        beam_offset = (paper_offset_mm * v_scale) / 304.8
    except:
        beam_offset = 1.5 

    # 1. 刪除舊標籤 
    try:
        col_tag_cat = ElementCategoryFilter(BuiltInCategory.OST_StructuralColumnTags)
        beam_tag_cat = ElementCategoryFilter(BuiltInCategory.OST_StructuralFramingTags)
        tag_filter = LogicalOrFilter(col_tag_cat, beam_tag_cat)
        
        tags_to_delete = FilteredElementCollector(doc, v.Id) \
                        .WherePasses(tag_filter) \
                        .WhereElementIsNotElementType() \
                        .ToElementIds()
        for t_id in tags_to_delete:
            doc.Delete(t_id)
            total_deleted += 1
    except:
        pass

    # 2. 重新建立新標籤
    collector = FilteredElementCollector(doc, v.Id) \
                .WherePasses(or_filter) \
                .WhereElementIsNotElementType() \
                .ToElements()
                
    for elem in collector:
        try:
            ref = Reference(elem)
            category_name = elem.Category.Name
            
            # 🏢 結構柱
            if "Column" in category_name or "柱" in category_name:
                bbox = elem.get_BoundingBox(v)
                if bbox is None: continue 
                
                cx = (bbox.Min.X + bbox.Max.X) / 2.0
                cy = (bbox.Min.Y + bbox.Max.Y) / 2.0
                cz = (bbox.Min.Z + bbox.Max.Z) / 2.0
                pt = XYZ(cx, cy, cz)
                
                tag = IndependentTag.Create(doc, v.Id, ref, False, TagMode.TM_ADDBY_CATEGORY, TagOrientation.Horizontal, pt)
                doc.Regenerate()
                tag.TagHeadPosition = pt
                total_created += 1
                
            # 🪵 結構樑
            else:
                loc = elem.Location
                if isinstance(loc, LocationCurve):
                    curve = loc.Curve
                    mid_pt = curve.Evaluate(0.5, True)
                    p1 = curve.GetEndPoint(0)
                    p2 = curve.GetEndPoint(1)
                    dx = abs(p1.X - p2.X)
                    dy = abs(p1.Y - p2.Y)
                    
                    bbox = elem.get_BoundingBox(v)
                    if bbox is not None:
                        half_width_x = (bbox.Max.X - bbox.Min.X) / 2.0
                        half_width_y = (bbox.Max.Y - bbox.Min.Y) / 2.0
                    else:
                        half_width_x = 0.0
                        half_width_y = 0.0
                    
                    if dx >= dy: 
                        pt = XYZ(mid_pt.X, mid_pt.Y + half_width_y + beam_offset, mid_pt.Z)
                        tag_ori = TagOrientation.Horizontal
                    else: 
                        pt = XYZ(mid_pt.X + half_width_x + beam_offset, mid_pt.Y, mid_pt.Z)
                        tag_ori = TagOrientation.Vertical
                        
                    tag = IndependentTag.Create(doc, v.Id, ref, False, TagMode.TM_ADDBY_CATEGORY, tag_ori, pt)
                    doc.Regenerate()
                    tag.TagHeadPosition = pt
                    total_created += 1
                else:
                    bbox = elem.get_BoundingBox(v)
                    if bbox is None: continue
                    cx = (bbox.Min.X + bbox.Max.X) / 2.0
                    cy = (bbox.Min.Y + bbox.Max.Y) / 2.0
                    cz = (bbox.Min.Z + bbox.Max.Z) / 2.0
                    pt = XYZ(cx, cy, cz)
                    tag_ori = TagOrientation.Horizontal
                    
                    tag = IndependentTag.Create(doc, v.Id, ref, False, TagMode.TM_ADDBY_CATEGORY, tag_ori, pt)
                    doc.Regenerate()
                    tag.TagHeadPosition = pt
                    total_created += 1
        except Exception as e:
            error_messages.append(str(e))

# 結束交易
TransactionManager.Instance.TransactionTaskDone()

# 輸出結果
if total_created == 0 and len(error_messages) > 0:
    unique_errors = list(set(error_messages))
    OUT = "❌ 失敗！\n{}".format("\n".join(unique_errors))
else:
    OUT = "✅ 報告小明哥哥！精準鎖定成功！\n🎯 目標視圖類型：[{}]\n共處理了 {} 個視圖。\n🧹 清除 {} 個舊標籤\n➕ 新增 {} 個新標籤！".format(target_type_name, len(views_to_process), total_deleted, total_created)
# ----------------------------------------
watch = Watch(python_script)  # graph output
