# Dynamo graph 標註-加標籤-門窗.dyn (Dynamo 3.6.1.9895)

同類型視窗一起加標籤 = BoolSelector(false)  # "1.同類型視窗一起加標籤"; graph input
n2_窗標籤與牆距離_3_5mm = DoubleInput(3.5)  # "2.窗標籤與牆距離(3.5mm)"; graph input
python_script = Python(IN[0]=同類型視窗一起加標籤, IN[1]=n2_窗標籤與牆距離_3_5mm)  # CPython3
# ---------- python_script.python (146 lines) ----------
import clr

# 載入 Revit API
clr.AddReference('RevitAPI')
import Autodesk
from Autodesk.Revit.DB import *

# 載入 Revit 服務
clr.AddReference('RevitServices')
import RevitServices
from RevitServices.Persistence import DocumentManager
from RevitServices.Transactions import TransactionManager

# ========================================================
# 🎛️ 讀取 IN[0] & IN[1] 設定
# ========================================================
if IN[0] is None:
    apply_to_all_views = False
elif isinstance(IN[0], list):
    apply_to_all_views = IN[0][0]
else:
    apply_to_all_views = IN[0]

if IN[1] is None:
    paper_offset_mm = 5.0  
elif isinstance(IN[1], list):
    paper_offset_mm = IN[1][0]
else:
    paper_offset_mm = IN[1]

doc = DocumentManager.Instance.CurrentDBDocument
active_view = doc.ActiveView

# ========================================================
# 🗺️ 決定要處理的視圖清單 (【ID字串】絕對比對法！)
# ========================================================
views_to_process = []
target_type_name = "未知類型" 

if apply_to_all_views:
    # 💡 核心防護 1：把目標類型 ID 強制轉成「字串 (String)」
    target_type_id_str = str(active_view.GetTypeId())
    
    # 💡 核心防護 2：繞過 .Name 報錯 Bug，安全抓取目標名稱用於顯示
    target_type_elem = doc.GetElement(active_view.GetTypeId())
    if target_type_elem:
        param = target_type_elem.get_Parameter(BuiltInParameter.SYMBOL_NAME_PARAM)
        if param:
            target_type_name = param.AsString()
            
    # 3. 篩選所有同類型視圖
    all_views = FilteredElementCollector(doc).OfClass(View).ToElements()
    for v in all_views:
        if v.IsTemplate: continue
        
        # 🐛 終極抓蟲：直接比對字串化的 ID，避開屬性讀取錯誤！
        if str(v.GetTypeId()) == target_type_id_str:
            views_to_process.append(v)
else:
    views_to_process.append(active_view)

# 開始交易
TransactionManager.Instance.EnsureInTransaction(doc)

total_deleted = 0
total_created = 0
error_messages = []

# 建立過濾器
door_filter = ElementCategoryFilter(BuiltInCategory.OST_Doors)
window_filter = ElementCategoryFilter(BuiltInCategory.OST_Windows)
or_filter = LogicalOrFilter(door_filter, window_filter)

# ========================================================
# 🔄 開始跨視圖大迴圈！
# ========================================================
for v in views_to_process:
    
    # 📐 比例換算
    try:
        v_scale = v.Scale if hasattr(v, 'Scale') and v.Scale else 100
        window_offset = (paper_offset_mm * v_scale) / 304.8
    except:
        window_offset = 1.5 

    # 1. 刪除舊標籤
    try:
        tag_collector = FilteredElementCollector(doc, v.Id).OfClass(IndependentTag).ToElements()
        for tag in tag_collector:
            if tag.Category is not None:
                tag_category = tag.Category.Name
                if "Window" in tag_category or "窗" in tag_category or "Door" in tag_category or "門" in tag_category:
                    doc.Delete(tag.Id)
                    total_deleted += 1
    except:
        pass 

    # 2. 建立新標籤
    collector = FilteredElementCollector(doc, v.Id) \
                .WherePasses(or_filter) \
                .WhereElementIsNotElementType() \
                .ToElements()
                
    for elem in collector:
        try:
            ref = Reference(elem)
            bbox = elem.get_BoundingBox(v)
            if bbox is None: continue 
            
            cx = (bbox.Min.X + bbox.Max.X) / 2.0
            cy = (bbox.Min.Y + bbox.Max.Y) / 2.0
            cz = (bbox.Min.Z + bbox.Max.Z) / 2.0
            center_pt = XYZ(cx, cy, cz)
            
            category_name = elem.Category.Name
            
            # 如果是窗戶，依照 FacingOrientation 偏移
            if "Window" in category_name or "窗" in category_name:
                try:
                    facing_vec = elem.FacingOrientation 
                    pt = center_pt.Add(facing_vec.Multiply(window_offset))
                except:
                    pt = center_pt
            else:
                pt = center_pt
                
            # 建立標籤
            tag = IndependentTag.Create(doc, v.Id, ref, False, TagMode.TM_ADDBY_CATEGORY, TagOrientation.Horizontal, pt)
            doc.Regenerate()
            tag.TagHeadPosition = pt
            total_created += 1
            
        except Exception as e:
            error_messages.append(str(e))

# 結束交易
TransactionManager.Instance.TransactionTaskDone()

# ========================================================
# 📊 輸出超狂戰績
# ========================================================
if total_created == 0 and len(error_messages) > 0:
    unique_errors = list(set(error_messages))
    OUT = "❌ 失敗！\nRevit 錯誤訊息：\n{}".format("\n".join(unique_errors))
else:
    OUT = "✅ 報告小明哥哥！PRO模式精準鎖定成功！\n🎯 目標視圖類型：[{}]\n🧹 清除 {} 個舊標籤\n➕ 新增 {} 個新標籤！".format(target_type_name, total_deleted, total_created)
# ----------------------------------------
watch = Watch(python_script)  # graph output
