# Dynamo graph 標註-尺寸-文公尺查詢.dyn (Dynamo 3.6.1.9895)

文公尺單位長 = CodeBlock { 42.854; }
n1_文公尺單位長_42_854 = DoubleInput(42.854)  # "1.文公尺單位長(42.854)"; graph input
查詢尺寸 = DoubleInput(105)  # "2.查詢尺寸"; graph input
python_script = Python(IN[0]=n1_文公尺單位長_42_854, IN[1]=查詢尺寸)  # CPython3
# ---------- python_script.python (61 lines) ----------
# 輸入參數
# IN[0] = 文公尺單位長 (預設 42.854)
# IN[1] = 欲查詢的長度 (公分，例如 557)

cycle_len_cm = IN[0] if IN[0] else 42.854
target_cm = IN[1]

# 八字訣與吉數索引 (0:財, 3:義, 4:官, 7:本)
list_8 = ["吉-財", "凶-病", "凶-離", "吉-義", "吉-官", "凶-劫", "凶-害", "吉-本"]
good_indices = [0, 3, 4, 7]

# 每個字訣的長度區間
step = cycle_len_cm / 8.0

def get_sector_info(abs_index):
    """根據絕對索引值，計算對應的字訣與公分區間"""
    c = abs_index // 8
    idx = abs_index % 8
    start_cm = c * cycle_len_cm + idx * step
    end_cm = c * cycle_len_cm + (idx + 1) * step
    return list_8[idx], start_cm, end_cm

# 1. 計算當前輸入長度所在的區間與字訣
current_abs_idx = int(target_cm / step)
current_name, current_start, current_end = get_sector_info(current_abs_idx)

# 2. 往回找 2 個比這個數字小，且屬於「吉」的區間
smaller_results = []
smaller_idx = current_abs_idx - 1
while smaller_idx >= 0 and len(smaller_results) < 2:
    if (smaller_idx % 8) in good_indices:
        s_name, s_start, s_end = get_sector_info(smaller_idx)
        smaller_results.append("{} (長度區間: {:.2f} cm ~ {:.2f} cm)".format(s_name, s_start, s_end))
    smaller_idx -= 1

# 3. 往前找 2 個比這個數字大，且屬於「吉」的區間
larger_results = []
larger_idx = current_abs_idx + 1
while len(larger_results) < 2:
    if (larger_idx % 8) in good_indices:
        l_name, l_start, l_end = get_sector_info(larger_idx)
        larger_results.append("{} (長度區間: {:.2f} cm ~ {:.2f} cm)".format(l_name, l_start, l_end))
    larger_idx += 1

# 4. 整理輸出結果給哥哥
out_text = "文公查詢完畢：\n"
out_text += "▶ 輸入長度: {} cm = {}\n".format(target_cm, current_name)
out_text += "--------------------------------------\n"

out_text += "【 較小的「吉」數區間 】\n"
if len(smaller_results) > 0:
    for i, txt in enumerate(smaller_results):
        out_text += "   {}. {}\n".format(i+1, txt)
else:
    out_text += "   已經沒有更小的吉數區間囉！\n"

out_text += "\n【 較大的「吉」數區間 】\n"
for i, txt in enumerate(larger_results):
    out_text += "   {}. {}\n".format(i+1, txt)

OUT = out_text
# ----------------------------------------
watch = Watch(python_script)  # graph output
