# Dynamo graph 標註-尺寸-文公尺清除.dyn "標註-清除文公尺" (Dynamo 3.6.1.9895)

文公尺單位長 = CodeBlock { 42.854; }
要不要細標 = BoolSelector(true)
文公尺單位長_2 = DoubleInput(42.854)
python_script = Python()  # CPython3
# ---------- python_script.python (61 lines) ----------
import clr
import System
clr.AddReference('RevitAPI')
from Autodesk.Revit.DB import *

clr.AddReference('RevitServices')
import RevitServices
from RevitServices.Persistence import DocumentManager
from RevitServices.Transactions import TransactionManager

doc = DocumentManager.Instance.CurrentDBDocument

# 暴力搜查所有尺寸標註
dims = FilteredElementCollector(doc).OfCategory(BuiltInCategory.OST_Dimensions).WhereElementIsNotElementType().ToElements()

count = 0
TransactionManager.Instance.EnsureInTransaction(doc)

for dim in dims:
    try:
        dim_name = dim.Name
        
        # 只要不是文公尺，就不動它
        if dim_name is None or "文公尺" not in dim_name:
            continue
            
        is_multi = False
        try:
            if dim.Segments is not None and dim.Segments.Size > 0:
                is_multi = True
        except: pass
            
        if is_multi:
            for seg in dim.Segments:
                try:
                    # 溫柔的暴力：上下左右的文字，全部擦掉！
                    seg.Suffix = ""
                    seg.Below = ""
                    seg.Prefix = ""
                    seg.Above = ""
                    count += 1
                except: pass
        else:
            try:
                # 溫柔的暴力：上下左右的文字，全部擦掉！
                dim.Suffix = ""
                dim.Below = ""
                dim.Prefix = ""
                dim.Above = ""
                count += 1
            except: pass
            
    except: pass

TransactionManager.Instance.TransactionTaskDone()

# 霸氣回報
if count > 0:
    OUT = "優喝！洗心革面大成功！妹妹幫你把 {} 個段落的文字全都擦得乾乾淨淨啦！啾咪！".format(count)
else:
    OUT = "報告哥哥：畫面上已經很乾淨囉，找不到需要洗白的標註！"
# ----------------------------------------
watch = Watch(python_script)
說明 = StringInput("清除所有文公尺")  # graph input
