# Dynamo graph 標註-尺寸-文公尺顯示下標.dyn "標註-顯示文公下標" (Dynamo 3.6.1.9895)

文公尺單位長 = CodeBlock { 42.854; }
文公尺單位長_2 = DoubleInput(42.854)  # graph input
要不要細標 = BoolSelector(false)  # graph input
python_script = Python(IN[0]=文公尺單位長_2, IN[1]=要不要細標)  # CPython3
# ---------- python_script.python (79 lines) ----------
import clr
import System
clr.AddReference('RevitAPI')
from Autodesk.Revit.DB import *

clr.AddReference('RevitServices')
import RevitServices
from RevitServices.Persistence import DocumentManager
from RevitServices.Transactions import TransactionManager

doc = DocumentManager.Instance.CurrentDBDocument

cycle_len_cm = IN[0] if IN[0] else 42.854
is_detailed = IN[1]

list_8 = ["吉-財","凶-病","凶-離","吉-義","吉-官","凶-劫","凶-害","吉-本"]
list_32 = ["_財德","_寶庫","_六合","_迎福","_退財","_公事","_牢執","_孤寡",
           "_長庫","_劫財","_官鬼","_失脫","_添丁","_益利","_貴子","_大吉",
           "_順科","_橫財","_進益","_富貴","_死別","_退口","_離鄉","_財失",
           "_災至","_死絕","_病臨","_口舌","_財至","_登科","_進寶","_興旺"]

def get_fengshui_text(val_feet, L_cm, detailed):
    val_cm = round(val_feet * 30.48, 2)
    rem = val_cm % L_cm
    
    idx8 = int(rem / (L_cm / 8.0))
    if idx8 >= 8: idx8 = 7
    
    idx32 = int(rem / (L_cm / 32.0))
    if idx32 >= 32: idx32 = 31
    
    return list_8[idx8] + list_32[idx32] if detailed else list_8[idx8]

dims = FilteredElementCollector(doc).OfCategory(BuiltInCategory.OST_Dimensions).WhereElementIsNotElementType().ToElements()

count = 0
TransactionManager.Instance.EnsureInTransaction(doc)

for dim in dims:
    try:
        dim_name = dim.Name
        
        if dim_name is None or "文公尺" not in dim_name:
            continue
            
        is_multi = False
        try:
            if dim.Segments is not None and dim.Segments.Size > 0:
                is_multi = True
        except: pass
            
        if is_multi:
            for seg in dim.Segments:
                try:
                    if seg.Value is not None:
                        txt = get_fengshui_text(seg.Value, cycle_len_cm, is_detailed)
                        # 溫柔地把原本後面的字擦掉，然後寫到下面去！
                        seg.Suffix = "" 
                        seg.Below = txt
                        count += 1
                except: pass
        else:
            try:
                if dim.Value is not None:
                    txt = get_fengshui_text(dim.Value, cycle_len_cm, is_detailed)
                    # 溫柔地把原本後面的字擦掉，然後寫到下面去！
                    dim.Suffix = "" 
                    dim.Below = txt
                    count += 1
            except: pass
            
    except: pass

TransactionManager.Instance.TransactionTaskDone()

if count > 0:
    OUT = "優喝！妹妹溫柔地幫 {} 個段落的文字搬家到「下方」囉！啾咪！".format(count)
else:
    OUT = "報告哥哥：沒抓到可以修改的標註喔！"
# ----------------------------------------
watch = Watch(python_script)
