# Dynamo graph 標註-尺寸-柱列線.dyn "標註-尺寸柱列腺" (Dynamo 3.6.1.9895)

python_script = Python()  # CPython3
# ---------- python_script.python (126 lines) ----------
import clr
import math

clr.AddReference('RevitAPI')
from Autodesk.Revit.DB import *

clr.AddReference('RevitServices')
import RevitServices
from RevitServices.Persistence import DocumentManager
from RevitServices.Transactions import TransactionManager

doc = DocumentManager.Instance.CurrentDBDocument
view = doc.ActiveView

# --- 妹妹的單位換算 (公分轉英呎) ---
def cm_to_feet(cm):
    return cm / 30.48

# --- 建立標註的輔助函式 ---
def create_dim(doc, view, line, ref_array):
    if ref_array.Size > 1:
        return doc.Create.NewDimension(view, line, ref_array)
    return None

# --- 1. 獲取當前視圖的網格並分類 ---
grids = FilteredElementCollector(doc, view.Id).OfCategory(BuiltInCategory.OST_Grids).WhereElementIsNotElementType().ToElements()

h_grids = [] # 水平網格
v_grids = [] # 垂直網格

for g in grids:
    curves = g.GetCurvesInView(DatumExtentType.ViewSpecific, view)
    if len(curves) > 0:
        curve = curves[0]
        dir = curve.Direction
        if abs(dir.X) > abs(dir.Y):
            h_grids.append(g)
        else:
            v_grids.append(g)

# 依照座標排序
if len(h_grids) > 0:
    h_grids.sort(key=lambda g: g.GetCurvesInView(DatumExtentType.ViewSpecific, view)[0].GetEndPoint(0).Y) 
if len(v_grids) > 0:
    v_grids.sort(key=lambda g: g.GetCurvesInView(DatumExtentType.ViewSpecific, view)[0].GetEndPoint(0).X)

# --- 2. 獲取標頭極值與計算向內偏移量 ---
v_endpoints_y = []
for g in v_grids:
    curves = g.GetCurvesInView(DatumExtentType.ViewSpecific, view)
    if len(curves) > 0:
        v_endpoints_y.extend([curves[0].GetEndPoint(0).Y, curves[0].GetEndPoint(1).Y])
    
h_endpoints_x = []
for g in h_grids:
    curves = g.GetCurvesInView(DatumExtentType.ViewSpecific, view)
    if len(curves) > 0:
        h_endpoints_x.extend([curves[0].GetEndPoint(0).X, curves[0].GetEndPoint(1).X])

max_y = max(v_endpoints_y) if v_endpoints_y else 0 
min_y = min(v_endpoints_y) if v_endpoints_y else 0 
max_x = max(h_endpoints_x) if h_endpoints_x else 0 
min_x = min(h_endpoints_x) if h_endpoints_x else 0 

# 自動比例換算
view_scale = view.Scale 

# 哥哥設定的圖紙公分
paper_dist_tier1_cm = 0.5  # 第一層距離 (最外圈)
paper_dist_tier2_cm = 0.65 # 尺寸間距 (內圈距離第一層)

# 換算成英呎
offset1 = cm_to_feet(paper_dist_tier1_cm * view_scale)
offset2 = offset1 + cm_to_feet(paper_dist_tier2_cm * view_scale)

# --- 3. 開始執行 Transaction 繪製標註 ---
TransactionManager.Instance.EnsureInTransaction(doc)

try:
    # 準備 Reference Arrays
    v_refs = ReferenceArray() # 細部尺寸
    for g in v_grids: v_refs.Append(Reference(g))
    v_refs_overall = ReferenceArray() # 總尺寸
    if len(v_grids) >= 2:
        v_refs_overall.Append(Reference(v_grids[0]))
        v_refs_overall.Append(Reference(v_grids[-1]))

    h_refs = ReferenceArray() # 細部尺寸
    for g in h_grids: h_refs.Append(Reference(g))
    h_refs_overall = ReferenceArray() # 總尺寸
    if len(h_grids) >= 2:
        h_refs_overall.Append(Reference(h_grids[0]))
        h_refs_overall.Append(Reference(h_grids[-1]))

    # 【妹妹最終修正：offset1(外圈)放總尺寸，offset2(內圈)放細部尺寸】
    if v_refs.Size > 0 and h_refs.Size > 0:
        # 頂部 (Top) 標註：Y座標向下減
        top_y_1 = max_y - offset1
        top_y_2 = max_y - offset2
        create_dim(doc, view, Line.CreateBound(XYZ(0, top_y_1, 0), XYZ(10, top_y_1, 0)), v_refs_overall)
        create_dim(doc, view, Line.CreateBound(XYZ(0, top_y_2, 0), XYZ(10, top_y_2, 0)), v_refs)

        # 底部 (Bottom) 標註：Y座標向上加
        bot_y_1 = min_y + offset1
        bot_y_2 = min_y + offset2
        create_dim(doc, view, Line.CreateBound(XYZ(0, bot_y_1, 0), XYZ(10, bot_y_1, 0)), v_refs_overall)
        create_dim(doc, view, Line.CreateBound(XYZ(0, bot_y_2, 0), XYZ(10, bot_y_2, 0)), v_refs)

        # 左側 (Left) 標註：X座標向右加
        left_x_1 = min_x + offset1
        left_x_2 = min_x + offset2
        create_dim(doc, view, Line.CreateBound(XYZ(left_x_1, 0, 0), XYZ(left_x_1, 10, 0)), h_refs_overall)
        create_dim(doc, view, Line.CreateBound(XYZ(left_x_2, 0, 0), XYZ(left_x_2, 10, 0)), h_refs)

        # 右側 (Right) 標註：X座標向左減
        right_x_1 = max_x - offset1
        right_x_2 = max_x - offset2
        create_dim(doc, view, Line.CreateBound(XYZ(right_x_1, 0, 0), XYZ(right_x_1, 10, 0)), h_refs_overall)
        create_dim(doc, view, Line.CreateBound(XYZ(right_x_2, 0, 0), XYZ(right_x_2, 10, 0)), h_refs)

    OUT = "內外圈對調完成！總尺寸在外，細部在內，完美符合製圖標準！啾咪！"

except Exception as e:
    OUT = "哎呀，出錯了：" + str(e)

TransactionManager.Instance.TransactionTaskDone()
# ----------------------------------------
說明 = StringInput("在每個視圖的柱列線上下左右標尺寸外圍為總尺寸第二層為細部尺寸")  # graph input
