# Dynamo graph 標註-尺寸-樓層線.dyn (Dynamo 3.6.1.9895)

說明 = StringInput("在每個視圖的樓層線左右標尺寸")  # graph input
python_script = Python()  # CPython3
# ---------- python_script.python (101 lines) ----------
import clr
import math

# 載入 Revit API
clr.AddReference('RevitAPI')
from Autodesk.Revit.DB import *

# 載入 Revit 服務與事務管理器
clr.AddReference('RevitServices')
import RevitServices
from RevitServices.Persistence import DocumentManager
from RevitServices.Transactions import TransactionManager

# 載入 Dynamo 的 Revit 節點擴充
clr.AddReference("RevitNodes")
import Revit
clr.ImportExtensions(Revit.Elements)
clr.ImportExtensions(Revit.GeometryConversion)

# 取得當前文件與視圖
doc = DocumentManager.Instance.CurrentDBDocument
view = doc.ActiveView

# 設定 3mm 的圖紙偏移量，轉換為 Revit 內部單位 (英呎)
offset_mm = 3.0
view_scale = view.Scale
offset_ft = offset_mm * view_scale * 0.00328084

# 收集當前視圖中可見的樓層
collector = FilteredElementCollector(doc, view.Id).OfClass(Level).WhereElementIsNotElementType()
levels = [l for l in collector]

# 依照高程 (Elevation) 排序樓層，確保由下往上標註
levels.sort(key=lambda x: x.Elevation)

# 開啟事務，準備寫入 Revit
TransactionManager.Instance.EnsureInTransaction(doc)

try:
    if len(levels) < 2:
        raise ValueError("視圖中的樓層數量不足 (至少需要2個) 才能建立標註喔！")

    # 🌟 關鍵修改 1：建立一個大籃子，把所有樓層的參考面都放進去 🌟
    refArray = ReferenceArray()
    for l in levels:
        refArray.Append(l.GetPlaneReference())
    
    # 🌟 關鍵修改 2：我們只需要用「最底層」的樓層來判斷左右泡泡的位置就好 🌟
    l_base = levels[0]
    curves = l_base.GetCurvesInView(DatumExtentType.ViewSpecific, view)
    if not curves:
        raise ValueError("無法取得最底層樓層的線段，請確認樓層線在視圖中是否可見。")
        
    curve = curves[0]
    end0 = curve.GetEndPoint(0)
    end1 = curve.GetEndPoint(1)
    
    # 檢查最底層標示圈狀態 (不修改視圖)
    has_bubble_0 = l_base.IsBubbleVisibleInView(DatumEnds.End0, view)
    has_bubble_1 = l_base.IsBubbleVisibleInView(DatumEnds.End1, view)
    
    bubble_pt = None
    other_pt = None
    
    # 邏輯判斷：根據唯一的泡泡位置決定標註參考點
    if has_bubble_0 and not has_bubble_1:
        bubble_pt = end0
        other_pt = end1
    elif not has_bubble_0 and has_bubble_1:
        bubble_pt = end1
        other_pt = end0
    else:
        status_msg = "腳本妹妹抓到錯誤了：無法在最底層 '{}' 上確定唯一的標示圈位置。請確保該樓層線只有一側顯示泡泡。".format(l_base.Name)
        raise ValueError(status_msg)

    # 判斷左右並計算標註線的 X 座標
    is_bubble_on_left = bubble_pt.X < other_pt.X
    
    if is_bubble_on_left:
        dim_x = bubble_pt.X + offset_ft
    else:
        dim_x = bubble_pt.X - offset_ft
        
    # 🌟 關鍵修改 3：建立一條從「最底層」貫穿到「最頂層」的垂直線 🌟
    p1 = XYZ(dim_x, bubble_pt.Y, levels[0].Elevation)
    p2 = XYZ(dim_x, bubble_pt.Y, levels[-1].Elevation)
    dim_line = Line.CreateBound(p1, p2)
    
    # 產生「單一個」連續尺寸標註
    new_dim = doc.Create.NewDimension(view, dim_line, refArray)

    TransactionManager.Instance.TransactionTaskDone()
    # 輸出這個連續標註物件
    OUT = new_dim.ToDSType(False)

except ValueError as ve:
    TransactionManager.Instance.ForceCloseTransaction()
    OUT = str(ve)
except Exception as e:
    TransactionManager.Instance.ForceCloseTransaction()
    OUT = "腳本妹妹抓到錯誤了哥哥看看：" + str(e)
# ----------------------------------------
watch = Watch(python_script)
