# Dynamo graph 標註-尺寸-牆心.dyn (Dynamo 3.6.2.11575)

說明 = StringInput("在每個視圖的牆取牆心上下左右標尺寸")  # graph input
python_script = Python()  # CPython3
# ---------- python_script.python (168 lines) ----------
import clr
import math
clr.AddReference('RevitAPI')
from Autodesk.Revit.DB import *

clr.AddReference('RevitNodes')
import Revit
clr.ImportExtensions(Revit.GeometryConversion)
clr.ImportExtensions(Revit.Elements)

clr.AddReference('RevitServices')
from RevitServices.Persistence import DocumentManager
from RevitServices.Transactions import TransactionManager

doc = DocumentManager.Instance.CurrentDBDocument
uidoc = DocumentManager.Instance.CurrentUIApplication.ActiveUIDocument
view = doc.ActiveView

all_walls = FilteredElementCollector(doc, view.Id).OfClass(Wall).ToElements()

# --- 【升級 1：樓層鎖定】找出目前視圖的基準樓層 ---
current_level_id = view.GenLevel.Id if view.GenLevel else None

valid_walls = []
for w in all_walls:
    if w.get_BoundingBox(view) is not None:
        try:
            if w.WallType.Kind == WallKind.Basic:
                # 拒絕透視！只抓隸屬於「本樓層」的牆
                if current_level_id and w.LevelId != current_level_id:
                    continue
                valid_walls.append(w)
        except:
            pass

global_min_x, global_max_x = float('inf'), float('-inf')
global_min_y, global_max_y = float('inf'), float('-inf')

vert_walls = []  
horiz_walls = [] 

for wall in valid_walls:
    bbox = wall.get_BoundingBox(view)
    global_min_x = min(global_min_x, bbox.Min.X)
    global_max_x = max(global_max_x, bbox.Max.X)
    global_min_y = min(global_min_y, bbox.Min.Y)
    global_max_y = max(global_max_y, bbox.Max.Y)
        
    location = wall.Location
    if isinstance(location, LocationCurve):
        curve = location.Curve
        if isinstance(curve, Line):
            p0, p1 = curve.GetEndPoint(0), curve.GetEndPoint(1)
            dx, dy = abs(p1.X - p0.X), abs(p1.Y - p0.Y)
            
            # 記錄牆的完整延伸範圍 (min/max)，用來判斷是否進入 3 米區
            if dx < 1e-5 and dy > 0.001:
                vert_walls.append({'wall': wall, 'x': p0.X, 'min_y': min(p0.Y, p1.Y), 'max_y': max(p0.Y, p1.Y)})
            elif dy < 1e-5 and dx > 0.001:
                horiz_walls.append({'wall': wall, 'y': p0.Y, 'min_x': min(p0.X, p1.X), 'max_x': max(p0.X, p1.X)})

if vert_walls and horiz_walls:
    # 視覺距離補償
    scale = view.Scale 
    base_offset_feet = (0.5 * scale) / 30.48
    text_buffer_feet = (0.3 * scale) / 30.48
    
    offset_NW = base_offset_feet
    offset_SE = base_offset_feet + text_buffer_feet
    
    line_N = Line.CreateBound(XYZ(global_min_x - 10, global_max_y + offset_NW, 0), XYZ(global_max_x + 10, global_max_y + offset_NW, 0))
    line_W = Line.CreateBound(XYZ(global_min_x - offset_NW, global_min_y - 10, 0), XYZ(global_min_x - offset_NW, global_max_y + 10, 0))
    line_S = Line.CreateBound(XYZ(global_min_x - 10, global_min_y - offset_SE, 0), XYZ(global_max_x + 10, global_min_y - offset_SE, 0))
    line_E = Line.CreateBound(XYZ(global_max_x + offset_SE, global_min_y - 10, 0), XYZ(global_max_x + offset_SE, global_max_y + 10, 0))

    dict_N, dict_S, dict_E, dict_W = {}, {}, {}, {}
    
    # --- 【升級 2：3 米邊界過濾法】 ---
    # 3 公尺轉換為英呎 (Revit 內部單位)
    depth_limit = 3.0 / 0.3048 

    def add_unique_coord(ref_dict, coord, wall_ref, current_tolerance=0.05):
        for existing_coord in ref_dict.keys():
            if abs(existing_coord - coord) < current_tolerance:
                return 
        ref_dict[round(coord, 2)] = wall_ref

    # 垂直牆提供 X 座標，給南北側標註用
    for w in vert_walls:
        # 北側：只要這道垂直牆的最頂端，有伸進建築物最北邊緣的 3 米內，就抓！
        if w['max_y'] > (global_max_y - depth_limit): 
            add_unique_coord(dict_N, w['x'], Reference(w['wall']))
        # 南側：只要這道垂直牆的最底端，有伸進建築物最南邊緣的 3 米內，就抓！
        if w['min_y'] < (global_min_y + depth_limit): 
            add_unique_coord(dict_S, w['x'], Reference(w['wall']))

    # 水平牆提供 Y 座標，給東西側標註用
    for w in horiz_walls:
        # 東側：只要這道水平牆的最右端，有伸進建築物最東邊緣的 3 米內，就抓！
        if w['max_x'] > (global_max_x - depth_limit): 
            add_unique_coord(dict_E, w['y'], Reference(w['wall']))
        # 西側：只要這道水平牆的最左端，有伸進建築物最西邊緣的 3 米內，就抓！
        if w['min_x'] < (global_min_x + depth_limit): 
            add_unique_coord(dict_W, w['y'], Reference(w['wall']))

    def create_ref_array(ref_dict, reverse=False):
        arr = ReferenceArray()
        for key in sorted(ref_dict.keys(), reverse=reverse): 
            arr.Append(ref_dict[key])
        return arr

    ref_N, ref_S = create_ref_array(dict_N), create_ref_array(dict_S)
    ref_W, ref_E = create_ref_array(dict_W), create_ref_array(dict_E)

    def safe_create_dimension(view, dim_line, ref_array, doc):
        if ref_array.Size < 2: return "牆數量不足"
        
        sub_tx = SubTransaction(doc)
        sub_tx.Start()
        
        clean_array = ReferenceArray()
        clean_array.Append(ref_array.get_Item(0))
        
        for i in range(1, ref_array.Size):
            ref_to_test = ref_array.get_Item(i)
            test_array = ReferenceArray()
            test_array.Append(clean_array.get_Item(0))
            test_array.Append(ref_to_test)
            
            is_valid = False
            try:
                doc.Create.NewDimension(view, dim_line, test_array)
                is_valid = True
            except: pass
            
            if is_valid: clean_array.Append(ref_to_test)
        
        sub_tx.RollBack() 
        
        if clean_array.Size > 1:
            new_dim = doc.Create.NewDimension(view, dim_line, clean_array)
            param = new_dim.get_Parameter(BuiltInParameter.ALL_MODEL_INSTANCE_COMMENTS)
            if param: param.Set("<Dynamo Sister>")
            return "成功 (過濾幽靈後的合法端點: {})".format(clean_array.Size)
        else:
            return "全部都是幽靈牆，無法標註"

    TransactionManager.Instance.EnsureInTransaction(doc)
    
    existing_dims = FilteredElementCollector(doc, view.Id).OfClass(Dimension).WhereElementIsNotElementType().ToElements()
    for dim in existing_dims:
        try:
            param = dim.get_Parameter(BuiltInParameter.ALL_MODEL_INSTANCE_COMMENTS)
            if param and param.AsString() == "<Dynamo Sister>":
                doc.Delete(dim.Id)
        except: pass
        
    msg_N = safe_create_dimension(view, line_N, ref_N, doc) if ref_N.Size > 1 else "略過"
    msg_S = safe_create_dimension(view, line_S, ref_S, doc) if ref_S.Size > 1 else "略過"
    msg_E = safe_create_dimension(view, line_E, ref_E, doc) if ref_E.Size > 1 else "略過"
    msg_W = safe_create_dimension(view, line_W, ref_W, doc) if ref_W.Size > 1 else "略過"

    TransactionManager.Instance.TransactionTaskDone()

    OUT = "【3米邊界過濾與樓層鎖定版】\n北側: {}\n南側: {}\n東側: {}\n西側: {}".format(msg_N, msg_S, msg_E, msg_W)

else:
    OUT = "找不到合法的直線基本牆壁喔！"
# ----------------------------------------
watch = Watch(python_script)
