# Dynamo graph 標註-尺寸間距重排.dyn (Dynamo 3.6.1.9895)

選取要重新安排的尺寸 = DSModelElementsSelection()  # 4 picked in the model; graph input
python_script = Python(IN[0]=選取要重新安排的尺寸)  # CPython3
# ---------- python_script.python (130 lines) ----------
import clr
clr.AddReference('RevitAPI')
from Autodesk.Revit.DB import *

clr.AddReference('RevitServices')
from RevitServices.Persistence import DocumentManager
from RevitServices.Transactions import TransactionManager

from System.Collections.Generic import List

doc = DocumentManager.Instance.CurrentDBDocument
view = doc.ActiveView

def to_list(obj):
    if hasattr(obj, '__iter__') and not isinstance(obj, dict) and not isinstance(obj, str):
        return obj
    return [obj]

if not IN[0]:
    OUT = "小明哥！Select 節點沒有抓到東西喔，請重新框選！"
else:
    dims = to_list(UnwrapElement(IN[0]))
    valid_dims = [d for d in dims if isinstance(d, Dimension) and d.Curve and isinstance(d.Curve, Line)]

    if not valid_dims:
        OUT = "沒有選到有效的線性標註喔！"
    else:
        scale = view.Scale
        dim_type = valid_dims[0].DimensionType
        text_size_param = dim_type.get_Parameter(BuiltInParameter.TEXT_SIZE)
        text_size_feet = text_size_param.AsDouble()
        model_text_height = text_size_feet * scale

        # === 💡 小明哥專屬設定區 ===
        spacing_multiplier = 2.0
        first_layer_clearance = spacing_multiplier * 2.0    # 第一層退讓 2 個間距 (約 3 條尺寸線)
        # ==========================

        target_gap = model_text_height * spacing_multiplier
        base_clearance = model_text_height * first_layer_clearance

        # 1. 【維度升級】：捨棄 Z 軸，改用當前視圖的法向量 (ViewDirection)
        base_line = valid_dims[0].Curve
        dim_dir = base_line.Direction
        view_dir = view.ViewDirection
        
        # 利用視圖法向量與尺寸線方向做外積，確保推移方向絕對平貼在當前視圖畫布上！
        normal = view_dir.CrossProduct(dim_dir).Normalize()

        # 2. 【全區掃描】：擴充實體過濾器 (加入屋頂、天花板應付立剖面)
        cats = List[BuiltInCategory]()
        cats.Add(BuiltInCategory.OST_Walls)
        cats.Add(BuiltInCategory.OST_StructuralColumns)
        cats.Add(BuiltInCategory.OST_Columns)
        cats.Add(BuiltInCategory.OST_Floors)
        cats.Add(BuiltInCategory.OST_Roofs)
        cats.Add(BuiltInCategory.OST_Ceilings)
        
        filter = ElementMulticategoryFilter(cats)
        physical_elems = FilteredElementCollector(doc, view.Id).WherePasses(filter).WhereElementIsNotElementType().ToElements()

        ref_pts = []
        bb_pts = [] 
        
        # 3. 【3D 包圍盒】：升級為 8 個角點，精準捕捉立剖面的高度與深度
        for elem in physical_elems:
            bb = elem.get_BoundingBox(view)
            if bb:
                ref_pts.append(XYZ((bb.Min.X + bb.Max.X)/2, (bb.Min.Y + bb.Max.Y)/2, (bb.Min.Z + bb.Max.Z)/2))
                bb_pts.extend([
                    XYZ(bb.Min.X, bb.Min.Y, bb.Min.Z), XYZ(bb.Max.X, bb.Min.Y, bb.Min.Z),
                    XYZ(bb.Min.X, bb.Max.Y, bb.Min.Z), XYZ(bb.Max.X, bb.Max.Y, bb.Min.Z),
                    XYZ(bb.Min.X, bb.Min.Y, bb.Max.Z), XYZ(bb.Max.X, bb.Min.Y, bb.Max.Z),
                    XYZ(bb.Min.X, bb.Max.Y, bb.Max.Z), XYZ(bb.Max.X, bb.Max.Y, bb.Max.Z)
                ])

        # 計算模型與尺寸線重心的 3D 座標 (避開 XYZ 直接相減的蟲蟲)
        if ref_pts:
            avg_model_x = sum(p.X for p in ref_pts) / len(ref_pts)
            avg_model_y = sum(p.Y for p in ref_pts) / len(ref_pts)
            avg_model_z = sum(p.Z for p in ref_pts) / len(ref_pts)
        else:
            avg_model_x, avg_model_y, avg_model_z = 0, 0, 0

        avg_dim_x = sum(d.Curve.Origin.X for d in valid_dims) / len(valid_dims)
        avg_dim_y = sum(d.Curve.Origin.Y for d in valid_dims) / len(valid_dims)
        avg_dim_z = sum(d.Curve.Origin.Z for d in valid_dims) / len(valid_dims)

        to_dims_dir = XYZ(avg_dim_x - avg_model_x, avg_dim_y - avg_model_y, avg_dim_z - avg_model_z)

        # 確保外推方向絕對遠離實體建築物
        if to_dims_dir.DotProduct(normal) > 0:
            outward_dir = normal
        else:
            outward_dir = normal.Multiply(-1)

        # 🎯 找出實體建築物在「目前推移方向」上的最外側邊緣
        if bb_pts:
            model_edge_dist = max(p.DotProduct(outward_dir) for p in bb_pts)
        else:
            model_edge_dist = min(d.Curve.Origin.DotProduct(outward_dir) for d in valid_dims)

        # 依照投影距離由內到外排序
        dim_info = []
        for d in valid_dims:
            proj_dist = d.Curve.Origin.DotProduct(outward_dir)
            dim_info.append({"dim": d, "dist": proj_dist})

        dim_info.sort(key=lambda x: x["dist"])

        TransactionManager.Instance.EnsureInTransaction(doc)
        moved_count = 0

        for i in range(len(dim_info)):
            current_dist = dim_info[i]["dist"]
            
            # 目標 = 實體邊緣 + 完美退讓距離 + (層數 * 間距)
            target_dist = model_edge_dist + base_clearance + (i * target_gap)
            
            move_amount = target_dist - current_dist

            # 執行移動
            if abs(move_amount) > 0.001:
                translation = outward_dir.Multiply(move_amount)
                ElementTransformUtils.MoveElement(doc, dim_info[i]["dim"].Id, translation)
                moved_count += 1

        TransactionManager.Instance.TransactionTaskDone()

        OUT = "平、立、剖面皆已支援，成功完美調整了 {} 條尺寸線！".format(moved_count)
# ----------------------------------------
watch = Watch(python_script)  # graph output
string = StringInput("因為比例的不同會產生尺寸線的間距由所不同甚至尺寸重疊利用此程式來重新安排尺寸線的間距")  # graph input
