# Dynamo graph 標註-文字位置重排.dyn (Dynamo 3.6.1.9895)

選取要重新安排的尺寸 = DSModelElementsSelection()  # 4 picked in the model; graph input
python_script = Python(IN[0]=選取要重新安排的尺寸)  # CPython3
# ---------- python_script.python (86 lines) ----------
import clr
clr.AddReference('RevitAPI')
from Autodesk.Revit.DB import *

clr.AddReference('RevitServices')
from RevitServices.Persistence import DocumentManager
from RevitServices.Transactions import TransactionManager

doc = DocumentManager.Instance.CurrentDBDocument
view = doc.ActiveView

def to_list(obj):
    if hasattr(obj, '__iter__') and not isinstance(obj, dict) and not isinstance(obj, str):
        return obj
    return [obj]

if not IN[0]:
    OUT = "小明哥！Select 節點沒抓到文字喔，快去 Revit 框選那些重疊的文字！"
else:
    elements = to_list(UnwrapElement(IN[0]))
    valid_texts = [t for t in elements if isinstance(t, TextNote)]

    if not valid_texts:
        OUT = "小明哥，選取範圍內沒有找到 Revit 的文字標註（TextNote）喔！"
    else:
        scale = view.Scale
        
        # 抓取單行字高，用來設定段落間距
        text_type = valid_texts[0].TextNoteType
        size_param = text_type.get_Parameter(BuiltInParameter.TEXT_SIZE)
        text_size_feet = size_param.AsDouble() if size_param else (3 / 304.8)
        
        # === 💡 小明哥專屬設定區 ===
        block_gap_multiplier = 0.5  # 段落之間的空白間距倍率 (0.5 = 半個字高的留白距離)
        # ==========================
        
        # 段落留白間距 (轉換為模型空間的真實距離)
        gap_between_blocks = text_size_feet * scale * block_gap_multiplier

        up_dir = view.UpDirection
        
        text_info = []
        for t in valid_texts:
            origin = t.Coord
            proj_dist = origin.DotProduct(up_dir)
            
            # 🧠 關鍵除蟲修正：t.Height 是圖紙高度，必須乘上「視圖比例(scale)」才會是模型裡的實際尺寸！
            model_height = t.Height * scale 
            
            text_info.append({
                "text": t, 
                "dist": proj_dist, 
                "origin": origin,
                "height": model_height 
            })

        # 由上往下排，高度投影值由大到小排序
        text_info.sort(key=lambda x: x["dist"], reverse=True)

        TransactionManager.Instance.EnsureInTransaction(doc)
        
        base_origin = text_info[0]["origin"]
        moved_count = 0
        current_cumulative_drop = 0.0

        for i in range(len(text_info)):
            current_text = text_info[i]["text"]
            current_origin = text_info[i]["origin"]
            current_model_height = text_info[i]["height"]
            
            # 目標位置 = 基準點 - 目前累積的下降距離
            offset_vector = up_dir.Multiply(-current_cumulative_drop)
            target_pos = base_origin.Add(offset_vector)
            
            translation = target_pos.Subtract(current_origin)
            
            if translation.GetLength() > 0.001:
                ElementTransformUtils.MoveElement(doc, current_text.Id, translation)
                moved_count += 1
                
            # 🧠 往下累積距離：加上「這塊文字的真實高度」+「段落留白」
            current_cumulative_drop += (current_model_height + gap_between_blocks)

        TransactionManager.Instance.TransactionTaskDone()

        OUT = "報告小明哥！接收愛心能量，除蟲成功！\n多行文字高度已正確乘上比例。\n成功將 {} 段文字完美往下排好啦！".format(moved_count)
# ----------------------------------------
watch = Watch(python_script)  # graph output
string = StringInput("因為比例的不同會產生文字的間距由所不同甚至文字重疊利用此程式來重新安排文字的位置\n")  # graph input
