# Dynamo graph 標註-文字多行歸一行.dyn (Dynamo 3.6.2.11575)

選取要合併的文字 = DSModelElementsSelection()  # 1 picked in the model; graph input
python_script = Python(IN[0]=選取要合併的文字)  # CPython3
# ---------- python_script.python (56 lines) ----------
import clr

# 載入 Revit API
clr.AddReference('RevitAPI')
from Autodesk.Revit.DB import *

# 載入 Revit 服務與交易管理
clr.AddReference('RevitServices')
import RevitServices
from RevitServices.Persistence import DocumentManager
from RevitServices.Transactions import TransactionManager

# 取得目前的 Revit 文件
doc = DocumentManager.Instance.CurrentDBDocument

# 取得輸入的元素
elements = UnwrapElement(IN[0])

if not isinstance(elements, list):
    elements = [elements]

# 過濾出文字註解
text_notes = [e for e in elements if isinstance(e, TextNote)]
result = ""

if len(text_notes) > 1:
    # 依照 X 座標 (由左至右) 排序
    sorted_notes = sorted(text_notes, key=lambda tn: tn.Coord.X)

    # 提取文字並「清除所有換行符號」(\r 與 \n)
    full_text = "".join([tn.Text.replace('\r', '').replace('\n', '') for tn in sorted_notes])

    primary_note = sorted_notes[0]
    notes_to_delete = sorted_notes[1:]

    # 開啟 Transaction 修改模型
    TransactionManager.Instance.EnsureInTransaction(doc)

    try:
        # 寫入乾淨的單行文字
        primary_note.Text = full_text

        # 刪除多餘文字方塊
        for note in notes_to_delete:
            doc.Delete(note.Id)
        
        result = "✅ 合併成功並已清除換行: " + full_text
    except Exception as e:
        result = "❌ 發生錯誤: " + str(e)

    # 結束 Transaction
    TransactionManager.Instance.TransactionTaskDone()
else:
    result = "⚠️ 請選取兩個以上的文字註解。"

OUT = result
# ----------------------------------------
watch = Watch(python_script)  # graph output
string = StringInput("散掉了多行文字合併成一行")  # graph input
