# Dynamo graph 標註-文字調水平.dyn (Dynamo 3.6.1.9895)

選取要重新安排的尺寸 = DSModelElementsSelection()  # 59 picked in the model; graph input
python_script = Python(IN[0]=選取要重新安排的尺寸)  # CPython3
# ---------- python_script.python (72 lines) ----------
import clr

# 載入 Revit API
clr.AddReference('RevitAPI')
from Autodesk.Revit.DB import *

# 載入 Revit Services
clr.AddReference('RevitServices')
import RevitServices
from RevitServices.Persistence import DocumentManager
from RevitServices.Transactions import TransactionManager

# 取得目前的 Revit 文件
doc = DocumentManager.Instance.CurrentDBDocument

# 取得輸入的元素
elements = UnwrapElement(IN[0])

# 確保輸入是扁平清單，避免框選時的巢狀結構報錯
def flatten(lst):
    res = []
    for i in lst:
        if isinstance(i, list) or isinstance(i, tuple):
            res.extend(flatten(i))
        else:
            res.append(i)
    return res

if isinstance(elements, list) or isinstance(elements, tuple):
    elements = flatten(elements)
else:
    elements = [elements]

# 開啟交易
TransactionManager.Instance.EnsureInTransaction(doc)

replaced_count = 0
error_count = 0

for elem in elements:
    if elem:
        try:
            # 確認是文字註釋
            if elem.GetType().Name == "TextNote":
                
                # 1. 記住舊文字的所有重要屬性
                text_str = elem.Text                  # 文字內容
                location = elem.Coord                 # 插入點座標
                type_id = elem.GetTypeId()            # 文字類型 (字體、大小等)
                view_id = elem.OwnerViewId            # 所屬視圖 ID
                
                # 2. 在同一個視圖、同一個位置，用同一個文字類型，建立全新的文字
                # 預設建立出來的文字絕對是 0 度水平的
                TextNote.Create(doc, view_id, location, text_str, type_id)
                
                # 3. 毀屍滅跡 (刪除原本傾斜的舊文字)
                doc.Delete(elem.Id)
                
                replaced_count += 1
                
        except Exception as e:
            error_count += 1
            pass # 如果有鎖定 (Pinned) 或其他權限問題，先略過

# 結束交易
TransactionManager.Instance.TransactionTaskDone()

# 輸出執行結果
if error_count == 0:
    OUT = f"妹妹報告：採用小明哥的「原地重建大法」！成功將 {replaced_count} 個文字轉回水平 0 度！"
else:
    OUT = f"妹妹報告：成功重建 {replaced_count} 個文字。但有 {error_count} 個處理失敗 (可能被圖釘鎖定了)。"
# ----------------------------------------
watch = Watch(python_script)  # graph output
string = StringInput("因為角度的不同會產生文字的角度由所不同安排文字的角度變水平\n")  # graph input
