# Dynamo graph 標註-柱線自動編號.dyn (Dynamo 3.6.1.9895)

說明 = StringInput("""水平起始值（例如：1 或 A 或 Y1）
垂直起始值（例如：1 或 A 或 X1）""")  # graph input
水平柱線起始值 = StringInput("1")  # graph input
垂直柱線起始值 = StringInput("A")  # graph input
python_script = Python(IN[0]=水平柱線起始值, IN[1]=垂直柱線起始值)  # CPython3
# ---------- python_script.python (85 lines) ----------
import clr
import re

# 匯入 Revit API
clr.AddReference('RevitAPI')
from Autodesk.Revit.DB import *

clr.AddReference('RevitServices')
import RevitServices
from RevitServices.Persistence import DocumentManager
from RevitServices.Transactions import TransactionManager

doc = DocumentManager.Instance.CurrentDBDocument

# --- 定義名稱遞增函式 ---
def get_next_name(start_val, index):
    # 情況 1: 純數字 (1, 2, 3...)
    if start_val.isdigit():
        return str(int(start_val) + index)
    
    # 情況 2: 純字母 (A, B, C...)
    elif start_val.isalpha() and len(start_val) == 1:
        return chr(ord(start_val) + index)
    
    # 情況 3: 前綴 + 數字 (X1, Y1, Grid-1...)
    else:
        match = re.search(r'([a-zA-Z]+)(\d+)', start_val)
        if match:
            prefix = match.group(1)
            num = int(match.group(2))
            return "{}{}".format(prefix, num + index)
        return start_val + str(index)

# 1. 抓取所有柱網
grids = FilteredElementCollector(doc).OfClass(Grid).ToElements()

h_start = str(IN[0])
v_start = str(IN[1])

horizontal_grids = []
vertical_grids = []

# 2. 判斷水平或垂直 (依據線段向量)
for g in grids:
    curve = g.Curve
    p1 = curve.GetEndPoint(0)
    p2 = curve.GetEndPoint(1)
    
    dx = abs(p1.X - p2.X)
    dy = abs(p1.Y - p2.Y)
    
    # 如果 Y 的變化量大於 X，代表它偏向垂直線；反之為水平線
    if dy > dx:
        vertical_grids.append(g)
    else:
        horizontal_grids.append(g)

# 3. 排序
# 垂直線：由左至右 (X 座標由小到大)
vertical_grids.sort(key=lambda x: x.Curve.GetEndPoint(0).X + x.Curve.GetEndPoint(1).X)
# 水平線：由下至上 (Y 座標由小到大)
horizontal_grids.sort(key=lambda x: x.Curve.GetEndPoint(0).Y + x.Curve.GetEndPoint(1).Y)

# --- 開始執行變更 ---
TransactionManager.Instance.EnsureInTransaction(doc)

# Step A: 先全部改為臨時名稱 (避免名稱衝突)
for i, g in enumerate(grids):
    try:
        g.Name = "TEMP_" + str(1000 + i)
    except:
        pass

# Step B: 依照排序重新編號
# 處理水平 (IN[0])
for i, g in enumerate(horizontal_grids):
    g.Name = get_next_name(h_start, i)

# 處理垂直 (IN[1])
for i, g in enumerate(vertical_grids):
    g.Name = get_next_name(v_start, i)

TransactionManager.Instance.TransactionTaskDone()

OUT = "完成！已重新編號 {} 條水平柱網與 {} 條垂直柱網。".format(len(horizontal_grids), len(vertical_grids))
# ----------------------------------------
