# Dynamo graph 標註-標註引線文字位置重排.dyn (Dynamo 3.6.1.9895)

是否調整行距 = BoolSelector(false)  # graph input
是否折線對齊 = BoolSelector(false)  # graph input
python_script = Python(IN[0]=是否調整行距, IN[1]=是否折線對齊)  # CPython3
# ---------- python_script.python (222 lines) ----------
import clr
clr.AddReference('RevitAPI')
from Autodesk.Revit.DB import *

clr.AddReference('RevitServices')
import RevitServices
from RevitServices.Persistence import DocumentManager
from RevitServices.Transactions import TransactionManager

doc = DocumentManager.Instance.CurrentDBDocument
view = doc.ActiveView
view_scale = view.Scale

# --- 輸入處理 ---
# IN[0]: 是否調整行距 (True/False 或 "是"/"否")
mode_input_0 = IN[0]
adjust_spacing = False
if isinstance(mode_input_0, bool): 
    adjust_spacing = mode_input_0
elif isinstance(mode_input_0, str) and mode_input_0 == "是": 
    adjust_spacing = True

# IN[1]: 是否對齊折線垂直點 (True/False 或 "是"/"否")
align_elbows = False
if len(IN) > 1:
    mode_input_1 = IN[1]
    if isinstance(mode_input_1, bool): 
        align_elbows = mode_input_1
    elif isinstance(mode_input_1, str) and mode_input_1 == "是": 
        align_elbows = True

selection_name = "000"
# 預設肩膀長度 (換算模型比例)
default_shoulder_len = (6.0 / 304.8) * view_scale

# --- 輔助函式 ---
def get_text_height(elem):
    el_type = doc.GetElement(elem.GetTypeId())
    p = el_type.get_Parameter(BuiltInParameter.TEXT_SIZE)
    if p: paper_size = p.AsDouble()
    else: paper_size = 3.0 / 304.8 
    return paper_size * view_scale

def set_text_justification(text_note, is_right):
    try:
        if is_right: text_note.HorizontalAlignment = HorizontalTextAlignment.Right
        else: text_note.HorizontalAlignment = HorizontalTextAlignment.Left
    except: pass

# --- 主要物件類別 ---
class AlignItem:
    def __init__(self, elem, head_pos, is_tag):
        self.elem = elem
        self.head_pos = head_pos
        self.is_tag = is_tag
        self.height = get_text_height(elem)
        
        self.leader_end = None
        self.first_elbow = None
        self.orientation = None 
        self.tag_ref = None 

        if is_tag:
            if hasattr(elem, "GetTaggedReferences"): 
                refs = elem.GetTaggedReferences()
                if refs and len(refs) > 0:
                    self.tag_ref = refs[0]
                    try:
                        self.leader_end = elem.GetLeaderEnd(self.tag_ref)
                        if elem.HasLeaderElbow(self.tag_ref):
                            self.first_elbow = elem.GetLeaderElbow(self.tag_ref)
                    except: pass
            else: 
                if getattr(elem, "HasLeader", False):
                    try:
                        self.leader_end = elem.LeaderEnd
                        self.first_elbow = elem.LeaderElbow
                    except: pass
        else:
            leaders = elem.GetLeaders()
            if leaders and len(leaders) > 0:
                leader = leaders[0]
                self.leader_end = leader.End
                try: self.first_elbow = leader.Elbow
                except: pass
        
        if self.leader_end:
            if self.head_pos.X < self.leader_end.X: self.orientation = "LEFT"
            else: self.orientation = "RIGHT"

    def set_elbow(self, new_elbow):
        if self.is_tag:
            if hasattr(self.elem, "SetLeaderElbow") and self.tag_ref:
                try: self.elem.SetLeaderElbow(self.tag_ref, new_elbow)
                except: pass
            else:
                try: self.elem.LeaderElbow = new_elbow
                except: pass
        else:
            leaders = self.elem.GetLeaders()
            if leaders and len(leaders) > 0:
                try: leaders[0].Elbow = new_elbow
                except: pass

# 1. 取得選集 "000"
filters = FilteredElementCollector(doc).OfClass(SelectionFilterElement).ToElements()
target_filter = next((f for f in filters if f.Name == selection_name), None)

items = []
if target_filter:
    for e_id in target_filter.GetElementIds():
        elem = doc.GetElement(e_id)
        if isinstance(elem, IndependentTag):
            items.append(AlignItem(elem, elem.TagHeadPosition, True))
        elif isinstance(elem, TextNote):
            items.append(AlignItem(elem, elem.Coord, False))

    if items:
        # 全域排序：抓出整個選集最高點作為 Y 軸初始高度
        items.sort(key=lambda x: x.head_pos.Y, reverse=True)
        top_y = items[0].head_pos.Y
        
        left_items = [i for i in items if i.orientation == "LEFT"]
        right_items = [i for i in items if i.orientation == "RIGHT"]
        
        TransactionManager.Instance.EnsureInTransaction(doc)
        
        # --- 處理左側物件 (文字在左 -> 靠右對齊) ---
        if left_items:
            # 依高度從上往下排
            left_items.sort(key=lambda x: x.head_pos.Y, reverse=True)
            
            # 【核心修改】直接拿左側群組「最上方那一個(index 0)」的文字X與折線X當基準線！
            base_head_x_left = left_items[0].head_pos.X
            if left_items[0].first_elbow:
                elbow_x_target_left = left_items[0].first_elbow.X
            else:
                elbow_x_target_left = base_head_x_left + default_shoulder_len
            
            current_y_left = top_y
            
            for i, item in enumerate(left_items):
                if i == 0: new_y = top_y
                elif adjust_spacing:
                    new_y = current_y_left - (left_items[i-1].height * 1.5)
                    current_y_left = new_y
                else: new_y = item.head_pos.Y
                
                delta_y = new_y - item.head_pos.Y
                delta_x = base_head_x_left - item.head_pos.X
                
                new_head_pos = XYZ(base_head_x_left, new_y, item.head_pos.Z)
                
                if item.first_elbow:
                    # 折線 Y 跟隨文字等量位移，永不翹起
                    new_elbow_y = item.first_elbow.Y + delta_y
                    if align_elbows: 
                        new_elbow_x = elbow_x_target_left
                    else: 
                        new_elbow_x = item.first_elbow.X + delta_x
                    new_elbow_pos = XYZ(new_elbow_x, new_elbow_y, item.first_elbow.Z)
                else:
                    new_elbow_pos = None

                if item.is_tag:
                    item.elem.TagHeadPosition = new_head_pos
                    if new_elbow_pos: item.set_elbow(new_elbow_pos)
                else:
                    item.elem.Coord = new_head_pos
                    if new_elbow_pos: item.set_elbow(new_elbow_pos)
                    set_text_justification(item.elem, True)

        # --- 處理右側物件 (文字在右 -> 靠左對齊) ---
        if right_items:
            # 依高度從上往下排
            right_items.sort(key=lambda x: x.head_pos.Y, reverse=True)
            
            # 【核心修改】直接拿右側群組「最上方那一個(index 0)」的文字X與折線X當基準線！
            base_head_x_right = right_items[0].head_pos.X
            if right_items[0].first_elbow:
                elbow_x_target_right = right_items[0].first_elbow.X
            else:
                elbow_x_target_right = base_head_x_right - default_shoulder_len
                
            current_y_right = top_y
            
            for i, item in enumerate(right_items):
                if i == 0: new_y = top_y
                elif adjust_spacing:
                    new_y = current_y_right - (right_items[i-1].height * 1.5)
                    current_y_right = new_y
                else: new_y = item.head_pos.Y
                
                delta_y = new_y - item.head_pos.Y
                delta_x = base_head_x_right - item.head_pos.X
                
                new_head_pos = XYZ(base_head_x_right, new_y, item.head_pos.Z)
                
                if item.first_elbow:
                    new_elbow_y = item.first_elbow.Y + delta_y
                    if align_elbows: 
                        new_elbow_x = elbow_x_target_right
                    else: 
                        new_elbow_x = item.first_elbow.X + delta_x
                    new_elbow_pos = XYZ(new_elbow_x, new_elbow_y, item.first_elbow.Z)
                else:
                    new_elbow_pos = None
                
                if item.is_tag:
                    item.elem.TagHeadPosition = new_head_pos
                    if new_elbow_pos: item.set_elbow(new_elbow_pos)
                else:
                    item.elem.Coord = new_head_pos
                    if new_elbow_pos: item.set_elbow(new_elbow_pos)
                    set_text_justification(item.elem, False)

        TransactionManager.Instance.TransactionTaskDone()
        OUT = "基準線校正完畢！已完全依據最上方物件之 X/Y 軸與折線位置切齊。"
    else:
        OUT = "選集 000 中沒有可識別的標籤或文字。"
else:
    OUT = "找不到選集 000，請確認 Revit 內命名是否為 000。"
# ----------------------------------------
watch = Watch(python_script)  # graph output
string = StringInput("""引線文字跟標註文字的排列整齊
把要排的存成選集"000"
""")  # graph input
