# Dynamo graph 群組-從Excel匯入群組參數表.dyn (Dynamo 3.7.0.11777)

選取群族名稱 = FamilyTypes("鋼骨-柱:305x305x97UC")  # frozen
說明 = StringInput("""注意:
excel的頁面名稱為"參數表"
第一行為參數名稱""")  # graph input
string = StringInput("鋼骨-柱")  # graph input
python_script = Python(IN[0]=string)  # CPython3
# ---------- python_script.python (46 lines) ----------
import clr
clr.AddReference('RevitAPI')
from Autodesk.Revit.DB import *

clr.AddReference('RevitNodes')
import Revit
clr.ImportExtensions(Revit.Elements)

clr.AddReference('RevitServices')
import RevitServices
from RevitServices.Persistence import DocumentManager

doc = DocumentManager.Instance.CurrentDBDocument

# 1. 取得哥哥輸入的關鍵字
raw_input = IN[0]
if isinstance(raw_input, list): 
    raw_input = raw_input[0]
keyword = str(raw_input).replace(" ", "").lower()

# 2. 萬用大客廳：搜集所有 ElementType
collector = FilteredElementCollector(doc).WhereElementIsElementType().ToElements()

target_elem = None

for elem in collector:
    f_name = ""
    t_name = ""
    
    # 防護罩
    try: f_name = str(elem.FamilyName)
    except: pass
    try: t_name = str(elem.Name)
    except: pass
        
    if not f_name and not t_name: continue
        
    full_string = (f_name + t_name).replace(" ", "").lower()
    
    # 🎯 只要字串命中，立刻抓取這個元件，並且馬上停止搜尋 (break)
    if keyword in full_string:
        target_elem = elem.ToDSType(True)
        break

# 🚀 妹妹極簡輸出：只給單一個綠色元件！(如果沒找到就會是 null)
OUT = target_elem
# ----------------------------------------
選取excel資料_注意資料是文字還是數字 = Filename("..\..\Today\TOOL\DATA\SC柱編號.xlsx")  # graph input
file_from_path = FileObject(path=選取excel資料_注意資料是文字還是數字)
工作表明稱 = StringInput("參數表")  # graph input
importExcel = Data.ImportExcel(file=file_from_path, sheetName=工作表明稱)
python_script_2 = Python(IN[0]=python_script, IN[1]=importExcel)  # CPython3
# ---------- python_script_2.python (103 lines) ----------
import clr
clr.AddReference('RevitAPI')
from Autodesk.Revit.DB import *

clr.AddReference('RevitServices')
import RevitServices
from RevitServices.Persistence import DocumentManager
from RevitServices.Transactions import TransactionManager

doc = DocumentManager.Instance.CurrentDBDocument

# IN[0]: 基準族群類型 (用來複製的母體)
base_type = UnwrapElement(IN[0])
# IN[1]: 來自 Data.ImportExcel 的資料清單
excel_data = IN[1]

headers = excel_data[0]
processed_types = []  
log_messages = []     

TransactionManager.Instance.EnsureInTransaction(doc)

# 🔍 妹妹的防當機魔法：建立母體族群的「現有類型點名單」
base_family = base_type.Family
existing_types_dict = {}

# 抓出這個族群底下所有已經存在的類型
for symbol_id in base_family.GetFamilySymbolIds():
    try:
        symbol = doc.GetElement(symbol_id)
        if symbol:
            s_name = ""
            # 🛡️ 防護罩 A：正常問名字
            try:
                s_name = symbol.Name
            except:
                # 🔨 破門鎚 B：如果它傲嬌報錯，直接從底層參數挖名字！
                param = symbol.get_Parameter(BuiltInParameter.SYMBOL_NAME_PARAM)
                if param:
                    s_name = param.AsString()
            
            # 確實有抓到名字才放進名單
            if s_name:
                existing_types_dict[s_name] = symbol
    except Exception as e:
        pass # 遇到真的很怪的殘缺元件，直接安全略過

# 開始處理 Excel 資料
for i in range(1, len(excel_data)):
    row = excel_data[i]
    if not row or not row[0]: continue

    new_type_name = str(row[0]).strip()
    if new_type_name.endswith('.0'):
        new_type_name = new_type_name[:-2]

    target_type = None

    # 🚀 核心 Upsert 邏輯：判斷是「更新」還是「新建」
    if new_type_name in existing_types_dict:
        target_type = existing_types_dict[new_type_name]
        log_messages.append("🔄 類型 [{}] 已存在 -> 執行參數更新".format(new_type_name))
    else:
        try:
            target_type = base_type.Duplicate(new_type_name)
            existing_types_dict[new_type_name] = target_type 
            log_messages.append("✨ 類型 [{}] 成功建立 -> 執行參數寫入".format(new_type_name))
        except Exception as e:
            log_messages.append("❌ 類型 [{}] 建立失敗: {}".format(new_type_name, str(e)))
            continue

    # 🎯 開始填入/更新參數
    if target_type:
        processed_types.append(target_type)
        
        for j in range(1, len(headers)):
            if j >= len(row): break

            param_name = str(headers[j]).strip()
            val = row[j]

            if val is None or str(val).strip() == "":
                continue

            param = target_type.LookupParameter(param_name)
            if param and not param.IsReadOnly:
                s_type = param.StorageType
                clean_str_val = str(int(val)) if isinstance(val, float) and val.is_integer() else str(val)

                try:
                    if s_type == StorageType.Double:
                        param.SetValueString(clean_str_val)
                    elif s_type == StorageType.String:
                        param.Set(clean_str_val)
                    elif s_type == StorageType.Integer:
                        param.Set(int(float(val)))
                except Exception as e:
                    pass

TransactionManager.Instance.TransactionTaskDone()

# 輸出結果
OUT = processed_types, "✅ 順利搞定！新建與更新雙引擎運作中！", log_messages
# ----------------------------------------
watch = Watch(python_script_2)
watch_2 = Watch(python_script)  # graph output
