# Dynamo graph 視圖-修改視圖名稱.dyn (Dynamo 3.6.1.9895)

前面加字 = StringInput("")  # graph input
後面加字 = StringInput("")  # graph input
被替換的字 = StringInput(" 複製 1")  # graph input
新的文字 = StringInput("-二次")  # graph input
python_script = Python(IN[0]=前面加字, IN[1]=後面加字, IN[2]=被替換的字, IN[3]=新的文字)  # CPython3
# ---------- python_script.python (67 lines) ----------
import clr

# 匯入 Revit API
clr.AddReference('RevitAPI')
from Autodesk.Revit.DB import *

# 匯入 Revit UI API (為了抓取選取項)
clr.AddReference('RevitAPIUI')
from Autodesk.Revit.UI import *

# 匯入 Revit 服務
clr.AddReference('RevitServices')
import RevitServices
from RevitServices.Persistence import DocumentManager
from RevitServices.Transactions import TransactionManager

# 取得目前的文檔與介面
doc = DocumentManager.Instance.CurrentDBDocument
uidoc = DocumentManager.Instance.CurrentUIApplication.ActiveUIDocument

# 讀取輸入的字串 (如果沒有輸入或是 null，就當作空字串處理)
prefix_str = IN[0] if IN[0] else ""
suffix_str = IN[1] if IN[1] else ""
target_str = IN[2] if IN[2] else ""
replace_str = IN[3] if IN[3] else ""

# 抓取目前專案瀏覽器中被選取的元素 ID
selection_ids = uidoc.Selection.GetElementIds()

renamed_views = []
failed_views = []

# 開啟交易 (Transaction)
TransactionManager.Instance.EnsureInTransaction(doc)

for eid in selection_ids:
    element = doc.GetElement(eid)
    
    # 判斷選取的是否為「視圖」(View)，並且排除掉「視圖樣板」(View Template)
    if isinstance(element, View) and not element.IsTemplate:
        current_name = element.Name
        new_name = current_name
        
        # 1. 先執行字串置換 (如果有指定要被置換的字串)
        if target_str != "":
            new_name = new_name.replace(target_str, replace_str)
            
        # 2. 再加上前綴與後綴
        new_name = prefix_str + new_name + suffix_str
        
        # 如果名稱有變動，才執行重新命名
        if new_name != current_name:
            try:
                element.Name = new_name
                renamed_views.append(new_name)
            except Exception as e:
                # Revit 不允許視圖名稱重複，如果遇到重複會報錯，這裡把它捕捉起來
                failed_views.append("{} (錯誤: {})".format(current_name, str(e)))

# 結束交易
TransactionManager.Instance.TransactionTaskDone()

# 輸出結果：告訴哥哥哪些成功了，哪些失敗了
OUT = {
    "成功重命名的視圖": renamed_views,
    "命名失敗的視圖 (可能名稱重複)": failed_views
}
# ----------------------------------------
說明 = StringInput("在專案瀏覽器之中選你要的視圖批次修改名稱")  # graph input
