# Dynamo graph 視圖-複製視圖.dyn (Dynamo 3.6.1.9895)

python_script = Python()  # CPython3
# ---------- python_script.python (46 lines) ----------
import clr

# 匯入 Revit API
clr.AddReference('RevitAPI')
from Autodesk.Revit.DB import *

# 匯入 Revit UI API (為了抓取選取項)
clr.AddReference('RevitAPIUI')
from Autodesk.Revit.UI import *

# 匯入 Revit 服務
clr.AddReference('RevitServices')
import RevitServices
from RevitServices.Persistence import DocumentManager
from RevitServices.Transactions import TransactionManager

# 取得目前的文檔與介面
doc = DocumentManager.Instance.CurrentDBDocument
uidoc = DocumentManager.Instance.CurrentUIApplication.ActiveUIDocument

# 1. 抓取專案瀏覽器中目前被選取的元素 ID
selection_ids = uidoc.Selection.GetElementIds()

duplicated_views = []

# 開啟交易 (Transaction)
TransactionManager.Instance.EnsureInTransaction(doc)

for eid in selection_ids:
    element = doc.GetElement(eid)
    
    # 2. 判斷選取的是不是「視圖」且「可以被複製」
    if isinstance(element, View) and element.CanViewBeDuplicated(ViewDuplicateOption.WithDetailing):
        try:
            # 3. 執行複製 (使用 WithDetailing 選項，即：與細節一起複製)
            new_view_id = element.Duplicate(ViewDuplicateOption.WithDetailing)
            new_view = doc.GetElement(new_view_id)
            duplicated_views.append(new_view)
        except:
            pass

# 結束交易
TransactionManager.Instance.TransactionTaskDone()

# 輸出結果
OUT = duplicated_views
# ----------------------------------------
說明 = StringInput("在專案瀏覽器之中選你要的視圖然按確定會複製一份一樣的視圖")  # graph input
