# Dynamo graph 設備-廁所擺衛浴.dyn (Dynamo 3.6.1.9895)

選一個廁所房間的物件 = DSModelElementSelection()  # 1 picked in the model; graph input
watch = Watch(選一個廁所房間的物件)
family_types = FamilyTypes("面盆 (3)-檯面式:洗臉盆")  # graph input
family_types_2 = FamilyTypes("馬桶 (4)-分離式:馬桶")  # graph input
family_types_3 = FamilyTypes("水龍頭_淋浴_1:淋浴水龍頭")  # graph input
設備間距 = CodeBlock { [0.6, 1.5, 2.4]; }
設備偏移量 = CodeBlock { [0.0, 0.50, 0.0]; }
python_script = Python(IN[0]=選一個廁所房間的物件, IN[1]=family_types, IN[2]=family_types_2, IN[3]=family_types_3, IN[4]=設備間距, IN[5]=設備偏移量)  # CPython3
# ---------- python_script.python (173 lines) ----------
import clr
import math
import traceback

clr.AddReference('RevitNodes')
import Revit
clr.ImportExtensions(Revit.Elements)
clr.ImportExtensions(Revit.GeometryConversion)

clr.AddReference('RevitServices')
import RevitServices
from RevitServices.Persistence import DocumentManager
from RevitServices.Transactions import TransactionManager

clr.AddReference('RevitAPI')
from Autodesk.Revit.DB import *

doc = DocumentManager.Instance.CurrentDBDocument

room = UnwrapElement(IN[0])
sink_type = UnwrapElement(IN[1])    
toilet_type = UnwrapElement(IN[2])  
shower_type = UnwrapElement(IN[3])  

spacing_m = IN[4] if len(IN) > 4 and IN[4] else [0.6, 1.5, 2.4]
push_outs_m = IN[5] if len(IN) > 5 and IN[5] else [0.0, 0.145, 0.0]

def get_room_door(rm):
    all_doors = FilteredElementCollector(doc).OfCategory(BuiltInCategory.OST_Doors).WhereElementIsNotElementType().ToElements()
    for d in all_doors:
        if (d.ToRoom and d.ToRoom.Id == rm.Id) or (d.FromRoom and d.FromRoom.Id == rm.Id):
            return d
    return None

# 🌟 修正點：解除了偏移的封印，讓外部數字可以寫入
def adjust_height_and_offset(instance, offset_val):
    try:
        # 將 IN[5] 的偏移值，正式寫入「距離主體的偏移」參數
        p1 = instance.get_Parameter(BuiltInParameter.INSTANCE_FREE_HOST_OFFSET_PARAM)
        if p1 and not p1.IsReadOnly: p1.Set(offset_val)
        
        # 高度依然保持歸零，防飛天
        p2 = instance.get_Parameter(BuiltInParameter.INSTANCE_ELEVATION_PARAM)
        if p2 and not p2.IsReadOnly: p2.Set(0.0)
        p3 = instance.get_Parameter(BuiltInParameter.FAMILY_BASE_LEVEL_OFFSET_PARAM)
        if p3 and not p3.IsReadOnly: p3.Set(0.0)
    except:
        pass

TransactionManager.Instance.EnsureInTransaction(doc)

results = []
log_msgs = []

try:
    types = [sink_type, toilet_type, shower_type]
    names = ["洗臉盆", "馬桶", "淋浴間"]
    for t in types:
        if t and not t.IsActive:
            t.Activate()
            doc.Regenerate()

    opt = SpatialElementBoundaryOptions()
    boundary_segments = room.GetBoundarySegments(opt)[0]
    
    door = get_room_door(room)
    door_loc = door.Location.Point if door else None
    
    wall_dict = {}
    for seg in boundary_segments:
        curve = seg.GetCurve()
        if door_loc and curve.Distance(door_loc) < 1.6: 
            continue
        eid = seg.ElementId
        if str(eid) == "-1": continue 
        
        if eid not in wall_dict:
            wall_dict[eid] = []
        wall_dict[eid].append(curve)
        
    best_wall_id = None
    max_total_len = 0
    for eid, curves in wall_dict.items():
        total_len = sum([c.Length for c in curves])
        if total_len > max_total_len:
            max_total_len = total_len
            best_wall_id = eid

    if not best_wall_id:
        raise Exception("找不到適合的靠背牆。")

    host_wall = doc.GetElement(best_wall_id)
    best_curves = wall_dict[best_wall_id]
    
    pts = []
    for c in best_curves:
        pts.append(c.GetEndPoint(0))
        pts.append(c.GetEndPoint(1))
        
    p0 = pts[0]
    p1 = pts[0]
    true_max_dist = 0
    for i in range(len(pts)):
        for j in range(i+1, len(pts)):
            d = pts[i].DistanceTo(pts[j])
            if d > true_max_dist:
                true_max_dist = d
                p0 = pts[i]
                p1 = pts[j]

    if door_loc and p1.DistanceTo(door_loc) < p0.DistanceTo(door_loc):
        start_pt = p1
        end_pt = p0
    else:
        start_pt = p0
        end_pt = p1

    direction = XYZ(end_pt.X - start_pt.X, end_pt.Y - start_pt.Y, end_pt.Z - start_pt.Z).Normalize()
    wall_normal = XYZ(-direction.Y, direction.X, 0).Normalize()
    
    room_bb = room.get_BoundingBox(None)
    room_center = XYZ((room_bb.Min.X + room_bb.Max.X)/2, (room_bb.Min.Y + room_bb.Max.Y)/2, 0)
    mid_pt = start_pt.Add(direction.Multiply(true_max_dist/2))
    to_center = XYZ(room_center.X - mid_pt.X, room_center.Y - mid_pt.Y, 0).Normalize()
    
    if wall_normal.DotProduct(to_center) < 0:
        wall_normal = XYZ(-wall_normal.X, -wall_normal.Y, 0)

    offsets_ft = [x * 3.28084 for x in spacing_m]
    push_outs_ft = [x * 3.28084 for x in push_outs_m]
    
    level_z = room.Level.Elevation

    for i, dist_ft in enumerate(offsets_ft):
        if dist_ft < true_max_dist:
            place_pt = start_pt.Add(direction.Multiply(dist_ft))
            target_pt = XYZ(place_pt.X, place_pt.Y, level_z).Add(wall_normal.Multiply(push_outs_ft[i]))
            
            instance = None
            try:
                instance = doc.Create.NewFamilyInstance(target_pt, types[i], host_wall, room.Level, Structure.StructuralType.NonStructural)
                log_msgs.append(names[i] + " -> 成功(依附牆)")
            except Exception as e1:
                try:
                    instance = doc.Create.NewFamilyInstance(target_pt, types[i], room.Level, Structure.StructuralType.NonStructural)
                    log_msgs.append(names[i] + " -> 成功(依附樓層)")
                except Exception as e2:
                    continue
            
            if instance:
                # 🌟 呼叫更新版的神器，把偏移量傳進去
                adjust_height_and_offset(instance, push_outs_ft[i])
                
                try:
                    axis_line = Line.CreateBound(target_pt, target_pt.Add(XYZ.BasisZ))
                    angle = XYZ.BasisY.AngleTo(wall_normal)
                    cross = XYZ.BasisY.CrossProduct(wall_normal)
                    if cross.Z < 0:
                        angle = 2 * math.pi - angle
                    
                    angle = angle + math.pi
                    ElementTransformUtils.RotateElement(doc, instance.Id, axis_line, angle)
                except:
                    pass 
                
                results.append(instance)

    OUT = ["設備放置報告："] + log_msgs + [results]

except Exception as e:
    OUT = "執行失敗: " + str(e) + "\n" + traceback.format_exc()

TransactionManager.Instance.TransactionTaskDone()
# ----------------------------------------
watch_2 = Watch(python_script)
string = StringInput("""左右位置微調：找 offsets_m = [0.6, 1.5, 2.4] 這行。這代表洗臉盆離起點 60cm，馬桶 150cm，淋浴間 240cm。房間變大變小就改這裡。

前後靠牆微調：找 push_outs_m = [0.0, 0.35, 0.0] 這行。如果換了另一個牌子的馬桶，發現它又吃進牆裡或是離牆太遠，就調整中間那個 0.35（35公分）。""")  # graph input
